# Grasshopper definition Mesh Editor.gh (Grasshopper 0.9.76)
# Copyright: Co-de-iT
# plug-ins: MeshEdit Components, Human, Weaverbird

# automatic reference
# pipeline referenzia automaticamene geometrie da Rhinoceros
# si impostano i nomi (o maschere di ricerca) per:
# 
# . nome layer
# . nome oggetto
# 
# E' possibile filtrare anche per tipo di geometria
# 
# in questo caso stiamo cercando sul layer "work mesh" ogni oggetto di tipo mesh. Continuando a creare oggetti mesh su questo layer, questi saranno selezionati e referenziati automaticamente su GH
pipeline = GeometryPipeline(
    GroupByLayer=False,
    GroupByType=False,
    IncludeHidden=True,
    IncludeLocked=True,
    LayerFilter="work mesh",
    NameFilter="*",
    TypeFilter=32)
# Mesh Editor
# 
# Mesh editor helper
# 
# © a3 2017 _ Creative Commons Attribution-NonCommercial-ShareAlike3.0 UnportedLicense.
mesh = Mesh(pipeline)
flip = BooleanToggle(False)

# ----
# Join, Weld e Unify Normals
wbjoin = WeaverbirdsJoinMeshesAndWeld(Mesh=mesh, Weld=True)
weldvertices = MeshWeldVertices(Mesh=wbjoin, Tolerance=Slider(0.01, range=0.01..10))  # -> RuntimeMessage, Mesh
unifynormals = MeshUnifyNormals(Mesh=weldvertices.Mesh)

panel = Panel("Flip (opzionale)")

gate = StreamGate(Stream=unifynormals, Gate=flip)  # -> Target0, Target1
flip_2 = MeshFlip(Mesh=gate.Target1)
filter = StreamFilter(Gate=flip, Stream0=gate.Target0, Stream1=flip_2)

# ----
# bake this
mesh_2 = Mesh(filter)

# ----
# mesh
# naked edges
# clothed edges
# non-manifold edges
medges = MeshEdges(Mesh=mesh_2)  # -> NakedEdges, InteriorEdges, NonManifoldEdges
# display only
previewmat = CustomPreviewMaterials(Geometry=mesh_2, DiffuseColor=RGB(255, 255, 255), Transparency=Slider(0, range=0..1))
previewlw = CustomPreviewLineweights(
    Geometry=medges.NakedEdges,
    Shader=ColourSwatch(SwatchColor=RGB(204, 0, 255)),
    Thickness=Slider(3, range=0..10),
    Absolute=False)
previewlw_2 = CustomPreviewLineweights(Geometry=medges.InteriorEdges, Shader=ColourSwatch(SwatchColor=RGB(0, 0, 0)), Absolute=False)
previewlw_3 = CustomPreviewLineweights(Geometry=medges.NonManifoldEdges, Shader=ColourSwatch(SwatchColor=RGB(0, 0, 0)), Absolute=False)
