# Grasshopper definition 01_00_lists basics.gh (Grasshopper 0.9.76)
# Copyright: Co-de-iT

# Lists Basics
# 
# Basic operations with lists
# 
# © a3 2017 _ Creative Commons Attribution-NonCommercial-ShareAlike3.0 UnportedLicense.
# 01 basic operations
# list item
series = Series(Start=0, Step=1, Count=10)
# merge
panel = Panel("5")
panel_2 = Panel(series)
# sort list
panel_3 = Panel("0 to 100")
series_2 = Series(Start=0, Step=1, Count=panel)
series_3 = Series(Start=panel, Step=1, Count=panel)
wrap = BooleanToggle(False)
wrap_2 = BooleanToggle(False)
random = Random(Range=panel_3, Number="10", Seed=2, Integers=True)
panel_4 = Panel(series_2)
panel_5 = Panel(series_3)
item = ListItem(List=series, Index=Slider(0, range=0..20), Wrap=wrap)  # -> Item1, Item, Item1_2
item_2 = ListItem(List=series, Index=Slider(0, range=0..20), Wrap=wrap_2)

item_3 = ListItem(List=series, Index="0", Wrap="true")
item_4 = ListItem(List=series, Index="-1", Wrap="true")

panel_6 = Panel(random)
series_4 = Series(Start=0, Step=1, Count="10")
merge = Merge(Data1=series_2, Data2=series_3)
# NOTA
# 
# con l'opzione Wrap attivata, gli indici
# positivi scorrono la lista in un senso e
# gli indici negativi nel senso opposto.
# 
# Es: 0 è il primo elemento, -1 è l'ultimo
panel_7 = Panel(item_3)
panel_8 = Panel(item_4)
sort = SortList(Keys=random, ValuesA=series_4)  # -> Keys, ValuesA
panel_9 = Panel(item.Item1_2)
# Zoomando sul componente è possibile
# aggiungere outputs di indici successivi
# (+1,+2, ...) o precedenti (-1, -2, ...)
# all'indice corrente
# 
# con l'opzione Wrap attivata, gli indici
# positivi scorrono la lista in un senso e
# gli indici negativi nel senso opposto.
# se i=0, -1 è l'ultimo elemento della lista
# se wrap è attivo, è nullo se wrap è disattivato
panel_10 = Panel(item.Item1)
panel_11 = Panel(item.Item)
# Merge
# 
# unisce due o più liste accodandole tra loro
# (la lista D2 inizia subito dopo la fine di D1, etc.)
panel_12 = Panel(merge)
# per dare un titolo al panel
# cliccare sul panel con il
# tasto destro del mouse e
# scrivere nel campo in alto
# del menu contestuale
# list item
# 
# estrae l'elemento di indice i della lista L
# 
# L'opzione Wrap (attiva di default) rende
#  la lista circolare (simile ad un orologio,
# in cui dopo le 12 si ricomincia da 1)
# 
# Provare ad attivare/disattivare l'opzione
# Wrap con un indice superiore al numero
# dei punti
element = Panel(item_2)
int = Integer(sort.ValuesA)
panel_13 = Panel(sort.Keys)
# sort list
# 
# Ordina la lista di oggetti A secondo il
# parametro K (per ogni A deve esistere
# un parametro K misurabile - es. numero).
# Posso usare solo k se devo ordinare dei numeri
panel_14 = Panel(int)
division_pts = Slider(64, range=2..150)
# 02 examples
crv = Curve(<curve referenced from the Rhino model>)
pt = Point([Point(69, 51, 11.48105052), Point(68.96666667, 49.4, 11.40706153), Point(68.93333333, 47.8, 11.19529993), Point(68.9, 46.2, 10.86107379), Point(68.86666667, 44.6, 10.41969118), Point(68.83333333, 43, 9.886460168)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])
pdecon = Deconstruct(Point=pt)  # -> XComponent, YComponent, ZComponent
divide = DivideCurve(Curve=crv, Count=division_pts, Kinks=False)  # -> Points, Tangents, Parameters
wrap_3 = BooleanToggle(True)
item_index = Slider(13, range=0..150)
series_5 = Series(Start=0, Step=1, Count=10)
sort_2 = SortList(Keys=pdecon.ZComponent, ValuesA=pt)  # -> Keys, ValuesA
item_5 = ListItem(List=divide.Points, Index=item_index, Wrap=wrap_3)
lng = ListLength(List=divide.Points)
# modulo: il resto della divisione intera tra A e B.
# 
# Es: A = 14, B = 12 - risultato: 2
mod = Modulus(A=item_index, B=lng)
mod_2 = Modulus(A=series_5, B=Slider(2, range=1..10))
bnd = Bounds(Numbers=sort_2.Keys)
expression = Expression(x=item_index, y=mod, Expression="Format(\"slider: {0}  /  {1} : real index\", x, y)")
dedomain = DeconstructDomain(Domain=bnd)  # -> Start, End
panel_15 = Panel(mod_2)
list_length = Panel(lng)
gradient = Gradient(
    LowerLimit=dedomain.Start,
    UpperLimit=dedomain.End,
    Parameter=sort_2.Keys,
    stops=[0.011: RGB(191, 8, 8), 0.999: RGB(255, 255, 255)])
Z = UnitZ(Factor=1)
line = LineSDL(Start=item_5, Direction=Z, Length=Slider(10, range=0..10))
# Expression permette l'uso di funzioni in GH
# 
# Format è una funzione di formattazione del testo. I numeri in parentesi graffa {0} e {1}
# rappresentano, nell'ordine, le variabili
# elencate dopo la stringa.
# 
# Es:
# Format("ciao {0}!", Alessio) = "ciao Alessio!"
swatch = ColourSwatch(SwatchColor=RGB(255, 255, 255))
end = EndPoints(Curve=line)  # -> Start, End
preview = CustomPreview(Geometry=sort_2.ValuesA, Shader=gradient)
# e questa area colorata?
# Seleziona uno o più componenti,
# poi CTRL+g per creare un gruppo.
# 
# Facendo doppio click all'interno
# dell'area colorata si cambia la forma
# alternando tra 3 tipi possibili
# Fantastic Components
# and Where to Find Them
# per trovare chi è e cosa fa
# questo componente (o altri che non
# riconosci) tieni premuto CTRL+ALT
# e clicca con il tasto sx del mouse
# (tenendolo premuto) sul componente
preview_2 = CustomPreview(Geometry=line, Shader=swatch)
tag = TextTag3D(Location=end.End, Text=expression, Size=1, Colour=swatch, Justification=7)
