# Grasshopper definition 01_01_lists intermediate.gh (Grasshopper 0.9.76)
# Copyright: Co-de-iT

# Lists Intermediate
# 
# Intermediate operations with lists
# 
# © a3 2017 _ Creative Commons Attribution-NonCommercial-ShareAlike3.0 UnportedLicense.
# 01 intermediate operations
# dispatch/weave
series = Series(Start=0, Step=1, Count=10)
# split list
series_2 = Series(Start=0, Step=1, Count=10)
# sub list
series_3 = Series(Start=0, Step=1, Count=10)
# insert/replace items
series_4 = Series(Start=0, Step=1, Count=10)
# shift list
series_5 = Series(Start=0, Step=1, Count=10)
panel = Panel(series_2)
panel_2 = Panel(series_3)
panel_3 = Panel(series_4)
panel_4 = Panel(series)
panel_5 = Panel(series_5)
# split list
# 
# spezza la lista in due all'indice fornito
number_slider = Slider(3, range=0..9)
domain_start = Slider(2, range=0..9)
domain_start_2 = Slider(6, range=0..9)
number_slider_2 = Slider(0, range=0..20)
wrap = BooleanToggle(False)
# dispatch
# 
# reindirizza l'input su due canali (A, B)
# a seconda di un pattern di valori
# booleani (true, false)
# per creare un panel con dati su più righe
# cliccare con il tasto dx del mouse
# e deselezionare "multiline data"
panel_6 = Panel("""false
true""")
wrap_2 = BooleanToggle(False)
split = SplitList(List=series_2, Index=number_slider)  # -> ListA, ListB
# shift list
# 
# fa scorrere gli elementi della lista L della quantità S.
# 
# S può essere positiva o negativa, il segno
# indica il verso di scorrimento.
# 
# L'opzione Wrap (attiva di default) rende
#  la lista circolare (simile ad un orologio,
# in cui dopo le 12 si ricomincia da 1)
# 
# Provare ad attivare/disattivare l'opzione
# Wrap per S > 0
shift = ShiftList(List=series_5, Shift=Slider(-2, range=-9..9), Wrap=wrap)
dom = ConstructDomain(DomainStart=domain_start, DomainEnd=domain_start_2)
dispatch = Dispatch(List=series, DispatchPattern=panel_6)  # -> ListA, ListB

ins = InsertItems(List=series_4, Item="42", Indices=number_slider_2, Wrap=wrap_2)
replace = ReplaceItems(List=series_4, Item="42", Indices=number_slider_2, Wrap=wrap_2)

subset = SubList(List=series_3, Domain=dom, Wrap=True)  # -> List, Index
panel_7 = Panel(shift)
panel_8 = Panel(dispatch.ListA)
panel_9 = Panel(dispatch.ListB)
# insert item
# 
# inserisce l'elemento I all'indice i della lista L
# 
# L'opzione Wrap (attiva di default) rende
#  la lista circolare (simile ad un orologio,
# in cui dopo le 12 si ricomincia da 1)
# 
# Provare ad attivare/disattivare l'opzione
# Wrap con un indice superiore al numero
# di elementi
insert = Panel(ins)
# Replace items
# 
# sostituisce l'elemento I all'indice i della lista L
# 
# L'opzione Wrap (attiva di default) rende
#  la lista circolare (simile ad un orologio,
# in cui dopo le 12 si ricomincia da 1)
# 
# Provare ad attivare/disattivare l'opzione
# Wrap con un indice superiore al numero
# di elementi
replace_2 = Panel(replace)
list_a = Panel(split.ListA)
list_b = Panel(split.ListB)
items = Panel(subset.List)
# sub list
# 
# estrae una sotto-lista nel range di indici
# indicato all'input D
indices = Panel(subset.Index)
# weave
# 
# intreccia l'input da due canali (0, 1)
# a seconda di un pattern di valori
# booleani (true, false). La corrispondenza
# è:
# 0 = false
# 1 = true
weave = Weave(Pattern=panel_6, Stream0=dispatch.ListB, Stream1=dispatch.ListA, NullGaps=False)
panel_10 = Panel(weave)
division_pts = Slider(64, range=2..150)
domain_start_3 = Slider(23, range=2..150)
domain_end = Slider(36, range=2..150)
crv = Curve(<curve referenced from the Rhino model>)
# indice dinamico:
# in questo modo l'indice non eccede mai
# il valore nell'input B
number_slider_3 = Slider(0.404, range=0..1)
division_pts_2 = Slider(64, range=2..150)
crv_2 = Curve(<curve referenced from the Rhino model>)
# 02 examples
pt = Point(<point referenced from the Rhino model>)
crv_3 = Curve(<curve referenced from the Rhino model>)
crv_4 = Curve(<curve referenced from the Rhino model>)
crv_5 = Curve(<curve referenced from the Rhino model>)
crv_6 = Curve(<curve referenced from the Rhino model>)
number_slider_4 = Slider(176, range=2..200)
multiplication = Multiplication(A=number_slider_3, B=division_pts_2)
cp = ControlPoints(Curve=crv_4)  # -> Points, Weights, Knots
cp_2 = ControlPoints(Curve=crv_3)  # -> Points, Weights, Knots
divide = DivideCurve(Curve=crv, Count=division_pts, Kinks=False)  # -> Points, Tangents, Parameters
recgrid = Rectangular(Plane=pt, SizeX="1", SizeY="1", ExtentX="50", ExtentY="50")  # -> Cells, Points
tan_strength_b = Slider(-21.299, range=-100..0)
tan_strength_a = Slider(13.903, range=0..100)
dom_2 = ConstructDomain(DomainStart=domain_start_3, DomainEnd=domain_end)
int = Integer(multiplication)
pframes = PerpFrames(Curve=crv_2, Count=division_pts_2, Align=True)  # -> Frames, Parameters
pt_2 = Point(<point referenced from the Rhino model>)
cir = Circle(Plane=pt_2, Radius=1)
pt_3 = Point(<point referenced from the Rhino model>)
index = Panel(int)
series_6 = Series(Start=0, Step=1, Count="50")  # -> graft(Series)
divide_2 = DivideCurve(Curve=crv_6, Count=number_slider_4, Kinks=False)  # -> Points, Tangents, Parameters
divide_3 = DivideCurve(Curve=crv_5, Count=number_slider_4, Kinks=False)  # -> Points, Tangents, Parameters
random_threshold = Slider(0.24, range=0..1)
ins_2 = InsertItems(List=cp_2.Points, Item=pt_2, Indices=Slider(5, range=0..5), Wrap=True)
cir_2 = Circle(Plane=pt_3, Radius=1)
neg = Negative(Value=Slider(0, range=0..200))
replace_3 = ReplaceItems(List=cp.Points, Item=pt_3, Indices=Slider(4, range=0..6), Wrap=False)
split_2 = SplitList(List=pframes.Frames, Index=int)  # -> ListA, ListB
lng = ListLength(List=recgrid.Cells)

# ----
# sub list
# 
# estrae una sottolista da una lista L
subset_2 = SubList(List=divide.Points, Domain=dom_2, Wrap=True)  # -> List, Index
subset_3 = SubList(List=divide.Tangents, Domain=dom_2, Wrap=True)  # -> List, Index

X = UnitX(Factor=tan_strength_b)
pt_4 = Point(<point referenced from the Rhino model>)

shift_2 = ShiftList(List=divide_2.Points, Shift=neg, Wrap=True)
shift_3 = ShiftList(List=divide_3.Points, Shift=Slider(44, range=0..200), Wrap=True)

random = Random(Range=Domain(0, 1), Number=lng, Seed=series_6)
explode = Explode(Curve=recgrid.Cells, Recursive=True)  # -> Segments, Vertices
points = PointList(Points=ins_2, Size=2)
points_2 = PointList(Points=replace_3, Size=2)
polygon = Polygon(Plane=split_2.ListB, Radius="1.5", Segments=6, FilletRadius=0)  # -> Polygon, Length
cir_3 = Circle(Plane=split_2.ListA, Radius="1.5")
multiplication_2 = Multiplication(A=subset_3.List, B=tan_strength_a)
smaller = SmallerThan(FirstNumber=random, SecondNumber=random_threshold)  # -> graft(SmallerThan), OrEqualTo
ln = Line(StartPoint=shift_2, EndPoint=shift_3)
nurbs = NurbsCurve(Vertices=ins_2, Degree=3, Periodic=False)  # -> Curve, Length, Domain
pline = PolyLine(Vertices=ins_2, Closed=False)
nurbs_2 = NurbsCurve(Vertices=replace_3, Degree=3, Periodic=False)  # -> Curve, Length, Domain
pline_2 = PolyLine(Vertices=replace_3, Closed=False)
# Bézier span
# 
# per un help più comprensivo,
# cliccare con il tasto dx del mouse
# sulla parte centrale del componente
# e selezionare Help
bzspan = BezierSpan(StartPoint=subset_2.List, StartTangent=multiplication_2, EndPoint=pt_4, EndTangent=X)  # -> Curve, Length, Domain
item = ListItem(List=ln, Index=0, Wrap=True)
preview = CustomPreview(Geometry=cir_3, Shader=ColourSwatch(SwatchColor=RGB(255, 255, 255)))
dash = DashPattern(Curve=pline, Pattern="1")  # -> Dashes, Gaps
dispatch_2 = Dispatch(List=explode.Vertices, DispatchPattern=smaller.SmallerThan)  # -> ListA, ListB
dash_2 = DashPattern(Curve=pline_2, Pattern="1")  # -> Dashes, Gaps
preview_2 = CustomPreview(Geometry=item, Shader=ColourSwatch(SwatchColor=RGB(255, 255, 255)))
panel_11 = Panel("""0
2""")
panel_12 = Panel("""1
3""")
item_2 = ListItem(List=dispatch_2.ListA, Index=panel_11, Wrap=True)
item_3 = ListItem(List=dispatch_2.ListB, Index=panel_12, Wrap=True)
crv_7 = Curve([<curve referenced from the Rhino model> x2])
pline_3 = PolyLine(Vertices=item_2, Closed=False)  # -> flatten(Polyline)
pline_4 = PolyLine(Vertices=item_3, Closed=False)  # -> flatten(Polyline)
weave_2 = Weave(Pattern=flatten(smaller.SmallerThan), Stream0=pline_4, Stream1=pline_3, NullGaps=False)
divide_4 = DivideCurve(Curve=crv_7, Count=Slider(71, range=2..100), Kinks=False)  # -> Points, Tangents, Parameters

curvature = Curvature(Curve=graft(crv_7), Parameter=divide_4.Parameters)  # -> P, K, C
darc = DeconstructArc(Arc=curvature.C)  # -> BasePlane, Radius, Angle
# i punti vengono spostati lungo la
# rispettiva direzione di curvatura
# in modo proporzionale alla
# curvatura stessa
bnd = Bounds(Numbers=darc.Radius)
# K
remap = RemapNumbers(Value=darc.Radius, Source=bnd, Target=Domain(0, 1))  # -> Mapped, Clipped
multiplication_3 = Multiplication(A=Slider(4.818, range=0.1..20), B=remap.Mapped)
amp = Amplitude(Vector=curvature.K, Amplitude=multiplication_3)

preview_3 = CustomPreview(Geometry=weave_2, Shader=ColourSwatch(SwatchColor=RGB(0, 0, 0)))
# T
move = Move(Geometry=divide_4.Points, Motion=amp)  # -> Geometry, Transform
flip = FlipMatrix(Data=move.Geometry)
flip_2 = FlipMatrix(Data=divide_4.Points)
pline_5 = PolyLine(Vertices=flip_2, Closed=False)  # -> flatten(Polyline)
pline_6 = PolyLine(Vertices=flip, Closed=False)  # -> flatten(Polyline)
shift_4 = ShiftList(List=pline_6, Shift=1, Wrap=True)  # -> flatten(List)
merge = Merge(Data1=graft(pline_5), Data2=graft(pline_6))
merge_2 = Merge(Data1=graft(pline_5), Data2=graft(shift_4))
loft = Loft(Curves=merge_2, Options={Adjust=False, Closed=False, LoftEnds=0, LoftSimp=0, LoftType=3, Rebuild=10, Refit=0.01})
loft_2 = Loft(Curves=merge, Options={Adjust=False, Closed=False, LoftEnds=0, LoftSimp=0, LoftType=3, Rebuild=10, Refit=0.01})
# loft delle congiungenti dei punti sulle curve
# con i segmenti spostati lungo la curvatura
# alla posizione +1
preview_4 = CustomPreview(Geometry=loft, Shader=ColourSwatch(SwatchColor=RGB(168, 135, 0)))
# loft delle congiungenti dei punti sulle curve
# con le corrispondenti spostate lungo la curvatura
preview_5 = CustomPreview(Geometry=loft_2, Shader=ColourSwatch(SwatchColor=RGB(255, 255, 255)))
