# Grasshopper definition 01_02_lists advanced.gh (Grasshopper 0.9.76)
# Copyright: Co-de-iT

# dispatch/weave
series = Series(Start=0, Step=1, Count=10)
# sift/combine
series_2 = Series(Start=0, Step=1, Count=10)
series_3 = Series(Start="11", Step="10", Count=10)
# Lists Basics
# 
# Basic operations with lists
# 
# © a3 2017 _ Creative Commons Attribution-NonCommercial-ShareAlike3.0 UnportedLicense.
# 01 advanced operations
# pick'n'choose
series_4 = Series(Start=0, Step=1, Count=10)
# partition list
series_5 = Series(Start=0, Step=1, Count=10)
panel = Panel(series_2)
panel_2 = Panel(series)
panel_3 = Panel(series_4)
panel_4 = Panel(series_3)
panel_5 = Panel(series_5)
panel_6 = Panel("""0
0
1
1""")
# dispatch
# 
# reindirizza l'input su due canali (A, B)
# a seconda di un pattern di valori
# booleani (true, false)
# per creare un panel con dati su più righe
# cliccare con il tasto dx del mouse
# e deselezionare "multiline data"
panel_7 = Panel("""false
true""")

sift = SiftPattern(List=series_2, SiftPattern=panel_6)  # -> Output0, Output1
# combine data
# 
# combina i dati da vari canali di input
# seguendo il pattern P
# Avvicinandosi al componente si
# possono aggiungere dinamicamente
# nuovi canali
combine = CombineData(Input0=sift.Output0, Input1=sift.Output1)  # -> Result, Index

random = Random(Range=Domain(0, 1), Number=Slider(8, range=1..20), Seed=2, Integers=True)
panel_8 = Panel(sift.Output0)
# sift
# 
# setaccia la lista e la separa nei vari
# canali di output seguendo il pattern P
# Avvicinandosi al componente si
# possono aggiungere dinamicamente
# nuovi canali
panel_9 = Panel(sift.Output1)
dispatch = Dispatch(List=series, DispatchPattern=panel_7)  # -> ListA, ListB
# partition list
# 
# ripartisce la lista in sotto liste seguendo
# la sequenza S. La sequenza indica
# il numero di elementi per ciascuna
# sotto lista e si ripete fino ad esaurimento
# lista
# per creare un panel con dati su più righe
# cliccare con il tasto dx del mouse
# e deselezionare "multiline data"
panel_10 = Panel("""3
2
1""")
# pick'n'choose
# 
# utilizza un pattern di indici (P) per
# comporre una lista prendendo elementi
# dai rispettivi canali di input
p_n_c = PickNChoose(Pattern=random, Stream0=series_4, Stream1=series_3)
panel_11 = Panel(dispatch.ListA)
panel_12 = Panel(dispatch.ListB)
partition = PartitionList(List=series_5, Size=panel_10)
panel_13 = Panel(random)
panel_14 = Panel(p_n_c)
# weave
# 
# intreccia l'input da due canali (0, 1)
# a seconda di un pattern di valori
# booleani (true, false). La corrispondenza
# è:
# 0 = false
# 1 = true
weave = Weave(Pattern=panel_7, Stream0=dispatch.ListB, Stream1=dispatch.ListA, NullGaps=False)
panel_15 = Panel(combine.Index)
panel_16 = Panel(combine.Result)
panel_17 = Panel(partition)
panel_18 = Panel(weave)
crv = Curve(<curve referenced from the Rhino model>)
crv_2 = Curve(<curve referenced from the Rhino model>)
crv_3 = Curve(<curve referenced from the Rhino model>)
# 02 examples
division_pts = Slider(150, range=2..150)
grid_size = Slider(52.533, range=0..100)
y_cells = Slider(46, range=2..200)
x_cells = Slider(46, range=2..200)
division_pts_2 = Slider(64, range=2..150)
pt = Point(<point referenced from the Rhino model>)
crv_4 = Curve(<curve referenced from the Rhino model>)
crv_5 = Curve(<curve referenced from the Rhino model>)
divide = DivideCurve(Curve=crv, Count=division_pts, Kinks=False)  # -> Points, Tangents, Parameters
y_cells_2 = Slider(14, range=2..200)
grid_size_2 = Slider(52.533, range=0..100)
x_cells_2 = Slider(54, range=2..200)
divide_2 = DivideCurve(Curve=crv_2, Count=division_pts, Kinks=False)  # -> Points, Tangents, Parameters
divide_3 = DivideCurve(Curve=crv_3, Count=division_pts, Kinks=False)  # -> Points, Tangents, Parameters
pt_2 = Point(<point referenced from the Rhino model>)
addition = Addition(A=x_cells_2, B="1")
division = Division(A=grid_size, B=x_cells)
division_2 = Division(A=grid_size, B=y_cells)
divide_4 = DivideCurve(Curve=crv_4, Count=division_pts_2, Kinks=False)  # -> Points, Tangents, Parameters
divide_5 = DivideCurve(Curve=crv_5, Count=division_pts_2, Kinks=False)  # -> Points, Tangents, Parameters
random_2 = Random(Range="0 to 2", Number=division_pts, Seed=2, Integers=True)
division_3 = Division(A=grid_size_2, B=x_cells_2)
entwine = Entwine(Branch00=divide.Points, Branch01=divide_2.Points, Branch02=divide_3.Points, FlattenInputs=True)
division_4 = Division(A=grid_size_2, B=y_cells_2)
addition_2 = Addition(A=y_cells_2, B="1")
series_6 = Series(Start=0, Step=1, Count=addition)
panel_19 = Panel("""5
3
4""")
flip = FlipMatrix(Data=entwine)
recgrid = Rectangular(Plane=pt, SizeX=division, SizeY=division_2, ExtentX=x_cells, ExtentY=y_cells)  # -> Cells, Points
p_n_c_2 = PickNChoose(Pattern=random_2, Stream0=divide.Points, Stream1=divide_2.Points, Stream2=divide_3.Points)  # -> graft(Result)
recgrid_2 = Rectangular(Plane=pt_2, SizeX=division_3, SizeY=division_4, ExtentX=x_cells_2, ExtentY=y_cells_2)  # -> Cells, Points
random_3 = Random(Range="0 to 2", Number=addition_2, Seed=series_6, Integers=True)
avr = Average(Input=flip)

partition_2 = PartitionList(List=divide_5.Points, Size=panel_19)
partition_3 = PartitionList(List=divide_4.Points, Size=panel_19)
rev = ReverseList(List=partition_3)

addition_3 = Addition(A="20", B=grid_size)
series_7 = Series(Start=0, Step=1, Count=x_cells)  # -> graft(Series)
random_threshold = Slider(0.84, range=0..1)
Y = UnitY(Factor=addition_3)
multiplication = Multiplication(A=division_3, B=Slider(0, range=0..1))
lng = ListLength(List=recgrid.Cells)
pline = PolyLine(Vertices=flatten(avr), Closed=False)
merge = Merge(Data1=partition_2, Data2=rev)
move = Move(Geometry=recgrid.Cells, Motion=Y)  # -> Geometry, Transform
ln = Line(StartPoint=avr, EndPoint=p_n_c_2)
random_4 = Random(Range=Domain(0, 1), Number=lng, Seed=series_7)
X = UnitX(Factor=multiplication)
X_2 = UnitX(Factor=division_3)
explode = Explode(Curve=move.Geometry, Recursive=True)  # -> Segments, Vertices
explode_2 = Explode(Curve=recgrid.Cells, Recursive=True)  # -> Segments, Vertices
nurbs = NurbsCurve(Vertices=merge, Degree=3, Periodic=Toggle(True))  # -> Curve, Length, Domain
smaller = SmallerThan(FirstNumber=random_4, SecondNumber=random_threshold)  # -> graft(SmallerThan), OrEqualTo
dispatch_2 = Dispatch(List=explode.Vertices, DispatchPattern=smaller.SmallerThan)  # -> ListA, ListB
dispatch_3 = Dispatch(List=explode_2.Vertices, DispatchPattern=smaller.SmallerThan)  # -> ListA, ListB
panel_20 = Panel("""1
2""")
panel_21 = Panel("""0
3""")
panel_22 = Panel("""1
2""")
panel_23 = Panel("""2
3""")
panel_24 = Panel("""0
1""")
panel_25 = Panel("""0
3""")
panel_26 = Panel("""0
2""")
panel_27 = Panel("""1
3""")
item = ListItem(List=dispatch_2.ListA, Index=panel_21, Wrap=True)
item_2 = ListItem(List=dispatch_2.ListA, Index=panel_22, Wrap=True)
item_3 = ListItem(List=dispatch_2.ListA, Index=panel_23, Wrap=True)
item_4 = ListItem(List=dispatch_2.ListA, Index=panel_24, Wrap=True)
item_5 = ListItem(List=dispatch_2.ListB, Index=panel_25, Wrap=True)
item_6 = ListItem(List=dispatch_2.ListB, Index=panel_20, Wrap=True)
item_7 = ListItem(List=dispatch_3.ListA, Index=panel_26, Wrap=True)
item_8 = ListItem(List=dispatch_3.ListB, Index=panel_27, Wrap=True)
avr_2 = Average(Input=item)
avr_3 = Average(Input=item_2)
pline_2 = PolyLine(Vertices=item_3, Closed=False)  # -> flatten(Polyline)
pline_3 = PolyLine(Vertices=item_4, Closed=False)  # -> flatten(Polyline)
pline_4 = PolyLine(Vertices=item_5, Closed=False)  # -> flatten(Polyline)
pline_5 = PolyLine(Vertices=item_6, Closed=False)  # -> flatten(Polyline)
pline_6 = PolyLine(Vertices=item_7, Closed=False)  # -> flatten(Polyline)
pline_7 = PolyLine(Vertices=item_8, Closed=False)  # -> flatten(Polyline)
ln_2 = Line(StartPoint=avr_2, EndPoint=avr_3)  # -> flatten(Line)
weave_2 = Weave(Pattern=flatten(smaller.SmallerThan), Stream0=[pline_4, pline_5], Stream1=[pline_3, pline_2, ln_2], NullGaps=False)
weave_3 = Weave(Pattern=flatten(smaller.SmallerThan), Stream0=pline_7, Stream1=pline_6, NullGaps=False)
multiplication_2 = Multiplication(A=Y, B=2)
move_2 = Move(Geometry=pt, Motion=multiplication_2)  # -> Geometry, Transform
preview = CustomPreview(Geometry=weave_2, Shader=ColourSwatch(SwatchColor=RGB(94, 94, 94)))
preview_2 = CustomPreview(Geometry=weave_3, Shader=ColourSwatch(SwatchColor=RGB(0, 0, 0)))
grid_size_3 = Slider(52.533, range=0..100)
x_cells_3 = Slider(46, range=2..200)
# K
# T
y_cells_3 = Slider(46, range=2..200)
pt_3 = Point(<point referenced from the Rhino model>)
num = Number(grid_size)
pt_4 = Point(move_2.Geometry)
x_cells_4 = Slider(87, range=2..200)
y_cells_4 = Slider(87, range=2..200)
division_5 = Division(A=grid_size_3, B=x_cells_3)
division_6 = Division(A=grid_size_3, B=y_cells_3)
recgrid_3 = Rectangular(Plane=pt_3, SizeX=division_5, SizeY=division_6, ExtentX=x_cells_3, ExtentY=y_cells_3)  # -> Cells, Points
division_7 = Division(A=num, B=y_cells_4)
division_8 = Division(A=num, B=x_cells_4)
rectangle = Rectangle(Plane=pt_4, XSize=num, YSize=num, Radius=0)  # -> Rectangle, Length
lng_2 = ListLength(List=flatten(recgrid_3.Cells))
pcen = PolygonCenter(Polyline=rectangle.Rectangle)  # -> CenterV, CenterE, CenterA
explode_3 = Explode(Curve=recgrid_3.Cells, Recursive=True)  # -> Segments, Vertices
panel_28 = Panel("""1
3""")
panel_29 = Panel("""0
2""")
recgrid_4 = Rectangular(Plane=pt_4, SizeX=division_8, SizeY=division_7, ExtentX=x_cells_4, ExtentY=y_cells_4)  # -> Cells, Points
random_threshold_2 = Slider(0.622, range=0..1)
scale = Scale(Geometry=rectangle.Rectangle, Center=pcen.CenterV, Factor=Slider(0.969, range=0..1))  # -> Geometry, Transform
random_5 = Random(Range=Domain(0, 1), Number=lng_2, Seed=2)
item_9 = ListItem(List=explode_3.Vertices, Index=panel_29, Wrap=True)
item_10 = ListItem(List=explode_3.Vertices, Index=panel_28, Wrap=True)
pop2d = Populate2D(Region=scale.Geometry, Count=Slider(3, range=3..40), Seed=Slider(30, range=1..100))
panel_30 = Panel("0.5")
pcen_2 = PolygonCenter(Polyline=recgrid_4.Cells)  # -> CenterV, CenterE, CenterA
pline_8 = PolyLine(Vertices=item_9, Closed=False)  # -> flatten(Polyline)
pline_9 = PolyLine(Vertices=item_10, Closed=False)  # -> flatten(Polyline)
smaller_2 = SmallerThan(FirstNumber=random_5, SecondNumber=random_threshold_2)  # -> SmallerThan, OrEqualTo
fspin = SpinForce(Plane=pop2d, Strength=1, Radius=Slider(20.09, range=0..50), Decay=2)
mergef = MergeFields(Fields=fspin)
evf = EvaluateField(Field=mergef, Point=pcen_2.CenterV)  # -> Tensor, Strength
p_n_c_3 = PickNChoose(Pattern=smaller_2.SmallerThan, Stream0=pline_8, Stream1=pline_9)
unit = UnitVector(Vector=evf.Tensor)
pdecon = Deconstruct(Point=unit)  # -> XComponent, YComponent, ZComponent
preview_3 = CustomPreview(Geometry=p_n_c_3, Shader=ColourSwatch(SwatchColor=RGB(0, 0, 0)))
vdisex = VectorDisplayEx(Point=pcen_2.CenterV, Vector=evf.Tensor, Colour=ColourSwatch(SwatchColor=RGB(9, 76, 97)), Width=1)
abs = Absolute(Value=pdecon.XComponent)
explode_4 = Explode(Curve=recgrid_4.Cells, Recursive=True)  # -> Segments, Vertices
larger = LargerThan(FirstNumber=abs, SecondNumber=Slider(0.5, range=0..1))  # -> graft(LargerThan), OrEqualTo
dispatch_4 = Dispatch(List=explode_4.Vertices, DispatchPattern=larger.LargerThan)  # -> ListA, ListB
panel_31 = Panel("""1
2""")
panel_32 = Panel("""0
3""")
panel_33 = Panel("""2
3""")
panel_34 = Panel("""0
1""")
item_11 = ListItem(List=dispatch_4.ListB, Index=panel_31, Wrap=True)
item_12 = ListItem(List=dispatch_4.ListB, Index=panel_32, Wrap=True)
item_13 = ListItem(List=dispatch_4.ListA, Index=panel_33, Wrap=True)
item_14 = ListItem(List=dispatch_4.ListA, Index=panel_34, Wrap=True)
pline_10 = PolyLine(Vertices=item_11, Closed=False)
pline_11 = PolyLine(Vertices=item_12, Closed=False)
pline_12 = PolyLine(Vertices=item_13, Closed=False)
pline_13 = PolyLine(Vertices=item_14, Closed=False)
merge_2 = Merge(Data1=pline_13, Data2=pline_12)  # -> flatten(Result)
merge_3 = Merge(Data1=pline_11, Data2=pline_10)  # -> flatten(Result)
move_3 = Move(Geometry=pt_4, Motion=Y)  # -> Geometry, Transform
preview_4 = CustomPreview(Geometry=[merge_2, merge_3], Shader=ColourSwatch(SwatchColor=RGB(0, 0, 0)))
num_2 = Number(grid_size)
pt_5 = Point(move_3.Geometry)
x_cells_5 = Slider(87, range=2..200)
y_cells_5 = Slider(87, range=2..200)
rectangle_2 = Rectangle(Plane=pt_5, XSize=num_2, YSize=num_2, Radius=0)  # -> Rectangle, Length
pcen_3 = PolygonCenter(Polyline=rectangle_2.Rectangle)  # -> CenterV, CenterE, CenterA
division_9 = Division(A=num_2, B=y_cells_5)
division_10 = Division(A=num_2, B=x_cells_5)
scale_2 = Scale(Geometry=rectangle_2.Rectangle, Center=pcen_3.CenterV, Factor=Slider(1.125, range=0.5..2))  # -> Geometry, Transform
recgrid_5 = Rectangular(Plane=pt_5, SizeX=division_10, SizeY=division_9, ExtentX=x_cells_5, ExtentY=y_cells_5)  # -> Cells, Points
pcen_4 = PolygonCenter(Polyline=recgrid_5.Cells)  # -> CenterV, CenterE, CenterA
pop2d_2 = Populate2D(Region=scale_2.Geometry, Count=Slider(5, range=3..40), Seed=Slider(16, range=1..100))
nurbs_2 = NurbsCurve(Vertices=pop2d_2, Degree=3, Periodic=False)  # -> Curve, Length, Domain
crv_cp = CurveClosestPoint(Point=pcen_4.CenterV, Curve=nurbs_2.Curve)  # -> Point, Parameter, Distance
field_threshold = Slider(0.5, range=0..1)
curve_dist_threshold = Slider(3.15, range=0..10)
field_threshold_2 = Slider(0.5, range=0..1)
vec2pt = Vector2Pt(PointA=pcen_4.CenterV, PointB=crv_cp.Point, Unitize=True)  # -> Vector, Length
eval = EvaluateCurve(Curve=nurbs_2.Curve, Parameter=crv_cp.Parameter)  # -> Point, Tangent, Angle
pi = Pi(Factor=1)
pdecon_2 = Deconstruct(Point=eval.Tangent)  # -> XComponent, YComponent, ZComponent
Z = UnitZ(Factor=1)
multiplication_3 = Multiplication(A=pi, B=Slider(0.5, range=0..0.5))
abs_2 = Absolute(Value=pdecon_2.XComponent)
vrot = Rotate(Vector=vec2pt.Vector, Axis=Z, Angle=multiplication_3)
pdecon_3 = Deconstruct(Point=vrot)  # -> XComponent, YComponent, ZComponent
abs_3 = Absolute(Value=pdecon_3.XComponent)
scenario = ValueList({"field": 0, "curve field": 1, "curve distance": 2}, selected="curve distance")
smaller_3 = SmallerThan(FirstNumber=crv_cp.Distance, SecondNumber=curve_dist_threshold)  # -> graft(SmallerThan), OrEqualTo
explode_5 = Explode(Curve=recgrid_5.Cells, Recursive=True)  # -> Segments, Vertices
larger_2 = LargerThan(FirstNumber=abs_3, SecondNumber=field_threshold)  # -> graft(LargerThan), OrEqualTo
larger_3 = LargerThan(FirstNumber=abs_2, SecondNumber=field_threshold_2)  # -> graft(LargerThan), OrEqualTo
vdisex_2 = VectorDisplayEx(Point=pcen_4.CenterV, Vector=eval.Tangent, Colour=ColourSwatch(SwatchColor=RGB(197, 224, 232)), Width=1)
filter = StreamFilter(Gate=scenario, Stream0=larger_2.LargerThan, Stream1=larger_3.LargerThan, Stream2=smaller_3.SmallerThan)
dispatch_5 = Dispatch(List=explode_5.Vertices, DispatchPattern=filter)  # -> ListA, ListB
panel_35 = Panel("""2
3""")
panel_36 = Panel("""0
1""")
panel_37 = Panel("""1
2""")
panel_38 = Panel("""0
3""")
item_15 = ListItem(List=dispatch_5.ListA, Index=panel_35, Wrap=True)
item_16 = ListItem(List=dispatch_5.ListA, Index=panel_36, Wrap=True)
item_17 = ListItem(List=dispatch_5.ListB, Index=panel_37, Wrap=True)
item_18 = ListItem(List=dispatch_5.ListB, Index=panel_38, Wrap=True)
pline_14 = PolyLine(Vertices=item_15, Closed=False)
pline_15 = PolyLine(Vertices=item_16, Closed=False)
pline_16 = PolyLine(Vertices=item_17, Closed=False)
pline_17 = PolyLine(Vertices=item_18, Closed=False)
merge_4 = Merge(Data1=pline_15, Data2=pline_14)  # -> flatten(Result)
merge_5 = Merge(Data1=pline_17, Data2=pline_16)  # -> flatten(Result)
preview_5 = CustomPreview(Geometry=[merge_4, merge_5], Shader=ColourSwatch(SwatchColor=RGB(0, 0, 0)))

sift_2 = SiftPattern(List=recgrid_2.Points, SiftPattern=random_3)  # -> Output0, Output1, Output2

move_4 = Move(Geometry=sift_2.Output1, Motion=X)  # -> Geometry, Transform
move_5 = Move(Geometry=sift_2.Output2, Motion=X_2)  # -> Geometry, Transform

combine_2 = CombineData(Input0=sift_2.Output0, Input1=move_4.Geometry, Input2=move_5.Geometry)  # -> Result, Index

pline_18 = PolyLine(Vertices=combine_2.Result, Closed=False)  # -> flatten(Polyline)
fillet = Fillet(Curve=pline_18, Radius=Slider(2, range=0..5))
