# Grasshopper definition 01_03_trees basics.gh (Grasshopper 0.9.76)
# Copyright: Co-de-iT

series = Series(Start=0, Step=1, Count=10)
# data tree intro
# 
# © a3 2017 _ Creative Commons Attribution-NonCommercial-ShareAlike3.0 UnportedLicense.
# 01. the tree structure
pt = Point(Point(0, 0, 0))
number_slider = Slider(3, range=1..5)
number_slider_2 = Slider(10, range=0..10)
# 02. basic operations
addition = Addition(A=series, B="5")
number_slider_3 = Slider(0.45, range=0..1)
Y = UnitY(Factor="-1")
pt_2 = ConstructPoint(XCoordinate=addition, YCoordinate=series, ZCoordinate=0)

Z = UnitZ(Factor=1)
line = LineSDL(Start=pt, Direction=Z, Length=number_slider_2)
divide = DivideCurve(Curve=line, Count=number_slider, Kinks=False)  # -> Points, Tangents, Parameters

multiplication = Multiplication(A=number_slider_2, B=number_slider_3)
pt_3 = Point(pt_2)

xprod = CrossProduct(VectorA=Z, VectorB=Y, Unitize=False)  # -> Vector, Length
line_2 = LineSDL(Start=divide.Points, Direction=xprod.Vector, Length=multiplication)
# second subdivision
divide_2 = DivideCurve(Curve=line_2, Count=number_slider, Kinks=False)  # -> Points, Tangents, Parameters

multiplication_2 = Multiplication(A=multiplication, B=number_slider_3)
# 02. random radius: points in the list are associated with random radius
random = Random(Range=Domain(0, 0.8), Number=10, Seed=2)

xprod_2 = CrossProduct(VectorA=xprod.Vector, VectorB=Y, Unitize=False)  # -> Vector, Length
# third subdivision
line_3 = LineSDL(Start=divide_2.Points, Direction=xprod_2.Vector, Length=multiplication_2)
divide_3 = DivideCurve(Curve=line_3, Count=number_slider, Kinks=False)  # -> Points, Tangents, Parameters

# ----
# original data list: the original data list
viewer = ParamViewer(pt_3)
viewer_2 = ParamViewer(pt_3)
panel = Panel(pt_3)
# 03. different results: switch on or off alternatively to see how data is treated differently in both cases
# 03.1 embedded tree operations: flatten or graft can be activated on data input or output in components (right click to activate/deactivate graft or flatten in the components below).
cir = Circle(Plane=pt_3, Radius=random)
cir_2 = Circle(Plane=graft(pt_3), Radius=graft(random))
cir_3 = Circle(Plane=graft(pt_3), Radius=random)
# graft: graft: a path is built for each element
graft = GraftTree(Data=pt_3, IncludeEmptyLists=True, IncludeNullItems=True)
cir_4 = Circle(Plane=flatten(graft), Radius=random)
cir_5 = Circle(Plane=graft, Radius=graft(random))
viewer_3 = ParamViewer(graft)
viewer_4 = ParamViewer(graft)
panel_2 = Panel(graft)
cir_6 = Circle(Plane=graft, Radius=random)
viewer_5 = ParamViewer(divide_2.Points)
# first subdivision
viewer_6 = ParamViewer(divide.Points)
viewer_7 = ParamViewer(divide_3.Points)
# flatten: flatten: all data is squashed in one list
flatten = FlattenTree(Data=graft, Path="{0}")
panel_3 = Panel(flatten)
viewer_8 = ParamViewer(flatten)
viewer_9 = ParamViewer(flatten)
lng = ListLength(List=divide.Points)
lng_2 = ListLength(List=divide_2.Points)
lng_3 = ListLength(List=divide_3.Points)
series_2 = Series(Start=0, Step=1, Count=lng)
series_3 = Series(Start=0, Step=1, Count=lng_2)
series_4 = Series(Start=0, Step=1, Count=lng_3)
int = Integer(series_2)
int_2 = Integer(series_3)
int_3 = Integer(series_4)
concat = Concatenate(FragmentA=viewer_6, FragmentB=int)
xz = XZPlane(Origin=divide_3.Points)
xz_2 = XZPlane(Origin=divide_2.Points)
xz_3 = XZPlane(Origin=divide.Points)
concat_2 = Concatenate(FragmentA=graft(viewer_5), FragmentB=int_2)
concat_3 = Concatenate(FragmentA=graft(viewer_7), FragmentB=int_3)
prot = RotatePlane(Plane=xz_2, Angle=1.570796327)
tag = TextTag3D(
    Location=xz_3,
    Text=concat,
    Size=Slider(0.239, range=0..1),
    Colour=ColourSwatch(SwatchColor=RGB(255, 255, 255)),
    Justification=7)
tag_2 = TextTag3D(
    Location=prot,
    Text=concat_2,
    Size=Slider(0.112, range=0..1),
    Colour=ColourSwatch(SwatchColor=RGB(92, 92, 92)),
    Justification=7)
tag_3 = TextTag3D(
    Location=xz,
    Text=concat_3,
    Size=Slider(0.042, range=0..1),
    Colour=ColourSwatch(SwatchColor=RGB(0, 0, 0)),
    Justification=7)
