# Grasshopper definition 02_00_domain and curves.gh (Grasshopper 0.9.76)
# Copyright: Co-de-iT
# plug-ins: Human

# ----
# evaluate curve
rotation_angle = Slider(1.69, range=0..2)

# ----
# Domain and curves
# 
# © a3 2017 _ Creative Commons Attribution-NonCommercial-ShareAlike3.0 UnportedLicense.
# domain
number_slider = Slider(59.52, range=0..100)
crv = Curve(reparameterize(<curve referenced from the Rhino model>))
crv_2 = Curve(reparameterize(<curve referenced from the Rhino model>))
# domain & curves
crv_3 = Curve(<curve referenced from the Rhino model>)
# facendo scorrere lo slider il punto trovato sulle varie curve dipende dal dominio della singola curva, perciò un valore di 1 corrisponde ad una percentuale diversa di ogni curva
# Reparametrize: attivando Reparametrize (click con tasto destro sul componente curva > Reparametrize) il dominio di ogni curva viene normalizzato (0.0 To 1.0), in modo simile ad una "percentuale" della curva, permettendoci di trattarle in modo univoco
crv_4 = Curve([<curve referenced from the Rhino model> x4])
# divisions
crv_5 = Curve(<curve referenced from the Rhino model>)
crv_6 = Curve(<curve referenced from the Rhino model>)
crv_7 = Curve(<curve referenced from the Rhino model>)
crv_8 = Curve(<curve referenced from the Rhino model>)
number_slider_2 = Slider(10.408, range=1..50)
# Reparametrize: attivando Reparametrize (click con tasto destro sul componente curva > Reparametrize) il dominio di ogni curva viene normalizzato (0.0 To 1.0), in modo simile ad una "percentuale" della curva
crv_9 = Curve(reparameterize(crv_3))
merge = Merge(Data1=crv_7, Data2=crv_8)
crv_10 = Curve(reparameterize(<curve referenced from the Rhino model>))
pi = Pi(Factor=rotation_angle)
# vettore tangente At
# 
# a partire dal vettore direzione x, lo si ruota e gli si dà un'ampiezza (giocare con i 2 parametri)
X = UnitX(Factor=1)
Z = UnitZ(Factor=1)
series = Series(Start=Slider(0, range=0..10), Step=Slider(0.001, range=0.001..1), Count=Slider(100, range=2..100))
domain = Domain(crv_3)
domain_2 = Domain(crv_9)
# Construct Domain: crea un dominio tra un valore iniziale e uno finale
# A può anche essere > B
# 
# Se A = B il dominio collassa in un unico valore
dom = ConstructDomain(DomainStart=number_slider, DomainEnd=Slider(17.92, range=0..100))
divide = DivideCurve(Curve=crv_5, Count=Slider(22, range=10..100), Kinks=False)  # -> Points, Tangents, Parameters
divdist = DivideDistance(Curve=merge, Distance=number_slider_2)  # -> Points, Tangents, Parameters
divlength = DivideLength(Curve=crv_6, Length=Slider(10.408, range=1..50))  # -> Points, Tangents, Parameters
# è possibile usare i valori di t su due curve rimappate (entrambe i domini sono tra 0 e 1)
divide_2 = DivideCurve(Curve=crv_2, Count=Slider(200, range=10..200), Kinks=False)  # -> Points, Tangents, Parameters
eval = EvaluateCurve(Curve=crv_10, Parameter=Slider(0.56, range=0..1))  # -> Point, Tangent, Angle
vrot = Rotate(Vector=X, Axis=Z, Angle=pi)
multiplication = Multiplication(A=number_slider_2, B="0.5")
curve_domain = Panel(domain)
reparametrized_curve_domain = Panel(domain_2)
domain_3 = Domain(crv_4)
panel = Panel(series)
domain_4 = Domain(dom)
amp = Amplitude(Vector=eval.Tangent, Amplitude=Slider(50, range=0..50))
# attivare la visualizzazione delle sfere per una dimostrazione visiva di Divide Distance
panel_2 = Panel("0.8")
panel_3 = Panel(domain_3)
eval_2 = EvaluateCurve(Curve=crv, Parameter=divide_2.Parameters)  # -> Point, Tangent, Angle
dots = DotDisplay(Point=divide_2.Points, Colour=ColourSwatch(SwatchColor=RGB(255, 255, 255)), Size="0.3")
sph = Sphere(Base=divdist.Points, Radius=multiplication)
dots_2 = DotDisplay(Point=divlength.Points, Colour=ColourSwatch(SwatchColor=RGB(0, 255, 225)), Size="0.5")
dots_3 = DotDisplay(Point=divdist.Points, Colour=ColourSwatch(SwatchColor=RGB(0, 0, 0)), Size=panel_2)
dots_4 = DotDisplay(Point=divide.Points, Colour=ColourSwatch(SwatchColor=RGB(255, 255, 255)), Size="0.3")
amp_2 = Amplitude(Vector=vrot, Amplitude=Slider(25.279, range=0..50))
# Reverse: inverte la direzione del vettore
# 
# provare a saltare questo passaggio e/o a invertire la direzione di At
rev = Reverse(Vector=amp)
panel_4 = Panel(domain_4)
eval_3 = EvaluateCurve(Curve=crv_4, Parameter=Slider(0, range=0..1))  # -> Point, Tangent, Angle
# range: genera un numero n+1 di valori egualmente distribuiti lungo il dominio fornito
range = Range(Domain="0 To 1", Steps=Slider(10, range=1..10))
# divide domain: divide il dominio nel numero di sottodomini indicato
div = DivideDomain(Domain="0 To 1", Count=Slider(10, range=1..10))
# punto iniziale (provare a spostarlo su Rhino)
pt = Point(<point referenced from the Rhino model>)
# Bounds: ricava un dominio da una lista di valori
bnd = Bounds(Numbers=series)
# sebbene i punti di divisione sulla curva siano tra loro equidistanti, i corrispettivi valori t sul segmento lineare danno origine a un ritmo di densità diversa
Y = UnitY(Factor=1)
# Deconstruct Domain: ricava il valore iniziale e finale di un dominio
dedomain = DeconstructDomain(Domain=domain_4)  # -> Start, End
pline = PolyLine(Vertices=eval_3.Point, Closed=False)
# questo perchè il dominio della curva non rettilinea non è omogeneo, ovvero più la curvatura è accentuata, più il dominio è "denso"
panel_5 = Panel("2")
panel_6 = Panel(bnd)
panel_7 = Panel(div)
panel_8 = Panel(range)
line = LineSDL(Start=eval_2.Point, Direction=Y, Length=panel_5)
# Bezier Span: crea una curva di Bézier a partire da due estremi e dalle rispettive tangenti
bzspan = BezierSpan(StartPoint=pt, StartTangent=amp_2, EndPoint=eval.Point, EndTangent=rev)  # -> Curve, Length, Domain
# dominio: Un dominio è un continuo matematico tra due valori. Immaginate un segmento che contiene infiniti punti (continuo significa che tra due punti qualsiasi esiste sempre almeno un punto intermedio)
domain_start = Panel(dedomain.Start)
domain_end = Panel(dedomain.End)
dots_5 = DotDisplay(Point=eval_3.Point, Colour=ColourSwatch(SwatchColor=RGB(255, 255, 255)), Size="0.3")
previewlw = CustomPreviewLineweights(
    Geometry=pline,
    Shader={ambient=RGB(0, 0, 0), diffuse=RGB(255, 105, 180), emission=RGB(76, 32, 54), shine=0.5, specular=RGB(255, 255, 255), transparency=0},
    Absolute=False)
# visualizza il vettore tangente creato
vdisex = VectorDisplayEx(Point=pt, Vector=amp_2, Colour=RGB(0, 0, 0), Width=2)
# Dot Display: permette di customizzare il display dei punti
dots_6 = DotDisplay(Point=eval.Point, Colour=ColourSwatch(SwatchColor=RGB(255, 255, 255)), Size="0.5")
previewlw_2 = CustomPreviewLineweights(Geometry=line, Shader=ColourSwatch(SwatchColor=RGB(255, 255, 255)), Absolute=False)
