# Grasshopper definition 02_01_domain_remap.gh (Grasshopper 0.9.76)
# Copyright: Co-de-iT
# plug-ins: Human

series = Series(Start=0, Step=1, Count=10)
# dominio di origine
number_slider = Slider(1.36, range=0..10)
# dominio di destinazione
number_slider_2 = Slider(1, range=0..1)
# remap
# valori da rimappare
# (solo valori numerici)
series_2 = Series(Start=0, Step=1, Count=10)
panel = Panel(series)
# Remap
# 
# © a3 2017 _ Creative Commons Attribution-NonCommercial-ShareAlike3.0 UnportedLicense.
panel_2 = Panel(series_2)
dom = ConstructDomain(DomainStart=number_slider, DomainEnd=Slider(7.2, range=0..10))
dom_2 = ConstructDomain(DomainStart=Slider(0, range=0..1), DomainEnd=number_slider_2)
# il dominio sorgente è creato a partire dai valori stessi in ingresso con il componente Bounds
# 
# L'opzione Flatten in ingresso è utile quando i dati di input sono organizzati come un data tree ma serve il dominio di TUTTI i dati (senza il flatten si creerebbe un dominio per ogni ramo)
num = Number(series)
bnd = Bounds(Numbers=flatten(num))
# quando il dominio sorgente è creato a partire dai dati stessi gli output R e C sono sempre identici
dom_3 = ConstructDomain(DomainStart=0, DomainEnd=1)
# Remap: rimappa una lista di valori da un dominio sorgente ad uno di destinazione
remap = RemapNumbers(Value=series_2, Source=dom, Target=dom_2)  # -> Mapped, Clipped
remap_2 = RemapNumbers(Value=num, Source=bnd, Target=dom_3)  # -> Mapped, Clipped
remapped_values = Panel(remap_2.Mapped)
remapped_and_clipped_values = Panel(remap.Clipped)
# se i valori in input eccedono il dominio sorgente (escono oltre gli estremi A e B):
# 
# . i valori remapped mantengono la proporzione del nuovo dominio ma consentono ai valori di eccedere i limiti del dominio di destinazione
# 
# . i valori clipped impongono i limiti del dominio ai valori eccedenti
remapped_values_2 = Panel(remap.Mapped)
# example 1
parameter_t = Slider(0.24, range=0..1)
# example 2
parameter_t_2 = Slider(0.49, range=0..1)
# curva di riferimento
crv = Curve(reparameterize(<curve referenced from the Rhino model>))
eval = EvaluateCurve(Curve=crv, Parameter=parameter_t)  # -> Point, Tangent, Angle
number_slider_3 = Slider(9.53, range=0..50)
number_slider_4 = Slider(36.538, range=0..50)
# valore rimappato #1
crv_2 = Curve(<curve referenced from the Rhino model>)
# valore rimappato #2
crv_3 = Curve(<curve referenced from the Rhino model>)
start_angle = Slider(0, range=0..1)
end_angle = Slider(0.408, range=0..1)
# example 3
# initial points
pt = Point([<point referenced from the Rhino model> x11])
crv_4 = Curve(<curve referenced from the Rhino model>)
# curva di riferimento
crv_5 = Curve(reparameterize(<curve referenced from the Rhino model>))
domain = Domain(crv_2)
domain_2 = Domain(crv_3)
crv_cp = CurveClosestPoint(Point=pt, Curve=crv_4)  # -> Point, Parameter, Distance
previewlw = CustomPreviewLineweights(
    Geometry=crv_4,
    Shader={ambient=RGB(0, 0, 0), diffuse=RGB(255, 105, 180), emission=RGB(76, 32, 54), shine=0.5, specular=RGB(255, 255, 255), transparency=0},
    Absolute=False)
remap_3 = RemapNumbers(Value=parameter_t_2, Source=Domain(0, 1), Target=domain)  # -> Mapped, Clipped
remap_4 = RemapNumbers(Value=parameter_t_2, Source=Domain(0, 1), Target=domain_2)  # -> Mapped, Clipped
dom_4 = ConstructDomain(DomainStart=number_slider_3, DomainEnd=number_slider_4)
merge = Merge(Data1=number_slider_3, Data2=number_slider_4)
eval_2 = EvaluateCurve(Curve=crv_5, Parameter=parameter_t_2)  # -> Point, Tangent, Angle
end = EndPoints(Curve=crv_5)  # -> Start, End
pi = Pi(Factor=end_angle)
pi_2 = Pi(Factor=start_angle)

# ----
# remap
dom_5 = ConstructDomain(DomainStart=Slider(0, range=0..1), DomainEnd=Slider(1, range=0..1))
domain_3 = Domain(crv_4)
remap_5 = RemapNumbers(Value=crv_cp.Parameter, Source=domain_3, Target=dom_5)  # -> Mapped, Clipped

eval_3 = EvaluateCurve(Curve=crv_3, Parameter=remap_4.Mapped)  # -> Point, Tangent, Angle
end_2 = EndPoints(Curve=crv_3)  # -> Start, End
eval_4 = EvaluateCurve(Curve=crv_2, Parameter=remap_3.Mapped)  # -> Point, Tangent, Angle
end_3 = EndPoints(Curve=crv_2)  # -> Start, End
remap_6 = RemapNumbers(Value=parameter_t, Source=Domain(0, 1), Target=dom_4)  # -> Mapped, Clipped
dom_6 = ConstructDomain(DomainStart=pi_2, DomainEnd=pi)
pt_2 = Point(<point referenced from the Rhino model>)
dedomain = DeconstructDomain(Domain=domain_2)  # -> Start, End
arc = Arc(Plane=pt_2, Radius=Slider(50, range=0..50), Angle=dom_6)  # -> Arc, Length
pt_3 = Point(<point referenced from the Rhino model>)

ln = Line(StartPoint=end.Start, EndPoint=eval_2.Point)
ln_2 = Line(StartPoint=eval_2.Point, EndPoint=end.End)
# display dei segmenti
panel_3 = Panel("3")
previewlw_2 = CustomPreviewLineweights(Geometry=ln, Shader=ColourSwatch(SwatchColor=RGB(255, 255, 255)), Thickness="5", Absolute=False)
previewlw_3 = CustomPreviewLineweights(Geometry=ln_2, Shader=ColourSwatch(SwatchColor=RGB(0, 0, 0)), Thickness=panel_3, Absolute=False)

ln_3 = Line(StartPoint=end_3.Start, EndPoint=eval_4.Point)
ln_4 = Line(StartPoint=eval_4.Point, EndPoint=end_3.End)
# display dei segmenti
panel_4 = Panel("3")
previewlw_4 = CustomPreviewLineweights(Geometry=ln_3, Shader=ColourSwatch(SwatchColor=RGB(255, 255, 255)), Thickness="5", Absolute=False)
previewlw_5 = CustomPreviewLineweights(Geometry=ln_4, Shader=ColourSwatch(SwatchColor=RGB(0, 0, 0)), Thickness=panel_4, Absolute=False)

dom_7 = ConstructDomain(DomainStart=dedomain.Start, DomainEnd=remap_4.Mapped)
# Sub Curve: estrae un tratto di curva a partire da un sottinsieme del dominio originale
dom_8 = ConstructDomain(DomainStart=remap_4.Mapped, DomainEnd=dedomain.End)
subcrv = SubCurve(BaseCurve=crv_3, Domain=dom_7)
subcrv_2 = SubCurve(BaseCurve=crv_3, Domain=dom_8)
# display delle sottocurve
panel_5 = Panel("3")
previewlw_6 = CustomPreviewLineweights(Geometry=subcrv, Shader=ColourSwatch(SwatchColor=RGB(255, 255, 255)), Thickness="5", Absolute=False)
previewlw_7 = CustomPreviewLineweights(Geometry=subcrv_2, Shader=ColourSwatch(SwatchColor=RGB(0, 0, 0)), Thickness=panel_5, Absolute=False)

cir = Circle(Plane=pt_3, Radius=merge)
cir_2 = Circle(Plane=pt_3, Radius=remap_6.Mapped)
eval_5 = EvaluateCurve(Curve=reparameterize(arc.Arc), Parameter=remap_5.Mapped)  # -> Point, Tangent, Angle
previewlw_8 = CustomPreviewLineweights(
    Geometry=cir_2,
    Shader={ambient=RGB(0, 0, 0), diffuse=RGB(255, 105, 180), emission=RGB(76, 32, 54), shine=0.5, specular=RGB(255, 255, 255), transparency=0},
    Absolute=False)
previewlw_9 = CustomPreviewLineweights(Geometry=arc.Arc, Shader=ColourSwatch(SwatchColor=RGB(255, 255, 255)), Thickness="2", Absolute=False)
len = Length(Curve=ln)
len_2 = Length(Curve=ln_2)
len_3 = Length(Curve=ln_3)
len_4 = Length(Curve=ln_4)
subtraction = Subtraction(A=remap_4.Mapped, B=dedomain.Start)
subtraction_2 = Subtraction(A=dedomain.End, B=remap_4.Mapped)
# remapped points
pt_4 = Point(eval_5.Point)
dots = DotDisplay(Point=pt_4, Colour=RGB(0, 0, 0), Size=1)
division = Division(A=len, B=len_2)
division_2 = Division(A=len_3, B=len_4)
division_3 = Division(A=subtraction, B=subtraction_2)

Z = UnitZ(Factor=1)
xprod = CrossProduct(VectorA=eval_5.Tangent, VectorB=Z, Unitize=False)  # -> Vector, Length
Y = UnitY(Factor=1)
addition = Addition(A=xprod.Vector, B=Y)
X = UnitX(Factor=Slider(-100, range=-100..0))
multiplication = Multiplication(A=X, B=remap_5.Mapped)
amp = Amplitude(Vector=addition, Amplitude=Slider(30, range=0..100))
# connection curves
bzspan = BezierSpan(StartPoint=crv_cp.Point, StartTangent=multiplication, EndPoint=pt_4, EndTangent=amp)  # -> Curve, Length, Domain

# ----
# quello che si conserva è la posizione relativa di ciascun valore V tra gli estremi del dominio A e B, ovvero il rapporto:
# 
# (V-A)/(B-V)
# 
# nel caso delle linee, essendo curve di grado 1 il loro dominio è lineare (del tipo y = ax+b), quindi distribuito in modo omogeneo. Per questo si può usare il rapporto tra le lunghezze dei segmenti per la verifica
# 
# nel caso della curva, essendo di grado 3 (non lineare), occorre fare il rapporto tra i valori del dominio
panel_6 = Panel(division)
panel_7 = Panel(division_2)
panel_8 = Panel(division_3)
