# Grasshopper definition 02_02_tween curves.gh (Grasshopper 0.9.76)
# Copyright: Co-de-iT

number_slider = Slider(14.32, range=0..20)
resolution = Slider(118, range=10..200)
# Tween curves
# 
# Tween curves command and better alternatives
# 
# © a3 2017 _ Creative Commons Attribution-NonCommercial-ShareAlike3.0 UnportedLicense.
# two curves
crv = Curve(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)
crv_2 = Curve(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)
# multiple curves
crv_3 = Curve([<curve referenced from the Rhino model> x3])
resolution_2 = Slider(118, range=10..200)
crv_4 = Curve(<curve referenced from the Rhino model>)
crv_5 = Curve(<curve referenced from the Rhino model>)
crv_6 = Curve(<curve referenced from the Rhino model>)
resolution_3 = Slider(118, range=10..200)
merge = Merge(Data1=crv_5, Data2=crv_6, Data3=crv_4)
fillet = Fillet(Curve=crv, Radius=number_slider)
fillet_2 = Fillet(Curve=crv_2, Radius=number_slider)
divide = DivideCurve(Curve=crv_3, Count=resolution, Kinks=False)  # -> Points, Tangents, Parameters
n_curves = Slider(17, range=10..200)
divide_2 = DivideCurve(Curve=merge, Count=resolution_2, Kinks=False)  # -> Points, Tangents, Parameters
range = Range(Domain=Domain(0, 1), Steps=Slider(16, range=1..30))

# ----
# anzichè il componente tween curves:
# 
# . suddivido le curve iniziali
# . connetto i punti di divisione rispettivi tramite linee
# . suddivido le linee ottenute
# . utilizzo flip matrix per trasporre l'ordine dei punti e costruisco le curve
divide_3 = DivideCurve(Curve=fillet_2, Count=resolution_3, Kinks=False)  # -> Points, Tangents, Parameters
divide_4 = DivideCurve(Curve=fillet, Count=resolution_3, Kinks=False)  # -> Points, Tangents, Parameters
n_curves_2 = Slider(14, range=10..200)
ln = Line(StartPoint=divide_4.Points, EndPoint=divide_3.Points)
divide_5 = DivideCurve(Curve=ln, Count=n_curves_2, Kinks=False)  # -> Points, Tangents, Parameters

flip = FlipMatrix(Data=divide.Points)
n_curves_3 = Slider(44, range=10..200)
flip_2 = FlipMatrix(Data=divide_2.Points)
# single curve
tweencrv = TweenCurve(CurveA=crv, CurveB=crv_2, Factor=Slider(0, range=0..1), BlendType=0)
# many curves
tweencrv_2 = TweenCurve(CurveA=crv, CurveB=crv_2, Factor=range, BlendType=0)
pline = PolyLine(Vertices=flip, Closed=False)

# ----
# per collegare tra loro più curve posso usare curve NURBS o interpolate al posto delle polilinee
intcrv = Interpolate(Vertices=flip_2, Degree=3, Periodic=False, KnotStyle=1)  # -> Curve, Length, Domain
nurbs = NurbsCurve(Vertices=flip_2, Degree="2", Periodic=False)  # -> Curve, Length, Domain

explode = Explode(Curve=pline, Recursive=True)  # -> Segments, Vertices
# suddivido le polilinee per singoli tratti
divide_6 = DivideCurve(Curve=explode.Segments, Count=n_curves, Kinks=False)  # -> Points, Tangents, Parameters
pshift = ShiftPaths(Data=divide_6.Points, Offset=-1)
flip_3 = FlipMatrix(Data=pshift)

n_curves_4 = Slider(10, range=10..50)

divide_7 = DivideCurve(Curve=pline, Count=n_curves_3, Kinks=False)  # -> Points, Tangents, Parameters
flip_4 = FlipMatrix(Data=divide_7.Points)

panel = Panel("suddivido l'intera polilinea")
# provare una delle 2
crv_7 = Curve(intcrv.Curve)
toggle = BooleanToggle(True)
range_2 = Range(Domain=Domain(0, 1), Steps=Slider(22, range=1..30))
flip_5 = FlipMatrix(Data=divide_5.Points)
divide_8 = DivideCurve(Curve=crv_7, Count=n_curves_4, Kinks=False)  # -> Points, Tangents, Parameters
flip_6 = FlipMatrix(Data=divide_8.Points)
intcrv_2 = Interpolate(Vertices=flip_5, Degree=3, Periodic=False, KnotStyle=1)  # -> Curve, Length, Domain

intcrv_3 = Interpolate(Vertices=flip_4, Degree=3, Periodic=False, KnotStyle=1)  # -> Curve, Length, Domain
# attivare/disattivare la preview di questi componenti per vedere i differenti tipi di output
pline_2 = PolyLine(Vertices=flip_4, Closed=False)
intcrv_4 = Interpolate(Vertices=flip_3, Degree=3, Periodic=False, KnotStyle=1)  # -> Curve, Length, Domain
pline_3 = PolyLine(Vertices=flip_3, Closed=False)

tweencrv_3 = TweenCurve(CurveA=fillet, CurveB=fillet_2, Factor=range_2, BlendType=0)
number_slider_2 = Slider(200, range=0..500)
nurbs_2 = NurbsCurve(Vertices=flip_6, Degree=3, Periodic=toggle)  # -> Curve, Length, Domain
intcrv_5 = Interpolate(Vertices=flip_6, Degree=3, Periodic=toggle, KnotStyle=1)  # -> Curve, Length, Domain
multiplication = Multiplication(A=number_slider_2, B="2")
X = UnitX(Factor=multiplication)
X_2 = UnitX(Factor=number_slider_2)
move = Move(Geometry=nurbs_2.Curve, Motion=X)  # -> Geometry, Transform
move_2 = Move(Geometry=intcrv_5.Curve, Motion=X_2)  # -> Geometry, Transform
# provare una delle 2
crv_8 = Curve(flatten(intcrv_5.Curve))
# NURBS
preview = CustomPreview(Geometry=move.Geometry, Shader=ColourSwatch(SwatchColor=RGB(58, 197, 252)))
# interpolated
preview_2 = CustomPreview(Geometry=move_2.Geometry, Shader=ColourSwatch(SwatchColor=RGB(201, 97, 6)))

toggle_2 = BooleanToggle(False)
# altro modo di creare coppie di curve consecutive per poter fare il loft tra loro
panel_2 = Panel("1")
shift = ShiftList(List=crv_8, Shift=panel_2, Wrap=toggle_2)  # -> graft(List)
shift_2 = ShiftList(List=crv_8, Shift="-1", Wrap=toggle_2)  # -> graft(List)

merge_2 = Merge(Data1=shift, Data2=shift_2)
loft = Loft(Curves=merge_2, Options={Adjust=False, Closed=False, LoftEnds=0, LoftSimp=0, LoftType=0, Rebuild=10, Refit=0.01})  # -> flatten(Loft)

area = Area(Geometry=loft)  # -> Area, Centroid
bnd = Bounds(Numbers=area.Area)
# color by area
dedomain = DeconstructDomain(Domain=bnd)  # -> Start, End
gradient = Gradient(
    LowerLimit=dedomain.Start,
    UpperLimit=dedomain.End,
    Parameter=area.Area,
    stops=[0.0345: RGB(137, 205, 240), 0.98: RGB(14, 26, 76)])

bake = Button()
# bake with attributes (froGH component)
f_bakeatt = BakeAttributesEnhanced(obj=loft, layer="surfaces", color=gradient, bake_iT=bake)  # -> info; inputs obj: GeometryBase, name: String, layer: String, color: Color, pWidth: Double, wires: Int32, group_n: Int32, group: Boolean, bake_iT: Boolean
#   port layer: Layer name for the object if the layer doesn't exist, it will be created
#   port bake_iT: Performs bake operation attach a button here and click to bake
# ---------- f_bakeatt: C# ----------
                                                                /*
    froGH - a sparse collection of (in)utilities for Grasshopper

    Bake Attributes ++
    Original Version Written by Giulio Piacentino - 2010 11 21 - for Grasshopper 0.8.002
    Enhanced by Co-de-iT (Alessio) - now bakes on chosen layer(s) and in groups

    froGH by Co-de-iT is licensed under a Creative Commons Attribution 4.0 International License.
    http://creativecommons.org/licenses/by/4.0/

    */

    initComp();

    if (bake_iT)
    {
      if(obj == null)
      {
        Print("No object to bake");
        return;
      }

      //Make new attribute to set name
      Rhino.DocObjects.ObjectAttributes att = new Rhino.DocObjects.ObjectAttributes();

      //Set object name
      if(!string.IsNullOrEmpty(name))
      {
        att.Name = name;
      }

      //Set color
      if(!color.IsEmpty)
      {
        att.ColorSource = Rhino.DocObjects.ObjectColorSource.ColorFromObject; //Make the color type "by object"
        att.ObjectColor = color;

        att.PlotColorSource = Rhino.DocObjects.ObjectPlotColorSource.PlotColorFromObject; //Make the plot color type "by object"
        att.PlotColor = color;
      }

      // Set group

      if(group)
      {
        doc.Groups.Add(Convert.ToString(group_n));
        att.AddToGroup(group_n);

      }

      //Set layer
      if(!string.IsNullOrEmpty(layer) && Rhino.DocObjects.Layer.IsValidName(layer))
      {
        //Get the current layer index
        Rhino.DocObjects.Tables.LayerTable layerTable = doc.Layers;
        int layerIndex = layerTable.Find(layer, true);

        if(layerIndex < 0) //This layer does not exist, we add it
        {
          Rhino.DocObjects.Layer onlayer = new Rhino.DocObjects.Layer(); //Make a new layer
          onlayer.Name = layer;

          layerIndex = layerTable.Add(onlayer); //Add the layer to the layer table
          if (layerIndex > -1) //We manged to add layer!
          {
            att.LayerIndex = layerIndex;
            Print("Added new layer to the document at position " + layerIndex + " named " + layer + ". ");
          } else
            Print("Layer did not add. Try cleaning up your layers."); //This never happened to me.
        }
        else
          att.LayerIndex = layerIndex; //We simply add to the existing layer
      }


      //Set plotweight
      if(pWidth > 0)
      {
        att.PlotWeightSource = Rhino.DocObjects.ObjectPlotWeightSource.PlotWeightFromObject;
        att.PlotWeight = pWidth;
      }


      //Set material
      bool materialByName = !string.IsNullOrEmpty(material as string);
      Rhino.Display.DisplayMaterial inMaterial = material as Rhino.Display.DisplayMaterial;
      if(material is Color)
      {
        inMaterial = new Rhino.Display.DisplayMaterial((Color) material);
      }
      if(material != null && inMaterial == null && !materialByName)
      {
        if(!(material is string))
        {
          try //We also resort to try with IConvertible
          {
            inMaterial = (Rhino.Display.DisplayMaterial) Convert.ChangeType(material, typeof(Rhino.Display.DisplayMaterial));
          }
          catch(InvalidCastException)
          {
          }
        }
      }
      if(inMaterial != null || materialByName)
      {
        string matName;

        if(!materialByName)
        {
          matName = string.Format("A:{0}-D:{1}-E:{2}-S:{3},{4}-T:{5}",
            Format(inMaterial.Ambient),
            Format(inMaterial.Diffuse),
            Format(inMaterial.Emission),
            Format(inMaterial.Specular),
            inMaterial.Shine.ToString(),
            inMaterial.Transparency.ToString()
            );
        }
        else
        {
          matName = (string) material;
        }

        int materialIndex = doc.Materials.Find(matName, true);
        if(materialIndex < 0 && !materialByName) //Material does not exist and we have its specs
        {
          materialIndex = doc.Materials.Add(); //Let's add it
          if(materialIndex > -1)
          {
            Print("Added new material at position " + materialIndex + " named \"" + matName + "\". ");
            Rhino.DocObjects.Material m = doc.Materials[materialIndex];
            m.Name = matName;
            m.AmbientColor = inMaterial.Ambient;
            m.DiffuseColor = inMaterial.Diffuse;
            m.EmissionColor = inMaterial.Emission;
            //m.ReflectionColor = no equivalent
            m.SpecularColor = inMaterial.Specular;
            m.Shine = inMaterial.Shine;
            m.Transparency = inMaterial.Transparency;
            //m.TransparentColor = no equivalent
            m.CommitChanges();

            att.MaterialSource = Rhino.DocObjects.ObjectMaterialSource.MaterialFromObject;
            att.MaterialIndex = materialIndex;
          }
          else
            Print("Material did not add. Try cleaning up your materials."); //This never happened to me.
        }
        else if(materialIndex < 0 && materialByName) //Material does not exist and we do not have its specs. We do nothing
        {
          Print("Warning: material name not found. I cannot set the source to this material name. Add a material with name: " + matName);
        }
        else
        {
          //If this material exists, we do not replace it!
          att.MaterialSource = Rhino.DocObjects.ObjectMaterialSource.MaterialFromObject;
          att.MaterialIndex = materialIndex;
        }
      }


      //Set wire density
      if(wires == -1 || wires > 0)
      {
        att.WireDensity = wires;
      }


      //Bake to the right type of object
      switch(obj.ObjectType)
      {
        case Rhino.DocObjects.ObjectType.Brep:
          doc.Objects.AddBrep(obj as Brep, att);
          break;
        case Rhino.DocObjects.ObjectType.Curve:
          doc.Objects.AddCurve(obj as Curve, att);
          break;
        case Rhino.DocObjects.ObjectType.Point:
          doc.Objects.AddPoint((obj as Rhino.Geometry.Point).Location, att);
          break;
        case Rhino.DocObjects.ObjectType.Surface:
          doc.Objects.AddSurface(obj as Surface, att);
          break;
        case Rhino.DocObjects.ObjectType.Mesh:
          doc.Objects.AddMesh(obj as Mesh, att);
          break;
        case Rhino.DocObjects.ObjectType.Extrusion:
          typeof(Rhino.DocObjects.Tables.ObjectTable).InvokeMember("AddExtrusion", BindingFlags.Instance | BindingFlags.InvokeMethod, null, doc.Objects, new object[]{obj, att});
          break;
        case Rhino.DocObjects.ObjectType.PointSet:
          doc.Objects.AddPointCloud(obj as Rhino.Geometry.PointCloud, att); //This is a speculative entry
          break;
        default:
          Print("The script does not know how to handle this type of geometry: " + obj.GetType().FullName);
          break;
      }
      Print("Added " + obj.GetType().Name);

    }
    else
    {
      Print("Inactive");
    }
    //obj_out = obj;
# ---------- f_bakeatt: C# additional code ----------
  void initComp(){

    Component.Name = "Bake Attributes Enhanced";
    Component.NickName = "f_BakeAtt++";
    Component.Description = "Bakes objects with attributes such as color, material, layer, object name, wire density. Option to bake in groups";
    Component.Params.Input[0].Name = "Object";
    Component.Params.Input[0].Description = "Object to bake";
    Component.Params.Input[1].Name = "Object name";
    Component.Params.Input[1].Description = "A custom name for the object";
    Component.Params.Input[2].Name = "Object Layer";
    Component.Params.Input[2].Description = "Layer name for the object\nif the layer doesn't exist, it will be created";
    Component.Params.Input[3].Name = "Object Color";
    Component.Params.Input[3].Description = "Color of baked object";
    Component.Params.Input[4].Name = "Print Width";
    Component.Params.Input[4].Description = "Print width";
    Component.Params.Input[5].Name = "Wire density";
    Component.Params.Input[5].Description = "Density of wires for display";
    Component.Params.Input[6].Name = "Material";
    Component.Params.Input[6].Description = "Object custom material";
    Component.Params.Input[7].Name = "Group Number";
    Component.Params.Input[7].Description = "Number of the group for the object\n(in case group option is active)";
    Component.Params.Input[8].Name = "Group Objects";
    Component.Params.Input[8].Description = "Bake objects in groups according to the group number for each object";
    Component.Params.Input[9].Name = "Bake it!";
    Component.Params.Input[9].Description = "Performs bake operation\nattach a button here and click to bake";
    Component.Params.Output[0].Name = "Info";
    Component.Params.Output[0].Description = "Info on the bake process/result";

  }

  static string Format(Color c)
  {
    return (new System.Text.StringBuilder("A")).Append(c.A.ToString()).Append("R").Append(c.R.ToString()).Append("G")
      .Append(c.G.ToString()).Append("B").Append(c.B.ToString()).ToString();
  }
# ---------- end f_bakeatt ----------

preview_3 = CustomPreview(Geometry=loft, Shader=gradient)
