# Grasshopper definition 02_03_domain and surfaces.gh (Grasshopper 0.9.76)
# Copyright: Co-de-iT
# plug-ins: Human

# Domain and surfaces
# 
# © a3 2017 _ Creative Commons Attribution-NonCommercial-ShareAlike3.0 UnportedLicense.
# domain square
srf = Surface(<surface referenced from the Rhino model>)
# isotrim
srf_2 = Surface(reparameterize(<surface referenced from the Rhino model>))
srf_3 = Surface(reparameterize(<surface referenced from the Rhino model>))
# è possibile scrivere manualmente un dominio mantenendo la sintassi:
# 
# <start> To <end>
number_slider = Slider(29.05, range=0..100)
# evaluate surface
srf_4 = Surface(reparameterize([<surface referenced from the Rhino model> x5]))
u = Slider(0.277, range=0..1)
v = Slider(0.616, range=0..1)
number_slider_2 = Slider(9, range=2..50)
number_slider_3 = Slider(11, range=2..50)
# divide surface
# all surfaces
srf_5 = Surface(reparameterize([<surface referenced from the Rhino model> x5]))
# reparametrize normalizza il dominio in entrambe le direzioni
srf_6 = Surface(reparameterize(srf))
# trimmed surfaces only
srf_7 = Surface(reparameterize([<surface referenced from the Rhino model> x2]))
# untrimmed surface
srf_8 = Surface(reparameterize(<surface referenced from the Rhino model>))
domain² = Domain²(srf)
domain²_2 = Domain²(srf_6)

range = Range(Domain=Domain(0, 1), Steps=number_slider_2)  # -> graft(Range)
# genera una griglia di valori u,v
range_2 = Range(Domain=Domain(0, 1), Steps=number_slider_3)
pt = ConstructPoint(XCoordinate=range, YCoordinate=range_2, ZCoordinate=0)

divide = DivideDomain²(Domain=srf_3, UCount=Slider(7, range=1..10), VCount=Slider(10, range=1..10))
dom²num = ConstructDomain²(
    UMin=Slider(0.106, range=0..1),
    UMax=Slider(0.214, range=0..1),
    VMin=Slider(0.036, range=0..1),
    VMax=Slider(0.939, range=0..1))
# le superfici hanno un dominio bidimensionale (in u e v)
panel = Panel(domain²)
panel_2 = Panel(domain²_2)
pt_2 = ConstructPoint(XCoordinate=u, YCoordinate=v, ZCoordinate=0)
dom = ConstructDomain(DomainStart=number_slider, DomainEnd=Slider(71.046, range=0..100))
# Divide Surface: genera una griglia di punti di suddivisione in u e v
# 
# Se la superfice è trimmata, esclude i punti nel dominio non visibile
sdivide = DivideSurface(Surface=srf_5, UCount=number_slider_2, VCount=number_slider_3)  # -> Points, Normals, Parameters
sdivide_2 = DivideSurface(Surface=srf_8, UCount=Slider(9, range=2..50), VCount=Slider(11, range=2..50))  # -> Points, Normals, Parameters
dom²num_2 = ConstructDomain²(UMin=0, UMax=1, VMin=0, VMax=1)
# isotrim: estrae una sottosuperfice da una superfice base mediante un dominio u,v
subsrf = Isotrim(Surface=srf_2, Domain=dom²num)
# isotrim: suddividendo il dominio iniziale ottengo un insieme di superifci che scompongono quella iniziale
subsrf_2 = Isotrim(Surface=srf_3, Domain=divide)
pshift = ShiftPaths(Data=pt, Offset=-1)
panel_3 = Panel(dom)
panel_4 = Panel(dom²num_2)
# Evaluate Surface: Analogo di Evaluate Curve per le superfici, a partire da una coppia di parametri u,v fornisce il punto P, la normale N e il piano tangente F alla superfice
evalsrf = EvaluateSurface(Surface=srf_4, Point=pt_2)  # -> Point, Normal, Frame
# IsoCurves: genera le curve di isovalore in u e v
iso = IsoCurve(Surface=srf_4, UVPoint=pt_2)  # -> UIsocurve, VIsocurve
# un dominio bidimensionale è costruibile a partire dai 4 estremi o da due domini lineari
dom²num_3 = ConstructDomain²(
    UMin=Slider(0.162, range=0..1),
    UMax=Slider(0.69, range=0..1),
    VMin=Slider(0.714, range=0..1),
    VMax=Slider(0.098, range=0..1))
dom² = ConstructDomain²(DomainU="2.5 To 543.46", DomainV=dom)
evalsrf_2 = EvaluateSurface(Surface=graft(srf_7), Point=pshift)  # -> Point, Normal, Frame
flip = FlipMatrix(Data=sdivide_2.Points)
# Point in Trim: genera valori True o False a seconda se i valori u,v forniti sono o meno all'interno della parte trimmata
triminc = PointInTrim(Surface=graft(srf_7), UVPoint=pshift)
previewmat = CustomPreviewMaterials(Geometry=subsrf_2, DiffuseColor=RGB(255, 255, 255))
previewmat_2 = CustomPreviewMaterials(Geometry=subsrf, DiffuseColor=RGB(255, 255, 255))
viewer = ParamViewer(sdivide_2.Points)
viewer_2 = ParamViewer(sdivide_2.Points)
panel_5 = Panel(dom²num_3)
# ...ed è ugualmente scomponibile nei due modi (4 estremi o 2 domini lineari)
panel_6 = Panel(dom²)
# usando Flip Matrix l'ordine dei punti viene trasposto
pline = PolyLine(Vertices=flip, Closed=False)
# i punti sono ordinati in questo modo:
# 
# . il numero di divisioni in u genera i rami
# . il numero di divisioni in v il numero di punti in ogni ramo
pline_2 = PolyLine(Vertices=sdivide_2.Points, Closed=False)
dispatch = Dispatch(List=evalsrf_2.Point, DispatchPattern=triminc)  # -> ListA, ListB
# divide domain square: divide il dominio nelle due dimensioni nel numero di sottodomini indicato
divide_2 = DivideDomain²(Domain=dom²num_2, UCount=Slider(5, range=1..10), VCount=Slider(2, range=1..10))
dedom2num = DeconstructDomain²(Domain=dom²)  # -> UMin, UMax, VMin, VMax
dedom2 = DeconstructDomain²(Domain=dom²)  # -> UComponent, VComponent
dots = DotDisplay(Point=evalsrf.Point, Colour=ColourSwatch(SwatchColor=RGB(255, 255, 255)), Size="0.8")
panel_7 = Panel(sdivide_2.Points)
panel_8 = Panel(dedom2num.UMin)
panel_9 = Panel(dedom2num.UMax)
panel_10 = Panel(dedom2num.VMin)
panel_11 = Panel(dedom2num.VMax)
panel_12 = Panel(dedom2.UComponent)
panel_13 = Panel(dedom2.VComponent)
panel_14 = Panel(divide_2)
dots_2 = DotDisplay(Point=dispatch.ListA, Colour=ColourSwatch(SwatchColor=RGB(255, 255, 255)), Size="0.8")
dots_3 = DotDisplay(Point=dispatch.ListB, Colour=ColourSwatch(SwatchColor=RGB(255, 0, 221)), Size="1.6")
number_slider_4 = Slider(100, range=2..100)
srf_9 = Surface(reparameterize(<surface referenced from the Rhino model>))
srf_10 = Surface(reparameterize(<surface referenced from the Rhino model>))
sdivide_3 = DivideSurface(Surface=srf_9, UCount=Slider(8, range=2..20), VCount=number_slider_4)  # -> Points, Normals, Parameters
range_3 = Range(Domain=Domain(0, 1), Steps=number_slider_4)
sdivide_4 = DivideSurface(Surface=srf_10, UCount=Slider(8, range=2..20), VCount=Slider(100, range=2..100))  # -> Points, Normals, Parameters
max_height = Slider(20, range=0..20)
# graph mapper: permette di manipolare tramite curve la distribuzione dei dati entro un dominio 0 to 1
# 
# cliccare col tasto destro del mouse e esplorare i vari Graph Types
graph = GraphMapper(range_3, x0=0, x1=1, y0=0, y1=1, container_name="Sine", Equation_px=[0, 0.4993047416], Equation_py=[0.2899116874, 1])
multiplication = Multiplication(A=sdivide_4.Normals, B=Slider(7.5, range=0..10))
move = Move(Geometry=sdivide_4.Points, Motion=multiplication)  # -> Geometry, Transform
multiplication_2 = Multiplication(A=graph, B=max_height)
multiplication_3 = Multiplication(A=sdivide_3.Normals, B=multiplication_2)
pline_3 = PolyLine(Vertices=sdivide_4.Points, Closed=False)
pline_4 = PolyLine(Vertices=move.Geometry, Closed=False)
ln = Line(StartPoint=sdivide_4.Points, EndPoint=move.Geometry)
move_2 = Move(Geometry=sdivide_3.Points, Motion=multiplication_3)  # -> Geometry, Transform
pline_5 = PolyLine(Vertices=sdivide_3.Points, Closed=False)
ln_2 = Line(StartPoint=sdivide_3.Points, EndPoint=move_2.Geometry)
pline_6 = PolyLine(Vertices=move_2.Geometry, Closed=False)
