# Grasshopper definition 03_00_mesh basics.gh (Grasshopper 0.9.76)
# Copyright: Co-de-iT
# plug-ins: Human

# Value list permette di creare una lista personalizzata di etichette e valori corrispondenti
# 
# cliccando col tasto destro del mouse sul componente e scegliendo Edit si possono vedere e cambiare i valori impostati
mesh_components_display = ValueList({"simple": 0, "advanced": 1}, selected="advanced")
# Mesh basics
# 
# © a3 2017 _ Creative Commons Attribution-NonCommercial-ShareAlike3.0 UnportedLicense.
# collegare una alla volta le mesh qui sotto e verificare i risultati sia in Rhino che nei componenti di GH
# 
# Dopo aver preso confidenza con il simple display, attivare l'advanced display e studiarne la struttura
# triangular face
mesh = Mesh(<mesh referenced from the Rhino model>)
# quadrangular face
mesh_2 = Mesh(<mesh referenced from the Rhino model>)
# mesh box
mesh_3 = Mesh(<mesh referenced from the Rhino model>)
# complex mesh
mesh_4 = Mesh(<mesh referenced from the Rhino model>)
# complex colored mesh
mesh_5 = Mesh(<mesh referenced from the Rhino model>)
# subdivided colored mesh
mesh_6 = Mesh(<mesh referenced from the Rhino model>)
mesh_7 = Mesh(mesh)
# Stream Gate permette di dirigere il flusso dati (S) in un gate tra quelli disponibili. Il numero di gate è fornito in G
gate = StreamGate(Stream=mesh_7, Gate=mesh_components_display)  # -> Target0, Target1

# ----
# mesh display
previewmat = CustomPreviewMaterials(Geometry=mesh_7, DiffuseColor=ColourSwatch(SwatchColor=RGB(140, 140, 140)))

# ----
# mesh structure
# deconstruct mesh mi permette di accedere alla struttura della mesh:
# 
# V - Vertices (points)
# F - Faces (list)
# C - Colors (per vertex)
# N - Normals (vectors)
demesh = DeconstructMesh(Mesh=mesh_7)  # -> Vertices, Faces, Colours, Normals

# ----
# simple display
# il simple display permette una visualizzazione immediata di dati utili (indice dei punti e direzione delle normali), ma senza troppo controllo su altre caratteristiche di display (colore, orientamento, etc)
# i componenti che non hanno parametri in output hanno solo funzione di display
# point list
# vector display
# i vettori hanno bisogno di un punto base per poter essere visualizzati - in questo caso vengono visualizzati a partire dai vertici
demesh_2 = DeconstructMesh(Mesh=gate.Target0)  # -> Vertices, Faces, Colours, Normals
text_size = Slider(5, range=0..10)
vdis = VectorDisplay(Anchor=demesh_2.Vertices, Vector=demesh_2.Normals)
points = PointList(Points=demesh_2.Vertices, Size=text_size)

normals = Panel(demesh.Normals)
colors = Panel(demesh.Colours)
faces_as_list = Panel(demesh.Faces)
vertices = Panel(demesh.Vertices)
# vertici come punti in x,y,z
# Colors (1 colore RGB per vertice, se presente)
# vettori delle normali uscenti dai vertici
panel = Panel("""T - triangular faces
Q - quadrangular faces""")

# ----
# advanced display
# l'advanced display permette una visualizzazione dati più controllata e articolata (colore, orientamento, indici delle facce), al prezzo di una maggiore difficoltà nello strutturare la catena di componenti. Seguire un percorso alla volta (vertici, facce, normali) per cercare di capire al meglio le varie operazioni
# vertex as points
# allontano il punto base del testo dal vertice per maggiore chiarezza grafica:
# 
# per farlo, sposto il vertice lungo il vettore normale, regolado la quantità di offset con uno slider
# vertex tag display
# Text Tag 3D mi permette più opzioni per la visualizzazione dei testi del semplice Point List
# 
# Inoltre, i testi possono essere trasferiti a Rhino tramite Bake
# genero gli indici dei vertici con una serie: il count è pari alla lunghezza della lista dei vertici
# click col tasto destro del mouse
# per le opzioni di giustificazione
# plane from normal
# 
# ricava il piano a partire dalla normale della faccia - Text Tag 3D vuole un piano dove visualizzare il testo
# face normals
# 
# per ciascuna faccia della mesh ricava il centro e la normale uscente
# face tag display
# il centro viene spostato in direzione della normale per evitare sovrapposizioni visive tra faccia e testo
# vector display
mesh_8 = Mesh(gate.Target1)
demesh_3 = DeconstructMesh(Mesh=mesh_8)  # -> Vertices, Faces, Colours, Normals
facen = FaceNormals(Mesh=mesh_8)  # -> Centers, Normals
move = Move(Geometry=facen.Centers, Motion=facen.Normals)  # -> Geometry, Transform
pl = PlaneNormal(Origin=move.Geometry, ZAxis=facen.Normals)
normal_size = Slider(5, range=0..10)
text_size_2 = Slider(2, range=0..5)
text_size_3 = Slider(3.5, range=1..50)
multiplication = Multiplication(A=demesh_3.Normals, B=normal_size)
pt = Point(demesh_3.Vertices)
vdisex = VectorDisplayEx(Point=demesh_3.Vertices, Vector=multiplication, Colour=ColourSwatch(SwatchColor=RGB(0, 0, 0)), Width=2)
tag = TextTag3D(Location=pl, Text=demesh_3.Faces, Size=text_size_2, Colour=ColourSwatch(SwatchColor=RGB(153, 153, 153)), Justification=5)

offset = Slider(10, range=0..10)
multiplication_2 = Multiplication(A=demesh_3.Normals, B=offset)
move_2 = Move(Geometry=demesh_3.Vertices, Motion=multiplication_2)  # -> Geometry, Transform

lng = ListLength(List=demesh_3.Vertices)
series = Series(Start=0, Step=1, Count=lng)
int = Integer(series)

tag_2 = TextTag3D(
    Location=move_2.Geometry,
    Text=int,
    Size=text_size_3,
    Colour=ColourSwatch(SwatchColor=RGB(255, 255, 255)),
    Justification=5)
