# Grasshopper definition 03_01_color mesh.gh (Grasshopper 0.9.76)
# Copyright: Co-de-iT

# color points by simulated solar incidence
mesh = Mesh(<mesh referenced from the Rhino model>)
# color points by Z coordinate
mesh_2 = Mesh(<mesh referenced from the Rhino model>)
# Color mesh
# 
# © a3 2017 _ Creative Commons Attribution-NonCommercial-ShareAlike3.0 UnportedLicense.
# color points by spray
mesh_3 = Mesh(<mesh referenced from the Rhino model>)
demesh = DeconstructMesh(Mesh=mesh)  # -> Vertices, Faces, Colours, Normals
demesh_2 = DeconstructMesh(Mesh=mesh_2)  # -> Vertices, Faces, Colours, Normals
avr = Average(Input=demesh.Vertices)

altitude = Slider(49.585, range=0..180)
# genera il piano per l'arco solare, a partire da un piano XY ruotato di un angolo azimutale e uno di altitudine
azimuth = Slider(-90, range=-90..90)
xy = XYPlane(Origin=avr)
X = UnitX(Factor=1)
Z = UnitZ(Factor=1)
rot3d = Rotate3D(Geometry=xy, Angle=degrees(altitude), Center=avr, Axis=X)  # -> Geometry, Transform
rot3d_2 = Rotate3D(Geometry=rot3d.Geometry, Angle=degrees(azimuth), Center=avr, Axis=Z)  # -> Geometry, Transform

pdecon = Deconstruct(Point=demesh_2.Vertices)  # -> XComponent, YComponent, ZComponent
pt = Point([<point referenced from the Rhino model> x3])
merge = Merge(
    Data1=ColourSwatch(SwatchColor=RGB(255, 0, 0)),
    Data2=ColourSwatch(SwatchColor=RGB(0, 255, 0)),
    Data3=ColourSwatch(SwatchColor=RGB(0, 93, 255)))

# ----
# remap
num = Number(pdecon.ZComponent)
bnd = Bounds(Numbers=flatten(num))
dom = ConstructDomain(DomainStart="0", DomainEnd="1")
remap = RemapNumbers(Value=num, Source=bnd, Target=dom)  # -> Mapped, Clipped

# ----
# un colore per ogni punto.
# 
# Cliccare col tasto destro sul componente per le opzioni di blending
mspray = MeshSpray(Mesh=mesh_3, Points=pt, Colours=merge, SprayMode=11)
gradient = Gradient(LowerLimit=0, UpperLimit=1, Parameter=remap.Mapped, stops=[0: RGB(14, 26, 76), 1: RGB(237, 249, 255)])
arc = Arc(Plane=rot3d_2.Geometry, Radius=Slider(80, range=0..100), Angle=Domain(0, 3.141592654))  # -> Arc, Length
conmesh = ConstructMesh(Vertices=demesh_2.Vertices, Faces=demesh_2.Faces, Colours=gradient)
eval = EvaluateCurve(Curve=reparameterize(arc.Arc), Parameter=Slider(0.338, range=0..1))  # -> Point, Tangent, Angle
vec2pt = Vector2Pt(PointA=eval.Point, PointB=avr, Unitize=False)  # -> Vector, Length
Y = UnitY(Factor=Slider(120, range=0..200))
amp = Amplitude(Vector=vec2pt.Vector, Amplitude=Slider(24.75, range=0..50))
move = Move(Geometry=conmesh, Motion=Y)  # -> Geometry, Transform
angle = Angle(VectorA=demesh.Normals, VectorB=vec2pt.Vector)  # -> Angle, Reflex
vdisex = VectorDisplayEx(Point=eval.Point, Vector=amp, Colour=RGB(0, 0, 0), Width=2)

# ----
# remap
num_2 = Number(angle.Reflex)
bnd_2 = Bounds(Numbers=flatten(num_2))
dom_2 = ConstructDomain(DomainStart="0", DomainEnd="1")
remap_2 = RemapNumbers(Value=num_2, Source=bnd_2, Target=dom_2)  # -> Mapped, Clipped

gradient_2 = Gradient(
    LowerLimit=0,
    UpperLimit=1,
    Parameter=remap_2.Mapped,
    stops=[0: RGB(234, 38, 0), 0.25: RGB(234, 126, 0), 0.5: RGB(254, 244, 84), 0.75: RGB(173, 203, 249), 1: RGB(75, 107, 169)])
conmesh_2 = ConstructMesh(Vertices=demesh.Vertices, Faces=demesh.Faces, Colours=gradient_2)
Y_2 = UnitY(Factor=Slider(120, range=0..200))
move_2 = Move(Geometry=conmesh_2, Motion=Y_2)  # -> Geometry, Transform
