# Grasshopper definition 03_02_01_mesh patterning-field.gh (Grasshopper 0.9.76)
# Copyright: Co-de-iT
# plug-ins: Human, Weaverbird

# Mesh patterning - field based
# 
# patterning di una mesh in base a campi scalari e vettoriali
# 
# © a3 2017 _ Creative Commons Attribution-NonCommercial-ShareAlike3.0 UnportedLicense.
# mesh patterning by vector field
# visualize vector field by face
# base mesh
mesh = Mesh(<mesh referenced from the Rhino model>)
# field lines
crv = Curve([<curve referenced from the Rhino model> x2])
# base mesh
mesh_2 = Mesh(<mesh referenced from the Rhino model>)
# field lines
crv_2 = Curve([<curve referenced from the Rhino model> x2])
# base mesh
mesh_3 = Mesh(<mesh referenced from the Rhino model>)
# field lines
crv_3 = Curve([<curve referenced from the Rhino model> x2])
naked_edges = ValueList({"Fixed": 0, "Smooth": 1, "Corner fixed": 2}, selected="Smooth")
naked_edges_2 = ValueList({"Fixed": 0, "Smooth": 1, "Corner fixed": 2}, selected="Smooth")
naked_edges_3 = ValueList({"Fixed": 0, "Smooth": 1, "Corner fixed": 2}, selected="Smooth")
wbcatmullclark = WeaverbirdsCatmullClarkSubdivision(MeshCurves=mesh_3, Level=Slider(3, range=1..3), SmoothNakedEdges=naked_edges)
wbcatmullclark_2 = WeaverbirdsCatmullClarkSubdivision(MeshCurves=mesh_2, Level=Slider(3, range=1..3), SmoothNakedEdges=naked_edges_2)

# ----
# le curve vengono suddivise per tratti di uguale lunghezza in modo da generare un "campo discreto" di vettori
number_slider = Slider(2.426, range=1..20)
divlength = DivideLength(Curve=crv, Length=number_slider)  # -> flatten(Points), flatten(Tangents), Parameters

divlength_2 = DivideLength(Curve=crv_3, Length=Slider(2.426, range=1..20))  # -> flatten(Points), flatten(Tangents), Parameters

# ----
# aumentando ulteriormente la risoluzione della mesh aumenta di conseguenza anche quella del pattern che si forma
naked_edges_4 = ValueList({"Fixed": 0, "Smooth": 1, "Corner fixed": 2}, selected="Smooth")
wbcatmullclark_3 = WeaverbirdsCatmullClarkSubdivision(MeshCurves=wbcatmullclark, Level=Slider(1, range=0..3), SmoothNakedEdges=naked_edges_4)

medges = MeshEdges(Mesh=wbcatmullclark_2)  # -> NakedEdges, InteriorEdges, NonManifoldEdges
wbcatmullclark_4 = WeaverbirdsCatmullClarkSubdivision(MeshCurves=mesh, Level=Slider(3, range=1..3), SmoothNakedEdges=naked_edges_3)
amp = Amplitude(Vector=divlength_2.Tangents, Amplitude=Slider(1.735, range=0..10))
previewmat = CustomPreviewMaterials(Geometry=wbcatmullclark_2, DiffuseColor=RGB(255, 255, 255))
divlength_3 = DivideLength(Curve=crv_2, Length=Slider(2.426, range=1..20))  # -> flatten(Points), flatten(Tangents), Parameters
previewlw = CustomPreviewLineweights(
    Geometry=[medges.NakedEdges, medges.InteriorEdges],
    Shader=ColourSwatch(SwatchColor=RGBA(196, 196, 196, 0)),
    Absolute=False)
medges_2 = MeshEdges(Mesh=wbcatmullclark_4)  # -> NakedEdges, InteriorEdges, NonManifoldEdges
previewmat_2 = CustomPreviewMaterials(Geometry=wbcatmullclark_4, DiffuseColor=RGB(255, 255, 255))
amp_2 = Amplitude(Vector=divlength_3.Tangents, Amplitude=Slider(1.735, range=0..10))
previewlw_2 = CustomPreviewLineweights(
    Geometry=[medges_2.NakedEdges, medges_2.InteriorEdges],
    Shader=ColourSwatch(SwatchColor=RGBA(45, 89, 94, 0)),
    Absolute=False)
panel = Panel("vertex by face")
vdisex = VectorDisplayEx(Point=divlength_2.Points, Vector=amp, Colour=ColourSwatch(SwatchColor=RGB(255, 255, 255)), Width=2)

demesh = DeconstructMesh(Mesh=wbcatmullclark_2)  # -> Vertices, Faces, Colours, Normals
deface = DeconstructFace(Face=graft(demesh.Faces))  # -> CornerA, CornerB, CornerC, CornerD
# gli indici generati qui possono servire per ordinare per faccia qualsiasi dato collegato ai vertici, ad esempio le normali, i colori, etc.
merge = Merge(Data1=deface.CornerA, Data2=deface.CornerB, Data3=deface.CornerC, Data4=deface.CornerD)
item = ListItem(List=demesh.Vertices, Index=merge, Wrap=True)

amp_3 = Amplitude(Vector=divlength.Tangents, Amplitude=Slider(1.735, range=0..10))

demesh_2 = DeconstructMesh(Mesh=wbcatmullclark_4)  # -> Vertices, Faces, Colours, Normals
deface_2 = DeconstructFace(Face=graft(demesh_2.Faces))  # -> CornerA, CornerB, CornerC, CornerD
# gli indici generati qui possono servire per ordinare per faccia qualsiasi dato collegato ai vertici, ad esempio le normali, i colori, etc.
merge_2 = Merge(Data1=deface_2.CornerA, Data2=deface_2.CornerB, Data3=deface_2.CornerC, Data4=deface_2.CornerD)
item_2 = ListItem(List=demesh_2.Vertices, Index=merge_2, Wrap=True)

medges_3 = MeshEdges(Mesh=wbcatmullclark_3)  # -> NakedEdges, InteriorEdges, NonManifoldEdges
vdisex_2 = VectorDisplayEx(Point=divlength_3.Points, Vector=amp_2, Colour=ColourSwatch(SwatchColor=RGB(255, 255, 255)), Width=2)
vdisex_3 = VectorDisplayEx(Point=divlength.Points, Vector=amp_3, Colour=ColourSwatch(SwatchColor=RGB(255, 255, 255)), Width=2)
previewmat_3 = CustomPreviewMaterials(Geometry=wbcatmullclark_3, DiffuseColor=ColourSwatch(SwatchColor=RGB(43, 43, 43)))
previewlw_3 = CustomPreviewLineweights(
    Geometry=[medges_3.NakedEdges, medges_3.InteriorEdges],
    Shader=ColourSwatch(SwatchColor=RGBA(196, 196, 196, 0)),
    Absolute=False)

demesh_3 = DeconstructMesh(Mesh=wbcatmullclark_3)  # -> Vertices, Faces, Colours, Normals
deface_3 = DeconstructFace(Face=graft(demesh_3.Faces))  # -> CornerA, CornerB, CornerC, CornerD
# gli indici generati qui possono servire per ordinare per faccia qualsiasi dato collegato ai vertici, ad esempio le normali, i colori, etc.
merge_3 = Merge(Data1=deface_3.CornerA, Data2=deface_3.CornerB, Data3=deface_3.CornerC, Data4=deface_3.CornerD)
item_3 = ListItem(List=demesh_3.Vertices, Index=merge_3, Wrap=True)

item_4 = ListItem(List=item, Index=0, Wrap=True)  # -> Item, Item1, Item2, Item3
# "centro" delle facce (punto medio dei vertici)
avr = Average(Input=item)
# "centro" delle facce (punto medio dei vertici)
avr_2 = Average(Input=item_2)

# ----
# in questo modo è possibile campionare il field usando la tecnica del closest point
cp = ClosestPoint(Point=avr_2, Cloud=divlength.Points)  # -> ClosestPoint, CPIndex, Distance
item_5 = ListItem(List=divlength.Tangents, Index=cp.CPIndex, Wrap=True)

cp_2 = ClosestPoint(Point=avr, Cloud=divlength_3.Points)  # -> ClosestPoint, CPIndex, Distance
# tra le due diagonali di ogni faccia della mesh sceglie quella con direzione più prossima a quella della curva più vicina
number_slider_2 = Slider(0.61, range=0..10)
# vector field based pattern (by face)
ln = Line(StartPoint=item_4.Item, EndPoint=item_4.Item2)
ln_2 = Line(StartPoint=item_4.Item1, EndPoint=item_4.Item3)
item_6 = ListItem(List=divlength_3.Tangents, Index=cp_2.CPIndex, Wrap=True)
merge_4 = Merge(Data1=ln, Data2=ln_2)
amp_4 = Amplitude(Vector=item_6, Amplitude=number_slider_2)
angle = Angle(VectorA=merge_4, VectorB=amp_4)  # -> Angle, Reflex
vdisex_4 = VectorDisplayEx(Point=avr, Vector=amp_4, Colour=RGB(0, 0, 0), Width=2)
sort = SortList(Keys=angle.Angle, ValuesA=merge_4)  # -> Keys, ValuesA
item_7 = ListItem(List=sort.ValuesA, Index=0, Wrap=True)
previewlw_4 = CustomPreviewLineweights(Geometry=item_7, Shader=ColourSwatch(SwatchColor=RGB(196, 125, 255)), Thickness="2", Absolute=False)

item_8 = ListItem(List=item_3, Index=0, Wrap=True)  # -> Item, Item1, Item2, Item3
# "centro" delle facce (punto medio dei vertici)
avr_3 = Average(Input=item_3)
amp_5 = Amplitude(Vector=item_5, Amplitude=Slider(0.61, range=0..10))
vdisex_5 = VectorDisplayEx(Point=avr_2, Vector=amp_5, Colour=RGB(0, 0, 0), Width=2)
ln_3 = Line(StartPoint=item_8.Item, EndPoint=item_8.Item1)
ln_4 = Line(StartPoint=item_8.Item2, EndPoint=item_8.Item3)

cp_3 = ClosestPoint(Point=avr_3, Cloud=divlength_2.Points)  # -> ClosestPoint, CPIndex, Distance
# tra i 4 edges di ogni faccia della mesh sceglie quello con direzione più prossima a quella della curva più vicina
number_slider_3 = Slider(0.61, range=0..10)
# vector field based pattern v2 (by face)
ln_5 = Line(StartPoint=item_8.Item, EndPoint=item_8.Item2)
ln_6 = Line(StartPoint=item_8.Item1, EndPoint=item_8.Item3)
item_9 = ListItem(List=divlength_2.Tangents, Index=cp_3.CPIndex, Wrap=True)
merge_5 = Merge(Data1=ln_5, Data2=ln_6, Data3=ln_3, Data4=ln_4)
amp_6 = Amplitude(Vector=item_9, Amplitude=number_slider_3)
angle_2 = Angle(VectorA=merge_5, VectorB=amp_6)  # -> Angle, Reflex
vdisex_6 = VectorDisplayEx(Point=avr_3, Vector=amp_6, Colour=RGB(0, 0, 0), Width=2)
sort_2 = SortList(Keys=angle_2.Angle, ValuesA=merge_5)  # -> Keys, ValuesA
item_10 = ListItem(List=sort_2.ValuesA, Index=0, Wrap=True)
previewlw_5 = CustomPreviewLineweights(Geometry=item_10, Shader=ColourSwatch(SwatchColor=RGB(110, 255, 248)), Thickness="2", Absolute=False)

# ----
# mesh patterning by scalar field
# visualize scalar field by vertex
# base mesh
mesh_4 = Mesh(<mesh referenced from the Rhino model>)
# base mesh
mesh_5 = Mesh(<mesh referenced from the Rhino model>)
# field lines
crv_4 = Curve([<curve referenced from the Rhino model> x2])
# field lines
crv_5 = Curve([<curve referenced from the Rhino model> x2])
naked_edges_5 = ValueList({"Fixed": 0, "Smooth": 1, "Corner fixed": 2}, selected="Smooth")
naked_edges_6 = ValueList({"Fixed": 0, "Smooth": 1, "Corner fixed": 2}, selected="Smooth")
wbcatmullclark_5 = WeaverbirdsCatmullClarkSubdivision(MeshCurves=mesh_4, Level=Slider(3, range=1..3), SmoothNakedEdges=naked_edges_5)
wbcatmullclark_6 = WeaverbirdsCatmullClarkSubdivision(MeshCurves=mesh_5, Level=Slider(3, range=1..3), SmoothNakedEdges=naked_edges_6)

naked_edges_7 = ValueList({"Fixed": 0, "Smooth": 1, "Corner fixed": 2}, selected="Smooth")
# aumentando la risoluzione della mesh aumenta di conseguenza anche quella del pattern che si forma
wbcatmullclark_7 = WeaverbirdsCatmullClarkSubdivision(MeshCurves=wbcatmullclark_5, Level=Slider(1, range=0..3), SmoothNakedEdges=naked_edges_7)

naked_edges_8 = ValueList({"Fixed": 0, "Smooth": 1, "Corner fixed": 2}, selected="Smooth")
# aumentando la risoluzione della mesh aumenta di conseguenza anche quella del pattern che si forma
wbcatmullclark_8 = WeaverbirdsCatmullClarkSubdivision(MeshCurves=wbcatmullclark_6, Level=Slider(1, range=0..3), SmoothNakedEdges=naked_edges_8)

demesh_4 = DeconstructMesh(Mesh=wbcatmullclark_7)  # -> Vertices, Faces, Colours, Normals

# ----
# calcolo delle distanze minime da ciascun vertice alla curva più vicina
crv_cp = CurveClosestPoint(Point=graft(demesh_4.Vertices), Curve=crv_5)  # -> Point, Parameter, Distance
sort_3 = SortList(Keys=crv_cp.Distance)  # -> Keys, ValuesA
item_11 = ListItem(List=sort_3.Keys, Index=0, Wrap=True)  # -> flatten(Item)

# ----
# scalar field based pattern (by vertex)
demesh_5 = DeconstructMesh(Mesh=wbcatmullclark_8)  # -> Vertices, Faces, Colours, Normals

crv_cp_2 = CurveClosestPoint(Point=graft(demesh_5.Vertices), Curve=crv_4)  # -> Point, Parameter, Distance
sort_4 = SortList(Keys=crv_cp_2.Distance)  # -> Keys, ValuesA
item_12 = ListItem(List=sort_4.Keys, Index=0, Wrap=True)  # -> flatten(Item)
ampiezza = Slider(4, range=0..5)
multiplication = Multiplication(A=item_12, B=ampiezza)
sin = Sine(Value=multiplication)
num = Number(sin)
bnd = Bounds(Numbers=flatten(num))
dom = ConstructDomain(DomainStart=0, DomainEnd=1)
remap = RemapNumbers(Value=num, Source=bnd, Target=dom)  # -> Mapped, Clipped
dom_2 = ConstructDomain(DomainStart=Slider(0, range=0..1), DomainEnd=Slider(0.795, range=0..2))
sqrt = SquareRoot(Value=remap.Mapped)
# conversione(remapping) dei valori di distanza in valori da 0 a 1 per generare i colori a partire dal gradiente
gradient = Gradient(
    LowerLimit=0,
    UpperLimit=1,
    Parameter=remap.Mapped,
    stops=[0: RGB(0, 98, 0), 0.25: RGB(81, 175, 17), 0.5: RGB(159, 198, 146), 0.75: RGB(170, 235, 41), 1: RGB(221, 255, 53)])
remap_2 = RemapNumbers(Value=sqrt, Source=Domain(0, 1), Target=dom_2)  # -> Mapped, Clipped
amp_7 = Amplitude(Vector=demesh_5.Normals, Amplitude=remap_2.Mapped)
move = Move(Geometry=demesh_5.Vertices, Motion=amp_7)  # -> Geometry, Transform
line = LineSDL(Start=demesh_5.Vertices, Direction=amp_7, Length=remap_2.Mapped)
conmesh = ConstructMesh(Vertices=move.Geometry, Faces=demesh_5.Faces, Colours=gradient)

ampiezza_2 = Slider(4, range=0..5)
# modulazione con una funzione trigonometrica per generare effetti più interessanti
multiplication_2 = Multiplication(A=item_11, B=ampiezza_2)
sin_2 = Sine(Value=multiplication_2)

# ----
# conversione(remapping) dei valori di distanza in valori di dimensione di visualizzazione
num_2 = Number(sin_2)
bnd_2 = Bounds(Numbers=flatten(num_2))
dom_3 = ConstructDomain(DomainStart="0.001", DomainEnd=Slider(0.38, range=0.01..1))
remap_3 = RemapNumbers(Value=num_2, Source=bnd_2, Target=dom_3)  # -> Mapped, Clipped

msphere = MeshSphere(Base=demesh_4.Vertices, Radius=remap_3.Mapped, UCount="8", VCount="8")
mjoin = MeshJoin(Meshes=msphere)
material = CreateMaterial(Diffuse="black", Specular="black", Emission=RGB(0, 0, 0), Transparency=0, Shine=0)
mesh_6 = Mesh(mjoin)
preview = CustomPreview(Geometry=mesh_6, Shader=material)
medges_4 = MeshEdges(Mesh=conmesh)  # -> NakedEdges, InteriorEdges, NonManifoldEdges
previewlw_6 = CustomPreviewLineweights(
    Geometry=[medges_4.NakedEdges, medges_4.InteriorEdges],
    Shader=ColourSwatch(SwatchColor=RGBA(38, 38, 38, 0)),
    Absolute=False)
