# Grasshopper definition 03_02_mesh patterning-gradient descent.gh (Grasshopper 0.9.76)
# Copyright: Co-de-iT
# plug-ins: MeshEdit Components, Human, Weaverbird

# pipeline referenzia automaticamene geometrie da Rhinoceros
# si impostano i nomi (o maschere di ricerca) per:
# 
# . nome layer
# . nome oggetto
# 
# E' possibile filtrare anche per tipo di geometria
# 
# in questo caso stiamo cercando sul layer "work mesh" ogni oggetto di tipo mesh. Continuando a creare oggetti mesh su questo layer, questi saranno selezionati e referenziati automaticamente su GH
pipeline = GeometryPipeline(
    GroupByLayer=False,
    GroupByType=False,
    IncludeHidden=False,
    IncludeLocked=False,
    LayerFilter="work mesh",
    NameFilter="*",
    TypeFilter=32)
# Mesh modeling/gradient descent
# 
# © a3 2017 _ Creative Commons Attribution-NonCommercial-ShareAlike3.0 UnportedLicense.
wbjoin = WeaverbirdsJoinMeshesAndWeld(Mesh=pipeline, Weld=False)
weldvertices = MeshWeldVertices(Mesh=wbjoin, Tolerance=0.01)  # -> RuntimeMessage, Mesh
unifynormals = MeshUnifyNormals(Mesh=weldvertices.Mesh)
flip = MeshFlip(Mesh=unifynormals)
number_slider = Slider(3, range=1..3)
wbcatmullclark = WeaverbirdsCatmullClarkSubdivision(MeshCurves=flip, Level=number_slider, SmoothNakedEdges=Slider(1, range=0..2))
wbloop = WeaverbirdsLoopSubdivision(MeshCurves=flip, Level=number_slider, SmoothNakedEdges=1)
# bake this
# (base mesh)
mesh = Mesh(wbloop)
# ricavo i 4 vertici per ogni faccia
demesh = DeconstructMesh(Mesh=mesh)  # -> Vertices, Faces, Colours, Normals

deface = DeconstructFace(Face=graft(demesh.Faces))  # -> CornerA, CornerB, CornerC, CornerD
merge = Merge(Data1=deface.CornerA, Data2=deface.CornerB, Data3=deface.CornerC, Data4=deface.CornerD)
item = ListItem(List=demesh.Vertices, Index=merge, Wrap=True)

# ----
# mesh
# naked edges
# clothed edges
# non-manifold edges
medges = MeshEdges(Mesh=mesh)  # -> NakedEdges, InteriorEdges, NonManifoldEdges
# display only
previewmat = CustomPreviewMaterials(Geometry=mesh, DiffuseColor=ColourSwatch(SwatchColor=RGB(84, 84, 84)), Transparency=Slider(0, range=0..1))
previewlw = CustomPreviewLineweights(
    Geometry=medges.NakedEdges,
    Shader=ColourSwatch(SwatchColor=RGB(204, 0, 255)),
    Thickness=Slider(3, range=0..10),
    Absolute=False)
previewlw_2 = CustomPreviewLineweights(Geometry=medges.InteriorEdges, Shader=ColourSwatch(SwatchColor=RGB(56, 56, 56)), Absolute=False)
previewlw_3 = CustomPreviewLineweights(Geometry=medges.NonManifoldEdges, Shader=ColourSwatch(SwatchColor=RGB(0, 0, 0)), Absolute=False)

# ----
# ordino i vertici di ogni faccia in base alla loro coordinata Z
pdecon = Deconstruct(Point=item)  # -> XComponent, YComponent, ZComponent
sort = SortList(Keys=pdecon.ZComponent, ValuesA=item)  # -> Keys, ValuesA

# ----
# seleziono il più basso (primo della lista ordinata) e il più alto (ultimo della lista ordinata) e li collego con una linea
item_2 = ListItem(List=sort.ValuesA, Index=0, Wrap=True)  # -> Item1, Item
ln = Line(StartPoint=item_2.Item1, EndPoint=item_2.Item)

# ----
# bake this
# (pattern)
crv = Curve(ln)
previewlw_4 = CustomPreviewLineweights(Geometry=crv, Shader=ColourSwatch(SwatchColor=RGB(255, 255, 255)), Thickness=Slider(3, range=0..10), Absolute=False)
