# Grasshopper definition 03_03_mesh subdivision.gh (Grasshopper 1.0.7)
# Copyright: Co-de-iT
# plug-ins: MeshEdit Components, Pufferfish, Human, Weaverbird

y_interval = Panel("-60")
# subdivision modeling
# simple
interval = Panel("60")
# advanced
# WeaverBird - Catmull-Clark subdivision
# WeaverBird - Catmull-Clark + Quad Split subdivision
mesh = Mesh(<mesh referenced from the Rhino model>)
mesh_2 = Mesh(<mesh referenced from the Rhino model>)
# Mesh comprehensive definition
# 
# © a3 2017 _ Creative Commons Attribution-NonCommercial-ShareAlike3.0 UnportedLicense.
mesh_3 = Mesh(<mesh referenced from the Rhino model>)
Y = UnitY(Factor=y_interval)
X = UnitX(Factor=interval)
# using symmetry
# insert your coarse mesh here and keep
# modeling in Rhino using the Gumball
# techniques to extrude edges, faces and modify them
# mesh vertices should be aligned with mirror plane
pt = Point(<point referenced from the Rhino model>)
# WeaverBird - Loop + Quad Split subdivision
move = Move(Geometry=mesh_2, Motion=Y)  # -> Geometry, Transform
move_2 = Move(Geometry=mesh_3, Motion=X)  # -> Geometry, Transform
yz = YZPlane(Origin=pt)
xz = XZPlane(Origin=pt)
mesh_4 = Mesh(<mesh referenced from the Rhino model>)
naked_edges = ValueList({"Fixed": 0, "Smooth": 1, "Corner fixed": 2}, selected="Corner fixed")
naked_edges_2 = ValueList({"Fixed": 0, "Smooth": 1, "Corner fixed": 2}, selected="Smooth")
naked_edges_3 = ValueList({"Fixed": 0, "Smooth": 1, "Corner fixed": 2}, selected="Fixed")
naked_edges_4 = ValueList({"Fixed": 0, "Smooth": 1, "Corner fixed": 2}, selected="Smooth")
naked_edges_5 = ValueList({"Fixed": 0, "Smooth": 1, "Corner fixed": 2}, selected="Fixed")
naked_edges_6 = ValueList({"Fixed": 0, "Smooth": 1, "Corner fixed": 2}, selected="Smooth")
naked_edges_7 = ValueList({"Fixed": 0, "Smooth": 1, "Corner fixed": 2}, selected="Smooth")
naked_edges_8 = ValueList({"Fixed": 0, "Smooth": 1, "Corner fixed": 2}, selected="Fixed")
naked_edges_9 = ValueList({"Fixed": 0, "Smooth": 1, "Corner fixed": 2}, selected="Smooth")
naked_edges_10 = ValueList({"Fixed": 0, "Smooth": 1, "Corner fixed": 2}, selected="Fixed")
naked_edges_11 = ValueList({"Fixed": 0, "Smooth": 1, "Corner fixed": 2}, selected="Smooth")
naked_edges_12 = ValueList({"Fixed": 0, "Smooth": 1, "Corner fixed": 2}, selected="Fixed")
naked_edges_13 = ValueList({"Fixed": 0, "Smooth": 1, "Corner fixed": 2}, selected="Smooth")
naked_edges_14 = ValueList({"Fixed": 0, "Smooth": 1, "Corner fixed": 2}, selected="Smooth")
interval_2 = Panel("60")
interval_3 = Panel("60")
mirror = Mirror(Geometry=mesh_4, Plane=xz)  # -> Geometry, Transform
wbcatmullclark = WeaverbirdsCatmullClarkSubdivision(MeshCurves=move_2.Geometry, Level=Slider(3, range=1..3), SmoothNakedEdges=naked_edges)

skip_naked_edges = BooleanToggle(True)
# Mesh Smooth: rende le mesh più curvilinee senza aumentare il numero dei vertici
msmooth = SmoothMesh(Mesh=wbcatmullclark, Strength=Slider(0, range=0..1), SkipNaked=skip_naked_edges, Iterations=Slider(1, range=1..50))

wbjoin = WeaverbirdsJoinMeshesAndWeld(Mesh=[mesh_4, mirror.Geometry], Weld=Toggle(True))
X_2 = UnitX(Factor=Slider(50, range=0..100))
previewmat = CustomPreviewMaterials(Geometry=mirror.Geometry, DiffuseColor=RGB(255, 255, 255))
wbcatmullclark_2 = WeaverbirdsCatmullClarkSubdivision(MeshCurves=mesh, Level=Slider(3, range=1..3), SmoothNakedEdges=naked_edges_2)
wbsplitquads = WeaverbirdsConstantQuadsSplitSubdivision(MeshCurves=mesh, Level=Slider(1, range=1..3), SmoothNakedEdges=naked_edges_3)
wbsplitquads_2 = WeaverbirdsConstantQuadsSplitSubdivision(MeshCurves=mesh, Level=Slider(2, range=1..3), SmoothNakedEdges=naked_edges_5)
wbloop = WeaverbirdsLoopSubdivision(MeshCurves=move.Geometry, Level=Slider(3, range=1..3), SmoothNakedEdges=naked_edges_7)
wbsplitquads_3 = WeaverbirdsConstantQuadsSplitSubdivision(MeshCurves=move.Geometry, Level=Slider(1, range=1..3), SmoothNakedEdges=naked_edges_8)
wbsplitquads_4 = WeaverbirdsConstantQuadsSplitSubdivision(MeshCurves=move.Geometry, Level=Slider(2, range=1..3), SmoothNakedEdges=naked_edges_10)
wbsplitquads_5 = WeaverbirdsConstantQuadsSplitSubdivision(MeshCurves=move.Geometry, Level=Slider(1, range=1..3), SmoothNakedEdges=naked_edges_12)
move_3 = Move(Geometry=wbjoin, Motion=X_2)  # -> Geometry, Transform
multiplication = Multiplication(A=interval_2, B="1")
multiplication_2 = Multiplication(A=interval_2, B="2")
multiplication_3 = Multiplication(A=interval_2, B="3")
multiplication_4 = Multiplication(A=interval_3, B="1")
multiplication_5 = Multiplication(A=interval_3, B="2")
multiplication_6 = Multiplication(A=interval_3, B="3")
wbloop_2 = WeaverbirdsLoopSubdivision(MeshCurves=wbsplitquads_5, Level=Slider(1, range=1..3), SmoothNakedEdges=naked_edges_13)
multiplication_7 = Multiplication(A=interval_3, B="4")

# ----
# sometimes WeaverBird's welding isn't enough,
# this makes sure vertices are welded (increase
# tolerance to weld also non coincident vertices),
# the following component unifies normals direction
weldvertices = MeshWeldVertices(Mesh=move_3.Geometry, Tolerance=0.01)  # -> RuntimeMessage, Mesh
unifynormals = MeshUnifyNormals(Mesh=weldvertices.Mesh)

wbcatmullclark_3 = WeaverbirdsCatmullClarkSubdivision(MeshCurves=wbsplitquads, Level=Slider(2, range=1..3), SmoothNakedEdges=naked_edges_4)
wbcatmullclark_4 = WeaverbirdsCatmullClarkSubdivision(MeshCurves=wbsplitquads_2, Level=Slider(1, range=1..3), SmoothNakedEdges=naked_edges_6)
wbloop_3 = WeaverbirdsLoopSubdivision(MeshCurves=wbsplitquads_3, Level=Slider(2, range=1..3), SmoothNakedEdges=naked_edges_9)
wbloop_4 = WeaverbirdsLoopSubdivision(MeshCurves=wbsplitquads_4, Level=Slider(1, range=1..3), SmoothNakedEdges=naked_edges_11)
wbcatmullclark_5 = WeaverbirdsCatmullClarkSubdivision(MeshCurves=wbloop_2, Level=Slider(1, range=1..3), SmoothNakedEdges=naked_edges_14)
X_3 = UnitX(Factor=multiplication)
X_4 = UnitX(Factor=multiplication_2)
X_5 = UnitX(Factor=multiplication_3)
X_6 = UnitX(Factor=multiplication_4)
X_7 = UnitX(Factor=multiplication_5)
X_8 = UnitX(Factor=multiplication_6)
X_9 = UnitX(Factor=multiplication_7)
# Mesh Thicken: ispessisce le mesh aperte
wbthicken = WeaverbirdsMeshThicken(MeshCurves=msmooth, Distance=Slider(0.2, range=0..1), OffsetType=0)
move_4 = Move(Geometry=wbcatmullclark_2, Motion=X_3)  # -> Geometry, Transform
move_5 = Move(Geometry=wbcatmullclark_3, Motion=X_4)  # -> Geometry, Transform
move_6 = Move(Geometry=wbcatmullclark_4, Motion=X_5)  # -> Geometry, Transform
move_7 = Move(Geometry=wbloop, Motion=X_6)  # -> Geometry, Transform
move_8 = Move(Geometry=wbloop_3, Motion=X_7)  # -> Geometry, Transform
move_9 = Move(Geometry=wbloop_4, Motion=X_8)  # -> Geometry, Transform
move_10 = Move(Geometry=wbcatmullclark_5, Motion=X_9)  # -> Geometry, Transform
medges = MeshEdges(Mesh=wbthicken)  # -> NakedEdges, InteriorEdges, NonManifoldEdges
# (flip normals if necessary)
flip = MeshFlip()
medges_2 = MeshEdges(Mesh=[move_4.Geometry, move_5.Geometry, move_6.Geometry])  # -> NakedEdges, InteriorEdges, NonManifoldEdges
previewmat_2 = CustomPreviewMaterials(Geometry=wbthicken, DiffuseColor=RGB(255, 255, 255))
previewlw = CustomPreviewLineweights(Geometry=[medges.NakedEdges, medges.InteriorEdges], Shader=ColourSwatch(SwatchColor=RGBA(56, 88, 92, 0)), Absolute=False)
dual_mesh = Panel("""mesh duale
(escono polilinee)""")
wbdual = WeaverbirdsDualGraph(MeshCurves=move_7.Geometry, DualMode=0)
previewmat_3 = CustomPreviewMaterials(Geometry=[move_4.Geometry, move_5.Geometry, move_6.Geometry], DiffuseColor=RGB(255, 255, 255))
previewmat_4 = CustomPreviewMaterials(Geometry=[move_7.Geometry, move_8.Geometry, move_9.Geometry, move_10.Geometry], DiffuseColor=RGB(255, 255, 255))
previewlw_2 = CustomPreviewLineweights(
    Geometry=[medges_2.NakedEdges, medges_2.InteriorEdges],
    Shader=ColourSwatch(SwatchColor=RGBA(45, 89, 94, 0)),
    Absolute=False)
previewlw_3 = CustomPreviewLineweights(
    Geometry=[move_7.Geometry, move_8.Geometry, move_9.Geometry, move_10.Geometry],
    Shader=ColourSwatch(SwatchColor=RGBA(56, 88, 92, 0)),
    Absolute=False)
# bake and go to
# the step above
mesh_5 = Mesh(unifynormals)

X_10 = UnitX(Factor=interval)
pt_2 = Point(<point referenced from the Rhino model>)
# mesh mirror cut (from Pufferfish)
# lavora solo su meshes chiuse
move_11 = Move(Geometry=wbthicken, Motion=X_10)  # -> Geometry, Transform
xz_2 = XZPlane(Origin=pt_2)
Z = UnitZ(Factor=1)
rot3d = Rotate3D(Geometry=xz_2, Angle=Slider(1.977, range=0..3.142), Center=pt_2, Axis=Z)  # -> Geometry, Transform
mircutmsh = MirrorCutMesh(
    Mesh=move_11.Geometry,
    MirrorPlane=rot3d.Geometry,
    Reach=0,
    Offset=0,
    Flip=Toggle(False),
    Join=True,
    Keep=False,
    ConnectionType=0,
    Bulge=-0.5,
    Divisions=1,
    WeldTolerance=0.01)  # -> MirrorCut, SplitIndex, ReachPlane, OffsetPlane, Intersected
medges_3 = MeshEdges(Mesh=mircutmsh.MirrorCut)  # -> NakedEdges, InteriorEdges, NonManifoldEdges
previewmat_5 = CustomPreviewMaterials(Geometry=mircutmsh.MirrorCut, DiffuseColor=RGB(255, 255, 255))
previewlw_4 = CustomPreviewLineweights(
    Geometry=[medges_3.NakedEdges, medges_3.InteriorEdges],
    Shader=ColourSwatch(SwatchColor=RGBA(56, 88, 92, 0)),
    Absolute=False)

crv = Curve(wbdual)
y_interval_2 = Panel("-60")
# mesh patterning
panel = Panel("vertex by face")

demesh = DeconstructMesh(Mesh=move_4.Geometry)  # -> Vertices, Faces, Colours, Normals
deface = DeconstructFace(Face=graft(demesh.Faces))  # -> CornerA, CornerB, CornerC, CornerD
merge = Merge(Data1=deface.CornerA, Data2=deface.CornerB, Data3=deface.CornerC, Data4=deface.CornerD)
item = ListItem(List=demesh.Vertices, Index=merge, Wrap=True)

Y_2 = UnitY(Factor=y_interval_2)
move_12 = Move(Geometry=wbdual, Motion=Y_2)  # -> Geometry, Transform
previewlw_5 = CustomPreviewLineweights(Geometry=move_12.Geometry, Shader=ColourSwatch(SwatchColor=RGB(255, 255, 255)), Absolute=False)
crv_2 = Curve([<curve referenced from the Rhino model> x2])
divlength = DivideLength(Curve=crv_2, Length=Slider(2.426, range=1..20))  # -> flatten(Points), flatten(Tangents), Parameters
item_2 = ListItem(List=item, Index=0, Wrap=True)  # -> Item, Item1, Item2, Item3
avr = Average(Input=item)
amp = Amplitude(Vector=divlength.Tangents, Amplitude=Slider(1.735, range=0..10))
cp = ClosestPoint(Point=avr, Cloud=divlength.Points)  # -> ClosestPoint, CPIndex, Distance
vdisex = VectorDisplayEx(Point=divlength.Points, Vector=amp, Colour=ColourSwatch(SwatchColor=RGB(255, 255, 255)), Width=2)
interval_4 = Panel("60")
Y_3 = UnitY(Factor=interval_4)

# ----
# field based pattern
ln = Line(StartPoint=item_2.Item, EndPoint=item_2.Item2)
ln_2 = Line(StartPoint=item_2.Item1, EndPoint=item_2.Item3)
item_3 = ListItem(List=divlength.Tangents, Index=cp.CPIndex, Wrap=True)
merge_2 = Merge(Data1=ln, Data2=ln_2)
amp_2 = Amplitude(Vector=item_3, Amplitude=Slider(0.61, range=0..10))
angle = Angle(VectorA=merge_2, VectorB=amp_2)  # -> Angle, Reflex
vdisex_2 = VectorDisplayEx(Point=avr, Vector=amp_2, Colour=RGB(0, 0, 0), Width=2)
sort = SortList(Keys=angle.Angle, ValuesA=merge_2)  # -> Keys, ValuesA
item_4 = ListItem(List=sort.ValuesA, Index=0, Wrap=True)
move_13 = Move(Geometry=item_4, Motion=Y_3)  # -> Geometry, Transform
previewlw_6 = CustomPreviewLineweights(Geometry=move_13.Geometry, Shader=ColourSwatch(SwatchColor=RGB(196, 125, 255)), Thickness="2", Absolute=False)

move_14 = Move(Geometry=move_4.Geometry, Motion=Y_3)  # -> Geometry, Transform
# base mesh
previewmat_6 = CustomPreviewMaterials(Geometry=move_14.Geometry, DiffuseColor=RGB(255, 255, 255))

# ----
# descent pattern
pdecon = Deconstruct(Point=item)  # -> XComponent, YComponent, ZComponent
sort_2 = SortList(Keys=pdecon.ZComponent, ValuesA=item)  # -> Keys, ValuesA
item_5 = ListItem(List=sort_2.ValuesA, Index=0, Wrap=True)  # -> Item1, Item
ln_3 = Line(StartPoint=item_5.Item1, EndPoint=item_5.Item)

move_15 = Move(Geometry=ln_3, Motion=Y_3)  # -> Geometry, Transform

previewlw_7 = CustomPreviewLineweights(Geometry=move_15.Geometry, Shader=ColourSwatch(SwatchColor=RGB(7, 11, 240)), Thickness="2", Absolute=False)
