# Grasshopper definition 03_04_mesh modify-voxelize.gh (Grasshopper 0.9.76)
# Copyright: Co-de-iT
# plug-ins: Human, Weaverbird, Noise 4D, Mesh Pipe

cell_y = Slider(12, range=1..50)
cell_x = Slider(15, range=1..50)
cell_z = Slider(17, range=1..50)
mesh = Mesh(<mesh referenced from the Rhino model>)
# voxelizer
# usare una mesh chiusa
mesh_2 = Mesh(<mesh referenced from the Rhino model>)
# Mesh comprehensive definition
# 
# © a3 2017 _ Creative Commons Attribution-NonCommercial-ShareAlike3.0 UnportedLicense.
# BRep to simple mesh
brep = Brep(<brep referenced from the Rhino model>)
wbcatmullclark = WeaverbirdsCatmullClarkSubdivision(MeshCurves=mesh, Level=Slider(3, range=1..3), SmoothNakedEdges=1)
# deconstruct and reconstruct
mesh_3 = ValueList({"original": 0, "subdivided": 1}, selected="subdivided")
smesh = SimpleMesh(Brep=brep)
xy = XYPlane(Origin=Point(0, 0, 0))
Y = UnitY(Factor=Slider(50, range=0..100))
# value list
# . to edit title right click and edit the first line in the context menu
# . to edit values double click on the right side
# stream filter
# (see component help)
filter = StreamFilter(Gate=mesh_3, Stream0=mesh, Stream1=wbcatmullclark)
# try both slider and knob
# (to edit values double click
# on the components)
Y_2 = UnitY(Factor=Slider(60, range=0..100))
prot = RotatePlane(Plane=xy, Angle=Slider(0, range=0..1.571))
move = Move(Geometry=smesh, Motion=Y)  # -> Geometry, Transform
bbox = BoundingBox(Content=mesh_2, Plane=prot, UnionBox=True)  # -> Box, Box_2
move_2 = Move(Geometry=filter, Motion=Y_2)  # -> Geometry, Transform
deplane = DeconstructPlane(Plane=prot)  # -> Origin, XAxis, YAxis, ZAxis
box_corners = BoxCorners(Box=bbox.Box)  # -> CornerA, CornerB, CornerC, CornerD, CornerE, CornerF, CornerG, CornerH
demesh = DeconstructMesh(Mesh=move_2.Geometry)  # -> Vertices, Faces, Colours, Normals
panel = Panel("""Red
Green
Blue""")
ln = Line(StartPoint=box_corners.CornerA, EndPoint=box_corners.CornerD)
ln_2 = Line(StartPoint=box_corners.CornerA, EndPoint=box_corners.CornerE)
ln_3 = Line(StartPoint=box_corners.CornerA, EndPoint=box_corners.CornerB)

# ----
# modify vertices position
number_slider = Slider(0, range=0..2)
amplitude = Slider(2.559, range=0..10)
knob = ControlKnob(Decimals=2, Limit=True, Maximum=10, Minimum=0, Range=1, Value=0)
perlin = PerlinNoise(Values=demesh.Vertices, Time=knob, Scale=Slider(0.043, range=0..1))
multiplication = Multiplication(A=perlin, B=amplitude)
amp = Amplitude(Vector=demesh.Normals, Amplitude=multiplication)
move_3 = Move(Geometry=demesh.Vertices, Motion=amp)  # -> Geometry, Transform

len = Length(Curve=ln_2)
len_2 = Length(Curve=ln_3)
len_3 = Length(Curve=ln)
pl_origin = PlaneOrigin(Base=prot, Origin=box_corners.CornerA)
previewlw = CustomPreviewLineweights(Geometry=[ln_3, ln, ln_2], Shader=panel, Absolute=False)
division = Division(A=len, B=cell_z)
division_2 = Division(A=len_2, B=cell_x)
division_3 = Division(A=len_3, B=cell_y)
series = Series(Start=0, Step=division_2, Count=cell_x)
series_2 = Series(Start=0, Step=division_3, Count=cell_y)
series_3 = Series(Start=0, Step=division, Count=cell_z)
amp_2 = Amplitude(Vector=deplane.XAxis, Amplitude=series)
move_4 = Move(Geometry=box_corners.CornerA, Motion=amp_2)  # -> Geometry, Transform
amp_3 = Amplitude(Vector=deplane.YAxis, Amplitude=series_2)
amp_4 = Amplitude(Vector=deplane.ZAxis, Amplitude=series_3)
move_5 = Move(Geometry=graft(move_4.Geometry), Motion=amp_3)  # -> Geometry, Transform
move_6 = Move(Geometry=graft(move_5.Geometry), Motion=amp_4)  # -> simplify(Geometry), Transform

# ----
# color gradient by noise value
panel_2 = Panel("1")
neg = Negative(Value=panel_2)
gradient = Gradient(
    LowerLimit=neg,
    UpperLimit=panel_2,
    Parameter=perlin,
    stops=[0: RGB(0, 128, 0), 0.5: RGB(255, 255, 0), 1: RGB(255, 0, 0)])

# ----
# show displacement from original position
ln_4 = Line(StartPoint=demesh.Vertices, EndPoint=move_3.Geometry)
# topology preservation: è possibile trasformare la mesh modificando la posizione dei vertici. Si modifica la geometria ma si preserva la topologia (numero di vertici e lista delle facce)
previewlw_2 = CustomPreviewLineweights(Geometry=ln_4, Shader=ColourSwatch(SwatchColor=RGB(255, 255, 255)), Absolute=False)

pl_origin_2 = PlaneOrigin(Base=prot, Origin=move_6.Geometry)  # -> flatten(Plane)
pt = Point(Point(0, 0, 0))
rectangle = Rectangle(Plane=pt, XSize=division_2, YSize=division_3, Radius=0)  # -> Rectangle, Length
# base voxel
voxel = Voxel(Points=pt, X=division_2, Y=division_3, Z=division)
conmesh = ConstructMesh(Vertices=move_3.Geometry, Faces=demesh.Faces, Colours=gradient)
volume = Volume(Geometry=voxel)  # -> Volume, Centroid
wboffset = WeaverbirdsOffsetMesh(MeshCurves=mesh_2, Distance=Slider(1, range=1..10), OffsetType=0)
orient = Orient(Geometry=volume.Centroid, Source=PlaneXY(0, 0, 0), Target=pl_origin_2)  # -> Geometry, Transform
minc = MeshInclusion(Mesh=wboffset, Point=orient.Geometry, Strict=False)
dispatch = Dispatch(List=pl_origin_2, DispatchPattern=minc)  # -> ListA, ListB
orient_2 = Orient(Geometry=rectangle.Rectangle, Source=PlaneXY(0, 0, 0), Target=dispatch.ListA)  # -> Geometry, Transform

orient_3 = Orient(Geometry=voxel, Source=PlaneXY(0, 0, 0), Target=dispatch.ListA)  # -> Geometry, Transform
# voxel display
mjoin = MeshJoin(Meshes=orient_3.Geometry)
previewlw_3 = CustomPreviewLineweights(Geometry=mjoin, Shader=ColourSwatch(SwatchColor=RGB(255, 255, 255)), Absolute=False)

# ----
# voxel planes
crv = Curve(orient_2.Geometry)
previewlw_4 = CustomPreviewLineweights(Geometry=crv, Shader=ColourSwatch(SwatchColor=RGBA(255, 255, 255, 0)), Absolute=False)
