# Grasshopper definition day_01.gh (Grasshopper 0.9.76)
# Copyright: Co-de-iT

crv = Curve(reparameterize(<curve referenced from the Rhino model>))
pt = Point(<point referenced from the Rhino model>)
pt_2 = Point([<point referenced from the Rhino model> x3])
pt_3 = Point([<point referenced from the Rhino model> x5])
pt_4 = Point()
domain = Domain(crv)
eval = EvaluateCurve(Curve=crv, Parameter=Slider(0.205, range=0..1))  # -> Point, Tangent, Angle
ln = Line(StartPoint=pt, EndPoint=pt_2)
panel = Panel(domain)
# File template
# 
# © a3 2017 _ Creative Commons Attribution-NonCommercial-ShareAlike3.0 UnportedLicense.
panel_2 = Panel("componente punto")
line = LineSDL(Start=eval.Point, Direction=eval.Tangent, Length="50")
