# Grasshopper definition day_02.gh (Grasshopper 0.9.76)
# Copyright: Co-de-iT

crv = Curve(reparameterize(<curve referenced from the Rhino model>))
crv_2 = Curve(reparameterize(<curve referenced from the Rhino model>))
crv_3 = Curve(reparameterize(<curve referenced from the Rhino model>))
crv_4 = Curve(reparameterize(<curve referenced from the Rhino model>))
number_slider = Slider(6, range=2..200)
# File template
# 
# © a3 2017 _ Creative Commons Attribution-NonCommercial-ShareAlike3.0 UnportedLicense.
eval = EvaluateCurve(Curve=crv_3, Parameter=Slider(0.53, range=0..1))  # -> Point, Tangent, Angle
eval_2 = EvaluateCurve(Curve=crv, Parameter=Slider(0.65, range=0..1))  # -> Point, Tangent, Angle
divide = DivideCurve(Curve=crv_2, Count=number_slider, Kinks=False)  # -> Points, Tangents, Parameters
divide_2 = DivideCurve(Curve=crv_4, Count=number_slider, Kinks=False)  # -> Points, Tangents, Parameters
number_slider_2 = Slider(2, range=2..50)
number_slider_3 = Slider(1, range=0..1)
number_slider_4 = Slider(100, range=0..100)
number_slider_5 = Slider(320, range=5..320)
ln = Line(StartPoint=eval.Point, EndPoint=eval_2.Point)
ln_2 = Line(StartPoint=divide.Points, EndPoint=divide_2.Points)
# 0<<1
# 0<<100
# 5<<320
# testo di prova
panel = Panel("testo di prova")
len = Length(Curve=ln_2)
panel_2 = Panel(ln_2)
divide_3 = DivideCurve(Curve=ln_2, Count=Slider(21, range=2..50), Kinks=False)  # -> Points, Tangents, Parameters
ma = MassAddition(Input=len)  # -> Result, PartialResults
# 2<50
flip = FlipMatrix(Data=divide_3.Points)
intcrv = Interpolate(Vertices=flip, Degree=3, Periodic=False, KnotStyle=1)  # -> Curve, Length, Domain
panel_3 = Panel(ma.Result)
nurbs = NurbsCurve(Vertices=flip, Degree=3, Periodic=False)  # -> Curve, Length, Domain
number_slider_6 = Slider(5, range=0..20)
pline = PolyLine(Vertices=flip, Closed=False)
flatten = FlattenTree(Tree=nurbs.Curve, Path="{0}")
lng = ListLength(List=flatten)
panel_4 = Panel(lng)
subtraction = Subtraction(A=lng, B="1")
series = Series(Start=0, Step=1, Count=subtraction)
graft = GraftTree(Tree=series, IncludeEmptyLists=True, IncludeNullItems=True)
panel_5 = Panel(divide_3.Points)
viewer = ParamViewer(flip)
item = ListItem(List=flatten, Index=graft, Wrap=Toggle(False))  # -> Item, Item1
panel_6 = Panel(graft)
loft = Loft(Curves=flatten, Options={Adjust=False, Closed=False, LoftEnds=0, LoftSimp=0, LoftType=0, Rebuild=10, Refit=0.01})
panel_7 = Panel(series)
merge = Merge(Data1=item.Item, Data2=item.Item1)
viewer_2 = ParamViewer(nurbs.Curve)
loft_2 = Loft(Curves=merge, Options={Adjust=False, Closed=False, LoftEnds=0, LoftSimp=0, LoftType=0, Rebuild=10, Refit=0.01})
viewer_3 = ParamViewer(flatten)
series_2 = Series(Start=0, Step=1, Count=10)
panel_8 = Panel(merge)
num = Number(simplify(flatten(series_2)))
series_3 = Series(Start=series_2, Step=1, Count=10)
num_2 = Number(Slider(0.25, range=0..1))
panel_9 = Panel(num_2)
panel_10 = Panel(num)
panel_11 = Panel(series_3)
viewer_4 = ParamViewer(series_3)
viewer_5 = ParamViewer(num_2)
viewer_6 = ParamViewer(num)
