# Grasshopper definition XX_ds_01_field on mesh surface by geometry.gh (Grasshopper 0.9.76)
# Copyright: Co-de-iT
# plug-ins: Millipede, Weaverbird, Noise 4D

# field from geometry
mesh = Mesh(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)
# field from vertex data 01
panel = Panel("60")
# field from vertex data 02
panel_2 = Panel("120")
# File template
# 
# © a3 2017 _ Creative Commons Attribution-NonCommercial-ShareAlike3.0 UnportedLicense.
wbcatmullclark = WeaverbirdsCatmullClarkSubdivision(MeshCurves=mesh, Level=Slider(3, range=1..3), SmoothNakedEdges=1)
Y = UnitY(Factor=panel)
Y_2 = UnitY(Factor=panel_2)
# geometry 2
pt = Point(Point(54.32317057, 31.72863191, 12.94750817))
# geometry 1
# le geometries possono essere di qualunque tipo, da punti a BReps
crv = Curve(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)
move = Move(Geometry=wbcatmullclark, Motion=Y)  # -> Geometry, Transform
move_2 = Move(Geometry=wbcatmullclark, Motion=Y_2)  # -> Geometry, Transform
# input mesh
mesh_2 = Mesh(wbcatmullclark)

geo = Geometry(crv)
geo_2 = Geometry(pt)
mcomp = Decompose(Mesh=mesh_2)  # -> Vertices, Faces, Colours, Normals
pull = PullPoint(Point=mcomp.Vertices, Geometry=geo, ClosestOnly=True)  # -> ClosestPoint, Distance
# genera un campo di valori confrontando le distanze dalle geometrie
pull_2 = PullPoint(Point=mcomp.Vertices, Geometry=geo_2, ClosestOnly=True)  # -> ClosestPoint, Distance
division = Division(A=pull.Distance, B=pull_2.Distance)
atan = ArcTangent(Value=division)
n_curves = Slider(20, range=1..60)
bnd = Bounds(Numbers=atan)
range = Range(Domain=bnd, Steps=n_curves)

mesh_3 = Mesh(move.Geometry)
mesh_4 = Mesh(move_2.Geometry)
demesh = DeconstructMesh(Mesh=mesh_3)  # -> Vertices, Faces, Colours, Normals
demesh_2 = DeconstructMesh(Mesh=mesh_4)  # -> Vertices, Faces, Colours, Normals
preview = CustomPreview(Geometry=mesh_3, Shader=ColourSwatch(SwatchColor=RGB(255, 255, 255)))
preview_2 = CustomPreview(Geometry=mesh_4, Shader=ColourSwatch(SwatchColor=RGB(255, 255, 255)))
pdecon = Deconstruct(Point=demesh_2.Normals)  # -> XComponent, YComponent, ZComponent
preview_3 = CustomPreview(Geometry=mesh_2, Shader=ColourSwatch(SwatchColor=RGB(255, 255, 255)))
perlin = PerlinNoise(Values=demesh.Vertices, Time=Slider(0, range=0..10), Scale=Slider(0.05, range=0..1))
n_curves_2 = Slider(20, range=1..60)
n_curves_3 = Slider(15, range=1..60)
bnd_2 = Bounds(Numbers=perlin)
bnd_3 = Bounds(Numbers=pdecon.ZComponent)
range_2 = Range(Domain=bnd_2, Steps=n_curves_2)
range_3 = Range(Domain=bnd_3, Steps=n_curves_3)

# ----
# genera le isocurve di campo
mesh_contours = MeshContourField(Mesh=mesh_2, Values=atan, IsoValues=flatten(range))
join = JoinCurves(Curves=flatten(mesh_contours), Preserve=False)

mesh_contours_2 = MeshContourField(Mesh=mesh_3, Values=perlin, IsoValues=range_2)
mesh_contours_3 = MeshContourField(Mesh=mesh_4, Values=pdecon.ZComponent, IsoValues=range_3)
join_2 = JoinCurves(Curves=flatten(mesh_contours_2), Preserve=False)
join_3 = JoinCurves(Curves=flatten(mesh_contours_3), Preserve=False)

item = ListItem(List=join_2, Index=0, Wrap=True)
# suddivisione length-based delle isocurve
vector_length = Slider(0.3, range=0..1)
flip = FlipCurve(Curve=join_2, Guide=item)  # -> Curve, Flag
divlength = DivideLength(Curve=flip.Curve, Length=Slider(1, range=0.2..2))  # -> Points, Tangents, Parameters

item_2 = ListItem(List=join_3, Index=0, Wrap=True)
# suddivisione length-based delle isocurve
vector_length_2 = Slider(0.3, range=0..1)
flip_2 = FlipCurve(Curve=join_3, Guide=item_2)  # -> Curve, Flag
divlength_2 = DivideLength(Curve=flip_2.Curve, Length=Slider(1, range=0.2..2))  # -> Points, Tangents, Parameters

item_3 = ListItem(List=join, Index=0, Wrap=True)
# suddivisione length-based delle isocurve
vector_length_3 = Slider(0.3, range=0..1)
flip_3 = FlipCurve(Curve=join, Guide=item_3)  # -> Curve, Flag
divlength_3 = DivideLength(Curve=flip_3.Curve, Length=Slider(1, range=0.2..2))  # -> Points, Tangents, Parameters

preview_4 = CustomPreview(Geometry=join_2, Shader=ColourSwatch(SwatchColor=RGB(133, 133, 133)))
preview_5 = CustomPreview(Geometry=join_3, Shader=ColourSwatch(SwatchColor=RGB(133, 133, 133)))
preview_6 = CustomPreview(Geometry=join, Shader=ColourSwatch(SwatchColor=RGB(133, 133, 133)))
multiplication = Multiplication(A=divlength.Tangents, B=vector_length)
multiplication_2 = Multiplication(A=divlength_2.Tangents, B=vector_length_2)
multiplication_3 = Multiplication(A=divlength_3.Tangents, B=vector_length_3)
# field vector curves
line = LineSDL(Start=divlength.Points, Direction=divlength.Tangents, Length=vector_length)
# field vector curves
line_2 = LineSDL(Start=divlength_2.Points, Direction=divlength_2.Tangents, Length=vector_length_2)
vdisex = VectorDisplayEx(Point=divlength.Points, Vector=multiplication, Colour=RGB(0, 0, 0), Width=2)
vdisex_2 = VectorDisplayEx(Point=divlength_2.Points, Vector=multiplication_2, Colour=RGB(0, 0, 0), Width=2)
# field vector curves
line_3 = LineSDL(Start=divlength_3.Points, Direction=divlength_3.Tangents, Length=vector_length_3)
vdisex_3 = VectorDisplayEx(Point=divlength_3.Points, Vector=multiplication_3, Colour=RGB(0, 0, 0), Width=2)
# bake to Rhino and use as design factor
crv_2 = Curve(line)
# bake to Rhino and use as design factor
crv_3 = Curve(line_2)
# bake to Rhino and use as design factor
crv_4 = Curve(line_3)
