# Grasshopper definition XX_ds_01_field on mesh surface by geometry_02.gh (Grasshopper 0.9.76)
# Copyright: Co-de-iT
# plug-ins: MeshEdit Components, Millipede, Weaverbird, Noise 4D

# File template
# 
# © a3 2017 _ Creative Commons Attribution-NonCommercial-ShareAlike3.0 UnportedLicense.
mesh = Mesh(<mesh referenced from the Rhino model>)
weldvertices = MeshWeldVertices(Mesh=mesh, Tolerance=0.01)  # -> RuntimeMessage, Mesh
wbcatmullclark = WeaverbirdsCatmullClarkSubdivision(MeshCurves=weldvertices.Mesh, Level="3", SmoothNakedEdges=1)
demesh = DeconstructMesh(Mesh=wbcatmullclark)  # -> Vertices, Faces, Colours, Normals
devec = DeconstructVector(Vector=demesh.Normals)  # -> XComponent, YComponent, ZComponent
perlin = PerlinNoise(Values=demesh.Vertices, Time=0, Scale=Slider(0.019, range=0..1))
bnd = Bounds(Numbers=perlin)
range = Range(Domain=bnd, Steps=Slider(9, range=1..20))
mesh_contours = MeshContourField(Mesh=wbcatmullclark, Values=perlin, IsoValues=range)
join = JoinCurves(Curves=flatten(mesh_contours), Preserve=False)
redpline = Reduce(Polyline=join, Tolerance=1)  # -> Polyline, Reduction
