# Grasshopper definition XX_ds_M00_Millipede FEM basic.gh (Grasshopper 0.9.76)
# Copyright: Co-de-iT
# plug-ins: Millipede

# supports
slider = Slider(-802.523, range=-1110..1)
mat = Material(MaterialType=2)
# loads
brep = Brep(<brep referenced from the Rhino model>)
brep_2 = Brep([<brep referenced from the Rhino model> x3])
mat_2 = MillC_StockSupportType(X=True, Y=True, Z=True, RX=True, RY=True, RZ=True)
# Millipede FEM basics
# 
# Calcolo delle informazioni strutturali su una mesh considerata come superficie o involucro
# 
# © a3 2017 _ Creative Commons Attribution-NonCommercial-ShareAlike3.0 UnportedLicense.
# QUAD meshes only!!
mesh = Mesh(<mesh referenced from the Rhino model>)
faceb = FaceBoundaries(Mesh=mesh)
load_region = LoadRegion(Boundary=brep, ArealNormalLoad=slider)
support_region = MSupportTypeRegion(Boundary=brep_2, SupportType=mat_2, AmmendExistingSupports=True)
femesh = FEMesh(Meshes=mesh, Material=mat, Thickness=Slider(0.1, range=0..3), AreaLoad=Vector(0, 0, 0), NormalAreaLoad=0)

# ----
# n. di iterazioni ad ogni step. Maggiore il numero di iterazioni, più lungo il calcolo prima di visualizzare i risultati
number_slider = Slider(4, range=0..18)

# ----
# deactivete-reactivate this to change model
fe_system = FESystem(
    ModelComponents=[femesh, support_region, load_region],
    IntersectAddedCurves=True,
    MergeTolerance=0.0001,
    MinimumCurveSpan=0.05,
    MaximumCurveSpan=10000,
    CurveTolerance=0.1)

# ----
# do NOT deactivate-reactivate this component
# Cliccare "Step" e attendere il calcolo. Ripetere fino alla comparsa del pattern di rigidezze in b/n sulla mesh
# 
# Maggiorre il numero di steps fatti, più accurato è il risultato
fe_solver = FESolver(
    FEModel=fe_system,
    SelfWeightCoefficient=Slider(0, range=0..1),
    BeamOptimisationIterations=0,
    QuadOptimisationIterations=number_slider,
    OptimizationTarget=Slider(0.15, range=0..1),
    OptimizationPenalization=Slider(2.088, range=0..3),
    LoadCase=0,
    AllCases=True)  # -> FEModel, MaxDeflection, Weight

deformation_factor = Slider(0, range=0..14)
division = Division(A=deformation_factor, B=fe_solver.MaxDeflection)
mesh_visualization = MeshVisualization(FEModel=fe_solver.FEModel, Deflection=division, Plane=Slider(0, range=-1..1), ShowThickness=Toggle(False), ColorMode=8)  # -> Mesh, CompleteRange, VisibleRange
