# Grasshopper definition XX_ds_M00_Millipede FEM field.gh (Grasshopper 0.9.76)
# Copyright: Co-de-iT
# plug-ins: Millipede

# supports
slider = Slider(-802.523, range=-1110..1)
mat = Material(MaterialType=2)
# loads
brep = Brep(<brep referenced from the Rhino model>)
brep_2 = Brep([<brep referenced from the Rhino model> x3])
mat_2 = MillC_StockSupportType(X=True, Y=True, Z=True, RX=True, RY=True, RZ=True)
# Millipede FEM basics
# 
# Uso di Millipede su superfici mesh per ricavare fields scalari e vettoriali contenenti informazioni strutturali
# 
# © a3 2017 _ Creative Commons Attribution-NonCommercial-ShareAlike3.0 UnportedLicense.
# QUAD meshes only!!
mesh = Mesh(<mesh referenced from the Rhino model>)
faceb = FaceBoundaries(Mesh=mesh)
load_region = LoadRegion(Boundary=brep, ArealNormalLoad=slider)
support_region = MSupportTypeRegion(Boundary=brep_2, SupportType=mat_2, AmmendExistingSupports=True)
femesh = FEMesh(Meshes=mesh, Material=mat, Thickness=Slider(0.1, range=0..3), AreaLoad=Vector(0, 0, 0), NormalAreaLoad=0)

# ----
# n. di iterazioni ad ogni step. Maggiore il numero di iterazioni, più lungo il calcolo prima di visualizzare i risultati
number_slider = Slider(4, range=0..18)

# ----
# deactivete-reactivate this to change model
fe_system = FESystem(
    ModelComponents=[femesh, support_region, load_region],
    IntersectAddedCurves=True,
    MergeTolerance=0.0001,
    MinimumCurveSpan=0.05,
    MaximumCurveSpan=10000,
    CurveTolerance=0.1)

# ----
# do NOT deactivate-reactivate this component
# Cliccare "Step" e attendere il calcolo. Ripetere fino alla comparsa del pattern di rigidezze in b/n sulla mesh
# 
# Maggiore il numero di steps fatti, più accurato è il risultato
fe_solver = FESolver(
    FEModel=fe_system,
    SelfWeightCoefficient=Slider(0, range=0..1),
    BeamOptimisationIterations=0,
    QuadOptimisationIterations=number_slider,
    OptimizationTarget=Slider(0.15, range=0..1),
    OptimizationPenalization=Slider(2.088, range=0..3),
    LoadCase=0,
    AllCases=True)  # -> FEModel, MaxDeflection, Weight

quad_results = QuadResults(FEModel=fe_solver.FEModel, Plane=1)  # -> PrincipalStressFrame, Area, NormalDisplacement, MaxVonMisesStress, PS1, PS2, StiffnessMultiplier, Bending
deformation_factor = Slider(0, range=0..14)

num = Number(quad_results.Bending)
bnd = Bounds(Numbers=num)
dom = Domain(DomainStart=Slider(0.15, range=0..5), DomainEnd=Slider(1.5, range=0..20))
remap = RemapNumbers(Value=num, Source=bnd, Target=dom)  # -> Mapped, Clipped
resolution = ValueList({"coarse": 0, "fine": 1, "extra fine": 2}, selected="fine")
fastdotdis = DotDisplayFast(point=quad_results.PrincipalStressFrame, radius=remap.Mapped, resolution=resolution)

# ----
# maxStress values (Von Mises Stress)
number_slider_2 = Slider(0.656, range=0..20)
# display scalar values
# stiffness multiplier
num_2 = Number(quad_results.StiffnessMultiplier)
bnd_2 = Bounds(Numbers=num_2)
dom_2 = Domain(DomainStart=Slider(0.1, range=0..5), DomainEnd=number_slider_2)
remap_2 = RemapNumbers(Value=num_2, Source=bnd_2, Target=dom_2)  # -> Mapped, Clipped
resolution_2 = ValueList({"coarse": 0, "fine": 1, "extra fine": 2}, selected="fine")
fastdotdis_2 = DotDisplayFast(point=quad_results.PrincipalStressFrame, radius=remap_2.Mapped, resolution=resolution_2)

# ----
# bending factor
number_slider_3 = Slider(2.32, range=0..20)
num_3 = Number(quad_results.MaxVonMisesStress)
bnd_3 = Bounds(Numbers=num_3)
dom_3 = Domain(DomainStart=Slider(0.2, range=0..5), DomainEnd=number_slider_3)
remap_3 = RemapNumbers(Value=num_3, Source=bnd_3, Target=dom_3)  # -> Mapped, Clipped
resolution_3 = ValueList({"coarse": 0, "fine": 1, "extra fine": 2}, selected="fine")
fastdotdis_3 = DotDisplayFast(point=quad_results.PrincipalStressFrame, radius=remap_3.Mapped, resolution=resolution_3)

division = Division(A=deformation_factor, B=fe_solver.MaxDeflection)
mesh_visualization = MeshVisualization(FEModel=fe_solver.FEModel, Deflection=division, Plane=Slider(0, range=-1..1), ShowThickness=Toggle(False), ColorMode=8)  # -> Mesh, CompleteRange, VisibleRange

# ----
# sort face centers
# l'ordine dei centri delle facce che esce da Millipede non è sfortunatamente lo stesso di quello della mesh originale. Questa parte della definizione riordina i punti e i dati in modo che siano coerenti con la mesh iniziale
demesh = DeconstructMesh(Mesh=mesh)  # -> Vertices, Faces, Colours, Normals
deface = DeconstructFace(Face=graft(demesh.Faces))  # -> CornerA, CornerB, CornerC, CornerD
merge = Merge(Data1=deface.CornerA, Data2=deface.CornerB, Data3=deface.CornerC, Data4=deface.CornerD)
item = ListItem(List=demesh.Vertices, Index=merge, Wrap=True)  # -> simplify(Item)
avr = Average(Input=item)
cp = ClosestPoint(Point=avr, Cloud=quad_results.PrincipalStressFrame)  # -> ClosestPoint, CPIndex, Distance

# ----
# i valori devono essere riordinati nell'ordine delle facce della mesh originale
item_2 = ListItem(List=quad_results.PrincipalStressFrame, Index=cp.CPIndex, Wrap=True)  # -> flatten(Item)
# insert values to discretize here
item_3 = ListItem(List=quad_results.StiffnessMultiplier, Index=cp.CPIndex, Wrap=True)  # -> flatten(Item)

# ----
# vector field
pln = Plane(item_2)
deplane = DeconstructPlane(Plane=pln)  # -> Origin, XAxis, YAxis, ZAxis
line = LineSDL(Start=deplane.Origin, Direction=deplane.XAxis, Length=Slider(1, range=0..10))
line_2 = LineSDL(Start=deplane.Origin, Direction=deplane.YAxis, Length=Slider(1, range=0..10))
line_3 = LineSDL(Start=deplane.Origin, Direction=deplane.ZAxis, Length=Slider(1, range=0..10))
panel = Panel("Pstress 1 - compression")
panel_2 = Panel("Pstress 2 - tension")
panel_3 = Panel("Pstress 3 - tension")

# ----
# converte un range di valori in un numero discreto di interi (utile per assegnare componenti)
n_of_components = Slider(4, range=1..6)
# scalar field to discrete, per-face values
num_4 = Number(item_3)
bnd_4 = Bounds(Numbers=num_4)
remap_4 = RemapNumbers(Value=num_4, Source=bnd_4, Target=Domain(0, 1))  # -> Mapped, Clipped
subtraction = Subtraction(A=n_of_components, B="1")
multiplication = Multiplication(A=remap_4.Mapped, B=subtraction)

pt = Point(flatten(avr))

# ----
# copy/paste (or bake to Rhino):
# for vector field
crv = Curve(line)
# for point cloud (mesh face centers)
pt_2 = Point(pt)
# for pattern block type (if more than one)
int = Integer(multiplication)

tag = TextTag3D(
    Location=pt_2,
    Text=int,
    Size=Slider(0.613, range=0..1),
    Colour=ColourSwatch(SwatchColor=RGB(255, 255, 255)),
    Justification=7)

# ==== cluster DotDisplayFast: like Dot Display, but faster (black dots only)
radius = ClusterInput()
point = ClusterInput()
resolution = ClusterInput()  # 0 = coarse, 1 = fine, 2 = extra-fine
filter = StreamFilter(Gate=resolution, Stream0="5", Stream1="10", Stream2="20")
material = CreateMaterial(Diffuse="black", Specular="black", Emission="black", Transparency=0, Shine=0)
msphere = MeshSphere(Base=point, Radius=radius, UCount=filter, VCount=filter)
mjoin = MeshJoin(Meshes=msphere)
preview = CustomPreview(Geometry=mjoin, Shader=material)
