# Grasshopper definition XX_ds_01_truchet tiles.gh (Grasshopper 0.9.76)
# Copyright: Co-de-iT
# plug-ins: Human, Noise 4D

number_slider = Slider(17, range=0..50)
sqgrid = Square(Plane=PlaneXY(0, 0, 0), Size=number_slider, ExtentX=Slider(20, range=0..100), ExtentY=Slider(20, range=0..100))  # -> Cells, Points

rectangle = Rectangle(Plane=PlaneXY(0, 0, 0), XSize=number_slider, YSize=number_slider, Radius=0)  # -> Rectangle, Length
# Truchet tiles
# 
# © a3 2017 _ Creative Commons Attribution-NonCommercial-ShareAlike3.0 UnportedLicense.
pcen = PolygonCenter(Polyline=rectangle.Rectangle)  # -> CenterV, CenterE, CenterA
explode = Explode(Curve=rectangle.Rectangle, Recursive=True)  # -> Segments, Vertices
curvepoint = PointOnCurve(explode.Segments, parameter=0.5)
# tile geometry generation
item = ListItem(List=curvepoint, Index=0, Wrap=True)  # -> Item, Item1, Item2, Item3
ln = Line(StartPoint=item.Item, EndPoint=item.Item1)
ln_2 = Line(StartPoint=item.Item2, EndPoint=item.Item3)

pcen_2 = PolygonCenter(Polyline=flatten(sqgrid.Cells))  # -> CenterV, CenterE, CenterA
perlin = PerlinNoise(Values=pcen_2.CenterV, Time=Slider(0, range=0..1), Scale=Slider(0.0171, range=0..0.1))
bnd = Bounds(Numbers=perlin)
dedomain = DeconstructDomain(Domain=bnd)  # -> Start, End
# orientation base plane
xy = XYPlane(Origin=pcen.CenterV)
# tile geometry
group = Group(Objects=[ln, ln_2])
gradient = Gradient(LowerLimit=dedomain.Start, UpperLimit=dedomain.End, Parameter=perlin, stops=[0: RGB(255, 255, 255), 1: RGB(0, 0, 0)])
neg = Negative(Value=number_slider)
X = UnitX(Factor=neg)
move = Move(Geometry=[group, rectangle.Rectangle], Motion=X)  # -> Geometry, Transform
bnd_2 = Bounds(Numbers=perlin)
remap = RemapNumbers(Value=perlin, Source=bnd_2, Target=Domain(0, 1))  # -> Mapped, Clipped
previewlw = CustomPreviewLineweights(
    Geometry=move.Geometry,
    Shader=ColourSwatch(SwatchColor=RGB(255, 0, 0)),
    Thickness=Slider(3, range=0..10),
    Absolute=False)
dots = DotDisplay(Point=pcen_2.CenterV, Colour=gradient, Size=Slider(2.7, range=0..5))
int = Integer(remap.Mapped)
xy_2 = XYPlane(Origin=pcen_2.CenterV)
multiplication = Multiplication(A=int, B="90")
prot = RotatePlane(Plane=xy_2, Angle=degrees(multiplication))
orient = Orient(Geometry=group, Source=xy, Target=prot)  # -> Geometry, Transform
ungroup = Ungroup(Group=orient.Geometry)  # -> flatten(Objects)
join = JoinCurves(Curves=ungroup, Preserve=False)
previewlw_2 = CustomPreviewLineweights(Geometry=join, Shader=ColourSwatch(SwatchColor=RGB(255, 255, 255)), Thickness=Slider(3, range=0..10), Absolute=False)
