# Grasshopper definition XX_ds_02_tiling principles.gh (Grasshopper 0.9.76)
# Copyright: Co-de-iT
# plug-ins: Human, Noise 4D

crv = Curve([<curve referenced from the Rhino model> x31])
geo = Geometry([<curve referenced from the Rhino model> x18])
crv_2 = Curve(<curve referenced from the Rhino model>)
geo_2 = Geometry([<curve referenced from the Rhino model> x14])
crv_3 = Curve(<curve referenced from the Rhino model>)
pcen = PolygonCenter(Polyline=crv_2)  # -> CenterV, CenterE, CenterA
pcen_2 = PolygonCenter(Polyline=crv_3)  # -> CenterV, CenterE, CenterA
merge = Merge(Data1=pcen_2.CenterV, Data2=geo_2)  # -> flatten(Result)
merge_2 = Merge(Data1=pcen.CenterV, Data2=geo)  # -> flatten(Result)
X = UnitX(Factor=Slider(-209.44, range=-300..0))
# Tiling algorithm
# 
# Choose 2 tiles and a set of planes to see tiling happen
# 
# © a3 2017 _ Creative Commons Attribution-NonCommercial-ShareAlike3.0 UnportedLicense.
move = Move(Geometry=crv, Motion=X)  # -> Geometry, Transform
pcen_3 = PolygonCenter(Polyline=move.Geometry)  # -> CenterV, CenterE, CenterA
group = Group(Objects=merge_2)
group_2 = Group(Objects=merge)
perlin = PerlinNoise(Values=pcen_3.CenterV, Time=Slider(1, range=0..1), Scale=Slider(0.1107, range=0..0.5))
perlin_2 = PerlinNoise(Values=pcen_3.CenterV, Time=Slider(0.205, range=0..1), Scale=Slider(0.3083, range=0..0.5))
larger = LargerThan(FirstNumber=perlin, SecondNumber="0")  # -> LargerThan, OrEqualTo
num = Number(perlin_2)
weave = Weave(Pattern=graft(larger.LargerThan), Stream0=group, Stream1=group_2, NullGaps=False)
bnd = Bounds(Numbers=flatten(num))
dom = ConstructDomain(DomainStart=0, DomainEnd=1)
ungroup = Ungroup(Group=weave)
remap = RemapNumbers(Value=num, Source=bnd, Target=dom)  # -> Mapped, Clipped
split = SplitList(List=ungroup, Index="1")  # -> ListA, ListB
multiplication = Multiplication(A=remap.Mapped, B="3")
int = Integer(multiplication)
multiplication_2 = Multiplication(A="Pi*0.5", B=int)  # -> graft(Result)
rotate = Rotate(Geometry=split.ListB, Angle=multiplication_2, Plane=split.ListA)  # -> Geometry, Transform
orient = Orient(Geometry=rotate.Geometry, Source=split.ListA, Target=graft(pcen_3.CenterV))  # -> Geometry, Transform
group_3 = Group(Objects=orient.Geometry)
dispatch = Dispatch(List=group_3, DispatchPattern=graft(larger.LargerThan))  # -> ListA, ListB
grp = Group(dispatch.ListA)
grp_2 = Group(dispatch.ListB)
previewlw = CustomPreviewLineweights(Geometry=grp, Shader=ColourSwatch(SwatchColor=RGB(201, 251, 255)), Absolute=False)
previewlw_2 = CustomPreviewLineweights(Geometry=grp_2, Shader=ColourSwatch(SwatchColor=RGB(83, 88, 120)), Absolute=False)
