# Grasshopper definition 00_discrete curve field.gh (Grasshopper 0.9.76)
# Copyright: Co-de-iT
# plug-ins: Human, ClosestVector

# field curve
crv = Curve(<curve referenced from the Rhino model>)
# 1
# curve to field
# border curve
crv_2 = Curve(<curve referenced from the Rhino model>)
# 2
# avoid empty areas
# border curve
crv_3 = Curve(<curve referenced from the Rhino model>)
# field curve
crv_4 = Curve(<curve referenced from the Rhino model>)
# empty areas (voids)
# 3
crv_5 = Curve([<curve referenced from the Rhino model> x2])
# field from multiple curves
# border curve
crv_6 = Curve(<curve referenced from the Rhino model>)
# field curves
crv_7 = Curve([<curve referenced from the Rhino model> x5])
# empty areas (voids)
crv_8 = Curve([<curve referenced from the Rhino model> x2])
number_slider = Slider(23, range=10..100)
number_slider_2 = Slider(23, range=10..100)
number_slider_3 = Slider(23, range=10..100)
# 00_discrete curve field
# 
# Create a field from a curve and transform into discrete directions
# 
# © a3 2017 _ Creative Commons Attribution-NonCommercial-ShareAlike3.0 UnportedLicense.
point_distribution = ValueList({"random": 0, "grid": 1}, selected="grid")
point_distribution_2 = ValueList({"random": 0, "grid": 1}, selected="grid")
point_distribution_3 = ValueList({"random": 0, "grid": 1}, selected="grid")
sdivide = DivideSurface(Surface=crv_2, UCount=number_slider, VCount=number_slider)  # -> graft(Points), Normals, Parameters
sdivide_2 = DivideSurface(Surface=crv_3, UCount=number_slider_2, VCount=number_slider_2)  # -> graft(Points), Normals, Parameters
sdivide_3 = DivideSurface(Surface=crv_6, UCount=number_slider_3, VCount=number_slider_3)  # -> graft(Points), Normals, Parameters
pop2d = Populate2D(Region=crv_2, Count=Slider(379, range=100..1000), Seed=1)  # -> graft(Population)
pop2d_2 = Populate2D(Region=crv_3, Count=Slider(379, range=100..1000), Seed=1)  # -> graft(Population)
pop2d_3 = Populate2D(Region=crv_6, Count=Slider(379, range=100..1000), Seed=1)  # -> graft(Population)
filter = StreamFilter(Gate=point_distribution_2, Stream0=pop2d_2, Stream1=sdivide_2.Points)
filter_2 = StreamFilter(Gate=point_distribution_3, Stream0=pop2d_3, Stream1=sdivide_3.Points)
voids = ValueList({"ignore": 0, "consider": 1}, selected="consider")
filter_3 = StreamFilter(Gate=point_distribution, Stream0=pop2d, Stream1=sdivide.Points)

# ---- group: check for points inside void curves
incurves = PointInCurves(Point=filter, Curves=crv_5)  # -> Relationship, Index, Point
panel = Panel("""Point/Region relationship:

0 = outside
1 = coincident
2 = inside""")
equals = Equality(FirstNumber=incurves.Relationship, SecondNumber="0")  # -> Equality, Inequality
dispatch = Dispatch(List=filter, DispatchPattern=equals.Equality)  # -> ListA, ListB

incurves_2 = PointInCurves(Point=filter_2, Curves=crv_8)  # -> Relationship, Index, Point
equals_2 = Equality(FirstNumber=incurves_2.Relationship, SecondNumber="0")  # -> Equality, Inequality
dispatch_2 = Dispatch(List=filter_2, DispatchPattern=equals_2.Equality)  # -> ListA, ListB

# ----
voids_2 = ValueList({"ignore": 0, "consider": 1}, selected="consider")

# ---- group: calculate tangents
crv_cp = CurveClosestPoint(Point=filter_3, Curve=crv)  # -> Point, Parameter, Distance
eval = EvaluateCurve(Curve=crv, Parameter=crv_cp.Parameter)  # -> Point, Tangent, Angle

# ----
n_of_discrete_directions = Slider(4, range=0..10)
filter_4 = StreamFilter(Gate=voids_2, Stream0=filter, Stream1=dispatch.ListA)
filter_5 = StreamFilter(Gate=voids, Stream0=filter_2, Stream1=dispatch_2.ListA)
angle_range = Panel("0 to 2*Pi")
number_slider_4 = Slider(2.85, range=0..100)

# ---- group: calculate tangents
crv_cp_2 = CurveClosestPoint(Point=filter_4, Curve=crv_4)  # -> Point, Parameter, Distance
eval_2 = EvaluateCurve(Curve=crv_4, Parameter=crv_cp_2.Parameter)  # -> Point, Tangent, Angle

crv_cp_3 = CurveClosestPoint(Point=filter_5, Curve=crv_7)  # -> Point, Parameter, Distance
sort = SortList(Keys=crv_cp_3.Distance, ValuesB=crv_7, ValuesA=crv_cp_3.Parameter)  # -> Keys, ValuesB, ValuesA
item = ListItem(List=sort.ValuesB, Index=0, Wrap=True)
item_2 = ListItem(List=sort.ValuesA, Index=0, Wrap=True)
eval_3 = EvaluateCurve(Curve=item, Parameter=item_2)  # -> Point, Tangent, Angle

# ----
range = Range(Domain=angle_range, Steps=n_of_discrete_directions)
n_of_discrete_directions_2 = Slider(4, range=0..10)
cull_i = CullIndex(List=range, Indices="-1", Wrap=True)
X = UnitX(Factor=1)
Z = UnitZ(Factor=1)
angle_range_2 = Panel("0 to 2*Pi")
line = LineSDL(Start=filter_3, Direction=eval.Tangent, Length=number_slider_4)
vrot = Rotate(Vector=X, Axis=Z, Angle=cull_i)
number_slider_5 = Slider(2.85, range=0..100)
n_of_discrete_directions_3 = Slider(4, range=0..10)
range_2 = Range(Domain=angle_range_2, Steps=n_of_discrete_directions_2)
angle_range_3 = Panel("0 to 2*Pi")
cull_i_2 = CullIndex(List=range_2, Indices="-1", Wrap=True)
cv = ClosestVector(Reference=line, Target=vrot)  # -> Vector, Angle

# ---- group: show discrete orientations
vector_length = Slider(5, range=1..10)
multiplication = Multiplication(A=vrot, B=vector_length)
pt = Point(Point(0, 0, 0))
vdisex = VectorDisplayEx(Point=pt, Vector=multiplication, Colour=vrot, Width=2)

# ----
X_2 = UnitX(Factor=1)
Z_2 = UnitZ(Factor=1)
number_slider_6 = Slider(2.85, range=0..100)
line_2 = LineSDL(Start=filter_4, Direction=eval_2.Tangent, Length=number_slider_5)  # -> graft(Line)
vrot_2 = Rotate(Vector=X_2, Axis=Z_2, Angle=cull_i_2)
range_3 = Range(Domain=angle_range_3, Steps=n_of_discrete_directions_3)
line_3 = LineSDL(Start=filter_3, Direction=cv.Vector, Length=number_slider_4)
unit = UnitVector(Vector=line)
cull_i_3 = CullIndex(List=range_3, Indices="-1", Wrap=True)
X_3 = UnitX(Factor=1)
Z_3 = UnitZ(Factor=1)
cv_2 = ClosestVector(Reference=line_2, Target=vrot_2)  # -> Vector, Angle
# discrete tangent field
previewlw = CustomPreviewLineweights(Geometry=line_3, Shader=cv.Vector, Thickness="2", Absolute=False)
# continuous tangent field
previewlw_2 = CustomPreviewLineweights(Geometry=line, Shader=unit, Thickness="2", Absolute=False)

# ---- group: show discrete orientations
vector_length_2 = Slider(5, range=1..10)
multiplication_2 = Multiplication(A=vrot_2, B=vector_length_2)
pt_2 = Point(Point(300, 0, 0))
vdisex_2 = VectorDisplayEx(Point=pt_2, Vector=multiplication_2, Colour=vrot_2, Width=2)

# ----
line_4 = LineSDL(Start=filter_5, Direction=eval_3.Tangent, Length=number_slider_6)  # -> graft(Line)
vrot_3 = Rotate(Vector=X_3, Axis=Z_3, Angle=cull_i_3)
line_5 = LineSDL(Start=graft(filter_4), Direction=cv_2.Vector, Length=number_slider_5)  # -> graft(Line)
unit_2 = UnitVector(Vector=line_2)
cv_3 = ClosestVector(Reference=line_4, Target=vrot_3)  # -> Vector, Angle

# ---- group: show discrete orientations
vector_length_3 = Slider(5, range=1..10)
multiplication_3 = Multiplication(A=vrot_3, B=vector_length_3)
pt_3 = Point(Point(600, 0, 0))
vdisex_3 = VectorDisplayEx(Point=pt_3, Vector=multiplication_3, Colour=vrot_3, Width=2)

# ----
# discrete tangent field
previewlw_3 = CustomPreviewLineweights(Geometry=line_5, Shader=cv_2.Vector, Thickness="2", Absolute=False)
# continuous tangent field
previewlw_4 = CustomPreviewLineweights(Geometry=line_2, Shader=unit_2, Thickness="2", Absolute=False)
line_6 = LineSDL(Start=graft(filter_5), Direction=cv_3.Vector, Length=number_slider_6)  # -> graft(Line)
unit_3 = UnitVector(Vector=line_4)
# discrete tangent field
previewlw_5 = CustomPreviewLineweights(Geometry=line_6, Shader=cv_3.Vector, Thickness="2", Absolute=False)
# continuous tangent field
previewlw_6 = CustomPreviewLineweights(Geometry=line_4, Shader=unit_3, Thickness="2", Absolute=False)
