# Grasshopper definition 01_00_voxelise_planes.gh (Grasshopper 0.9.76)
# Copyright: Co-de-iT
# plug-ins: Human

panel = Panel("voxelise geometry ( meshes)")
# simple grid
geo = Geometry(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)
# alternate grid
geo_2 = Geometry(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)
bbox = BoundingBox(Content=geo, Plane=PlaneXY(0, 0, 0))  # -> Box, Box_2
bbox_2 = BoundingBox(Content=geo_2, Plane=PlaneXY(0, 0, 0))  # -> Box, Box_2
boxprop = BoxProperties(Box=bbox.Box)  # -> Center, Diagonal, Area, Volume, Degeneracy
boxprop_2 = BoxProperties(Box=bbox_2.Box)  # -> Center, Diagonal, Area, Volume, Degeneracy
# Voxelise planes
# 
# generate a 3D voxel planes grid from object
# 
# © a3 2017 _ Creative Commons Attribution-NonCommercial-ShareAlike3.0 UnportedLicense.
panel_2 = Panel("for box-compatible voxels")
scale = Scale(Geometry=bbox.Box, Center=boxprop.Center, Factor=Slider(1.5, range=1..3))  # -> Geometry, Transform
scale_2 = Scale(Geometry=bbox_2.Box, Center=boxprop_2.Center, Factor=Slider(1.5, range=1..3))  # -> Geometry, Transform
box_corners = BoxCorners(Box=scale.Geometry)  # -> CornerA, CornerB, CornerC, CornerD, CornerE, CornerF, CornerG, CornerH
# for geometries like truncated octahedrons, double pyramids, etc.
box_corners_2 = BoxCorners(Box=scale_2.Geometry)  # -> CornerA, CornerB, CornerC, CornerD, CornerE, CornerF, CornerG, CornerH
plane_size = Slider(24, range=0..100)
layer_height = Slider(12, range=0..100)
layer_count = Slider(20, range=0..100)
layer_height_2 = Slider(30, range=0..100)
plane_size_2 = Slider(30, range=0..100)
layer_count_2 = Slider(20, range=0..100)
recgrid = Rectangular(
    Plane=box_corners.CornerA,
    SizeX=plane_size,
    SizeY=plane_size,
    ExtentX=Slider(25, range=0..100),
    ExtentY=Slider(24, range=0..100))  # -> Cells, graft(Points)
recgrid_2 = Rectangular(
    Plane=box_corners_2.CornerA,
    SizeX=plane_size_2,
    SizeY=plane_size_2,
    ExtentX=Slider(25, range=0..100),
    ExtentY=Slider(24, range=0..100))  # -> Cells, graft(Points)
series = Series(Start=0, Step=layer_height, Count=layer_count)
series_2 = Series(Start=0, Step=layer_height_2, Count=layer_count_2)
multiplication = Multiplication(A=layer_height_2, B="0.5")
multiplication_2 = Multiplication(A=plane_size_2, B="0.5")
Z = UnitZ(Factor=series)
vec = VectorXYZ(XComponent=multiplication_2, YComponent=multiplication_2, ZComponent=multiplication)  # -> Vector, Length
Z_2 = UnitZ(Factor=series_2)
move = Move(Geometry=recgrid.Points, Motion=Z)  # -> Geometry, Transform
move_2 = Move(Geometry=recgrid_2.Points, Motion=Z_2)  # -> Geometry, Transform
minc = MeshInclusion(Mesh=geo, Point=move.Geometry, Strict=False)
move_3 = Move(Geometry=graft(move_2.Geometry), Motion=vec.Vector)  # -> Geometry, Transform
merge = Merge(Data1=flatten(move_2.Geometry), Data2=flatten(move_3.Geometry))
dispatch = Dispatch(List=move.Geometry, DispatchPattern=minc)  # -> ListA, ListB
pt = Point(dispatch.ListA)
multiplication_3 = Multiplication(A=plane_size, B="0.5")
clean = CleanTree(RemoveNulls=True, RemoveInvalid=True, RemoveEmpty=True, Tree=dispatch.ListA)  # -> flatten(Tree)
neg = Negative(Value=multiplication_3)
xy = XYPlane(Origin=clean)  # -> simplify(graft(Plane))
dom = ConstructDomain(DomainStart=neg, DomainEnd=multiplication_3)
minc_2 = MeshInclusion(Mesh=geo_2, Point=merge, Strict=False)
rectangle = Rectangle(Plane=xy, XSize=dom, YSize=dom, Radius=0)  # -> Rectangle, Length
dispatch_2 = Dispatch(List=merge, DispatchPattern=minc_2)  # -> ListA, ListB
pt_2 = Point(dispatch_2.ListA)
# internalise data and copy/paste this in Discretiser_Orientations
# voxel grid-planes
geo_3 = Geometry(rectangle.Rectangle)
multiplication_4 = Multiplication(A=plane_size_2, B="0.5")
clean_2 = CleanTree(RemoveNulls=True, RemoveInvalid=True, RemoveEmpty=True, Tree=dispatch_2.ListA)  # -> flatten(Tree)
neg_2 = Negative(Value=multiplication_4)
xy_2 = XYPlane(Origin=clean_2)  # -> simplify(graft(Plane))
dom_2 = ConstructDomain(DomainStart=neg_2, DomainEnd=multiplication_4)
rectangle_2 = Rectangle(Plane=xy_2, XSize=dom_2, YSize=dom_2, Radius=0)  # -> Rectangle, Length
# internalise data and copy/paste this in Discretiser_Orientations
# voxel grid-planes
geo_4 = Geometry(rectangle_2.Rectangle)
size = Slider(30, range=1..50)
# example
# truncated octahedrons
# 
# NOTE: grid should be same size of the octahedron in x,y,z
pt_3 = Point(Point(0, 0, 0))
Y = UnitY(Factor=Slider(500, range=10..500))
# this component generates space-filling polyhedra
# (see parameter "type" help)
f_sphgen = SpaceFillingPolyhedraGenerator(P=pt_3, type="1", scale=size)  # -> M, Poly; inputs P: Point3d, type: Int32, scale: Double
# ---------- f_sphgen: C# ----------
                                            /*
    froGH - a sparse collection of (in)utilities for Grasshopper

    Space-filling Polyhedra generator
    code by Alessio Erioli

    froGH by Co-de-iT is licensed under a Creative Commons Attribution 4.0 International License.
    http://creativecommons.org/licenses/by/4.0/

    */
    initComp();

    //Print("Hello " + Environment.UserName);
    //int vCount = RhinoDoc.ActiveDoc.NamedViews.Count;
    //Print(vCount.ToString());

    // __________________ autoList part __________________

    // variable for the list
    Grasshopper.Kernel.Special.GH_ValueList vList;
    // tries to cast input as list
    try{

      // if the list is not the first parameter then change Input[0] to the corresponding value
      vList = (Grasshopper.Kernel.Special.GH_ValueList) Component.Params.Input[1].Sources[0];
      // Print("value list connected");
      // check if the list must be created
      //if (vList.NickName != "dir type"){
      if (!vList.NickName.Equals("polygon type")){
        vList.ClearData();
        vList.ListItems.Clear();
        vList.NickName = "polygon type";
        var item1 = new Grasshopper.Kernel.Special.GH_ValueListItem("Bisymmetric Hendecahedron", "0");
        var item2 = new Grasshopper.Kernel.Special.GH_ValueListItem("Truncated Octahedron", "1");
        var item3 = new Grasshopper.Kernel.Special.GH_ValueListItem("Sphenoid Hendecahedron", "2");
        vList.ListItems.Add(item1);
        vList.ListItems.Add(item2);
        vList.ListItems.Add(item3);

        vList.ListItems[0].Value.CastTo(out type);
      }
    }
    catch{
      // handles anything that is not a value list
    }

    PolyHedra b;
    b = new PolyHedra(P, type, scale);
    M = b.mesh;
    Poly = b.fc;
# ---------- f_sphgen: C# additional code ----------
  void initComp(){
    Component.Name = "Space-filling polyhedra generator";
    Component.NickName = "f_SPHGen";
    Component.Description = "Creates a space filling polyhedra";

    Component.Params.Input[0].Name = "Base Point";
    Component.Params.Input[0].Description = "Base point for polyhedra";
    Component.Params.Input[1].Name = "Polyhedra type";
    Component.Params.Input[1].Description = "0 Bysimmetric Hendecahedron, 1 Truncated Octahedron, 2 Sphenoid Hendecahedron";
    Component.Params.Input[2].Name = "Scale";
    Component.Params.Input[2].Description = "Polyhedra scale (center on base point)";
    Component.Params.Output[0].Name = "Mesh";
    Component.Params.Output[0].Description = "Polyhedron as mesh";
    Component.Params.Output[1].Name = "Face polylines";
    Component.Params.Output[1].Description = "Polyhedron faces as polylines";
  }


  public class PolyHedra
  {

    public Point3d basePt;
    public Mesh mesh;
    public List<Polyline> fc;
    public int type;
    public double scale;

    public PolyHedra(Point3d basePt, int type, double scale)
    {
      this.basePt = basePt;
      this.type = type;
      this.scale = scale;
      fc = new List<Polyline>();
      switch (type){
        case 0:
          //mesh = BisymmetricHendec(basePt, scale, fc);
          mesh = BisymmetricHendec();
          break;
        case 1:
          mesh = TruncatedOct(basePt, scale, fc);
          break;
        case 2:
          mesh = SphenoidHendec(basePt, scale, fc);
          break;
        default:
          mesh = new Mesh();
          break;
      }
      getFacesPolylines();
    }

    Mesh BisymmetricHendec() {
      Mesh mesh = new Mesh();

      mesh.Vertices.Add(Point3d.Add(new Point3d(0, 0, 2), basePt));
      mesh.Vertices.Add(Point3d.Add(new Point3d(2, 1, 1), basePt));
      mesh.Vertices.Add(Point3d.Add(new Point3d(0, -1, 1), basePt));
      mesh.Vertices.Add(Point3d.Add(new Point3d(-2, 1, 1), basePt));
      mesh.Vertices.Add(Point3d.Add(new Point3d(0, 2, 0), basePt));
      mesh.Vertices.Add(Point3d.Add(new Point3d(1, -1, 0), basePt));
      mesh.Vertices.Add(Point3d.Add(new Point3d(-1, -1, 0), basePt));
      mesh.Vertices.Add(Point3d.Add(new Point3d(2, 1, -1), basePt));
      mesh.Vertices.Add(Point3d.Add(new Point3d(0, -1, -1), basePt));
      mesh.Vertices.Add(Point3d.Add(new Point3d(-2, 1, -1), basePt));
      mesh.Vertices.Add(Point3d.Add(new Point3d(0, 0, -2), basePt));

      mesh.Faces.AddFace(0, 3, 6, 2);
      mesh.Faces.AddFace(0, 2, 5, 1);
      mesh.Faces.AddFace(1, 5, 7);
      mesh.Faces.AddFace(7, 5, 8, 10);
      mesh.Faces.AddFace(10, 9, 6, 8);
      mesh.Faces.AddFace(8, 5, 2, 6);
      mesh.Faces.AddFace(6, 9, 3);
      mesh.Faces.AddFace(7, 4, 9, 10);
      mesh.Faces.AddFace(0, 3, 4, 1);
      mesh.Faces.AddFace(9, 4, 3);
      mesh.Faces.AddFace(7, 4, 1);

      mesh.UnifyNormals();

      mesh.Scale(scale);

      return mesh;
    }

    Mesh TruncatedOct(Point3d basePt, double scale, List<Polyline> fc) {
      Mesh mesh = new Mesh();

      mesh.Vertices.Add(Point3d.Add(new Point3d(0, -0.25, 0.5), basePt)); // A - 0
      mesh.Vertices.Add(Point3d.Add(new Point3d(-0.25, 0, 0.5), basePt)); // B - 1
      mesh.Vertices.Add(Point3d.Add(new Point3d(-0.5, 0, 0.25), basePt)); // C - 2
      mesh.Vertices.Add(Point3d.Add(new Point3d(-0.5, -0.25, 0), basePt)); // D - 3
      mesh.Vertices.Add(Point3d.Add(new Point3d(-0.25, -0.5, 0), basePt)); // E - 4
      mesh.Vertices.Add(Point3d.Add(new Point3d(0, -0.5, 0.25), basePt)); // F - 5
      mesh.Vertices.Add(Point3d.Add(new Point3d(0.25, 0, 0.5), basePt)); // G - 6
      mesh.Vertices.Add(Point3d.Add(new Point3d(0.5, 0, 0.25), basePt)); // H - 7
      mesh.Vertices.Add(Point3d.Add(new Point3d(0.5, -0.25, 0), basePt)); // I - 8
      mesh.Vertices.Add(Point3d.Add(new Point3d(0.25, -0.5, 0), basePt)); // J - 9

      mesh.Vertices.Add(Point3d.Add(new Point3d(0, 0.25, 0.5), basePt)); // K - 10
      mesh.Vertices.Add(Point3d.Add(new Point3d(-0.5, 0.25, 0), basePt)); // L - 11
      mesh.Vertices.Add(Point3d.Add(new Point3d(-0.25, 0.5, 0), basePt)); // M  - 12
      mesh.Vertices.Add(Point3d.Add(new Point3d(0, 0.5, 0.25), basePt)); // N - 13
      mesh.Vertices.Add(Point3d.Add(new Point3d(0.5, 0.25, 0), basePt)); // O - 14
      mesh.Vertices.Add(Point3d.Add(new Point3d(0.25, 0.5, 0), basePt)); // P - 15

      mesh.Vertices.Add(Point3d.Add(new Point3d(0, -0.25, -0.5), basePt)); // Q - 16
      mesh.Vertices.Add(Point3d.Add(new Point3d(-0.25, 0, -0.5), basePt)); // R - 17
      mesh.Vertices.Add(Point3d.Add(new Point3d(-0.5, 0, -0.25), basePt)); // S - 18
      mesh.Vertices.Add(Point3d.Add(new Point3d(0, -0.5, -0.25), basePt)); // T - 19
      mesh.Vertices.Add(Point3d.Add(new Point3d(0.25, 0, -0.5), basePt)); // U - 20
      mesh.Vertices.Add(Point3d.Add(new Point3d(0.5, 0, -0.25), basePt)); // V - 21
      mesh.Vertices.Add(Point3d.Add(new Point3d(0, 0.25, -0.5), basePt)); // W - 22
      mesh.Vertices.Add(Point3d.Add(new Point3d(0, 0.5, -0.25), basePt)); // Z - 23

      // hex faces
      mesh.Faces.AddFace(0, 1, 2, 5);
      mesh.Faces.AddFace(5, 2, 3, 4); // full face: 0, 1, 2, 3, 4, 5
      mesh.Faces.AddFace(5, 7, 6, 0);
      mesh.Faces.AddFace(5, 9, 8, 7); // full face: 5, 9, 8, 7, 6, 0
      mesh.Faces.AddFace(7, 13, 10, 6);
      mesh.Faces.AddFace(7, 14, 15, 13);
      mesh.Faces.AddFace(13, 2, 1, 10);
      mesh.Faces.AddFace(13, 12, 11, 2);
      mesh.Faces.AddFace(19, 21, 8, 9);
      mesh.Faces.AddFace(19, 16, 20, 21);
      mesh.Faces.AddFace(21, 23, 15, 14);
      mesh.Faces.AddFace(21, 20, 22, 23);
      mesh.Faces.AddFace(23, 18, 11, 12);
      mesh.Faces.AddFace(23, 22, 17, 18);
      mesh.Faces.AddFace(18, 19, 4, 3);
      mesh.Faces.AddFace(18, 17, 16, 19);
      // quad faces
      mesh.Faces.AddFace(0, 6, 10, 1); // top
      mesh.Faces.AddFace(16, 20, 22, 17); // bottom
      mesh.Faces.AddFace(8, 21, 14, 7); // E
      mesh.Faces.AddFace(15, 23, 12, 13); // N
      mesh.Faces.AddFace(11, 18, 3, 2); // W
      mesh.Faces.AddFace(4, 19, 9, 5); // S

      mesh.UnifyNormals();
      mesh.Scale(scale);

      return mesh;
    }

    Mesh SphenoidHendec(Point3d basePt, double scale, List<Polyline> fc)
    {
      Mesh mesh = new Mesh();

      mesh.Vertices.Add(Point3d.Add(new Point3d(13.0 / 7.0, 3 * Math.Sqrt(3) / 7, 1), basePt)); // A - 0
      mesh.Vertices.Add(Point3d.Add(new Point3d(1, Math.Sqrt(3), 0), basePt)); // B - 1
      mesh.Vertices.Add(Point3d.Add(new Point3d(2, Math.Sqrt(3), 0.5), basePt)); // C - 2
      mesh.Vertices.Add(Point3d.Add(new Point3d(2.5, Math.Sqrt(3) / 2, 0), basePt)); // D - 3
      mesh.Vertices.Add(Point3d.Add(new Point3d(2.25, Math.Sqrt(3) / 4, 0.5), basePt)); // E - 4
      mesh.Vertices.Add(Point3d.Add(new Point3d(2, 0, 0), basePt)); // F - 5
      mesh.Vertices.Add(Point3d.Add(new Point3d(0, 0, 0.5), basePt)); // G - 6
      mesh.Vertices.Add(Point3d.Add(new Point3d(2, Math.Sqrt(3), -0.5), basePt)); // H - 7
      mesh.Vertices.Add(Point3d.Add(new Point3d(2.25, Math.Sqrt(3) / 4, -0.5), basePt)); // J - 8
      mesh.Vertices.Add(Point3d.Add(new Point3d(0, 0, -0.5), basePt)); // K - 9
      mesh.Vertices.Add(Point3d.Add(new Point3d(13.0 / 7.0, 3 * Math.Sqrt(3) / 7, -1), basePt)); // L - 10

      // quad faces
      mesh.Faces.AddFace(0, 6, 5, 4); // A G F E
      mesh.Faces.AddFace(0, 2, 1, 6); // A C B G
      mesh.Faces.AddFace(0, 4, 3, 2); // A E D C
      mesh.Faces.AddFace(5, 9, 10, 8); // F K L J
      mesh.Faces.AddFace(7, 1, 9, 10); // H B K L
      mesh.Faces.AddFace(7, 10, 8, 3); // H L J D
      mesh.Faces.AddFace(4, 5, 8, 3); // E F J D

      // tri faces
      mesh.Faces.AddFace(6, 9, 5); // G K F
      mesh.Faces.AddFace(6, 1, 9); // G B K
      mesh.Faces.AddFace(2, 3, 7); // C D H
      mesh.Faces.AddFace(2, 7, 1); // C H B

      mesh.UnifyNormals();
      mesh.Scale(scale);

      return mesh;
    }

    public void getFacesPolylines(){
      Polyline ff = new Polyline();
      for (int i = 0; i < mesh.Faces.Count; i++){
        ff = new Polyline();
        Point3f[] pf = new Point3f[4];
        mesh.Faces.GetFaceVertices(i, out pf[0], out pf[1], out pf[2], out pf[3]);
        for (int j = 0; j < pf.Length; j++){
          ff.Add(pf[j].X, pf[j].Y, pf[j].Z);
        }
        ff.Add(pf[0].X, pf[0].Y, pf[0].Z); // adds again first point to generate a closed polyline
        fc.Add(ff);
      }
    }
  }
# ---------- end f_sphgen ----------
move_4 = Move(Geometry=xy_2, Motion=Y)  # -> Geometry, Transform
orient = Orient(Geometry=f_sphgen.M, Source=PlaneXY(0, 0, 0), Target=move_4.Geometry)  # -> Geometry, Transform
mjoin = MeshJoin(Meshes=flatten(orient.Geometry))
mesh = Mesh(mjoin)
medges = MeshEdges(Mesh=mesh)  # -> NakedEdges, InteriorEdges, NonManifoldEdges
previewmat = CustomPreviewMaterials(Geometry=mesh, DiffuseColor=RGB(255, 255, 255))
previewlw = CustomPreviewLineweights(Geometry=medges.InteriorEdges, Shader=ColourSwatch(SwatchColor=RGB(0, 0, 0)), Absolute=False)
