# Grasshopper definition 01_01_discretizer_orientations.gh (Grasshopper 0.9.76)
# Copyright: Co-de-iT
# plug-ins: MeshEdit Components, Human

panel = Panel("module geometry")
panel_2 = Panel("geometry center point")
panel_3 = Panel("field curves")
panel_4 = Panel("""voxel planes
from 01_00 file""")

# ---- group: case 00
# Rhino file:
# 
# 01_voxel planes.3dm
# set A
panel_5 = Panel("module geometry")
# discretiser/orientations
# 
# orient object to planes by field
# 
# © a3 2017 _ Creative Commons Attribution-NonCommercial-ShareAlike3.0 UnportedLicense.
geo = Geometry([<curve referenced from the Rhino model> x4])
pt = Point(<point referenced from the Rhino model>)

# ----
# planes can be filtered here according to custom-based criteria (ex. boundaries or conditions such as being too close/too far from something)
panel_8 = Panel("""voxel planes
from 01_00 file""")

# ---- group: case 01
geo_2 = Geometry([<curve referenced from the Rhino model> x9])
pt_2 = Point(<point referenced from the Rhino model>)

# ----
# planes can be filtered here according to custom-based criteria (ex. boundaries or conditions such as being too close/too far from something)
panel_11 = Panel("voids (meshes)")
# set B
panel_12 = Panel("module geometry")
# planes can be filtered here according to custom-based criteria (ex. boundaries or conditions such as being too close/too far from something)
panel_15 = Panel("""voxel planes
from 01_00 file""")
geo_3 = Geometry(<mesh referenced from the Rhino model>)
pt_3 = Point(<point referenced from the Rhino model>)
crv = Curve([<curve referenced from the Rhino model> x3])
crv_2 = Curve([<curve referenced from the Rhino model> x3129])
pt_4 = Point(<point referenced from the Rhino model>)
crv_3 = Curve([<curve referenced from the Rhino model> x2])
crv_4 = Curve([<curve referenced from the Rhino model> x3129])
# set C
geo_4 = Geometry(<mesh referenced from the Rhino model>)
geo_5 = Geometry([<mesh referenced from the Rhino model> x2])
geo_6 = Geometry(<mesh referenced from the Rhino model>)
pt_5 = Point(<point referenced from the Rhino model>)
crv_5 = Curve([<curve referenced from the Rhino model> x3])
crv_6 = Curve([<curve referenced from the Rhino model> x1152])
sampling_distance = Slider(29, range=0..100)
field_threshold = Slider(300, range=0..1000)
sampling_distance_2 = Slider(29, range=0..100)
field_threshold_2 = Slider(300, range=0..1000)
sampling_distance_3 = Slider(29, range=0..100)
field_threshold_3 = Slider(300, range=0..1000)
group = Group(Objects=geo)
weldvertices = MeshWeldVertices(Mesh=geo_4, Tolerance=0.01)  # -> RuntimeMessage, Mesh
weldvertices_2 = MeshWeldVertices(Mesh=geo_6, Tolerance=0.01)  # -> RuntimeMessage, Mesh
pt_6 = Point(pt)
pt_7 = Point(pt_4)
area = Area(Geometry=crv_2)  # -> Area, Centroid
area_2 = Area(Geometry=crv_4)  # -> Area, Centroid
area_3 = Area(Geometry=crv_6)  # -> Area, Centroid
minc = MeshInclusion(Mesh=geo_5, Point=graft(area.Centroid), Strict=False)

# ---- group: filter planes and find field tangent vectors
divdist = DivideDistance(Curve=crv_3, Distance=sampling_distance_2)  # -> flatten(Points), flatten(Tangents), Parameters
cp = ClosestPoint(Point=area_2.Centroid, Cloud=divdist.Points)  # -> ClosestPoint, CPIndex, Distance
# planes can also be filtered here according to custom-based criteria
smaller = SmallerThan(FirstNumber=cp.Distance, SecondNumber=field_threshold_2)  # -> SmallerThan, OrEqualTo
item = ListItem(List=divdist.Tangents, Index=cp.CPIndex, Wrap=True)
dispatch = Dispatch(List=area_2.Centroid, DispatchPattern=smaller.SmallerThan)  # -> ListA, ListB
dispatch_2 = Dispatch(List=item, DispatchPattern=smaller.SmallerThan)  # -> ListA, ListB

divdist_2 = DivideDistance(Curve=crv_5, Distance=sampling_distance_3)  # -> flatten(Points), flatten(Tangents), Parameters
cp_2 = ClosestPoint(Point=area_3.Centroid, Cloud=divdist_2.Points)  # -> ClosestPoint, CPIndex, Distance
# planes can also be filtered here according to custom-based criteria
smaller_2 = SmallerThan(FirstNumber=cp_2.Distance, SecondNumber=field_threshold_3)  # -> SmallerThan, OrEqualTo
item_2 = ListItem(List=divdist_2.Tangents, Index=cp_2.CPIndex, Wrap=True)
dispatch_3 = Dispatch(List=area_3.Centroid, DispatchPattern=smaller_2.SmallerThan)  # -> ListA, ListB
dispatch_4 = Dispatch(List=item_2, DispatchPattern=smaller_2.SmallerThan)  # -> ListA, ListB

# ----
f_massbool = MassBoolean(V=minc, type="1")  # -> B; inputs V: list of Boolean, type: Int32
# ---------- f_massbool: C# ----------
  /*
    froGH - a sparse collection of (in)utilities for Grasshopper

    mass boolean
    code by Alessio Erioli

    froGH by Co-de-iT is licensed under a Creative Commons Attribution 4.0 International License.
    http://creativecommons.org/licenses/by/4.0/

    */
    initComp();

    bool r;
    if (type == 0) {
      Component.Message = "AND";
      r = true;
    }else{
      Component.Message = "OR";
      r = false;
    }


    for (int i = 0; i < V.Count; i++){
      if (type == 0) {
        r = r && V[i];
      }
      else{
        r = r || V[i];
      }
    }
    B = r;
# ---------- f_massbool: C# additional code ----------
  void initComp(){
    Component.Name = "Mass Boolean";
    Component.NickName = "f_MassBool";
    Component.Description = "Mass boolean operator on a list of values";
    Component.Params.Input[0].Name = "Values";
    Component.Params.Input[0].Description = "boolean values as list";
    Component.Params.Input[1].Name = "Boolean operator";
    Component.Params.Input[1].Description = "type of operator: 0 AND, 1 OR";
    Component.Params.Output[0].Name = "Boolean result";
    Component.Params.Output[0].Description = "the result";

  }
# ---------- end f_massbool ----------
not = GateNot(A=f_massbool)  # -> flatten(Result)

# ---- group: filter planes and find field tangent vectors
divdist_3 = DivideDistance(Curve=crv, Distance=sampling_distance)  # -> flatten(Points), flatten(Tangents), Parameters
cp_3 = ClosestPoint(Point=area.Centroid, Cloud=divdist_3.Points)  # -> ClosestPoint, CPIndex, Distance
smaller_3 = SmallerThan(FirstNumber=cp_3.Distance, SecondNumber=field_threshold)  # -> SmallerThan, OrEqualTo
item_3 = ListItem(List=divdist_3.Tangents, Index=cp_3.CPIndex, Wrap=True)
and = GateAnd(A=smaller_3.SmallerThan, B=not)
dispatch_5 = Dispatch(List=area.Centroid, DispatchPattern=and)  # -> ListA, ListB
# planes can also be filtered here according to custom-based criteria
dispatch_6 = Dispatch(List=item_3, DispatchPattern=and)  # -> ListA, ListB

# ----
pt_8 = Point(dispatch.ListA)
pt_9 = Point(dispatch_3.ListA)

# ----
# discretize directions
n_directions = Panel("4")
discretize_vectors = DiscretizeVectors(vectors=dispatch_2.ListA, n_of_directions=n_directions)  # -> discretized_vectors, discretized_vector_grouped_by_direction, discrete_directions

# ----
# discretize directions
n_directions_2 = Panel("4")
discretize_vectors_2 = DiscretizeVectors(vectors=dispatch_4.ListA, n_of_directions=n_directions_2)  # -> discretized_vectors, discretized_vector_grouped_by_direction, discrete_directions

pt_10 = Point(dispatch_5.ListA)

# ----
# discretize directions
n_directions_3 = Panel("4")
discretize_vectors_3 = DiscretizeVectors(vectors=dispatch_6.ListA, n_of_directions=n_directions_3)  # -> discretized_vectors, discretized_vector_grouped_by_direction, discrete_directions

# ----
# display discrete directions
pt_11 = Point(Point(0, 0, 0))
vdisex = VectorDisplayEx(Point=pt_11, Vector=discretize_vectors.discrete_directions, Colour=discretize_vectors.discrete_directions, Width=2)
Z = UnitZ(Factor=1)
Z_2 = UnitZ(Factor=1)
item_4 = ListItem(
    List=discretize_vectors_2.discretized_vectors,
    Index=discretize_vectors_2.discretized_vector_grouped_by_direction,
    Wrap=True)
item_5 = ListItem(List=dispatch_3.ListA, Index=discretize_vectors_2.discretized_vector_grouped_by_direction, Wrap=True)
Z_3 = UnitZ(Factor=1)

# ----
# direction display by group
unit = UnitVector(Vector=dispatch_4.ListA)
item_6 = ListItem(List=unit, Index=discretize_vectors_2.discretized_vector_grouped_by_direction, Wrap=True)
item_7 = ListItem(
    List=discretize_vectors_2.discretized_vectors,
    Index=discretize_vectors_2.discretized_vector_grouped_by_direction,
    Wrap=True)
item_8 = ListItem(List=dispatch_3.ListA, Index=discretize_vectors_2.discretized_vector_grouped_by_direction, Wrap=True)
number_slider = Slider(7.667, range=0..10)
series = Series(Start=0, Step=1, Count=n_directions_2)
multiplication = Multiplication(A=item_7, B=number_slider)
multiplication_2 = Multiplication(A=item_6, B=number_slider)
int = Integer(graft(series))
entwine = Entwine(
    Branch00=ColourSwatch(SwatchColor=RGB(0, 0, 0)),
    Branch01=ColourSwatch(SwatchColor=RGB(255, 255, 255)),
    Branch02=ColourSwatch(SwatchColor=RGB(204, 94, 132)),
    Branch03=ColourSwatch(SwatchColor=RGB(138, 138, 138)),
    FlattenInputs=True)  # -> simplify(Result)
# "continuous" directions
vdisex_2 = VectorDisplayEx(Point=simplify(item_8), Vector=simplify(multiplication_2), Colour=entwine, Width=2)
# discrete directions
vdisex_3 = VectorDisplayEx(Point=simplify(item_8), Vector=simplify(multiplication), Colour=entwine, Width=2)
tag = TextTag3D(Location=item_8, Text=int, Size=Slider(4.705, range=0..5), Justification=7)

vrot = Rotate(Vector=discretize_vectors.discretized_vectors, Axis=Z, Angle="Pi*0.5")
vrot_2 = Rotate(Vector=discretize_vectors_2.discretized_vectors, Axis=Z_2, Angle="Pi*0.5")
vrot_3 = Rotate(Vector=item_4, Axis=Z_3, Angle="Pi*0.5")
pl = ConstructPlane(Origin=dispatch.ListA, XAxis=discretize_vectors.discretized_vectors, YAxis=vrot)
xy = XYPlane(Origin=pt_6)
Z_4 = UnitZ(Factor=1)
item_9 = ListItem(
    List=discretize_vectors_3.discretized_vectors,
    Index=discretize_vectors_3.discretized_vector_grouped_by_direction,
    Wrap=True)
item_10 = ListItem(List=dispatch_5.ListA, Index=discretize_vectors_3.discretized_vector_grouped_by_direction, Wrap=True)
pl_2 = ConstructPlane(Origin=dispatch_3.ListA, XAxis=discretize_vectors_2.discretized_vectors, YAxis=vrot_2)
Z_5 = UnitZ(Factor=1)
xy_2 = XYPlane(Origin=pt_5)
pl_3 = ConstructPlane(Origin=item_5, XAxis=item_4, YAxis=vrot_3)
xy_3 = XYPlane(Origin=pt_5)
# "continuous" directions
line = LineSDL(Start=dispatch.ListA, Direction=dispatch_2.ListA, Length=Slider(10, range=0..100))
# discrete directions
line_2 = LineSDL(Start=dispatch.ListA, Direction=discretize_vectors.discretized_vectors, Length=Slider(13, range=0..100))
orient = Orient(Geometry=group, Source=xy, Target=pl)  # -> Geometry, Transform
# "continuous" directions
line_3 = LineSDL(Start=dispatch_3.ListA, Direction=dispatch_4.ListA, Length=Slider(10, range=0..100))
# discrete directions
line_4 = LineSDL(Start=dispatch_3.ListA, Direction=discretize_vectors_2.discretized_vectors, Length=Slider(13, range=0..100))
vrot_4 = Rotate(Vector=item_9, Axis=Z_5, Angle="Pi*0.5")
orient_2 = Orient(Geometry=weldvertices_2.Mesh, Source=xy_2, Target=pl_2)  # -> Geometry, Transform
orient_3 = Orient(Geometry=weldvertices_2.Mesh, Source=xy_3, Target=pl_3)  # -> Geometry, Transform
Y = UnitY(Factor=Slider(500, range=0..1000))
vrot_5 = Rotate(Vector=discretize_vectors_3.discretized_vectors, Axis=Z_4, Angle="Pi*0.5")
tstat = TreeStatistics(Tree=orient_3.Geometry)  # -> Paths, Length, Count
pl_4 = ConstructPlane(Origin=item_10, XAxis=item_9, YAxis=vrot_4)
xy_4 = XYPlane(Origin=pt_7)
mjoin = MeshJoin(Meshes=orient_3.Geometry)
pl_5 = ConstructPlane(Origin=dispatch_5.ListA, XAxis=discretize_vectors_3.discretized_vectors, YAxis=vrot_5)
mjoin_2 = MeshJoin(Meshes=orient_2.Geometry)
xy_5 = XYPlane(Origin=pt_7)
range = Range(Domain=Domain(0, 1), Steps=expr("x-1", tstat.Count))
merge = Merge(Data1=ColourSwatch(SwatchColor=RGB(255, 255, 255)), Data2=ColourSwatch(SwatchColor=RGB(70, 98, 153)))
move = Move(Geometry=orient.Geometry, Motion=Y)  # -> Geometry, Transform
# "continuous" directions
line_5 = LineSDL(Start=dispatch_5.ListA, Direction=dispatch_6.ListA, Length=Slider(10, range=0..100))
orient_4 = Orient(Geometry=weldvertices.Mesh, Source=xy_4, Target=pl_4)  # -> Geometry, Transform
# discrete directions
line_6 = LineSDL(Start=dispatch_5.ListA, Direction=discretize_vectors_3.discretized_vectors, Length=Slider(13, range=0..100))
orient_5 = Orient(Geometry=weldvertices.Mesh, Source=xy_5, Target=pl_5)  # -> Geometry, Transform
tstat_2 = TreeStatistics(Tree=orient_4.Geometry)  # -> Paths, Length, Count
interp = InterpolateData(Data=merge, Parameter=range, Interpolation=2)  # -> graft(Value)
mjoin_3 = MeshJoin(Meshes=orient_5.Geometry)
mjoin_4 = MeshJoin(Meshes=orient_4.Geometry)
range_2 = Range(Domain=Domain(0, 1), Steps=expr("x-1", tstat_2.Count))
merge_2 = Merge(Data1=ColourSwatch(SwatchColor=RGB(255, 255, 255)), Data2=ColourSwatch(SwatchColor=RGB(230, 0, 255)))
# oriented geometry
previewlw = CustomPreviewLineweights(Geometry=orient.Geometry, Shader=ColourSwatch(SwatchColor=RGB(38, 38, 38)), Absolute=False)
# oriented geometry
previewlw_2 = CustomPreviewLineweights(Geometry=mjoin_2, Shader=ColourSwatch(SwatchColor=RGB(38, 38, 38)), Absolute=False)
# oriented geometry
# grouped by direction
previewlw_3 = CustomPreviewLineweights(Geometry=mjoin, Shader=interp, Absolute=False)
interp_2 = InterpolateData(Data=merge_2, Parameter=range_2, Interpolation=2)  # -> graft(Value)
# oriented geometry
previewlw_4 = CustomPreviewLineweights(Geometry=mjoin_3, Shader=ColourSwatch(SwatchColor=RGB(64, 64, 64)), Absolute=False)
# oriented geometry
# grouped by direction
previewlw_5 = CustomPreviewLineweights(Geometry=mjoin_4, Shader=interp_2, Absolute=False)

# ==== cluster DiscretizeVectors
vectors = ClusterInput()
n_of_directions = ClusterInput()
one_over_x = OneOverX(Value=n_of_directions)
neg = Negative(Value=one_over_x)
pi = Pi(Factor=neg)
X = UnitX(Factor=1)
Z = UnitZ(Factor=1)
vrot = Rotate(Vector=X, Axis=Z, Angle=pi)
xy = XYPlane(Origin=Point(0, 0, 0))
pi_2 = Pi(Factor="2")
angle = Angle(VectorA=vectors, VectorB=vrot, Plane=xy)  # -> Angle, Reflex
range = Range(Domain=pi_2, Steps=n_of_directions)
cull_i = CullIndex(List=range, Indices="-1", Wrap=True)
remap = RemapNumbers(Value=angle.Reflex, Source="0 to 2*Pi", Target=Domain(0, 1))  # -> Mapped, Clipped
multiplication = Multiplication(A=remap.Clipped, B=n_of_directions)
X_2 = UnitX(Factor=1)
Z_2 = UnitZ(Factor=1)
expression = Expression(x=multiplication, Expression="floor(x)")
vrot_2 = Rotate(Vector=X_2, Axis=Z_2, Angle=cull_i)
item = ListItem(List=vrot_2, Index=graft(expression), Wrap=True)  # -> flatten(Item)

# ----
# group by direction
series = Series(Start=0, Step=1, Count=n_of_directions)
int = Integer(series)
mindex = MemberIndex(Set=expression, Member=int)  # -> Index, Count

discretized_vectors = ClusterOutput(item)
discrete_directions = ClusterOutput(vrot_2)
discretized_vector_grouped_by_direction = ClusterOutput(mindex.Index)
