# Grasshopper definition 01_02_discretizer_orientations_multiple components.gh (Grasshopper 0.9.76)
# Copyright: Co-de-iT
# plug-ins: Human

# ---- group: case 02
panel = Panel("module geometry")
panel_2 = Panel("geometry center point")
geo = Geometry(<mesh referenced from the Rhino model>)
pt = Point(<point referenced from the Rhino model>)

geo_2 = Geometry(<mesh referenced from the Rhino model>)
pt_2 = Point(<point referenced from the Rhino model>)

# ---- group: case 01
geo_3 = Geometry(<mesh referenced from the Rhino model>)
pt_3 = Point(<point referenced from the Rhino model>)

# ----
# vector field for orientation
panel_7 = Panel("""voxel planes
from 01_00 file""")
panel_8 = Panel("field curves")
# vector field for orientation
panel_9 = Panel("""voxel planes
from 01_00 file""")

# ---- group: case 01
geo_4 = Geometry(<mesh referenced from the Rhino model>)
pt_4 = Point(<point referenced from the Rhino model>)

# ---- group: case 00
# discretiser/orientations - multiple components
# 
# orient object to planes by field
# 
# © a3 2017 _ Creative Commons Attribution-NonCommercial-ShareAlike3.0 UnportedLicense.
# simple grid
# component geometry types
# per ogni componente definire le geometrie e un punto di riferimento
panel_13 = Panel("module geometry")
geo_5 = Geometry(<mesh referenced from the Rhino model>)
pt_5 = Point(<point referenced from the Rhino model>)

# alternate grid
# component geometry types
# per ogni componente definire le geometrie e un punto di riferimento
panel_15 = Panel("module geometry")
geo_6 = Geometry(<mesh referenced from the Rhino model>)
pt_6 = Point(<point referenced from the Rhino model>)

# ----
crv = Curve([<curve referenced from the Rhino model> x1160])
crv_2 = Curve([<curve referenced from the Rhino model> x3])
crv_3 = Curve([<curve referenced from the Rhino model> x234])
crv_4 = Curve([<curve referenced from the Rhino model> x3])
sampling_distance = Slider(29, range=0..100)
sampling_distance_2 = Slider(29, range=0..100)

group = Group(Objects=geo)
pt_7 = Point(pt)
group_2 = Group(Objects=geo_5)
group_3 = Group(Objects=geo_3)
pt_8 = Point(pt_5)
pt_9 = Point(pt_3)

group_4 = Group(Objects=geo_2)
pt_10 = Point(pt_2)
group_5 = Group(Objects=geo_6)
group_6 = Group(Objects=geo_4)
pt_11 = Point(pt_6)
pt_12 = Point(pt_4)

area = Area(Geometry=crv)  # -> Area, Centroid
area_2 = Area(Geometry=crv_3)  # -> Area, Centroid

# ---- group: get closest field direction
divdist = DivideDistance(Curve=crv_2, Distance=sampling_distance)  # -> flatten(Points), flatten(Tangents), Parameters
cp = ClosestPoint(Point=area.Centroid, Cloud=divdist.Points)  # -> ClosestPoint, CPIndex, Distance
item = ListItem(List=divdist.Tangents, Index=cp.CPIndex, Wrap=True)

divdist_2 = DivideDistance(Curve=crv_4, Distance=sampling_distance_2)  # -> flatten(Points), flatten(Tangents), Parameters
cp_2 = ClosestPoint(Point=area_2.Centroid, Cloud=divdist_2.Points)  # -> ClosestPoint, CPIndex, Distance
item_2 = ListItem(List=divdist_2.Tangents, Index=cp_2.CPIndex, Wrap=True)

# ----
# discretize directions
n_directions = Panel("4")
# orientations
discretize_vectors = DiscretizeVectors(vectors=item, n_of_directions=n_directions)  # -> discretized_vectors, discretized_vector_grouped_by_direction, discrete_directions

# ----
# discretize directions
n_directions_2 = Panel("4")
# orientations
discretize_vectors_2 = DiscretizeVectors(vectors=item_2, n_of_directions=n_directions_2)  # -> discretized_vectors, discretized_vector_grouped_by_direction, discrete_directions

Z = UnitZ(Factor=1)
Z_2 = UnitZ(Factor=1)
vrot = Rotate(Vector=discretize_vectors.discretized_vectors, Axis=Z, Angle="Pi*0.5")
vrot_2 = Rotate(Vector=discretize_vectors_2.discretized_vectors, Axis=Z_2, Angle="Pi*0.5")
pl = ConstructPlane(Origin=area.Centroid, XAxis=discretize_vectors.discretized_vectors, YAxis=vrot)
pl_2 = ConstructPlane(Origin=area_2.Centroid, XAxis=discretize_vectors_2.discretized_vectors, YAxis=vrot_2)

# ----
# sort elements by orientation
mindex = MemberIndex(Set=discretize_vectors.discretized_vectors, Member=discretize_vectors.discrete_directions)  # -> Index, Count

# ----
# sort elements by orientation
mindex_2 = MemberIndex(Set=discretize_vectors_2.discretized_vectors, Member=discretize_vectors_2.discrete_directions)  # -> Index, Count

# ----
# converte un range di valori in un numero discreto di interi (utile per assegnare componenti)
n_of_components = Slider(3, range=1..6)
# selection criteria
# ad ogni posizione di destinazione va associato un indice corrispondente al tipo di componente da inserire.
# 
# In questo caso il pattern di scelta è determinato dalla distanza dalle curve, ma può essere generato o stabilito con criteri ad hoc
# scalar field to discrete values
# (component type selection)
# i componenti sono assegnati a seconda della distanza dalla curva più vicina. Il pattern di distribuzione può anche essere alterato con un graph mapper.
# insert values to discretize here
num = Number(cp.Distance)
bnd = Bounds(Numbers=num)
remap = RemapNumbers(Value=num, Source=bnd, Target=Domain(0, 1))  # -> Mapped, Clipped
subtraction = Subtraction(A=n_of_components, B="1")

graph = GraphMapper(
    remap.Mapped,
    x0=0,
    x1=1,
    y0=0,
    y1=1,
    container_name="Bezier",
    cpx=[0, 0.3443846107, 0.1953434348, 1],
    cpy=[0, 0.3101444244, 0.9918836355, 1])

multiplication = Multiplication(A=graph, B=subtraction)

# ----
# selection pattern
int = Integer(multiplication)

# ---- group: geometries
# select components
weave = Weave(Pattern=graft(int), Stream0=group_2, Stream1=group_3, Stream2=group, NullGaps=False)  # -> flatten(Weave)

# ---- group: base points
# se ho più componenti aggiungo il n. di canali di input che servono in questi componenti weave
weave_2 = Weave(Pattern=graft(int), Stream0=pt_8, Stream1=pt_9, Stream2=pt_7, NullGaps=False)  # -> flatten(Weave)

# ----
# selection pattern
# sort elements by type
series = Series(Start=0, Step=1, Count=n_of_components)
int_2 = Integer(series)
int_3 = Integer(int)
mindex_3 = MemberIndex(Set=int_3, Member=int_2)  # -> Index, Count

# ----
# orient components
xy = XYPlane(Origin=weave_2)
orient = Orient(Geometry=weave, Source=xy, Target=pl)  # -> Geometry, Transform
item_3 = ListItem(List=orient.Geometry, Index=mindex_3.Index, Wrap=True)
# aggiungere canali di output fino al n. di orientamenti utilizzato oppure cliccare con il tasto destro sul componente e scegliere "Match Outputs"
item_4 = ListItem(List=orient.Geometry, Index=mindex.Index, Wrap=True)
# aggiungere canali di output fino al n. di componenti utilizzato oppure cliccare con il tasto destro sul componente e scegliere "Match Outputs"
bang = ExplodeTree(Data=item_3)  # -> Branch0, Branch1, Branch2
bang_2 = ExplodeTree(Data=item_4)  # -> _0000, _0001, _0002, _0003
ungroup = Ungroup(Group=bang.Branch0)
ungroup_2 = Ungroup(Group=bang.Branch1)
ungroup_3 = Ungroup(Group=bang.Branch2)
ungroup_4 = Ungroup(Group=bang_2._0000)
ungroup_5 = Ungroup(Group=bang_2._0001)
ungroup_6 = Ungroup(Group=bang_2._0002)
ungroup_7 = Ungroup(Group=bang_2._0003)
# output and visualization
ungroup_8 = Ungroup(Group=orient.Geometry)
previewmat = CustomPreviewMaterials(Geometry=ungroup, DiffuseColor=ColourSwatch(SwatchColor=RGB(255, 255, 255)))
# oriented geometry by type
previewmat_2 = CustomPreviewMaterials(Geometry=ungroup_2, DiffuseColor=ColourSwatch(SwatchColor=RGB(255, 0, 0)))
previewmat_3 = CustomPreviewMaterials(Geometry=ungroup_3, DiffuseColor=ColourSwatch(SwatchColor=RGB(255, 238, 0)))
previewmat_4 = CustomPreviewMaterials(Geometry=ungroup_5, DiffuseColor=ColourSwatch(SwatchColor=RGB(255, 0, 0)))
# oriented geometry by orientation
previewmat_5 = CustomPreviewMaterials(Geometry=ungroup_6, DiffuseColor=ColourSwatch(SwatchColor=RGB(98, 255, 0)))
previewmat_6 = CustomPreviewMaterials(Geometry=ungroup_7, DiffuseColor=ColourSwatch(SwatchColor=RGB(0, 200, 255)))
# oriented geometry
previewmat_7 = CustomPreviewMaterials(Geometry=ungroup_8, DiffuseColor=RGB(255, 255, 255))
previewmat_8 = CustomPreviewMaterials(Geometry=ungroup_4, DiffuseColor=ColourSwatch(SwatchColor=RGB(255, 255, 255)))

# ----
# converte un range di valori in un numero discreto di interi (utile per assegnare componenti)
n_of_components_2 = Slider(3, range=1..6)
# selection criteria
# scalar field to discrete values
# (component type selection)
# i componenti sono assegnati a seconda della distanza dalla curva più vicina. Il pattern di distribuzione può anche essere alterato con un graph mapper.
# insert values to discretize here
num_2 = Number(cp_2.Distance)
bnd_2 = Bounds(Numbers=num_2)
remap_2 = RemapNumbers(Value=num_2, Source=bnd_2, Target=Domain(0, 1))  # -> Mapped, Clipped
subtraction_2 = Subtraction(A=n_of_components_2, B="1")

graph_2 = GraphMapper(
    remap_2.Mapped,
    x0=0,
    x1=1,
    y0=0,
    y1=1,
    container_name="Bezier",
    cpx=[0, 0.5941379666, 0.1557817906, 1],
    cpy=[0, 0.1256227493, 1, 1])

multiplication_2 = Multiplication(A=graph_2, B=subtraction_2)

# ----
# selection pattern
int_4 = Integer(multiplication_2)

# ---- group: geometries
# select components
weave_3 = Weave(Pattern=graft(int_4), Stream0=group_5, Stream1=group_6, Stream2=group_4, NullGaps=False)  # -> flatten(Weave)

# ---- group: base points
# se ho più componenti aggiungo il n. di canali di input che servono in questi componenti weave
weave_4 = Weave(Pattern=graft(int_4), Stream0=pt_11, Stream1=pt_12, Stream2=pt_10, NullGaps=False)  # -> flatten(Weave)

# ----
# selection pattern
# sort elements by type
series_2 = Series(Start=0, Step=1, Count=n_of_components_2)
int_5 = Integer(series_2)
int_6 = Integer(int_4)
mindex_4 = MemberIndex(Set=int_6, Member=int_5)  # -> Index, Count

# ----
# orient components
xy_2 = XYPlane(Origin=weave_4)
orient_2 = Orient(Geometry=weave_3, Source=xy_2, Target=pl_2)  # -> Geometry, Transform
item_5 = ListItem(List=orient_2.Geometry, Index=mindex_4.Index, Wrap=True)
# aggiungere canali di output fino al n. di orientamenti utilizzato oppure cliccare con il tasto destro sul componente e scegliere "Match Outputs"
item_6 = ListItem(List=orient_2.Geometry, Index=mindex_2.Index, Wrap=True)
# aggiungere canali di output fino al n. di componenti utilizzato oppure cliccare con il tasto destro sul componente e scegliere "Match Outputs"
bang_3 = ExplodeTree(Data=item_5)  # -> Branch0, Branch1, Branch2
bang_4 = ExplodeTree(Data=item_6)  # -> _0000, _0001, _0002, _0003
ungroup_9 = Ungroup(Group=bang_3.Branch0)
ungroup_10 = Ungroup(Group=bang_3.Branch1)
ungroup_11 = Ungroup(Group=bang_3.Branch2)
ungroup_12 = Ungroup(Group=bang_4._0000)
ungroup_13 = Ungroup(Group=bang_4._0001)
ungroup_14 = Ungroup(Group=bang_4._0002)
ungroup_15 = Ungroup(Group=bang_4._0003)
# output and visualization
ungroup_16 = Ungroup(Group=orient_2.Geometry)
previewmat_9 = CustomPreviewMaterials(Geometry=ungroup_9, DiffuseColor=ColourSwatch(SwatchColor=RGB(255, 255, 255)))
# oriented geometry by type
previewmat_10 = CustomPreviewMaterials(Geometry=ungroup_10, DiffuseColor=ColourSwatch(SwatchColor=RGB(255, 0, 0)))
previewmat_11 = CustomPreviewMaterials(Geometry=ungroup_11, DiffuseColor=ColourSwatch(SwatchColor=RGB(255, 238, 0)))
previewmat_12 = CustomPreviewMaterials(Geometry=ungroup_13, DiffuseColor=ColourSwatch(SwatchColor=RGB(255, 0, 0)))
# oriented geometry by orientation
previewmat_13 = CustomPreviewMaterials(Geometry=ungroup_14, DiffuseColor=ColourSwatch(SwatchColor=RGB(98, 255, 0)))
previewmat_14 = CustomPreviewMaterials(Geometry=ungroup_15, DiffuseColor=ColourSwatch(SwatchColor=RGB(0, 200, 255)))
# oriented geometry
previewmat_15 = CustomPreviewMaterials(Geometry=ungroup_16, DiffuseColor=RGB(255, 255, 255))
previewmat_16 = CustomPreviewMaterials(Geometry=ungroup_12, DiffuseColor=ColourSwatch(SwatchColor=RGB(255, 255, 255)))

# ==== cluster DiscretizeVectors
vectors = ClusterInput()
n_of_directions = ClusterInput()
one_over_x = OneOverX(Value=n_of_directions)
neg = Negative(Value=one_over_x)
pi = Pi(Factor=neg)
X = UnitX(Factor=1)
Z = UnitZ(Factor=1)
vrot = Rotate(Vector=X, Axis=Z, Angle=pi)
xy = XYPlane(Origin=Point(0, 0, 0))
pi_2 = Pi(Factor="2")
angle = Angle(VectorA=vectors, VectorB=vrot, Plane=xy)  # -> Angle, Reflex
range = Range(Domain=pi_2, Steps=n_of_directions)
cull_i = CullIndex(List=range, Indices="-1", Wrap=True)
remap = RemapNumbers(Value=angle.Reflex, Source="0 to 2*Pi", Target=Domain(0, 1))  # -> Mapped, Clipped
multiplication = Multiplication(A=remap.Clipped, B=n_of_directions)
X_2 = UnitX(Factor=1)
Z_2 = UnitZ(Factor=1)
expression = Expression(x=multiplication, Expression="floor(x)")
vrot_2 = Rotate(Vector=X_2, Axis=Z_2, Angle=cull_i)
item = ListItem(List=vrot_2, Index=graft(expression), Wrap=True)  # -> flatten(Item)

# ----
# group by direction
series = Series(Start=0, Step=1, Count=n_of_directions)
int = Integer(series)
mindex = MemberIndex(Set=expression, Member=int)  # -> Index, Count

discretized_vectors = ClusterOutput(item)
discrete_directions = ClusterOutput(vrot_2)
discretized_vector_grouped_by_direction = ClusterOutput(mindex.Index)
