# Grasshopper definition 02_02_Orient by stress data.gh (Grasshopper 0.9.76)
# Copyright: Co-de-iT
# plug-ins: Human, Mesh Pipe, ClosestVector

# ----
# Orient by stress data
# 
# Inherit stress data from Millipede analysis and orient a number of components. Gives the possibility to sort and manipulate oriented geometry by orientation, component type and individual sub-components.
# 
# © a3 2017 _ Creative Commons Attribution-NonCommercial-ShareAlike3.0 UnportedLicense.
# vector field
crv = Curve([<curve referenced from the Rhino model> x2757])
# base points
pt = Point([<point referenced from the Rhino model> x2757])
# cell type
int = Integer([0, 0, 0, 0, 0, 0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])

# ----
# cell type 3
# base plane
pt_2 = Point(<point referenced from the Rhino model>)
# geometries
# inside the cell
geo = Geometry([<curve referenced from the Rhino model> x7])
# cell type 2
# base plane
pt_3 = Point(<point referenced from the Rhino model>)
# geometries
# inside the cell
geo_2 = Geometry([<curve referenced from the Rhino model> x8])
# cell type 0
# base plane
pt_4 = Point(<point referenced from the Rhino model>)
# geometries
# inside the cell
geo_3 = Geometry([<curve referenced from the Rhino model> x7])
# cell type 1
# base plane
pt_5 = Point(<point referenced from the Rhino model>)
# geometries
# inside the cell
geo_4 = Geometry([<curve referenced from the Rhino model> x8])

# ----
# test cell (arrow shaped)
# base plane
# geometries
# inside the cell
pt_6 = Point(<point referenced from the Rhino model>)
geo_5 = Geometry([<curve referenced from the Rhino model> x4])
xz = XZPlane(Origin=pt_6)
merge = Merge(Data1=xz, Data2=geo_5)
group = Group(Objects=merge)

xz_2 = XZPlane(Origin=pt_2)
xz_3 = XZPlane(Origin=pt_3)
xz_4 = XZPlane(Origin=pt_4)
xz_5 = XZPlane(Origin=pt_5)

# ----
# convert field to discrete directions
X = UnitX(Factor=1)
Y = UnitY(Factor=1)
Z = UnitZ(Factor=1)
merge_2 = Merge(Data1=X, Data2=Y, Data3=Z)
neg = Negative(Value=merge_2)
merge_3 = Merge(Data1=merge_2, Data2=neg)
# discretized directions
cv = ClosestVector(Reference=graft(crv), Target=merge_3)  # -> flatten(Vector), Angle

merge_4 = Merge(Data1=xz_2, Data2=geo)
merge_5 = Merge(Data1=xz_3, Data2=geo_2)
merge_6 = Merge(Data1=xz_4, Data2=geo_3)
merge_7 = Merge(Data1=xz_5, Data2=geo_4)
group_2 = Group(Objects=merge_4)
group_3 = Group(Objects=merge_5)
group_4 = Group(Objects=merge_6)
group_5 = Group(Objects=merge_7)
vec = Vector(cv.Vector)

multiplication = Multiplication(A=vec, B=Slider(3.94, range=1..10))
vdisex = VectorDisplayEx(Point=pt, Vector=multiplication, Colour=multiplication, Width=2)

xz_6 = XZPlane(Origin=pt)
tag = TextTag3D(
    Location=xz_6,
    Text=int,
    Size=Slider(1, range=1..20),
    Colour=ColourSwatch(SwatchColor=RGB(255, 255, 255)),
    Justification=7)

panel = Panel("cell type tag")
panel_2 = Panel("discrete vectors")
panel_3 = Panel("orient components sequentially")

weave = Weave(Pattern=graft(int), Stream0=group_4, Stream1=group_5, Stream2=group_3, Stream3=group_2, NullGaps=False)
ungroup = Ungroup(Group=weave)
pl = PlaneNormal(Origin=pt, ZAxis=vec)  # -> graft(Plane)

item = ListItem(List=ungroup, Index=0, Wrap=True)

# ----
# select and orient
orient = Orient(Geometry=weave, Source=item, Target=pl)  # -> Geometry, Transform

# ----
# sort oriented cells by component type
component_type_indexes = Panel("""0
1
2
3""")
int_2 = Integer(component_type_indexes)
mindex = MemberIndex(Set=int, Member=graft(int_2))  # -> simplify(Index), Count
item_2 = ListItem(List=flatten(orient.Geometry), Index=mindex.Index, Wrap=True)
merge_8 = Merge(
    Data1=ColourSwatch(SwatchColor=RGB(0, 0, 0)),
    Data2=ColourSwatch(SwatchColor=RGB(255, 0, 0)),
    Data3=ColourSwatch(SwatchColor=RGB(255, 212, 0)),
    Data4=ColourSwatch(SwatchColor=RGB(255, 255, 255)))  # -> simplify(graft(Result))
ungroup_2 = Ungroup(Group=item_2)
# sort and visualize by component type
cull_i = CullIndex(List=ungroup_2, Indices=0, Wrap=True)
group_6 = Group(Objects=cull_i)  # -> simplify(Group)
crv_2 = Curve(cull_i)
pshift = ShiftPaths(Data=group_6, Offset=-1)
previewlw = CustomPreviewLineweights(Geometry=pshift, Shader=merge_8, Absolute=False)

# ----
# sort oriented cells by orientation angle
mindex_2 = MemberIndex(Set=vec, Member=graft(merge_3))  # -> simplify(Index), Count
item_3 = ListItem(List=flatten(orient.Geometry), Index=mindex_2.Index, Wrap=True)
colour_swatch = ColourSwatch(SwatchColor=RGB(255, 0, 0))
colour_swatch_2 = ColourSwatch(SwatchColor=RGB(17, 255, 0))
colour_swatch_3 = ColourSwatch(SwatchColor=RGB(0, 34, 255))
colour_swatch_4 = ColourSwatch(SwatchColor=RGB(117, 0, 0))
colour_swatch_5 = ColourSwatch(SwatchColor=RGB(0, 120, 2))
colour_swatch_6 = ColourSwatch(SwatchColor=RGB(0, 14, 105))
merge_9 = Merge(
    Data1=colour_swatch,
    Data2=colour_swatch_2,
    Data3=colour_swatch_3,
    Data4=colour_swatch_4,
    Data5=colour_swatch_5,
    Data6=colour_swatch_6)  # -> simplify(graft(Result))
ungroup_3 = Ungroup(Group=item_3)
cull_i_2 = CullIndex(List=ungroup_3, Indices=0, Wrap=True)
# sort and visualize by orientation
group_7 = Group(Objects=cull_i_2)  # -> simplify(Group)
pshift_2 = ShiftPaths(Data=group_7, Offset=-1)
previewlw_2 = CustomPreviewLineweights(Geometry=pshift_2, Shader=merge_9, Absolute=False)

bang = ExplodeTree(Data=item_2)  # -> Branch0, Branch1, Branch2, Branch3
ungroup_4 = Ungroup(Group=bang.Branch0)
ungroup_5 = Ungroup(Group=bang.Branch1)
ungroup_6 = Ungroup(Group=bang.Branch2)
ungroup_7 = Ungroup(Group=bang.Branch3)
cull_i_3 = CullIndex(List=ungroup_7, Indices=0, Wrap=True)
cull_i_4 = CullIndex(List=ungroup_6, Indices=0, Wrap=True)
cull_i_5 = CullIndex(List=ungroup_4, Indices=0, Wrap=True)
cull_i_6 = CullIndex(List=ungroup_5, Indices=0, Wrap=True)
merge_10 = Merge(Data1=cull_i_5, Data2=cull_i_4, Data3=cull_i_3)

# ----
# seleziona ogni singolo sub-componente
lng = ListLength(List=cull_i_6)
# break down in individual sub-components
item_4 = ListItem(List=cull_i_6, Index=0, Wrap=True)  # -> Item, Item1, Item2, Item3, Item4, Item5, Item6, Item7
range = Range(Domain=Domain(0, 1), Steps=expr("x-1", lng))
gradient = Gradient(LowerLimit=0, UpperLimit=1, Parameter=range, stops=[0: RGB(0, 128, 0), 0.5: RGB(255, 255, 0), 1: RGB(255, 0, 0)])
crv_3 = Curve(item_4.Item)
previewlw_3 = CustomPreviewLineweights(Geometry=crv_3, Shader=ColourSwatch(SwatchColor=RGB(0, 0, 0)), Thickness="3", Absolute=False)
previewlw_4 = CustomPreviewLineweights(Geometry=cull_i_6, Shader=gradient, Absolute=False)

curvepoint = PointOnCurve(crv_3, parameter=0.5)
# sub-component local variation
# (example)
end = EndPoints(Curve=crv_3)  # -> Start, End
pdecon = Deconstruct(Point=curvepoint)  # -> XComponent, YComponent, ZComponent
dist = Distance(PointA=end.Start, PointB=end.End)
num = Number(pdecon.ZComponent)
bnd = Bounds(Numbers=flatten(num))
dom = ConstructDomain(DomainStart=0, DomainEnd=1)
remap = RemapNumbers(Value=num, Source=bnd, Target=dom)  # -> Mapped, Clipped
graph = GraphMapper(remap.Mapped, x0=0, x1=1, y0=0, y1=1, container_name="Sine", Equation_px=[0, 0.2689297497], Equation_py=[0, 1])
max_length = Slider(5, range=0..5)
multiplication_2 = Multiplication(A=dist, B=graph)
multiplication_3 = Multiplication(A=multiplication_2, B=max_length)
line = LineSDL(Start=end.Start, Direction=crv_3, Length=multiplication_3)
previewlw_5 = CustomPreviewLineweights(Geometry=line, Shader=ColourSwatch(SwatchColor=RGB(0, 0, 0)), Thickness="3", Absolute=False)

replace = ReplaceItems(List=cull_i_6, Item=line, Indices="0", Wrap=False)
join = JoinCurves(Curves=crv_2, Preserve=False)
merge_11 = Merge(Data1=replace, Data2=merge_10)
join_2 = JoinCurves(Curves=merge_11, Preserve=False)

# ----
# Posso scegliere se visualizzare come mesh pipes le geometrie dei componenti appena orientati oppure la versione ottenuta dopo ulteriore modifica
# Poichè la creazione di geometrie è un'operazione che richiede tempo, il data dam mi consente di sperimentare con i dati avendo le curve come feedback visivo e poi creare le geometrie in un secondo momento, quando i parametri si sono stabilizzati
# bake this to Rhino
# Stream Filter: Permette di filtrare gli input. In questo caso permette la scelta tra le geometrie del componente pre e post modifica (canali 0 e 1 rispettivamente)
# Data Dam: Ferma il flusso dei dati in caso di modifica degli stessi. Per far passare i nuovi dati modificati è necessario premere sull'icona "Play"
geometries = ValueList({"pre-mod": 0, "post-mod": 1}, selected="pre-mod")
filter = StreamFilter(Gate=geometries, Stream0=join, Stream1=join_2)
dam = DataDam(DataA=filter, BufferDelay=10000000, BufferMode=0)
# geometry preview
mpipe = MeshPipe(Curve=dam, Radius=Slider(0.5, range=0..1), Accuracy=0.2, Rotation=0, Segments="3", Caps="1")
mjoin = MeshJoin(Meshes=flatten(mpipe))
previewmat = CustomPreviewMaterials(Geometry=mjoin, DiffuseColor=RGB(255, 255, 255))
