# Grasshopper definition ds_sub_00_mesh box orient.gh (Grasshopper 0.9.76)
# Copyright: Co-de-iT
# plug-ins: MeshEdit Components, Human, Weaverbird, Noise 4D

# Mesh Twisted Box techniques
# 
# Uso del twisted box per popolare una mesh con componenti complessi
# 
# © a3 2017 _ Creative Commons Attribution-NonCommercial-ShareAlike3.0 UnportedLicense.
# input su cui agire (geometrie o parametri)
# single component
# aggiunte rispetto alla definizione base
# single face (for testing)
mesh = Mesh(<mesh referenced from the Rhino model>)
# actual mesh
mesh_2 = Mesh(<mesh referenced from the Rhino model>)

# ----
# aggiunte rispetto alla definizione base
# Suddivisione della mesh iniziale (utile a vedere l'effetto su un numero alto di facce/iterazioni)
number_slider = Slider(2, range=0..2)
wbcatmullclark = WeaverbirdsCatmullClarkSubdivision(MeshCurves=mesh_2, Level=Slider(3, range=1..3), SmoothNakedEdges=number_slider)

# ----
# single component - multiple orientations
# pick orientation by scalar value
# single face (for testing)
mesh_3 = Mesh(<mesh referenced from the Rhino model>)
# actual mesh
mesh_4 = Mesh(<mesh referenced from the Rhino model>)
# single component - multiple orientations
# orientation by vector field
# single face (for testing)
mesh_5 = Mesh(<mesh referenced from the Rhino model>)
# actual mesh
mesh_6 = Mesh(<mesh referenced from the Rhino model>)
# field curves
crv = Curve([<curve referenced from the Rhino model> x2])
wbcatmullclark_2 = WeaverbirdsCatmullClarkSubdivision(MeshCurves=mesh_4, Level=Slider(2, range=1..3), SmoothNakedEdges=Slider(2, range=0..2))
wbcatmullclark_3 = WeaverbirdsCatmullClarkSubdivision(MeshCurves=mesh_6, Level=Slider(3, range=1..3), SmoothNakedEdges=Slider(2, range=0..2))

demesh = DeconstructMesh(Mesh=wbcatmullclark)  # -> Vertices, Faces, Colours, Normals
deface = DeconstructFace(Face=graft(demesh.Faces))  # -> CornerA, CornerB, CornerC, CornerD
merge = Merge(Data1=deface.CornerA, Data2=deface.CornerB, Data3=deface.CornerC, Data4=deface.CornerD)
# find the 4 vertices and normals
# for each face
item = ListItem(List=demesh.Vertices, Index=merge, Wrap=True)  # -> simplify(Item)
item_2 = ListItem(List=demesh.Normals, Index=merge, Wrap=True)  # -> simplify(Item)

normals_size = Slider(2, range=0..2)
multiplication = Multiplication(A=demesh.Normals, B=normals_size)
# show vertex normals
vdisex = VectorDisplayEx(Point=demesh.Vertices, Vector=multiplication, Colour=RGB(0, 0, 0), Width=2)

demesh_2 = DeconstructMesh(Mesh=wbcatmullclark_2)  # -> Vertices, Faces, Colours, Normals
deface_2 = DeconstructFace(Face=graft(demesh_2.Faces))  # -> CornerA, CornerB, CornerC, CornerD
merge_2 = Merge(Data1=deface_2.CornerA, Data2=deface_2.CornerB, Data3=deface_2.CornerC, Data4=deface_2.CornerD)
# find the 4 vertices and normals
# for each face
item_3 = ListItem(List=demesh_2.Vertices, Index=merge_2, Wrap=True)  # -> simplify(Item)
item_4 = ListItem(List=demesh_2.Normals, Index=merge_2, Wrap=True)  # -> simplify(Item)

demesh_3 = DeconstructMesh(Mesh=wbcatmullclark_3)  # -> Vertices, Faces, Colours, Normals
deface_3 = DeconstructFace(Face=graft(demesh_3.Faces))  # -> CornerA, CornerB, CornerC, CornerD
merge_3 = Merge(Data1=deface_3.CornerA, Data2=deface_3.CornerB, Data3=deface_3.CornerC, Data4=deface_3.CornerD)
# find the 4 vertices and normals
# for each face
item_5 = ListItem(List=demesh_3.Vertices, Index=merge_3, Wrap=True)  # -> simplify(Item)
item_6 = ListItem(List=demesh_3.Normals, Index=merge_3, Wrap=True)  # -> simplify(Item)

mesh_7 = Mesh([<mesh referenced from the Rhino model> x4])
mesh_8 = Mesh([<mesh referenced from the Rhino model> x4])
crv_2 = Curve([<curve referenced from the Rhino model> x4])

# ----
# provare uno dei due in alternativa
panel = Panel("-10")
X = UnitX(Factor=panel)
move = Move(Geometry=mesh_7, Motion=X)  # -> Geometry, Transform

vertex_offset = Slider(2.2, range=0..5)
amp = Amplitude(Vector=item_2, Amplitude=vertex_offset)
move_2 = Move(Geometry=item, Motion=amp)  # -> Geometry, Transform
# move vertices and create
# twisted boxes
item_7 = ListItem(List=item, Index=0, Wrap=True)  # -> Item, Item1, Item2, Item3
item_8 = ListItem(List=move_2.Geometry, Index=0, Wrap=True)  # -> Item, Item1, Item2, Item3
tbox = TwistedBox(
    CornerA=item_7.Item,
    CornerB=item_7.Item1,
    CornerC=item_7.Item2,
    CornerD=item_7.Item3,
    CornerE=item_8.Item,
    CornerF=item_8.Item1,
    CornerG=item_8.Item2,
    CornerH=item_8.Item3)  # -> flatten(TwistedBox)

X_2 = UnitX(Factor="-10")
# campo scalare generato tramite funzione noise
# 
# NOTA: la funzione noise qui è solo dimostrativa, nei propri progetti se si intende utilizzare un campo scalare verificare la possibilità di controllo sugli effetti
avr = Average(Input=item_3)

vertex_offset_2 = Slider(1.721, range=0..5)
amp_2 = Amplitude(Vector=item_4, Amplitude=vertex_offset_2)
move_3 = Move(Geometry=item_3, Motion=amp_2)  # -> Geometry, Transform
# move vertices and create
# twisted boxes
item_9 = ListItem(List=item_3, Index=0, Wrap=True)  # -> Item, Item1, Item2, Item3
item_10 = ListItem(List=move_3.Geometry, Index=0, Wrap=True)  # -> Item, Item1, Item2, Item3
tbox_2 = TwistedBox(
    CornerA=item_9.Item,
    CornerB=item_9.Item1,
    CornerC=item_9.Item2,
    CornerD=item_9.Item3,
    CornerE=item_10.Item,
    CornerF=item_10.Item1,
    CornerG=item_10.Item2,
    CornerH=item_10.Item3)  # -> flatten(TwistedBox)

mesh_9 = Mesh(<mesh referenced from the Rhino model>)
mesh_10 = Mesh([<mesh referenced from the Rhino model> x5])

vertex_offset_3 = Slider(3.132, range=0..5)
amp_3 = Amplitude(Vector=item_6, Amplitude=vertex_offset_3)
move_4 = Move(Geometry=item_5, Motion=amp_3)  # -> Geometry, Transform
# move vertices and create
# twisted boxes
item_11 = ListItem(List=item_5, Index=0, Wrap=True)  # -> Item, Item1, Item2, Item3
item_12 = ListItem(List=move_4.Geometry, Index=0, Wrap=True)  # -> Item, Item1, Item2, Item3
tbox_3 = TwistedBox(
    CornerA=item_11.Item,
    CornerB=item_11.Item1,
    CornerC=item_11.Item2,
    CornerD=item_11.Item3,
    CornerE=item_12.Item,
    CornerF=item_12.Item1,
    CornerG=item_12.Item2,
    CornerH=item_12.Item3)  # -> flatten(TwistedBox)

mesh_11 = Mesh([<mesh referenced from the Rhino model> x6])
crv_3 = Curve([<curve referenced from the Rhino model> x6])
crv_4 = Curve([<curve referenced from the Rhino model> x4])

# ----
# vector field per face
avr_2 = Average(Input=item_5)
divlength = DivideLength(Curve=crv, Length=Slider(1, range=0.05..2))  # -> flatten(Points), flatten(Tangents), Parameters
cp = ClosestPoint(Point=avr_2, Cloud=divlength.Points)  # -> ClosestPoint, CPIndex, Distance
item_13 = ListItem(List=divlength.Tangents, Index=cp.CPIndex, Wrap=True)
vdisex_2 = VectorDisplayEx(Point=avr_2, Vector=item_13, Colour=item_13, Width=2)

# ----
# devo stabilire per ogni mesh una direzione di riferimento
item_14 = ListItem(List=item_5, Index=0, Wrap=True)  # -> Item, Item1, Item2, Item3
avr_3 = Average(Input=[item_14.Item2, item_14.Item3])
ln = Line(StartPoint=avr_2, EndPoint=avr_3)

wbjoin = WeaverbirdsJoinMeshesAndWeld(Mesh=move.Geometry, Weld=True)
# component geometry
# reference bounding box
merge_4 = Merge(Data1=wbjoin, Data2=crv_2)
group = Group(Objects=merge_4)

move_5 = Move(Geometry=mesh_9, Motion=X_2)  # -> Geometry, Transform

wbjoin_2 = WeaverbirdsJoinMeshesAndWeld(Mesh=mesh_11, Weld=True)
# component geometry
merge_5 = Merge(Data1=wbjoin_2, Data2=crv_3, Data3=crv_4)
group_2 = Group(Objects=merge_5)

number_slider_2 = Slider(1.813, range=0..10)
number_slider_3 = Slider(0.156, range=0..0.3)

pt = Point(Point(18.90815017, 103.5012528, -3.103731064))
# the noise function
# Il noise è una funzione pseudo-casuale. A partire da una posizione nello spazio (x,y,z) restituisce sempre un valore tra -1, e 1.
# 
# Provare l'effetto dei parametri Time e Scale.
# 
# Scale molto piccole la portano verso una funzione sinusoidale, scale più grandi aumentano il grado di casualità.
number_slider_4 = Slider(91, range=10..100)
sqgrid = Square(Plane=pt, Size=Slider(0.562, range=0.01..1), ExtentX=Slider(87, range=10..100), ExtentY=number_slider_4)  # -> Cells, Points
perlin = PerlinNoise(Values=sqgrid.Points, Time=number_slider_2, Scale=number_slider_3)
remap = RemapNumbers(Value=perlin, Source="-1 to 1", Target=Domain(0, 1))  # -> Mapped, Clipped
gradient = Gradient(LowerLimit=0, UpperLimit=1, Parameter=remap.Mapped, stops=[0: RGB(0, 0, 0), 1: RGB(255, 255, 255)])
preview = CustomPreview(Geometry=sqgrid.Points, Shader=gradient)

crv_5 = Curve([<curve referenced from the Rhino model> x6])
bbox = BoundingBox(Content=crv_5, Plane=PlaneXY(0, 0, 0), UnionBox=True)  # -> Box, Box_2

crv_6 = Curve([<curve referenced from the Rhino model> x6])
# reference bounding box
bbox_2 = BoundingBox(Content=crv_6, Plane=PlaneXY(0, 0, 0), UnionBox=True)  # -> Box, Box_2

wbjoin_3 = WeaverbirdsJoinMeshesAndWeld(Mesh=move_5.Geometry, Weld=True)

crv_7 = Curve([<curve referenced from the Rhino model> x6])
bbox_3 = BoundingBox(Content=crv_7, Plane=PlaneXY(0, 0, 0), UnionBox=True)  # -> Box, Box_2

# ----
# component geometry
# reference bounding box
merge_6 = Merge(Data1=wbjoin_3)
group_3 = Group(Objects=merge_6)

unit = UnitVector(Vector=ln)

# ----
# controlla l'angolo tra il vettore del campo e la direzione di riferimento della faccia. Se il valore assoluto del seno è > 0.5 il componente è orientato di 90° rispetto al riferimento, altrimenti viene scelto quello inalterato
angle = Angle(VectorA=item_13, VectorB=unit)  # -> Angle, Reflex
sin = Sine(Value=angle.Angle)
abs = Absolute(Value=sin)
larger = LargerThan(FirstNumber=abs, SecondNumber="0.5")  # -> LargerThan, OrEqualTo

perlin_2 = PerlinNoise(Values=avr, Time=number_slider_2, Scale=number_slider_3)

box = EvaluateBox(Box=bbox_2.Box, UParameter=0.5, VParameter=0.5, WParameter=0.5)  # -> Plane, Point, Include
# genera 4 possibili rotazioni del componente ruotando il Bounding Box di multipli di 90° attorno al suo centro
panel_2 = Panel("0 to 2*Pi")
range = Range(Domain=panel_2, Steps="4")
cull_i = CullIndex(List=range, Indices="-1", Wrap=True)
Z = UnitZ(Factor=1)
rot3d = Rotate3D(Geometry=bbox_2.Box, Angle=cull_i, Center=box.Point, Axis=Z)  # -> flatten(Geometry), Transform

box_2 = EvaluateBox(Box=bbox_3.Box, UParameter=0.5, VParameter=0.5, WParameter=0.5)  # -> Plane, Point, Include
# genera 2 possibili rotazioni del componente ruotando il Bounding Box: 0 e 90° (allineamento orizzontale o verticale con il vector field)
panel_3 = Panel("0 to Pi")
range_2 = Range(Domain=panel_3, Steps="2")
cull_i_2 = CullIndex(List=range_2, Indices="-1", Wrap=True)
Z_2 = UnitZ(Factor=1)
rot3d_2 = Rotate3D(Geometry=bbox_3.Box, Angle=cull_i_2, Center=box_2.Point, Axis=Z_2)  # -> flatten(Geometry), Transform

# ----
# trasforma i valori di noise nei 4 possibili indici 0,1,2,3
panel_4 = Panel("-1 to 1")
remap_2 = RemapNumbers(Value=perlin_2, Source=panel_4, Target=Domain(0, 1))  # -> Mapped, Clipped
expression = Expression(x=remap_2.Mapped, y="4", Expression="floor(x*y)")  # -> flatten(R)

# ----
# False e True vengono convertiti a 0 e 1 rispettivamente
int = Integer(flatten(larger.LargerThan))
panel_5 = Panel(int)
panel_6 = Panel(expression)
morph = BoxMorph(Geometry=group, Reference=bbox.Box, Target=tbox)
item_15 = ListItem(List=rot3d.Geometry, Index=expression, Wrap=True)
item_16 = ListItem(List=rot3d_2.Geometry, Index=int, Wrap=True)
ungroup = Ungroup(Group=morph)
morph_2 = BoxMorph(Geometry=group_2, Reference=item_15, Target=tbox_2)
morph_3 = BoxMorph(Geometry=group_3, Reference=item_16, Target=tbox_3)
ungroup_2 = Ungroup(Group=morph_2)
ungroup_3 = Ungroup(Group=morph_3)
# actual mesh
mesh_12 = Mesh(<mesh referenced from the Rhino model>)
# single face (for testing)
mesh_13 = Mesh(<mesh referenced from the Rhino model>)
# tweening between two components
# single face (for testing)
mesh_14 = Mesh(<mesh referenced from the Rhino model>)
# actual mesh
mesh_15 = Mesh(<mesh referenced from the Rhino model>)
wbcatmullclark_4 = WeaverbirdsCatmullClarkSubdivision(MeshCurves=mesh_12, Level=Slider(3, range=1..3), SmoothNakedEdges=Slider(2, range=0..2))
wbcatmullclark_5 = WeaverbirdsCatmullClarkSubdivision(MeshCurves=mesh_15, Level=Slider(3, range=1..3), SmoothNakedEdges=Slider(2, range=0..2))

demesh_4 = DeconstructMesh(Mesh=wbcatmullclark_4)  # -> Vertices, Faces, Colours, Normals
deface_4 = DeconstructFace(Face=graft(demesh_4.Faces))  # -> CornerA, CornerB, CornerC, CornerD
merge_7 = Merge(Data1=deface_4.CornerA, Data2=deface_4.CornerB, Data3=deface_4.CornerC, Data4=deface_4.CornerD)
item_17 = ListItem(List=demesh_4.Vertices, Index=merge_7, Wrap=True)  # -> simplify(Item)
item_18 = ListItem(List=demesh_4.Normals, Index=merge_7, Wrap=True)  # -> simplify(Item)

multiplication_2 = Multiplication(A=demesh_4.Normals, B=Slider(0.55, range=0..2))
# show vertex normals
vdisex_3 = VectorDisplayEx(Point=demesh_4.Vertices, Vector=multiplication_2, Colour=RGB(0, 0, 0), Width=2)

demesh_5 = DeconstructMesh(Mesh=wbcatmullclark_5)  # -> Vertices, Faces, Colours, Normals
deface_5 = DeconstructFace(Face=graft(demesh_5.Faces))  # -> CornerA, CornerB, CornerC, CornerD
merge_8 = Merge(Data1=deface_5.CornerA, Data2=deface_5.CornerB, Data3=deface_5.CornerC, Data4=deface_5.CornerD)
item_19 = ListItem(List=demesh_5.Vertices, Index=merge_8, Wrap=True)  # -> simplify(Item)
item_20 = ListItem(List=demesh_5.Normals, Index=merge_8, Wrap=True)  # -> simplify(Item)

# ----
# tweening between two components
# group by component type
number_slider_5 = Slider(0.55, range=0..2)
multiplication_3 = Multiplication(A=demesh_5.Normals, B=number_slider_5)
# show vertex normals
vdisex_4 = VectorDisplayEx(Point=demesh_5.Vertices, Vector=multiplication_3, Colour=RGB(0, 0, 0), Width=2)

# ----
# component geometry A
mesh_16 = Mesh(<mesh referenced from the Rhino model>)
# component geometry B
mesh_17 = Mesh(<mesh referenced from the Rhino model>)

# ----
# reference bounding box
# find the 4 vertices and normals
# for each face
crv_8 = Curve([<curve referenced from the Rhino model> x6])
bbox_4 = BoundingBox(Content=crv_8, Plane=PlaneXY(0, 0, 0), UnionBox=True)  # -> Box, Box_2

# ----
# component geometry A
mesh_18 = Mesh(<mesh referenced from the Rhino model>)
# component geometry B
mesh_19 = Mesh(<mesh referenced from the Rhino model>)

# ----
# reference bounding box
# find the 4 vertices and normals
# for each face
crv_9 = Curve([<curve referenced from the Rhino model> x6])
bbox_5 = BoundingBox(Content=crv_9, Plane=PlaneXY(0, 0, 0), UnionBox=True)  # -> Box, Box_2

vertex_offset_4 = Slider(1.721, range=0..5)
amp_4 = Amplitude(Vector=item_18, Amplitude=vertex_offset_4)
move_6 = Move(Geometry=item_17, Motion=amp_4)  # -> Geometry, Transform
# move vertices and create
# twisted boxes
item_21 = ListItem(List=item_17, Index=0, Wrap=True)  # -> Item, Item1, Item2, Item3
item_22 = ListItem(List=move_6.Geometry, Index=0, Wrap=True)  # -> Item, Item1, Item2, Item3
tbox_4 = TwistedBox(
    CornerA=item_21.Item,
    CornerB=item_21.Item1,
    CornerC=item_21.Item2,
    CornerD=item_21.Item3,
    CornerE=item_22.Item,
    CornerF=item_22.Item1,
    CornerG=item_22.Item2,
    CornerH=item_22.Item3)  # -> flatten(TwistedBox)

# ----
# field curve
crv_10 = Curve(<curve referenced from the Rhino model>)

vertex_offset_5 = Slider(1.721, range=0..5)
amp_5 = Amplitude(Vector=item_20, Amplitude=vertex_offset_5)
move_7 = Move(Geometry=item_19, Motion=amp_5)  # -> Geometry, Transform
# move vertices and create
# twisted boxes
item_23 = ListItem(List=item_19, Index=0, Wrap=True)  # -> Item, Item1, Item2, Item3
item_24 = ListItem(List=move_7.Geometry, Index=0, Wrap=True)  # -> Item, Item1, Item2, Item3
tbox_5 = TwistedBox(
    CornerA=item_23.Item,
    CornerB=item_23.Item1,
    CornerC=item_23.Item2,
    CornerD=item_23.Item3,
    CornerE=item_24.Item,
    CornerF=item_24.Item1,
    CornerG=item_24.Item2,
    CornerH=item_24.Item3)  # -> flatten(TwistedBox)

# ----
# field curve
crv_11 = Curve(<curve referenced from the Rhino model>)

# ----
# allinea i componenti allo stesso bounding box di riferimento
panel_7 = Panel("10")
Y = UnitY(Factor="20")
Y_2 = UnitY(Factor=panel_7)
move_8 = Move(Geometry=mesh_17, Motion=Y)  # -> Geometry, Transform
move_9 = Move(Geometry=mesh_16, Motion=Y_2)  # -> Geometry, Transform

# ----
# allinea i componenti al bounding box di riferimento
panel_8 = Panel("10")
Y_3 = UnitY(Factor="20")
Y_4 = UnitY(Factor=panel_8)
move_10 = Move(Geometry=mesh_19, Motion=Y_3)  # -> Geometry, Transform
move_11 = Move(Geometry=mesh_18, Motion=Y_4)  # -> Geometry, Transform

tweening_steps = Slider(4, range=1..10)
tweening_steps_2 = Slider(4, range=1..10)
demesh_6 = DeconstructMesh(Mesh=move_9.Geometry)  # -> Vertices, Faces, Colours, Normals
demesh_7 = DeconstructMesh(Mesh=move_8.Geometry)  # -> Vertices, Faces, Colours, Normals
demesh_8 = DeconstructMesh(Mesh=move_10.Geometry)  # -> Vertices, Faces, Colours, Normals
demesh_9 = DeconstructMesh(Mesh=move_11.Geometry)  # -> Vertices, Faces, Colours, Normals
# mesh face center
avr_4 = Average(Input=item_17)
# mesh face normal
avr_5 = Average(Input=item_18)
# mesh face center
avr_6 = Average(Input=item_19)

# ----
# tween mesh: crea un tween (interpolazione) tra due mesh con STESSO NUMERO di vertici e STESSO elenco di facce
merge_9 = Merge(Data1=graft(demesh_6.Vertices), Data2=graft(demesh_7.Vertices))
# interpolate data: crea una interpolazione tra dati (funziona anche tra punti e vettori)
range_3 = Range(Domain=Domain(0, 1), Steps=tweening_steps)
interp = InterpolateData(Data=merge_9, Parameter=range_3, Interpolation=2)
flip = FlipMatrix(Data=interp)
conmesh = ConstructMesh(Vertices=flip, Faces=demesh_6.Faces)  # -> flatten(Mesh)

# ----
# tween mesh: crea un tween (interpolazione) tra due mesh con STESSO NUMERO di vertici e STESSO elenco di facce
merge_10 = Merge(Data1=graft(demesh_9.Vertices), Data2=graft(demesh_8.Vertices))
# interpolate data: crea una interpolazione tra dati (funziona anche tra punti e vettori)
range_4 = Range(Domain=Domain(0, 1), Steps=tweening_steps_2)
interp_2 = InterpolateData(Data=merge_10, Parameter=range_4, Interpolation=2)
flip_2 = FlipMatrix(Data=interp_2)
conmesh_2 = ConstructMesh(Vertices=flip_2, Faces=demesh_9.Faces)  # -> flatten(Mesh)

crv_cp = CurveClosestPoint(Point=avr_4, Curve=crv_10)  # -> Point, Parameter, Distance
num = Number(crv_cp.Distance)
bnd = Bounds(Numbers=flatten(num))
dom = ConstructDomain(DomainStart=0, DomainEnd=1)
remap_3 = RemapNumbers(Value=num, Source=bnd, Target=dom)  # -> Mapped, Clipped
multiplication_4 = Multiplication(A=remap_3.Mapped, B=tweening_steps)
int_2 = Integer(multiplication_4)
item_25 = ListItem(List=conmesh, Index=int_2, Wrap=True)  # -> flatten(Item)

crv_cp_2 = CurveClosestPoint(Point=avr_6, Curve=crv_11)  # -> Point, Parameter, Distance
# Ordina i componenti in base alla distanza dalla curva: le distanze vengono rimappate in un range da 0 a 1, il valore viene poi moltiplicato per il numero dei tipi di componente e approssimato all-intero per essere usato come indice
num_2 = Number(crv_cp_2.Distance)
bnd_2 = Bounds(Numbers=flatten(num_2))
dom_2 = ConstructDomain(DomainStart=0, DomainEnd=1)
remap_4 = RemapNumbers(Value=num_2, Source=bnd_2, Target=dom_2)  # -> Mapped, Clipped
multiplication_5 = Multiplication(A=remap_4.Mapped, B=tweening_steps_2)
int_3 = Integer(multiplication_5)
item_26 = ListItem(List=conmesh_2, Index=int_3, Wrap=True)  # -> flatten(Item)

addition = Addition(A=tweening_steps, B="1")
series = Series(Start=0, Step=1, Count=addition)

morph_4 = BoxMorph(Geometry=item_26, Reference=bbox_5.Box, Target=tbox_5)
morph_5 = BoxMorph(Geometry=item_25, Reference=bbox_4.Box, Target=tbox_4)
mjoin = MeshJoin(Meshes=flatten(morph_4))

# ----
# raggruppa i componenti per tipo
# 
# S rappresenta la lista degli indici di quale componente è finito in ciascuna faccia della mesh
# 
# M è la lista degli indici da cercare (con graft, in modo che gli indici per ciascun tipo risultino in rami separati all'uscita)
# 
# Esempio:
# 
# S = 4,5,6,4,6,2,3,0,1
# M = 4
# 
# risultato: 0,3 (gli indici in cui appare 4 all'interno di S)
int_4 = Integer(graft(series))
mindex = MemberIndex(Set=flatten(int_2), Member=int_4)  # -> Index, Count

mjoin_2 = MeshJoin(Meshes=flatten(morph_5))
weldvertices = MeshWeldVertices(Mesh=mjoin, Tolerance=0.01)  # -> RuntimeMessage, Mesh
mesh_20 = Mesh(mjoin_2)
gradient_2 = Gradient(
    LowerLimit=0,
    UpperLimit=1,
    Parameter=range_3,
    stops=[0: RGB(234, 38, 0), 0.25: RGB(234, 126, 0), 0.5: RGB(254, 244, 84), 0.75: RGB(173, 203, 249), 1: RGB(75, 107, 169)])

tag_y_pos = Slider(-1.125, range=-3..0)
tag_x_pos = Slider(1.018, range=0..2)
# prende un punto di riferimento sul bounding box originale per posizionare il testo
pt_2 = Point(<point referenced from the Rhino model>)
X_3 = UnitX(Factor=tag_x_pos)
Y_5 = UnitY(Factor=tag_y_pos)
addition_2 = Addition(A=Y_5, B=X_3)
move_12 = Move(Geometry=pt_2, Motion=addition_2)  # -> Geometry, Transform

spacing = Slider(7, range=2..10)
multiplication_6 = Multiplication(A=spacing, B=series)
X_4 = UnitX(Factor=multiplication_6)
int_5 = Integer(series)
move_13 = Move(Geometry=conmesh, Motion=X_4)  # -> Geometry, Transform
concat = Concatenate(FragmentA="type ", FragmentB=int_5)
addition_3 = Addition(A=move_12.Geometry, B=X_4)
# pre-visualizza i componenti che variano - 1 colore per ogni componente
previewmat = CustomPreviewMaterials(Geometry=move_13.Geometry, DiffuseColor=gradient_2)
tag = TextTag3D(Location=addition_3, Text=concat, Size=1, Colour=gradient_2, Justification=7)

medges = MeshEdges(Mesh=mesh_20)  # -> NakedEdges, InteriorEdges, NonManifoldEdges
# colora i componenti in modo omogeneo
previewmat_2 = CustomPreviewMaterials(Geometry=mesh_20, DiffuseColor=RGB(255, 255, 255))

mesh_21 = Mesh(weldvertices.Mesh)
# indici delle facce di destinazione ordinate per tipo di componente
# 
# Ogni ramo del data tree rappresenta un tipo di componente
int_6 = Integer(mindex.Index)

medges_2 = MeshEdges(Mesh=mesh_21)  # -> NakedEdges, InteriorEdges, NonManifoldEdges
# colora i componenti in modo omogeneo
previewmat_3 = CustomPreviewMaterials(Geometry=mesh_21, DiffuseColor=RGB(255, 255, 255))

item_27 = ListItem(List=flatten(avr_5), Index=int_6, Wrap=True)  # -> simplify(Item)
item_28 = ListItem(List=flatten(int_2), Index=int_6, Wrap=True)  # -> simplify(Item)
item_29 = ListItem(List=flatten(avr_4), Index=int_6, Wrap=True)  # -> simplify(Item)
amp_6 = Amplitude(Vector=item_27, Amplitude=Slider(1.771, range=0..3))
text_size = Slider(0.574, range=0..1)
move_14 = Move(Geometry=item_29, Motion=amp_6)  # -> Geometry, Transform
# testo che indica il tipo di componente sulla geometria di destinazione, colorato nel colore corrispondente.
# 
# Il testo (il numero del tipo di componente) viene inserito in un punto a partire dal centro di ciascuna faccia, mosso lungo la normale corrispondente per evitare sovrapposizioni con le geometrie
tag_2 = TextTag3D(Location=move_14.Geometry, Text=item_28, Size=text_size, Colour=graft(gradient_2), Justification=5)

item_30 = ListItem(List=morph_5, Index=int_6, Wrap=True)  # -> simplify(Item)
mjoin_3 = MeshJoin(Meshes=item_30)
# colora i componenti per tipo di componente
previewmat_4 = CustomPreviewMaterials(Geometry=mjoin_3, DiffuseColor=graft(gradient_2))

split = SplitList(List=ungroup, Index="1")  # -> ListA, ListB
# selezione geometrie e display
# 
# Le geometrie sono nello stesso ordine con cui è stato fatto il group
mjoin_4 = MeshJoin(Meshes=flatten(split.ListA))
weldvertices_2 = MeshWeldVertices(Mesh=mjoin_4, Tolerance=0.01)  # -> RuntimeMessage, Mesh
crv_12 = Curve(split.ListB)
previewlw = CustomPreviewLineweights(Geometry=crv_12, Shader=ColourSwatch(SwatchColor=RGB(0, 0, 0)), Absolute=False)

mesh_22 = Mesh(weldvertices_2.Mesh)

medges_3 = MeshEdges(Mesh=mesh_22)  # -> NakedEdges, InteriorEdges, NonManifoldEdges
previewmat_5 = CustomPreviewMaterials(Geometry=mesh_22, DiffuseColor=RGB(255, 255, 255))

# ----
# selezione geometrie e display
# 
# Le geometrie sono nello stesso ordine con cui è stato fatto il group
split_2 = SplitList(List=ungroup_2, Index="1")  # -> ListA, ListB
mjoin_5 = MeshJoin(Meshes=flatten(split_2.ListA))
weldvertices_3 = MeshWeldVertices(Mesh=mjoin_5, Tolerance=0.01)  # -> RuntimeMessage, Mesh
crv_13 = Curve(split_2.ListB)
previewlw_2 = CustomPreviewLineweights(Geometry=crv_13, Shader=ColourSwatch(SwatchColor=RGB(0, 0, 0)), Absolute=False)

mesh_23 = Mesh(weldvertices_3.Mesh)

medges_4 = MeshEdges(Mesh=mesh_23)  # -> NakedEdges, InteriorEdges, NonManifoldEdges
previewmat_6 = CustomPreviewMaterials(Geometry=mesh_23, DiffuseColor=RGB(255, 255, 255))

# ----
# post-subdivision
# 
# Subdivision ulteriore delle geometrie (se necessario)
wbcatmullclark_6 = WeaverbirdsCatmullClarkSubdivision(MeshCurves=mesh_23, Level=Slider(2, range=1..3), SmoothNakedEdges=Slider(2, range=0..2))
previewmat_7 = CustomPreviewMaterials(Geometry=wbcatmullclark_6, DiffuseColor=RGB(255, 255, 255))

# ----
# selezione geometrie e display
# 
# Le geometrie sono nello stesso ordine con cui è stato fatto il group
split_3 = SplitList(List=ungroup_3, Index="1")  # -> ListA, ListB
mjoin_6 = MeshJoin(Meshes=flatten(split_3.ListA))
crv_14 = Curve(split_3.ListB)
previewlw_3 = CustomPreviewLineweights(Geometry=crv_14, Shader=ColourSwatch(SwatchColor=RGB(0, 0, 0)), Absolute=False)

mesh_24 = Mesh(mjoin_6)

medges_5 = MeshEdges(Mesh=mesh_24)  # -> NakedEdges, InteriorEdges, NonManifoldEdges
previewmat_8 = CustomPreviewMaterials(Geometry=mesh_24, DiffuseColor=RGB(255, 255, 255))
