# Grasshopper definition ds_sub_X1_facade components.gh (Grasshopper 0.9.76)
# Copyright: Co-de-iT
# plug-ins: Human

# Design the surface as shown in
# the figure to have an exact
# correspondence with the .csv file,
# both left to right and top to bottom
# cross section 01
# rail 1
# cross section 02
# il file contiene la sequenza numerica dei componenti, ordinati per piani (un piano ogni riga)
csv_file = Panel("ds_sub_XX_facade components.csv")
f_ghfilepath = GHFilePathInfo()  # -> F, P
# ---------- f_ghfilepath: C# ----------
                                      /*
    froGH - a sparse collection of (in)utilities for Grasshopper

    GH File and Path info

    code by Alessio Erioli

    froGH by Co-de-iT is licensed under a Creative Commons Attribution 4.0 International License.
    http://creativecommons.org/licenses/by/4.0/

    */

    initComp();

    GH_Document ghDoc = Grasshopper.Instances.ActiveCanvas.Document;

    int nameLen = ghDoc.DisplayName.TrimEnd('*').Length + 3; // +3 accounts for the '.gh' extension
    int fileLen = ghDoc.FilePath.TrimEnd('*').Length;

    F = ghDoc.DisplayName.TrimEnd('*');
    P = ghDoc.FilePath.Substring(0, fileLen - nameLen);
# ---------- f_ghfilepath: C# additional code ----------
  void initComp(){

    Component.Name = "GH File Path Info";
    Component.NickName = "f_GHFilePath";
    Component.Description = "Provides info on current Grasshopper Document file name and path\nUseful for exporting files with the same name as the gh file and in the same directory";
    Component.Params.Output[0].Name = "File Name";
    Component.Params.Output[0].Description = "Current GH file name";
    Component.Params.Output[1].Name = "File Path";
    Component.Params.Output[1].Description = "Current GH file path";
  }
# ---------- end f_ghfilepath ----------
concat = Concatenate(FragmentA=f_ghfilepath.P, FragmentB=csv_file)
file = ReadFile(File=concat, PerLineParse=True)
# Façade components
# 
# set components and load them to a façade according to a sequence saved on a .csv file
# 
# © a3 2017 _ Creative Commons Attribution-NonCommercial-ShareAlike3.0 UnportedLicense.
# rail 2
# SWEEP 2 RAILS
# surface
srf = Surface(<surface referenced from the Rhino model>)
split = TextSplit(Text=file, Separators=",")
panel = Panel(file)
lng = ListLength(List=split)
item = ListItem(List=flatten(lng), Index=0, Wrap=True)
lng_2 = ListLength(List=flatten(lng))
divide = DivideDomain²(Domain=srf, UCount=lng_2, VCount=item)
lng_3 = ListLength(List=divide)
series = Series(Start=0, Step=1, Count=lng_3)
sbox = SurfaceBox(Surface=srf, Domain=divide, Height="2.96")
panel_2 = Panel("component geometries")
graft = GraftTree(Data=split, IncludeEmptyLists=True, IncludeNullItems=True)  # -> simplify(Tree)

geo = Geometry([<brep referenced from the Rhino model> x5])
geo_2 = Geometry([<brep referenced from the Rhino model> x5])
geo_3 = Geometry([<brep referenced from the Rhino model> x5])
geo_4 = Geometry([<brep referenced from the Rhino model>, <curve referenced from the Rhino model>, <brep referenced from the Rhino model> x2, <point referenced from the Rhino model> x2, <brep referenced from the Rhino model>])
geo_5 = Geometry([<brep referenced from the Rhino model> x5])
geo_6 = Geometry([<brep referenced from the Rhino model> x5])
geo_7 = Geometry([<brep referenced from the Rhino model> x6])
geo_8 = Geometry([<brep referenced from the Rhino model> x5])
geo_9 = Geometry([<brep referenced from the Rhino model> x5])
geo_10 = Geometry([<brep referenced from the Rhino model> x6, <point referenced from the Rhino model>])
geo_11 = Geometry([<brep referenced from the Rhino model> x4, <point referenced from the Rhino model> x2])
geo_12 = Geometry([<brep referenced from the Rhino model>, <curve referenced from the Rhino model>, <brep referenced from the Rhino model> x2, <point referenced from the Rhino model> x2, <brep referenced from the Rhino model>])

partition = PartitionList(List=series, Size=item)  # -> simplify(graft(Chunks))
partition_2 = PartitionList(List=sbox, Size=item)  # -> simplify(graft(Chunks))
int = Integer(partition)
box = EvaluateBox(Box=partition_2, UParameter=0.5, VParameter=0.5, WParameter=0.5)  # -> Plane, Point, Include
weave = Weave(
    Pattern=graft,
    Stream0=geo_5,
    Stream1=geo,
    Stream2=geo_6,
    Stream3=geo_2,
    Stream4=geo_7,
    Stream5=geo_3,
    Stream6=geo_8,
    Stream7=geo_9,
    Stream8=geo_10,
    Stream9=geo_11,
    Stream10=geo_12,
    Stream11=geo_4,
    NullGaps=False)
xz = XZPlane(Origin=box.Point)
tag = TextTag3D(Location=xz, Text=graft, Size=1, Colour=ColourSwatch(SwatchColor=RGB(0, 0, 0)), Justification=7)
bbox = BoundingBox(Content=weave, Plane=PlaneXY(0, 0, 0), UnionBox=True)  # -> Box, Box_2
morph = BoxMorph(Geometry=weave, Reference=bbox.Box, Target=partition_2)
previewmat = CustomPreviewMaterials(Geometry=morph, DiffuseColor=RGB(255, 255, 255))
previewlw = CustomPreviewLineweights(Geometry=morph, Shader=ColourSwatch(SwatchColor=RGBA(0, 0, 0, 0)), Absolute=False)
