# Grasshopper definition tower floors_subdiv.gh (Grasshopper 0.9.76)
# Copyright: Co-de-iT
# plug-ins: MeshEdit Components, Human, Weaverbird, Mesh Pipe

# ----
# Tower floors subdivision
# 
# © a3 2017 _ Creative Commons Attribution-NonCommercial-ShareAlike3.0 UnportedLicense.
pt = Point(<point referenced from the Rhino model>)
polygon = Polygon(Plane=pt, Radius=Slider(61.192, range=1..100), Segments="3", FilletRadius=0)  # -> Polygon, Length
smesh = SimpleMesh(Brep=polygon.Polygon)
wbsplitquads = WeaverbirdsConstantQuadsSplitSubdivision(MeshCurves=smesh, Level=1, SmoothNakedEdges="0")
explode = MeshExplode(Mesh=wbsplitquads, Interpolate=False)
facen = FaceNormals(Mesh=smesh)  # -> Centers, Normals
demesh = DeconstructMesh(Mesh=explode)  # -> Vertices, Faces, Colours, Normals
dist = Distance(PointA=demesh.Vertices, PointB=facen.Centers)
sort = SortList(Keys=dist, ValuesA=demesh.Vertices)  # -> Keys, ValuesA
item = ListItem(List=sort.ValuesA, Index=0, Wrap=True)  # -> Item1, Item
# facce mesh generate a partire da un triangolo
scale = Scale(Geometry=graft(explode), Center=item.Item1, Factor=Slider(0.9, range=0..1))  # -> flatten(Geometry), Transform

# ----
# 3 facce mesh custom, modellate in Rhino
# oppure
mesh = Mesh([<mesh referenced from the Rhino model> x3])
floor_height = Slider(10, range=1..10)
n_of_floors = Slider(36, range=1..50)

of_height = Slider(0.355, range=0..1)
of_height_2 = Slider(0.695, range=0..1)
of_height_3 = Slider(0, range=0..1)
consecutive_floors = Slider(4, range=1..10)
consecutive_floors_2 = Slider(2, range=1..10)
consecutive_floors_3 = Slider(6, range=1..10)
multiplication = Multiplication(A=of_height, B=n_of_floors)
multiplication_2 = Multiplication(A=of_height_2, B=n_of_floors)
multiplication_3 = Multiplication(A=of_height_3, B=n_of_floors)
int = Integer(multiplication)
int_2 = Integer(multiplication_2)
int_3 = Integer(multiplication_3)
# select floors to remove
series = Series(Start=int, Step=1, Count=consecutive_floors)
series_2 = Series(Start=int_2, Step=1, Count=consecutive_floors_2)
series_3 = Series(Start=int_3, Step=1, Count=consecutive_floors_3)
int_4 = Integer(series)
int_5 = Integer(series_2)
int_6 = Integer(series_3)
entwine = Entwine(Branch00=int_4, Branch01=int_5, Branch02=int_6, FlattenInputs=True)

# ----
# inserire le facce qui
mesh_2 = Mesh(graft(mesh))
series_4 = Series(Start=0, Step=floor_height, Count=n_of_floors)
Z = UnitZ(Factor=series_4)

# ---- group: floor generation
move = Move(Geometry=mesh_2, Motion=Z)  # -> Geometry, Transform

# ---- group: remove floors to make terraces and voids
cull_i = CullIndex(List=move.Geometry, Indices=entwine, Wrap=True)  # -> simplify(List)

# ---- group: attractor points for subdivision
pt_2 = Point([<point referenced from the Rhino model> x3])

# ----
facen_2 = FaceNormals(Mesh=cull_i)  # -> graft(Centers), Normals
subdivision_iterations = Panel("""1
2
3""")
dist_2 = Distance(PointA=facen_2.Centers, PointB=pt_2)
# floor subdivision by attractor point
number_slider = Slider(0, range=0..2)
sort_2 = SortList(Keys=dist_2, ValuesA=subdivision_iterations)  # -> Keys, ValuesA
item_2 = ListItem(List=sort_2.ValuesA, Index=0, Wrap=True)
wbsplitquads_2 = WeaverbirdsConstantQuadsSplitSubdivision(MeshCurves=graft(cull_i), Level=item_2, SmoothNakedEdges=number_slider)  # -> simplify(OutputMeshCurves)

explode_2 = MeshExplode(Mesh=wbsplitquads_2, Interpolate=False)
facen_3 = FaceNormals(Mesh=flatten(explode_2))  # -> flatten(Centers), Normals
demesh_2 = DeconstructMesh(Mesh=flatten(explode_2))  # -> Vertices, Faces, Colours, Normals
Z_2 = UnitZ(Factor=floor_height)
move_2 = Move(Geometry=demesh_2.Vertices, Motion=Z_2)  # -> Geometry, Transform
item_3 = ListItem(List=move_2.Geometry, Index=0, Wrap=True)  # -> Item, Item1, Item2, Item3
# target voxels generation
item_4 = ListItem(List=demesh_2.Vertices, Index=0, Wrap=True)  # -> Item, Item1, Item2, Item3
tbox = TwistedBox(
    CornerA=item_4.Item,
    CornerB=item_4.Item1,
    CornerC=item_4.Item2,
    CornerD=item_4.Item3,
    CornerE=item_3.Item,
    CornerF=item_3.Item1,
    CornerG=item_3.Item2,
    CornerH=item_3.Item3)  # -> flatten(TwistedBox)

# ---- group: field curves
crv = Curve([<curve referenced from the Rhino model> x5])

# ---- group: type 0
crv_2 = Curve([<curve referenced from the Rhino model> x4])
group = Group(Objects=crv_2)

# ---- group: type 1
crv_3 = Curve([<curve referenced from the Rhino model> x5])
group_2 = Group(Objects=crv_3)

# ---- group: type 2
crv_4 = Curve([<curve referenced from the Rhino model> x5])
group_3 = Group(Objects=crv_4)

# ----
subtraction = Subtraction(A=item_2, B="1")
lng = ListLength(List=explode_2)
repeat = RepeatData(Data=subtraction, Length=lng)  # -> graft(Data)
# choose cell type
weave = Weave(Pattern=repeat, Stream0=group, Stream1=group_2, Stream2=group_3, NullGaps=False)  # -> flatten(Weave)

# ----
# show directions
# discretize directions
number_slider_2 = Slider(10, range=1..20)
divlength = DivideLength(Curve=crv, Length=number_slider_2)  # -> flatten(Points), flatten(Tangents), Parameters
cp = ClosestPoint(Point=facen_3.Centers, Cloud=divlength.Points)  # -> ClosestPoint, CPIndex, Distance
item_5 = ListItem(List=divlength.Tangents, Index=cp.CPIndex, Wrap=True)

n_directions = Panel("4")
discretize_vectors = DiscretizeVectors(vectors=item_5, n_of_directions=n_directions)  # -> discretized_vectors, discretized_vector_grouped_by_direction, discrete_directions

# ----
# vector field
amp = Amplitude(Vector=discretize_vectors.discretized_vectors, Amplitude=Slider(5.5, range=0..10))
vdisex = VectorDisplayEx(Point=facen_3.Centers, Vector=amp, Colour=amp, Width=2)

series_5 = Series(Start=0, Step="Pi*0.5", Count=n_directions)  # -> graft(Series)
# orientation by field
item_6 = ListItem(List=weave, Index=discretize_vectors.discretized_vector_grouped_by_direction, Wrap=True)
rotate = Rotate(Geometry=item_6, Angle=series_5, Plane=PlaneXY(0, 0, 0))  # -> Geometry, Transform

entwine_2 = Entwine(Branch00=crv_2, Branch01=crv_3, Branch02=crv_4, FlattenInputs=True)
join = JoinCurves(Curves=entwine_2, Preserve=False)
mpipe = MeshPipe(Curve=join, Radius=Slider(0.952, range=0..1), Accuracy=0.2, Rotation=0, Segments=Slider(3, range=3..6), Caps=1)
bang = ExplodeTree(Data=mpipe)  # -> Branch0, Branch1, Branch2
group_4 = Group(Objects=bang.Branch0)
group_5 = Group(Objects=bang.Branch1)
group_6 = Group(Objects=bang.Branch2)
weave_2 = Weave(Pattern=repeat, Stream0=group_4, Stream1=group_5, Stream2=group_6, NullGaps=False)  # -> flatten(Weave)
# mesh pipe geometry
# le mesh pipes sono solo per una migliore visualizzazione - sostituire con la propria geometria per i vari voxels
item_7 = ListItem(List=weave_2, Index=discretize_vectors.discretized_vector_grouped_by_direction, Wrap=True)
rotate_2 = Rotate(Geometry=item_7, Angle=series_5, Plane=PlaneXY(0, 0, 0))  # -> Geometry, Transform

# ---- group: sorting target voxels by rotation
item_8 = ListItem(List=tbox, Index=discretize_vectors.discretized_vector_grouped_by_direction, Wrap=True)

# ---- group: bounding box generation
bbox = BoundingBox(Content=rotate.Geometry, Plane=PlaneXY(0, 0, 0), UnionBox=False)  # -> Box, Box_2

# ----
morph = BoxMorph(Geometry=rotate_2.Geometry, Reference=bbox.Box, Target=item_8)
ungroup = Ungroup(Group=morph)  # -> flatten(Objects)
mjoin = MeshJoin(Meshes=ungroup)
medges = MeshEdges(Mesh=mjoin)  # -> NakedEdges, InteriorEdges, NonManifoldEdges
previewmat = CustomPreviewMaterials(Geometry=mjoin, DiffuseColor=RGB(255, 255, 255))
previewlw = CustomPreviewLineweights(Geometry=medges.InteriorEdges, Shader=ColourSwatch(SwatchColor=RGB(0, 0, 0)), Absolute=False)

# ==== cluster DiscretizeVectors
vectors = ClusterInput()
n_of_directions = ClusterInput()
one_over_x = OneOverX(Value=n_of_directions)
neg = Negative(Value=one_over_x)
pi = Pi(Factor=neg)
X = UnitX(Factor=1)
Z = UnitZ(Factor=1)
vrot = Rotate(Vector=X, Axis=Z, Angle=pi)
xy = XYPlane(Origin=Point(0, 0, 0))
pi_2 = Pi(Factor="2")
angle = Angle(VectorA=vectors, VectorB=vrot, Plane=xy)  # -> Angle, Reflex
range = Range(Domain=pi_2, Steps=n_of_directions)
cull_i = CullIndex(List=range, Indices="-1", Wrap=True)
remap = RemapNumbers(Value=angle.Reflex, Source="0 to 2*Pi", Target=Domain(0, 1))  # -> Mapped, Clipped
multiplication = Multiplication(A=remap.Clipped, B=n_of_directions)
X_2 = UnitX(Factor=1)
Z_2 = UnitZ(Factor=1)
expression = Expression(x=multiplication, Expression="floor(x)")
vrot_2 = Rotate(Vector=X_2, Axis=Z_2, Angle=cull_i)
item = ListItem(List=vrot_2, Index=graft(expression), Wrap=True)  # -> flatten(Item)

# ----
# group by direction
series = Series(Start=0, Step=1, Count=n_of_directions)
int = Integer(series)
mindex = MemberIndex(Set=expression, Member=int)  # -> Index, Count

discretized_vectors = ClusterOutput(item)
discrete_directions = ClusterOutput(vrot_2)
discretized_vector_grouped_by_direction = ClusterOutput(mindex.Index)
