# Grasshopper definition XX_01_discrete vectors.gh (Grasshopper 0.9.76)
# Copyright: Co-de-iT
# plug-ins: Human

X = UnitX(Factor=1)
Y = UnitY(Factor=1)
Z = UnitZ(Factor=1)
pt = Point(Point(10, 0, 0))
vec = Vector([Vector(1, 0, 1), Vector(0.996520844, 0.1248345265, 0.9991298324), Vector(0.9861075851, 0.2477160357, 0.996520844), Vector(0.968832682, 0.3667220648, 0.9921775753), Vector(0.9448163388, 0.4799907824, 0.9861075851), Vector(0.9142256688, 0.5857501166, 0.9783214372)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])
Z_2 = UnitZ(Factor=1)
X_2 = UnitX(Factor=1)
merge = Merge(Data1=flatten(X), Data2=flatten(Y), Data3=flatten(Z))
range = Range(Domain="0 to 360", Steps=Slider(28, range=1..100))
Z_3 = UnitZ(Factor=1)
X_3 = UnitX(Factor=1)
# discrete vectors component
# 
# © a3 2017 _ Creative Commons Attribution-NonCommercial-ShareAlike3.0 UnportedLicense.
vrot = Rotate(Vector=X_2, Axis=Z_2, Angle=degrees(Slider(42.298, range=0..360)))
rev = Reverse(Vector=merge)
multiplication = Multiplication(A=vrot, B="0.5")
merge_2 = Merge(Data1=flatten(merge), Data2=flatten(rev))
pt_2 = Point(Point(0, 0, 0))
vrot_2 = Rotate(Vector=X_3, Axis=Z_3, Angle=degrees(range))
pt_3 = Point(Point(5, 0, 0))
# discretize directions
# by input vectors
vec_2 = Vector(merge_2)
# this component discretizes vectors by number of subdivisions of the 360 angle
vdisex = VectorDisplayEx(Point=pt_2, Vector=multiplication, Colour=ColourSwatch(SwatchColor=RGB(135, 135, 135)), Width=2)
# this component discretizes vectors by number of subdivisions of the 360 angle
multiplication_2 = Multiplication(A=vrot_2, B="0.5")
panel = Panel(vec_2)

# ----
# discretize directions
# by number
n_directions = Panel("4")
discretize_vectors = DiscretizeVectors(vectors=vrot_2, n_of_directions=n_directions)  # -> discretized_vectors, discretized_vector_grouped_by_direction, discrete_directions

# ----
# discretize directions
# by number
n_directions_2 = Panel("4")
discretize_vectors_2 = DiscretizeVectors(vectors=vrot, n_of_directions=n_directions_2)  # -> discretized_vectors, discretized_vector_grouped_by_direction, discrete_directions

multiplication_3 = Multiplication(A=vec, B="0.5")
panel_2 = Panel("discrete reference directions")
entwine = Entwine(
    Branch00=ColourSwatch(SwatchColor=RGB(255, 0, 0)),
    Branch01=ColourSwatch(SwatchColor=RGB(0, 255, 0)),
    Branch02=ColourSwatch(SwatchColor=RGB(0, 0, 255)),
    Branch03=ColourSwatch(SwatchColor=RGB(125, 0, 0)),
    Branch04=ColourSwatch(SwatchColor=RGB(0, 117, 0)),
    Branch05=ColourSwatch(SwatchColor=RGB(0, 0, 107)),
    FlattenInputs=True)
# this component uses an input list of vectors to approximate to the nearest one
discretize_vectors_3 = DiscretizeVectors_2(vectors=vec, discrete_directions=vec_2)  # -> discretized_vectors, discretized_vector_grouped_by_direction
vdisex_2 = VectorDisplayEx(Point=pt_3, Vector=multiplication_2, Colour=ColourSwatch(SwatchColor=RGB(135, 135, 135)), Width=2)
item = ListItem(List=multiplication_3, Index=discretize_vectors_3.discretized_vector_grouped_by_direction, Wrap=True)
pt_4 = Point(Point(0, 0, 0))
vdisex_3 = VectorDisplayEx(Point=pt_4, Vector=discretize_vectors_2.discretized_vectors, Colour=RGB(0, 0, 0), Width=2)
vdisex_4 = VectorDisplayEx(Point=pt_3, Vector=discretize_vectors.discretized_vectors, Colour=RGB(0, 0, 0), Width=2)
# indici dei vettori per ciascuna direzione discretizzata
panel_3 = Panel(discretize_vectors.discretized_vector_grouped_by_direction)
# direzioni discrete di riferimento
panel_4 = Panel(discretize_vectors.discrete_directions)
vdisex_5 = VectorDisplayEx(Point=pt, Vector=graft(vec_2), Colour=entwine, Width=2)
vdisex_6 = VectorDisplayEx(Point=pt, Vector=item, Colour=entwine, Width=2)
# indici dei vettori per ciascuna direzione discretizzata
panel_5 = Panel(discretize_vectors_3.discretized_vector_grouped_by_direction)
cell_size = Slider(1, range=0.001..3)
# example
pt_5 = Point(Point(15, 0, 0))
recgrid = Rectangular(Plane=pt_5, SizeX=cell_size, SizeY=cell_size, ExtentX=Slider(12, range=1..100), ExtentY=Slider(17, range=1..100))  # -> Cells, Points
series = Series(Start=0, Step=cell_size, Count=Slider(15, range=1..100))
X_4 = UnitX(Factor=1)
Y_2 = UnitY(Factor=1)
Z_4 = UnitZ(Factor=1)
pcen = PolygonCenter(Polyline=recgrid.Cells)  # -> flatten(CenterV), CenterE, CenterA
Z_5 = UnitZ(Factor=series)
merge_3 = Merge(Data1=flatten(X_4), Data2=flatten(Y_2), Data3=flatten(Z_4))
move = Move(Geometry=graft(pcen.CenterV), Motion=Z_5)  # -> flatten(Geometry), Transform
crv = Curve(reparameterize(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))
rev_2 = Reverse(Vector=merge_3)
crv_cp = CurveClosestPoint(Point=move.Geometry, Curve=crv)  # -> Point, Parameter, Distance
merge_4 = Merge(Data1=flatten(merge_3), Data2=flatten(rev_2))
previewlw = CustomPreviewLineweights(Geometry=crv, Shader=ColourSwatch(SwatchColor=RGB(255, 255, 255)), Thickness="2", Absolute=False)
eval = EvaluateCurve(Curve=crv, Parameter=crv_cp.Parameter)  # -> Point, Tangent, Angle
vec_3 = Vector(merge_4)
discretize_vectors_4 = DiscretizeVectors_2(vectors=eval.Tangent, discrete_directions=vec_3)  # -> discretized_vectors, discretized_vector_grouped_by_direction
multiplication_4 = Multiplication(A=cell_size, B="0.25")
multiplication_5 = Multiplication(A=cell_size, B="0.5")
amp = Amplitude(Vector=eval.Tangent, Amplitude=multiplication_4)
amp_2 = Amplitude(Vector=discretize_vectors_4.discretized_vectors, Amplitude=multiplication_5)
entwine_2 = Entwine(
    Branch00=ColourSwatch(SwatchColor=RGB(255, 0, 0)),
    Branch01=ColourSwatch(SwatchColor=RGB(0, 255, 0)),
    Branch02=ColourSwatch(SwatchColor=RGB(0, 0, 255)),
    Branch03=ColourSwatch(SwatchColor=RGB(125, 0, 0)),
    Branch04=ColourSwatch(SwatchColor=RGB(0, 117, 0)),
    Branch05=ColourSwatch(SwatchColor=RGB(0, 0, 107)),
    FlattenInputs=True)
item_2 = ListItem(List=move.Geometry, Index=discretize_vectors_4.discretized_vector_grouped_by_direction, Wrap=True)
item_3 = ListItem(List=amp_2, Index=discretize_vectors_4.discretized_vector_grouped_by_direction, Wrap=True)
vdisex_7 = VectorDisplayEx(Point=move.Geometry, Vector=amp, Colour=ColourSwatch(SwatchColor=RGB(105, 105, 105)), Width=2)
vdisex_8 = VectorDisplayEx(Point=move.Geometry, Vector=amp_2, Colour=RGB(0, 0, 0), Width=2)
vdisex_9 = VectorDisplayEx(Point=item_2, Vector=item_3, Colour=entwine_2, Width=2)

# ==== cluster DiscretizeVectors
vectors = ClusterInput()
n_of_directions = ClusterInput()
one_over_x = OneOverX(Value=n_of_directions)
neg = Negative(Value=one_over_x)
pi = Pi(Factor=neg)
X = UnitX(Factor=1)
Z = UnitZ(Factor=1)
vrot = Rotate(Vector=X, Axis=Z, Angle=pi)
xy = XYPlane(Origin=Point(0, 0, 0))
pi_2 = Pi(Factor="2")
angle = Angle(VectorA=vectors, VectorB=vrot, Plane=xy)  # -> Angle, Reflex
range = Range(Domain=pi_2, Steps=n_of_directions)
cull_i = CullIndex(List=range, Indices="-1", Wrap=True)
remap = RemapNumbers(Value=angle.Reflex, Source="0 to 2*Pi", Target=Domain(0, 1))  # -> Mapped, Clipped
multiplication = Multiplication(A=remap.Clipped, B=n_of_directions)
X_2 = UnitX(Factor=1)
Z_2 = UnitZ(Factor=1)
expression = Expression(x=multiplication, Expression="floor(x)")
vrot_2 = Rotate(Vector=X_2, Axis=Z_2, Angle=cull_i)
item = ListItem(List=vrot_2, Index=graft(expression), Wrap=True)  # -> flatten(Item)

# ----
# group by direction
series = Series(Start=0, Step=1, Count=n_of_directions)
int = Integer(series)
mindex = MemberIndex(Set=expression, Member=int)  # -> Index, Count

discretized_vectors = ClusterOutput(item)
discrete_directions = ClusterOutput(vrot_2)
discretized_vector_grouped_by_direction = ClusterOutput(mindex.Index)

# ==== cluster DiscretizeVectors_2
discrete_directions = ClusterInput()
vectors = ClusterInput()
angle = Angle(VectorA=graft(vectors), VectorB=discrete_directions)  # -> Angle, Reflex
lng = ListLength(List=discrete_directions)
series = Series(Start=0, Step=1, Count=lng)
nullrep = ReplaceNulls(Items=angle.Angle, Replacements="999")  # -> Items, Count
int = Integer(series)
sort = SortList(Keys=nullrep.Items, ValuesA=int)  # -> Keys, ValuesA
item = ListItem(List=sort.ValuesA, Index=0, Wrap=True)  # -> flatten(Item)
# group by direction
int_2 = Integer(item)
item_2 = ListItem(List=discrete_directions, Index=graft(int_2), Wrap=True)  # -> flatten(Item)
mindex = MemberIndex(Set=int_2, Member=int)  # -> Index, Count
discretized_vectors = ClusterOutput(item_2)
discretized_vector_grouped_by_direction = ClusterOutput(mindex.Index)
