# Grasshopper definition XX_02_solar simulation.gh (Grasshopper 0.9.76)
# Copyright: Co-de-iT
# plug-ins: Human, Weaverbird

arc_radius = Slider(50, range=1..50)

azimuth_angle = Slider(145.613, range=-180..180)
altitude_angle = Slider(130.678, range=10..170)

sun_angle = Slider(64.4, range=10..170)

initial_sun_angle = Slider(46.48, range=10..170)
final_sun_angle = Slider(129.936, range=10..170)
steps = Slider(30, range=1..30)

sun_input = ValueList({"single value": 0, "range": 1}, selected="range")
# Solar simulation
# 
# Simulate a simplified solar incidence in GH
# 
# © a3 2017 _ Creative Commons Attribution-NonCommercial-ShareAlike3.0 UnportedLicense.
# input mesh
mesh = Mesh(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)
demesh = DeconstructMesh(Mesh=mesh)  # -> Vertices, Faces, Colours, Normals
dom = ConstructDomain(DomainStart=initial_sun_angle, DomainEnd=final_sun_angle)
deface = DeconstructFace(Face=graft(demesh.Faces))  # -> CornerA, CornerB, CornerC, CornerD

# ----
# centra l'arco solare sulla mesh
avr = Average(Input=demesh.Vertices)
xy = XYPlane(Origin=Point(0, 0, 0))
project = Project(Geometry=avr, Plane=xy)  # -> Geometry, Transform

rad = Radians(Degrees=sun_angle)
range = Range(Domain=dom, Steps=steps)
merge = Merge(Data1=deface.CornerA, Data2=deface.CornerB, Data3=deface.CornerC, Data4=deface.CornerD)
rad_2 = Radians(Degrees=range)
item = ListItem(List=demesh.Normals, Index=merge, Wrap=True)
item_2 = ListItem(List=demesh.Vertices, Index=merge, Wrap=True)

arc = Arc(Plane=project.Geometry, Radius=arc_radius, Angle=Domain(0, 3.141592654))  # -> Arc, Length
flip = FlipCurve(Curve=arc.Arc)  # -> Curve, Flag
xy_2 = XYPlane(Origin=project.Geometry)
# generazione arco solare
rotate = Rotate(Geometry=flip.Curve, Angle=degrees(azimuth_angle), Plane=xy_2)  # -> Geometry, Transform
end = EndPoints(Curve=rotate.Geometry)  # -> Start, End
vec2pt = Vector2Pt(PointA=end.Start, PointB=end.End, Unitize=False)  # -> Vector, Length
rot3d = Rotate3D(Geometry=rotate.Geometry, Angle=degrees(altitude_angle), Center=project.Geometry, Axis=vec2pt.Vector)  # -> Geometry, Transform

multiplication = Multiplication(A=arc_radius, B=rad)
multiplication_2 = Multiplication(A=arc_radius, B=rad_2)
filter = StreamFilter(Gate=sun_input, Stream0=multiplication, Stream1=multiplication_2)
eval = EvaluateLength(Curve=rot3d.Geometry, Length=filter, Normalized=False)  # -> Point, Tangent, Parameter
# direzione del sole
vec2pt_2 = Vector2Pt(PointA=eval.Point, PointB=project.Geometry, Unitize=True)  # -> Vector, Length
angle = Angle(VectorA=vec2pt_2.Vector, VectorB=graft(demesh.Normals))  # -> Angle, Reflex
xy_3 = XYPlane(Origin=Point(0, 0, 0))
avr_2 = Average(Input=angle.Angle)  # -> flatten(ArithmeticMean)
cir = Circle(Plane=project.Geometry, Radius=arc_radius)
mshadow = MeshShadow(Mesh=mesh, Light=vec2pt_2.Vector, Plane=xy_3)
f_mv2fval = MeshVertexToFaceValues(M=mesh, Vv=avr_2)  # -> Vf; inputs M: Mesh, Vv: list of Double, m: Boolean
#   port m: calculation method: simple or weighted average
# ---------- f_mv2fval: C# ----------
                                                                                                                                /*
    froGH - a sparse collection of (in)utilities for Grasshopper

    Convert per-Vertex values into per-Face values

    parallelization occurs after 1000 elements

    code by Alessio Erioli

    froGH by Co-de-iT is licensed under a Creative Commons Attribution 4.0 International License.
    http://creativecommons.org/licenses/by/4.0/

    */
    initComp(m);
    int pThres = 1000; // parallelization threshold

    if (M != null && Vv.Count > 0){
      if (Vv.Count == M.Vertices.Count){

        if (Vv.Count < pThres){ // non-parallel calculation

          List<double> faceVal = new List<double>();

          if(m){ //weighted average
            for (int i = 0; i < M.Faces.Count; i++){
              faceVal.Add(v2FaceWVal(M, Vv, i));
            }

          }else{ // simple average

            for (int i = 0; i < M.Faces.Count; i++){
              faceVal.Add(v2FaceVal(M, Vv, i));

            }
          }
          Vf = faceVal;


        }else{ // parallel calculation

          var mVv = new System.Collections.Concurrent.ConcurrentDictionary<int, double>(Environment.ProcessorCount, Vv.Count);
          List<int> fInd = new List<int>();
          for(int i = 0; i < M.Faces.Count; i++){
            fInd.Add(i);
          }
          foreach(int i in fInd) mVv[i] = 0; // initialise dictionary

          if(m){

            System.Threading.Tasks.Parallel.ForEach(fInd, i =>
              {
              mVv[i] = v2FaceWVal(M, Vv, i); //save your output here
              }
              );

          }else{

            System.Threading.Tasks.Parallel.ForEach(fInd, i =>
              {
              mVv[i] = v2FaceVal(M, Vv, i); //save your output here
              }
              );
          }

          Vf = mVv.Values;

        }
      }
    }
# ---------- f_mv2fval: C# additional code ----------
  void initComp(bool m){
    Component.Name = "Mesh Vertex to Face values";
    Component.NickName = "f_MV2FVal";
    Component.Description = "Converts per-vertex into per-face values";
    Component.Message = m ? "weighted" : "simple";
    Component.Params.Input[0].Name = "Mesh";
    Component.Params.Input[0].Description = "Input Mesh";
    Component.Params.Input[1].Name = "Values per vertices";
    Component.Params.Input[1].Description = "List of values (one for each vertex)";
    Component.Params.Input[2].Name = "Method";
    Component.Params.Input[2].Description = "calculation method:\nsimple or weighted average";
    Component.Params.Output[0].Name = "Values per face";
    Component.Params.Output[0].Description = "Values distributed per face";
  }

  public double v2FaceVal(Mesh M, List<double> Vv, int i){
    double fV = 0;
    int count = 0;
    MeshFace f = M.Faces.GetFace(i);
    if (f.IsValid(M.Vertices.Count)){
      fV += Vv[f.A];
      fV += Vv[f.B];
      fV += Vv[f.C];
      count = 3;
      if (f.IsQuad){
        fV += Vv[f.D];
        count = 4;
      }
      fV /= count;
    }
    return fV;
  }

  public double v2FaceWVal(Mesh M, List<double> Vv, int i){
    double fV = 0, fDist = 0, dists = 0;

    MeshFace f = M.Faces.GetFace(i);
    if (f.IsValid(M.Vertices.Count)){
      Point3d fc = getFaceCenter(M, i);
      fDist = fc.DistanceTo(M.Vertices[f.A]);
      dists += fDist;
      fV += Vv[f.A] * fDist;
      fDist = fc.DistanceTo(M.Vertices[f.B]);
      dists += fDist;
      fV += Vv[f.B] * fDist;
      fDist = fc.DistanceTo(M.Vertices[f.C]);
      dists += fDist;
      fV += Vv[f.C] * fDist;
      if (f.IsQuad){
        fDist = fc.DistanceTo(M.Vertices[f.D]);
        dists += fDist;
        fV += Vv[f.D] * fDist;
      }
      fV /= dists;
    }
    return fV;
  }

  public Point3d getFaceCenter(Mesh M, int fInd){
    MeshFace f = M.Faces[fInd];
    Point3d c = new Point3d();
    if (f.IsValid(M.Vertices.Count)){
      c = Point3d.Add(c, (Point3d) M.Vertices[f.A]);
      c = Point3d.Add(c, (Point3d) M.Vertices[f.B]);
      c = Point3d.Add(c, (Point3d) M.Vertices[f.C]);
      if (f.IsQuad){
        c = Point3d.Add(c, (Point3d) M.Vertices[f.D]);
      }
    }
    c /= f.IsQuad ? 4 : 3;
    return c;
  }
# ---------- end f_mv2fval ----------

lng = ListLength(List=flatten(mshadow))
# colora le ombre portate
panel = Panel("1")
range_2 = Range(Domain=Domain(0, 1), Steps=expr("x-1", lng))
equals = Equality(FirstNumber=lng, SecondNumber=panel)  # -> Equality, Inequality
graph = GraphMapper(range_2, x0=0, x1=1, y0=0, y1=1, container_name="Sine", Equation_px=[0, 0.5027810931], Equation_py=[0, 1])
filter_2 = StreamFilter(Gate=equals.Equality, Stream0=graph, Stream1="1")
gradient = Gradient(LowerLimit=0, UpperLimit=1, Parameter=filter_2, stops=[0: RGB(186, 186, 186), 1: RGB(0, 0, 0)])

bnd = Bounds(Numbers=f_mv2fval)
remap = RemapNumbers(Value=f_mv2fval, Source=bnd, Target=Domain(0, 1))  # -> Mapped, Clipped

avr_3 = Average(Input=item)  # -> flatten(ArithmeticMean)
avr_4 = Average(Input=item_2)  # -> flatten(ArithmeticMean)
amp = Amplitude(Vector=avr_3, Amplitude=Slider(0.914, range=0..1))
move = Move(Geometry=avr_4, Motion=amp)  # -> Geometry, Transform
ln = Line(StartPoint=avr_4, EndPoint=move.Geometry)
subcrv = SubCurve(BaseCurve=ln, Domain="0.8")
expression = Expression(x=remap.Mapped, Expression="round(x,2)")
# data display
swatch = ColourSwatch(SwatchColor=RGB(0, 0, 0))
previewlw = CustomPreviewLineweights(Geometry=subcrv, Shader=swatch, Absolute=False)
tag = TextTag3D(
    Location=move.Geometry,
    Text=expression,
    Size=Slider(0.2, range=0..1),
    Colour=ColourSwatch(SwatchColor=RGB(0, 0, 0)),
    Justification=5)

gradient_2 = Gradient(
    LowerLimit=0,
    UpperLimit=1,
    Parameter=graft(remap.Clipped),
    stops=[0.145: RGB(67, 88, 148), 0.504: RGB(255, 255, 0), 1: RGB(255, 0, 0)])
amp_2 = Amplitude(Vector=vec2pt_2.Vector, Amplitude=Slider(10, range=0..10))
weld = BooleanToggle(False)
conmesh = ConstructMesh(Vertices=item_2, Faces={A=0, B=1, C=2, D=3}, Colours=gradient_2)
multiplication_3 = Multiplication(A=filter_2, B=amp_2)
# colored mesh
wbjoin = WeaverbirdsJoinMeshesAndWeld(Mesh=flatten(conmesh), Weld=weld)
# shadow display
previewlw_2 = CustomPreviewLineweights(Geometry=flatten(mshadow), Shader=gradient, Absolute=False)
# scalar values for solar incidence
num = Number(remap.Mapped)

vdisex = VectorDisplayEx(Point=eval.Point, Vector=multiplication_3, Colour=gradient, Width=2)
# arc display
previewlw_3 = CustomPreviewLineweights(Geometry=[rot3d.Geometry, cir], Shader=ColourSwatch(SwatchColor=RGB(0, 0, 0)), Absolute=False)
