# Grasshopper definition XX_03_octree subdivision.gh (Grasshopper 0.9.76)
# Copyright: Co-de-iT
# plug-ins: Anemone, Human

volume_size_y = Slider(8.837, range=0..100)
# Perché un box Mesh?: viene generato un voxel mesh per minor peso in computazione. I vertici possono essere sempre ricavati con deconstruct mesh e sono nello stesso ordine di un qualunque box
volume_size_z = Slider(6.917, range=0..100)
volume_size_x = Slider(16.517, range=0..100)

box = CenterBox(Base=PlaneXY(0, 0, 0), X=volume_size_x, Y=volume_size_y, Z=volume_size_z)
# Voxel Octree subdivision
# 
# © a3 2017 _ Creative Commons Attribution-NonCommercial-ShareAlike3.0 UnportedLicense.
# mesh box generation
box_corners = BoxCorners(Box=box)  # -> CornerA, CornerB, CornerC, CornerD, CornerE, CornerF, CornerG, CornerH
panel = Panel("""Q{0;3;2;1}
Q{0;1;5;4}
Q{1;2;6;5}
Q{2;3;7;6}
Q{0;4;7;3}
Q{4;5;6;7}""")
merge = Merge(
    Data1=box_corners.CornerA,
    Data2=box_corners.CornerB,
    Data3=box_corners.CornerC,
    Data4=box_corners.CornerD,
    Data5=box_corners.CornerE,
    Data6=box_corners.CornerF,
    Data7=box_corners.CornerG,
    Data8=box_corners.CornerH)
conmesh = ConstructMesh(Vertices=merge, Faces=panel)

multiplication = Multiplication(A=volume_size_y, B=2)
Y = UnitY(Factor=multiplication)
move = Move(Geometry=conmesh, Motion=Y)  # -> Geometry, Transform
start_box_type = ValueList({"rectangular": 0, "skewed": 1}, selected="skewed")
merge_2 = Merge(Data1=conmesh, Data2=move.Geometry)
# la Octree subdivision implementata in questo modo funziona solo su box iniziali che hanno tutti i lati opposti paralleli tra loro (es: parallelepipedo o trapezoide)
mesh = Mesh([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])
filter = StreamFilter(Gate=start_box_type, Stream0=merge_2, Stream1=mesh)
# ATTENZIONE: le suddivisioni di octree generano potenzialmente un numero 8x di elementi ad ogni iterazione. In 3 iterazioni si può arrivare da 1 a 8^3 = 512 elementi.
# 
# Per questo si suggerisce un numero di iterazioni basso: partire da 0 o 1 e arrivare max a 3-4 (salvo casi eccezionali)
number_slider = Slider(4, range=0..4)
sample_length = Slider(0.5, range=0.1..10)
crv = Curve([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])
fastloopstart = FastLoopStart(I=number_slider, D0=filter, D1="0")  # -> port, Counter, Data, Data_2
preview = CustomPreview(
    Geometry=crv,
    Shader={ambient=RGB(0, 0, 0), diffuse=RGB(255, 105, 180), emission=RGB(76, 32, 54), shine=0.5, specular=RGB(255, 255, 255), transparency=0})

# ----
# La curva viene suddivisa e si controlla se uno qualunque dei punti di divisione cade all'interno del mesh box o meno - in caso positivo si procede a suddividere quel box
divlength = DivideLength(Curve=crv, Length=sample_length)  # -> flatten(Points), Tangents, Parameters
minc = MeshInclusion(Mesh=graft(fastloopstart.Data), Point=divlength.Points, Strict=False)
# condizione
f_massbool = MassBoolean(V=minc, type="1")  # -> flatten(B); inputs V: list of Boolean, type: Int32
# ---------- f_massbool: C# ----------
  /*
    froGH - a sparse collection of (in)utilities for Grasshopper

    mass boolean
    code by Alessio Erioli

    froGH by Co-de-iT is licensed under a Creative Commons Attribution 4.0 International License.
    http://creativecommons.org/licenses/by/4.0/

    */
    initComp();

    bool r;
    if (type == 0) {
      Component.Message = "AND";
      r = true;
    }else{
      Component.Message = "OR";
      r = false;
    }


    for (int i = 0; i < V.Count; i++){
      if (type == 0) {
        r = r && V[i];
      }
      else{
        r = r || V[i];
      }
    }
    B = r;
# ---------- f_massbool: C# additional code ----------
  void initComp(){
    Component.Name = "Mass Boolean";
    Component.NickName = "f_MassBool";
    Component.Description = "Mass boolean operator on a list of values";
    Component.Params.Input[0].Name = "Values";
    Component.Params.Input[0].Description = "boolean values as list";
    Component.Params.Input[1].Name = "Boolean operator";
    Component.Params.Input[1].Description = "type of operator: 0 AND, 1 OR";
    Component.Params.Output[0].Name = "Boolean result";
    Component.Params.Output[0].Description = "the result";

  }
# ---------- end f_massbool ----------

dispatch = Dispatch(List=fastloopstart.Data_2, DispatchPattern=f_massbool)  # -> ListA, ListB
dispatch_2 = Dispatch(List=fastloopstart.Data, DispatchPattern=f_massbool)  # -> graft(ListA), ListB

demesh = DeconstructMesh(Mesh=dispatch_2.ListA)  # -> Vertices, Faces, Colours, Normals
avr = Average(Input=demesh.Vertices)
scale = Scale(Geometry=demesh.Vertices, Center=avr, Factor=0.5)  # -> Geometry, Transform
vec2pt = Vector2Pt(PointA=avr, PointB=demesh.Vertices, Unitize=False)  # -> Vector, Length
# si scalano i punti estremi del box di 0.5 e si spostano 8 volte, una verso ciascun vertice del box di partenza, ricostruendo poi le 8 meshes
panel_2 = Panel("0.5")
multiplication_2 = Multiplication(A=vec2pt.Vector, B=panel_2)
group = Group(Objects=scale.Geometry)
# voxel octree subdivision
move_2 = Move(Geometry=group, Motion=multiplication_2)  # -> Geometry, Transform
panel_3 = Panel("""Q{0;3;2;1}
Q{0;1;5;4}
Q{1;2;6;5}
Q{2;3;7;6}
Q{0;4;7;3}
Q{4;5;6;7}""")
ungroup = Ungroup(Group=move_2.Geometry)
conmesh_2 = ConstructMesh(Vertices=ungroup, Faces=panel_3)  # -> flatten(Mesh)

lng = ListLength(List=conmesh_2)
repeat = RepeatData(Data=fastloopstart.Counter, Length=lng)
merge_3 = Merge(Data1=dispatch_2.ListB, Data2=conmesh_2)  # -> flatten(Result)
merge_4 = Merge(Data1=dispatch.ListB, Data2=repeat)  # -> flatten(Result)
# voxels
# indici
fastloopend = FastLoopEnd(port=fastloopstart.port, Exit=False, Data=flatten(merge_3), Data_2=flatten(merge_4), RecordData=False, TimeOutVal=0)  # -> D0, D1

exponent = Slider(0.15, range=0..1)
expression = Expression(x=fastloopend.D1, z=exponent, Expression="pow(1/(x+1),z)")
bnd = Bounds(Numbers=expression)
merge_5 = Merge(Data1=ColourSwatch(SwatchColor=RGBA(201, 201, 201, 0)), Data2=ColourSwatch(SwatchColor=RGBA(0, 0, 0, 0)))
remap = RemapNumbers(Value=expression, Source=bnd, Target=Domain(0, 1))  # -> Mapped, Clipped
medges = MeshEdges(Mesh=fastloopend.D0)  # -> NakedEdges, InteriorEdges, NonManifoldEdges
interp = InterpolateData(Data=merge_5, Parameter=remap.Mapped, Interpolation=2)  # -> graft(Value)
# display voxels
merge_6 = Merge(Data1=medges.NakedEdges, Data2=medges.InteriorEdges)
previewlw = CustomPreviewLineweights(Geometry=merge_6, Shader=interp, Absolute=False)

multiplication_3 = Multiplication(A=number_slider, B=Slider(0, range=0..1))
int = Integer(multiplication_3)
equals = Equality(FirstNumber=fastloopend.D1, SecondNumber=int)  # -> Equality, Inequality
panel_4 = Panel(int)
dispatch_3 = Dispatch(List=fastloopend.D0, DispatchPattern=equals.Equality)  # -> ListA, ListB
# select by generation
mjoin = MeshJoin(Meshes=dispatch_3.ListA)
previewmat = CustomPreviewMaterials(Geometry=mjoin, DiffuseColor=RGB(255, 255, 255))

volume = Volume(Geometry=fastloopend.D0)  # -> Volume, Centroid
multiplication_4 = Multiplication(A=expression, B=Slider(0.739, range=0..1))
# display indici
tag = TextTag3D(
    Location=volume.Centroid,
    Text=fastloopend.D1,
    Size=multiplication_4,
    Colour=ColourSwatch(SwatchColor=RGB(255, 0, 221)),
    Justification=7)
