# Grasshopper definition XX_04_double pyramid.gh (Grasshopper 0.9.76)
# Copyright: Co-de-iT
# plug-ins: MeshEdit Components, Human

number_slider = Slider(5, range=0..10)
# altezza della piramide per avere un triangolo equilatero sulla diagonale
expression = Expression(x=number_slider, Expression="sqrt(2)*x*cos(π/6)")
# double pyramid grid exploration
# 
# © a3 2017 _ Creative Commons Attribution-NonCommercial-ShareAlike3.0 UnportedLicense.
rectangle = Rectangle(Plane=PlaneXY(0, 0, 0), XSize=number_slider, YSize=number_slider, Radius=0)  # -> Rectangle, Length
pcen = PolygonCenter(Polyline=rectangle.Rectangle)  # -> CenterV, CenterE, CenterA
Z = UnitZ(Factor=expression)

_0 = BooleanToggle(True)
_1 = BooleanToggle(False)
_2 = BooleanToggle(False)
_3 = BooleanToggle(False)
_4 = BooleanToggle(True)
_5 = BooleanToggle(True)
_6 = BooleanToggle(False)
_7 = BooleanToggle(False)
# i criteri per eliminare le facce possono cambiare, occorre comunque fornire una lista degli indici delle facce da eliminare
panel = Panel("8")
merge = Merge(Data1=_0, Data2=_1, Data3=_2, Data4=_3, Data5=_4, Data6=_5, Data7=_6, Data8=_7)
series = Series(Start="1", Step=1, Count=panel)
multiplication = Multiplication(A=merge, B=series)
# cull faces
subtraction = Subtraction(A=multiplication, B="1")
int = Integer(subtraction)

rev = Reverse(Vector=Z)
disc = Discontinuity(Curve=rectangle.Rectangle, Level=1)  # -> Points, Parameters
shift = ShiftList(List=disc.Points, Shift=1, Wrap=True)
move = Move(Geometry=pcen.CenterV, Motion=Z)  # -> Geometry, Transform
move_2 = Move(Geometry=pcen.CenterV, Motion=rev)  # -> Geometry, Transform
merge_2 = Merge(Data1=simplify(graft(disc.Points)), Data2=simplify(graft(shift)))
ins = InsertItems(List=reverse(merge_2), Item=move_2.Geometry, Indices="-1", Wrap=True)
ins_2 = InsertItems(List=merge_2, Item=move.Geometry, Indices="-1", Wrap=True)
conmesh = ConstructMesh(Vertices=ins_2, Faces="T{0;1;2}")
conmesh_2 = ConstructMesh(Vertices=ins, Faces="T{0;1;2}")
merge_3 = Merge(Data1=flatten(conmesh), Data2=flatten(conmesh_2))
# cull faces
cull_i = CullIndex(List=merge_3, Indices=int, Wrap=False)
bbox = BoundingBox(Content=merge_3, Plane=PlaneXY(0, 0, 0), UnionBox=True)  # -> Box, Box_2
mjoin = MeshJoin(Meshes=cull_i)

boxprop = BoxProperties(Box=bbox.Box)  # -> Center, Diagonal, Area, Volume, Degeneracy
# type A grid from bounding box
arrbox = BoxArray(
    Geometry=pcen.CenterV,
    Cell=bbox.Box,
    XCount=Slider(3, range=2..20),
    YCount=Slider(5, range=2..20),
    ZCount=Slider(2, range=2..20))  # -> Geometry, Transform
multiplication_2 = Multiplication(A=boxprop.Diagonal, B=0.5)
move_3 = Move(Geometry=arrbox.Geometry, Motion=multiplication_2)  # -> Geometry, Transform
merge_4 = Merge(Data1=arrbox.Geometry, Data2=move_3.Geometry)

weldvertices = MeshWeldVertices(Mesh=mjoin, Tolerance=0.01)  # -> RuntimeMessage, Mesh
facen = FaceNormals(Mesh=weldvertices.Mesh)  # -> Centers, Normals
# single component
previewmat = CustomPreviewMaterials(Geometry=weldvertices.Mesh, DiffuseColor=RGB(255, 255, 255))
vdisex = VectorDisplayEx(Point=facen.Centers, Vector=facen.Normals, Colour=RGB(0, 0, 0), Width=2)

# ---- group: pyramid height
num = Number(expression)

# ---- group: pyramid side
num_2 = Number(number_slider)

# ----
xy = XYPlane(Origin=pcen.CenterV)
xy_2 = XYPlane(Origin=merge_4)

orient = Orient(Geometry=weldvertices.Mesh, Source=xy, Target=xy_2)  # -> Geometry, Transform
# type A grid oriented
mjoin_2 = MeshJoin(Meshes=orient.Geometry)
previewmat_2 = CustomPreviewMaterials(Geometry=mjoin_2, DiffuseColor=RGB(255, 255, 255))

rad = Radians(Degrees="60")

switch_direction = BooleanToggle(False)
filter = StreamFilter(Gate=switch_direction, Stream0="Pi*0.25", Stream1="Pi*0.75")
neg = Negative(Value=filter)
expression_2 = Expression(x=number_slider, Expression="sqrt(2)*x*0.5")
prot = RotatePlane(Plane=xy, Angle=neg)
multiplication_3 = Multiplication(A=num, B="2")
deplane = DeconstructPlane(Plane=prot)  # -> Origin, XAxis, YAxis, ZAxis
amp = Amplitude(Vector=deplane.XAxis, Amplitude=expression_2)
panel_2 = Panel("""0
120
240""")
series_2 = Series(Start=0, Step=multiplication_3, Count=Slider(2, range=1..10))
series_3 = Series(Start=0, Step=num_2, Count=Slider(4, range=1..10))
deplane_2 = DeconstructPlane(Plane=xy)  # -> Origin, XAxis, YAxis, ZAxis
move_4 = Move(Geometry=deplane.Origin, Motion=amp)  # -> Geometry, Transform
rad_2 = Radians(Degrees=panel_2)
neg_2 = Negative(Value=deplane_2.YAxis)
num_3 = Number(number_slider)
neg_3 = Negative(Value=num_2)
# type B grid (one case) from bounding box
rot3d = Rotate3D(Geometry=prot, Angle=rad_2, Center=move_4.Geometry, Axis=deplane.YAxis)  # -> Geometry, Transform
amp_2 = Amplitude(Vector=deplane_2.XAxis, Amplitude=series_3)
amp_3 = Amplitude(Vector=deplane_2.ZAxis, Amplitude=series_2)
amp_4 = Amplitude(Vector=neg_2, Amplitude=num_3)
addition = Addition(A=graft(amp_3), B=amp_4)  # -> flatten(Result)
addition_2 = Addition(A=graft(amp_3), B=amp_2)  # -> flatten(Result)
merge_5 = Merge(Data1=addition_2, Data2=addition)

amp_5 = Amplitude(Vector=deplane_2.YAxis, Amplitude=neg_3)

move_5 = Move(Geometry=rot3d.Geometry, Motion=amp_5)  # -> Geometry, Transform
group = Group(Objects=move_5.Geometry)
move_6 = Move(Geometry=group, Motion=merge_5)  # -> Geometry, Transform
ungroup = Ungroup(Group=move_6.Geometry)  # -> flatten(Objects)

orient_2 = Orient(Geometry=weldvertices.Mesh, Source=prot, Target=ungroup)  # -> Geometry, Transform
# type B grid oriented
mjoin_3 = MeshJoin(Meshes=orient_2.Geometry)
previewmat_3 = CustomPreviewMaterials(Geometry=mjoin_3, DiffuseColor=ColourSwatch(SwatchColor=RGB(255, 222, 89)))

rot3d_2 = Rotate3D(Geometry=mjoin_3, Angle=rad, Center=move_4.Geometry, Axis=deplane.YAxis)  # -> Geometry, Transform
