# Grasshopper definition XX_05-0_Anemone intro.gh (Grasshopper 0.9.76)
# Copyright: Co-de-iT
# plug-ins: Anemone, Noise 4D

# simple loop
# Anemone is like a "For" loop in coding language. It basically repeats all the operations inside the "start" and "end" components until the n. of iterations reaches the input value
n_iterations = Slider(50, range=0..50)
# use restart button to start/restart loop
restart = Button()
pt = Point(Point(0, 0, 0))
# simple loop with stop condition
increment = Slider(1.327, range=0.1..3)
n_iterations_2 = Slider(50, range=0..50)
restart_2 = Button()
pt_2 = Point(Point(0, 5, 0))
# simple loop - multiple inputs/outputs
max_x_value = Slider(35, range=10..50)
pt_3 = Point(Point(0, 30, 0))
X = UnitX(Factor=1)
increment_2 = Slider(0.12, range=0.1..3)
increment_angle = Slider(80, range=0..90)
# You can add as many input variables as you like, just remember the number of variables should be the same in the start loop and end loop components
n_iterations_3 = Slider(50, range=0..200)
restart_3 = Button()
pt_4 = Point(Point(0, 10, 0))
X_2 = UnitX(Factor=1)
increment_3 = Slider(0.536, range=0.1..3)
# simple loop - multiple inputs/outputs - keeping data
# Anemone has a "record data" option in the end loop component, but it's not very flexible. This method (merging new and old data) allows for more flexibility and options within the loop (see next example)
n_iterations_4 = Slider(50, range=0..200)
restart_4 = Button()
pt_5 = Point(Point(0, 20, 0))
X_3 = UnitX(Factor=1)
increment_4 = Slider(0.536, range=0.1..3)
increment_angle_2 = Slider(0.5, range=0..10)
# simple loop - multiple inputs/outputs - multiple data - keeping data
# How to deal with a list of inputs instead of a single element: each element in the list should go in a separate tree branch
n_iterations_5 = Slider(100, range=0..200)
rev = Reverse(Vector=X)
restart_5 = Button()
entwine = Entwine(Branch00=pt_3, Branch01=pt_3, FlattenInputs=True)
entwine_2 = Entwine(Branch00=X, Branch01=rev, FlattenInputs=True)

loop_start = LoopStart(Repeat=n_iterations, Trigger=restart, Data=pt)  # -> port, Counter, Data
panel = Panel("increment")
X_4 = UnitX(Factor=increment)
move = Move(Geometry=loop_start.Data, Motion=X_4)  # -> Geometry, Transform
loop_end = LoopEnd(port=loop_start.port, Exit=False, Data=move.Geometry, pausedState=False, state="Constant output", TimeOutVal=0)

# ----
# enable this to
# see the example
# simplify data in the start loop inputs
# simplify new data tree structure when merging with old one
loop_start_2 = LoopStart(N=n_iterations_5, T=restart_5, D0=simplify(entwine), D1=simplify(entwine_2))  # -> port, Counter, Data, Data_2; disabled
item = ListItem(List=loop_start_2.Data, Index="-1", Wrap=True)
item_2 = ListItem(List=loop_start_2.Data_2, Index="-1", Wrap=True)
perlin = PerlinNoise(Values=item, Time=0, Scale=Slider(0.041, range=0..0.1))
amp = Amplitude(Vector=item_2, Amplitude=increment_2)
multiplication = Multiplication(A=perlin, B=increment_angle)
Z = UnitZ(Factor=1)
vrot = Rotate(Vector=amp, Axis=Z, Angle=degrees(multiplication))
move_2 = Move(Geometry=item, Motion=vrot)  # -> Geometry, Transform
viewer = ParamViewer(move_2.Geometry)
merge = Merge(Data1=loop_start_2.Data, Data2=simplify(move_2.Geometry))
merge_2 = Merge(Data1=loop_start_2.Data_2, Data2=simplify(vrot))
viewer_2 = ParamViewer(merge_2)
loop_end_2 = LoopEnd(port=loop_start_2.port, Exit=False, Data=merge, Data_2=merge_2, pausedState=False, state="Constant output", TimeOutVal=0)  # -> D0, D1

# ----
# enable this to
# see the example
# new points and vectors are merged with the previous steps
loop_start_3 = LoopStart(N=n_iterations_4, T=restart_4, D0=pt_5, D1=X_3)  # -> port, Counter, Data, Data_2; disabled
item_3 = ListItem(List=loop_start_3.Data, Index="-1", Wrap=True)
item_4 = ListItem(List=loop_start_3.Data_2, Index="-1", Wrap=True)
amp_2 = Amplitude(Vector=item_4, Amplitude=increment_4)
multiplication_2 = Multiplication(A=loop_start_3.Counter, B=increment_angle_2)
Z_2 = UnitZ(Factor=1)
vrot_2 = Rotate(Vector=amp_2, Axis=Z_2, Angle=degrees(multiplication_2))
move_3 = Move(Geometry=item_3, Motion=vrot_2)  # -> Geometry, Transform
merge_3 = Merge(Data1=loop_start_3.Data, Data2=move_3.Geometry)  # -> flatten(Result)
merge_4 = Merge(Data1=loop_start_3.Data_2, Data2=vrot_2)  # -> flatten(Result)
loop_end_3 = LoopEnd(
    port=loop_start_3.port,
    Exit=False,
    Data=merge_3,
    Data_2=merge_4,
    pausedState=False,
    state="Constant output",
    TimeOutVal=0)  # -> D0, D1

# ----
# enable this to
# see the example
loop_start_4 = LoopStart(N=n_iterations_3, T=restart_3, D0=pt_4, D1=X_2)  # -> port, Counter, Data, Data_2; disabled
amp_3 = Amplitude(Vector=loop_start_4.Data_2, Amplitude=increment_3)
Z_3 = UnitZ(Factor=1)
multiplication_3 = Multiplication(A=loop_start_4.Counter, B=Slider(0.552, range=0..10))
vrot_3 = Rotate(Vector=amp_3, Axis=Z_3, Angle=degrees(multiplication_3))
move_4 = Move(Geometry=loop_start_4.Data, Motion=vrot_3)  # -> Geometry, Transform
loop_end_4 = LoopEnd(
    port=loop_start_4.port,
    Exit=False,
    Data=move_4.Geometry,
    Data_2=vrot_3,
    pausedState=False,
    state="Constant output",
    TimeOutVal=0)  # -> D0, D1

# ----
# Anemone intro
# 
# Basic use of Anemone
# 
# © a3 2017 _ Creative Commons Attribution-NonCommercial-ShareAlike3.0 UnportedLicense.
iterations_done = Panel(loop_start.Counter)
iterations_done_2 = Panel(loop_start_3.Counter)
iterations_done_3 = Panel(loop_start_2.Counter)
iterations_done_4 = Panel(loop_start_4.Counter)
resolution = ValueList({"coarse": 0, "fine": 1, "extra fine": 2}, selected="fine")
pt_6 = Point(loop_end)
fastdotdis = DotDisplayFast(point=pt_6, radius=Slider(0.5, range=0..1), resolution=resolution)
resolution_2 = ValueList({"coarse": 0, "fine": 1, "extra fine": 2}, selected="fine")
pt_7 = Point(loop_end_4.D0)
vec = Vector(loop_end_3.D1)
pt_8 = Point(loop_end_3.D0)
vec_2 = Vector(loop_end_2.D1)
pt_9 = Point(loop_end_2.D0)
# adjust the vector and point lists for display
panel_3 = Panel("0")
# adjust the vector and point lists for display
panel_4 = Panel("0")
cull_i = CullIndex(List=pt_8, Indices="-1", Wrap=True)
cull_i_2 = CullIndex(List=vec, Indices=panel_3, Wrap=True)
cull_i_3 = CullIndex(List=pt_9, Indices="-1", Wrap=True)
cull_i_4 = CullIndex(List=vec_2, Indices=panel_4, Wrap=True)
pline = PolyLine(Vertices=pt_8, Closed=False)
pline_2 = PolyLine(Vertices=pt_9, Closed=False)
vdisex = VectorDisplayEx(Point=cull_i, Vector=cull_i_2, Colour=RGB(0, 0, 0), Width=2)
vdisex_2 = VectorDisplayEx(Point=cull_i_3, Vector=cull_i_4, Colour=RGB(0, 0, 0), Width=2)
number_slider = Slider(100, range=10..200)
R = Region({Plane=PlaneXY(0, 0, 0), Size=Domain2(u=0..10, v=0..5)})
random = Random(Range="-Pi to Pi", Number=number_slider, Seed=2)
X_5 = UnitX(Factor=1)
Z_4 = UnitZ(Factor=1)
pop2d = Populate2D(Region=R, Count=number_slider, Seed=1)
pt_10 = Point(Point(20, 30, 0))
move_5 = Move(Geometry=pop2d, Motion=pt_10)  # -> graft(Geometry), Transform
vrot_4 = Rotate(Vector=X_5, Axis=Z_4, Angle=random)  # -> graft(Vector)
# How to deal with a list of inputs instead of a single element: each element in the list should go in a separate tree branch
n_iterations_6 = Slider(100, range=0..200)
increment_5 = Slider(0.25, range=0.1..3)
increment_angle_3 = Slider(24.864, range=0..90)
restart_6 = Button()

# ----
# enable this to
# see the example
# simplify data in the start loop inputs
# simplify new data tree structure when merging with old one
loop_start_5 = LoopStart(N=n_iterations_6, T=restart_6, D0=simplify(move_5.Geometry), D1=simplify(vrot_4))  # -> port, Counter, Data, Data_2; disabled
item_5 = ListItem(List=loop_start_5.Data, Index="-1", Wrap=True)
item_6 = ListItem(List=loop_start_5.Data_2, Index="-1", Wrap=True)
perlin_2 = PerlinNoise(Values=item_5, Time=0, Scale=Slider(0.033, range=0..0.1))
amp_4 = Amplitude(Vector=item_6, Amplitude=increment_5)
multiplication_4 = Multiplication(A=perlin_2, B=increment_angle_3)
Z_5 = UnitZ(Factor=1)
vrot_5 = Rotate(Vector=amp_4, Axis=Z_5, Angle=degrees(multiplication_4))
move_6 = Move(Geometry=item_5, Motion=vrot_5)  # -> Geometry, Transform
viewer_3 = ParamViewer(move_6.Geometry)
merge_5 = Merge(Data1=loop_start_5.Data, Data2=simplify(move_6.Geometry))
merge_6 = Merge(Data1=loop_start_5.Data_2, Data2=simplify(vrot_5))
viewer_4 = ParamViewer(merge_6)
loop_end_5 = LoopEnd(
    port=loop_start_5.port,
    Exit=False,
    Data=merge_5,
    Data_2=merge_6,
    pausedState=False,
    state="Constant output",
    TimeOutVal=0)  # -> D0, D1

iterations_done_5 = Panel(loop_start_5.Counter)
# check when loop ends
equals = Equality(FirstNumber=loop_start_5.Counter, SecondNumber=n_iterations_6)  # -> Equality, Inequality
vec_3 = Vector(loop_end_5.D1)
pt_11 = Point(loop_end_5.D0)
# adjust the vector and point lists for display
panel_5 = Panel("0")
cull_i_5 = CullIndex(List=pt_11, Indices="-1", Wrap=True)
cull_i_6 = CullIndex(List=vec_3, Indices=panel_5, Wrap=True)
pline_3 = PolyLine(Vertices=pt_11, Closed=False)
lng = ListLength(List=cull_i_5)
range = Range(Domain=Domain(0, 1), Steps=expr("x-1", lng))
dispatch = Dispatch(List=cull_i_5, DispatchPattern=equals.Equality)  # -> ListA, ListB
gradient = Gradient(
    LowerLimit=0,
    UpperLimit=1,
    Parameter=range,
    stops=[0: RGB(14, 26, 76), 0.793: RGB(137, 205, 240), 1: RGB(255, 255, 255)])
# this visualization is activated only when loop ends
resolution_3 = ValueList({"coarse": 0, "fine": 1, "extra fine": 2}, selected="coarse")
fastdotdis_2 = DotDisplayFast(point=dispatch.ListA, radius=Slider(0.05, range=0..1), resolution=resolution_3)
vdisex_3 = VectorDisplayEx(Point=cull_i_5, Vector=cull_i_6, Colour=gradient, Width=2)

# ----
# enable this to
# see the example
# it is possible to set an exit condition (if the input in E is True Anemone will exit the loop)
loop_start_6 = LoopStart(Repeat=n_iterations_2, Trigger=restart_2, Data=pt_2)  # -> port, Counter, Data; disabled
X_6 = UnitX(Factor=1)
move_7 = Move(Geometry=loop_start_6.Data, Motion=X_6)  # -> Geometry, Transform

iterations_done_6 = Panel(loop_start_6.Counter)

pdecon = Deconstruct(Point=move_7.Geometry)  # -> XComponent, YComponent, ZComponent
larger = LargerThan(FirstNumber=pdecon.XComponent, SecondNumber=max_x_value)  # -> LargerThan, OrEqualTo

loop_end_6 = LoopEnd(
    port=loop_start_6.port,
    Exit=larger.LargerThan,
    Data=move_7.Geometry,
    pausedState=False,
    state="Constant output",
    TimeOutVal=0)

pt_12 = Point(loop_end_6)
fastdotdis_3 = DotDisplayFast(point=pt_12, radius=Slider(0.5, range=0..1), resolution=resolution_2)

# ==== cluster DotDisplayFast: like Dot Display, but faster (black dots only)
radius = ClusterInput()
point = ClusterInput()
resolution = ClusterInput()  # 0 = coarse, 1 = fine, 2 = extra-fine
filter = StreamFilter(Gate=resolution, Stream0="5", Stream1="10", Stream2="20")
material = CreateMaterial(Diffuse="black", Specular="black", Emission="black", Transparency=0, Shine=0)
msphere = MeshSphere(Base=point, Radius=radius, UCount=filter, VCount=filter)
mjoin = MeshJoin(Meshes=msphere)
preview = CustomPreview(Geometry=mjoin, Shader=material)
