# Grasshopper definition XX_05-1_Anemone aggregation.gh (Grasshopper 0.9.76)
# plug-ins: Anemone, Human

# handle 0
geo = Geometry(flatten(<brep referenced from the Rhino model>))

# ---- group: x axis
crv = Curve(<curve referenced from the Rhino model>)

# ---- group: y axis
crv_2 = Curve(<curve referenced from the Rhino model>)

# ---- group: x axis
# handle 1
crv_3 = Curve(<curve referenced from the Rhino model>)

# ---- group: y axis
crv_4 = Curve(<curve referenced from the Rhino model>)

# ---- group: x axis
# handle 2
crv_5 = Curve(<curve referenced from the Rhino model>)

# ---- group: y axis
crv_6 = Curve(<curve referenced from the Rhino model>)

# ---- group: x axis
# handle 3
crv_7 = Curve(<curve referenced from the Rhino model>)

# ---- group: y axis
crv_8 = Curve(<curve referenced from the Rhino model>)

# ---- group: x axis
# handle 4
crv_9 = Curve(<curve referenced from the Rhino model>)

# ---- group: y axis
crv_10 = Curve(<curve referenced from the Rhino model>)

# ----
# Anemone aggregation
# 
# © a3 2017 _ Creative Commons Attribution-NonCommercial-ShareAlike3.0 UnportedLicense.
# model as mesh or convert to mesh
mesh = MeshBrep(
    Brep=geo,
    Settings={GridMaxCount=0, GridMinCount=16, JaggedSeams=False, MaxEdgeLength=0, MinEdgeLength=0.0001, MinTolerance=0, Refine=True, RefineAngle=0, RelativeTolerance=0.65, SimplePlanes=True, Tolerance=0})

merge = Merge(Data1=crv_7, Data2=crv_8)

# ----
# The handles are used to construct planes for orientation
merge_2 = Merge(Data1=crv, Data2=crv_2)

merge_3 = Merge(Data1=crv_5, Data2=crv_6)

merge_4 = Merge(Data1=crv_3, Data2=crv_4)

merge_5 = Merge(Data1=crv_9, Data2=crv_10)

# ---- group: group geometry
group = Group(Objects=mesh)

# ----
merge_6 = Merge(Data1=group, Data2=merge_2, Data3=merge_4, Data4=merge_3, Data5=merge, Data6=merge_5)

# ----
# basic orientation operation
# Handles are converted into vectors and form them I build the "sender" plane (normal outwards) and the corresponding "receiver" plane (normal pointing inwards.
# 
# In this case, the handle on face 0 is used both as a sender and receiver (face 0 is compatible with itself for assembly)
vec = Vector(unitize(crv))
vec_2 = Vector(unitize(crv_2))
rev = Reverse(Vector=vec)
end = EndPoints(Curve=crv)  # -> Start, End

# ----
# component 0
# Component: Component = geometry + handles
# 
# 
# The first element in the list is the geometry group, followed by all the handles in couples (x first, then y).
# 
# Grouping the component allows to pack together the component geometry and the axis handles in a single object within the loop
group_2 = Group(Objects=merge_6)

# ---- group: "sender" plane
pl = ConstructPlane(Origin=end.Start, XAxis=vec, YAxis=vec_2)

# ---- group: "receiver" plane
pl_2 = ConstructPlane(Origin=end.Start, XAxis=rev, YAxis=vec_2)

# ----
# Orient: To make an orientation operation I need the geometry and two compatible planes, a "sender" and a "receiver". Thus, geometry is oriented from the sender to the receiver
orient = Orient(Geometry=group, Source=pl, Target=pl_2)  # -> Geometry, Transform

n_of_iterations = Slider(100, range=1..200)
# iterative operation (growth) - with clash detection
restart = Button()
# single operation (orientation)
# component
grp = Group(group_2)

ungroup = Ungroup(Group=grp)
cull_i = CullIndex(List=ungroup, Indices="0", Wrap=True)
partition = PartitionList(List=cull_i, Size="2")  # -> simplify(Chunks)
item = ListItem(List=partition, Index=0, Wrap=True)  # -> Item, Item1
vec_3 = Vector(unitize(item.Item))
vec_4 = Vector(unitize(item.Item1))
rev_2 = Reverse(Vector=vec_3)
# extract s/r planes
end_2 = EndPoints(Curve=item.Item)  # -> Start, End

# ----
# These are all the possible combinations with this geometry. Face 0 is only compatible with itself, 1 with 2 and 3 with 4. Other combinations will yield non-aligned geometry
# combinations are parsed and split into sender/rceiver indexes
sender_receiver_combinations = Panel("""0,0
2,1
1,2
3,4
4,3""")
# choose orientation criteria (s/r sequence)
number_slider = Slider(4, range=0..4)
item_2 = ListItem(List=sender_receiver_combinations, Index=number_slider, Wrap=True)
split = TextSplit(Text=item_2, Separators=",")
int = Integer(split)
item_3 = ListItem(List=int, Index=0, Wrap=True)  # -> Item, Item1

# ---- group: "sender" plane
pl_3 = ConstructPlane(Origin=end_2.Start, XAxis=vec_3, YAxis=vec_4)

# ---- group: "receiver" plane
pl_4 = ConstructPlane(Origin=end_2.Start, XAxis=rev_2, YAxis=vec_4)

# ----
branch = TreeBranch(Tree=pl_3, Path=item_3.Item, MaintainPaths=True)
branch_2 = TreeBranch(Tree=pl_4, Path=item_3.Item1, MaintainPaths=True)
# orient
# geometry from "sender" to "receiver" planes
orient_2 = Orient(Geometry=grp, Source=branch, Target=branch_2)  # -> Geometry, Transform
previewmat = CustomPreviewMaterials(Geometry=orient_2.Geometry, DiffuseColor=RGB(255, 255, 255))
# visualization while the loop is active
swatch = ColourSwatch(SwatchColor=RGBA(173, 232, 255, 99))
# visualization when the loop has ended
swatch_2 = ColourSwatch(SwatchColor=RGB(0, 0, 0))

# ----
# enable this to
# see the example
# extract s/r planes
# New components are added to the old ones
# The whole component is oriented so the handles of each one can be used for the next iterations
# selection: Here, only the last component on each iteration is selected. Different selection criteria are possible
# choose orientation criteria (s/r sequence)
# clash detection
# checks if a slightly smaller version of the new component clashes with the rest of the aggregation
loop_start = LoopStart(Repeat=n_of_iterations, Trigger=restart, Data=group_2)  # -> port, Counter, Data; disabled
item_4 = ListItem(List=loop_start.Data, Index=0, Wrap=True)  # -> Item1, Item

iterations_done = Panel(loop_start.Counter)
equals = Equality(FirstNumber=loop_start.Counter, SecondNumber=n_of_iterations)  # -> Equality, Inequality

ungroup_2 = Ungroup(Group=item_4.Item1)
cull_i_2 = CullIndex(List=ungroup_2, Indices="0", Wrap=True)
partition_2 = PartitionList(List=cull_i_2, Size="2")  # -> simplify(Chunks)
item_5 = ListItem(List=partition_2, Index=0, Wrap=True)  # -> Item, Item1
vec_5 = Vector(unitize(item_5.Item))
vec_6 = Vector(unitize(item_5.Item1))
rev_3 = Reverse(Vector=vec_5)
end_3 = EndPoints(Curve=item_5.Item)  # -> Start, End

s_r_combinations = Panel("""0,0
2,1
2,1
2,1
0,0
3,4
3,4""")
int_2 = Integer(loop_start.Counter)
item_6 = ListItem(List=s_r_combinations, Index=int_2, Wrap=True)
split_2 = TextSplit(Text=item_6, Separators=",")
int_3 = Integer(split_2)
item_7 = ListItem(List=int_3, Index=0, Wrap=True)  # -> Item, Item1

# ---- group: "sender" plane
pl_5 = ConstructPlane(Origin=end_3.Start, XAxis=vec_5, YAxis=vec_6)

# ---- group: "receiver" plane
pl_6 = ConstructPlane(Origin=end_3.Start, XAxis=rev_3, YAxis=vec_6)

# ----
bool = Boolean(equals.Equality)

branch_3 = TreeBranch(Tree=pl_5, Path=item_7.Item, MaintainPaths=True)
branch_4 = TreeBranch(Tree=pl_6, Path=item_7.Item1, MaintainPaths=True)
orient_3 = Orient(Geometry=item_4.Item1, Source=branch_3, Target=branch_4)  # -> Geometry, Transform

ungroup_3 = Ungroup(Group=orient_3.Geometry)
ungroup_4 = Ungroup(Group=loop_start.Data)
item_8 = ListItem(List=ungroup_3, Index=0, Wrap=True)  # -> flatten(Item)
item_9 = ListItem(List=ungroup_4, Index=0, Wrap=True)  # -> flatten(Item)
ungroup_5 = Ungroup(Group=item_8)  # -> flatten(Objects)
ungroup_6 = Ungroup(Group=item_9)  # -> flatten(Objects)
demesh = DeconstructMesh(Mesh=ungroup_5)  # -> Vertices, Faces, Colours, Normals
avr = Average(Input=demesh.Vertices)
scale = Scale(Geometry=ungroup_5, Center=avr, Factor="0.999")  # -> Geometry, Transform
colom = CollisionOneMany(Collider=scale.Geometry, Obstacles=ungroup_6)  # -> Collision, Index
not = GateNot(A=colom.Collision)

dispatch = Dispatch(List=orient_3.Geometry, DispatchPattern=not)  # -> ListA, ListB
merge_7 = Merge(Data1=flatten(loop_start.Data), Data2=flatten(dispatch.ListA))
loop_end = LoopEnd(port=loop_start.port, Exit=False, Data=flatten(merge_7), pausedState=False, state="Constant output", TimeOutVal=0)

ungroup_7 = Ungroup(Group=loop_end)
split_3 = SplitList(List=ungroup_7, Index="1")  # -> ListA, ListB
geo_2 = Geometry(split_3.ListA)
crv_11 = Curve(split_3.ListB)
dispatch_2 = Dispatch(List=geo_2, DispatchPattern=bool)  # -> ListA, ListB
# mesh for baking
ungroup_8 = Ungroup(Group=dispatch_2.ListA)  # -> flatten(Objects)
previewlw = CustomPreviewLineweights(Geometry=dispatch_2.ListB, Shader=swatch, Absolute=False)
mjoin = MeshJoin(Meshes=ungroup_8)
mesh_2 = Mesh(mjoin)
medges = MeshEdges(Mesh=mesh_2)  # -> NakedEdges, InteriorEdges, NonManifoldEdges
previewmat_2 = CustomPreviewMaterials(Geometry=mesh_2, DiffuseColor=ColourSwatch(SwatchColor=RGB(173, 232, 255)))
previewlw_2 = CustomPreviewLineweights(Geometry=[medges.InteriorEdges, medges.NonManifoldEdges], Shader=swatch_2, Absolute=False)
