# Grasshopper definition XX_05-2-1_Anemone aggregation_v2-field.gh (Grasshopper 0.9.76)
# plug-ins: Anemone, Human

# handle 0
geo = Geometry(flatten(<brep referenced from the Rhino model>))

# ---- group: x axis
crv = Curve(<curve referenced from the Rhino model>)

# ---- group: y axis
crv_2 = Curve(<curve referenced from the Rhino model>)

# ---- group: x axis
# handle 1
crv_3 = Curve(<curve referenced from the Rhino model>)

# ---- group: y axis
crv_4 = Curve(<curve referenced from the Rhino model>)

# ---- group: x axis
# handle 2
crv_5 = Curve(<curve referenced from the Rhino model>)

# ---- group: y axis
crv_6 = Curve(<curve referenced from the Rhino model>)

# ---- group: x axis
# handle 3
crv_7 = Curve(<curve referenced from the Rhino model>)

# ---- group: y axis
crv_8 = Curve(<curve referenced from the Rhino model>)

# ---- group: x axis
# handle 4
crv_9 = Curve(<curve referenced from the Rhino model>)

# ---- group: y axis
crv_10 = Curve(<curve referenced from the Rhino model>)

# ----
geo_2 = Geometry(flatten(<brep referenced from the Rhino model>))

# ---- group: x axis
# handle 5
crv_11 = Curve(<curve referenced from the Rhino model>)

# ---- group: y axis
crv_12 = Curve(<curve referenced from the Rhino model>)

crv_13 = Curve(<curve referenced from the Rhino model>)

# ---- group: x axis
# handle 3
crv_14 = Curve(<curve referenced from the Rhino model>)

# handle 4
crv_15 = Curve(<curve referenced from the Rhino model>)

# handle 0
crv_16 = Curve(<curve referenced from the Rhino model>)

# ---- group: y axis
crv_17 = Curve(<curve referenced from the Rhino model>)

# ---- group: x axis
# handle 1
crv_18 = Curve(<curve referenced from the Rhino model>)

# ---- group: y axis
crv_19 = Curve(<curve referenced from the Rhino model>)

# ---- group: x axis
# handle 2
crv_20 = Curve(<curve referenced from the Rhino model>)

# ---- group: y axis
crv_21 = Curve(<curve referenced from the Rhino model>)

crv_22 = Curve(<curve referenced from the Rhino model>)

# ----
# Anemone aggregation
# 
# From simple aggregation to clash control and scalar field controlled growth
# 
# © a3 2017 _ Creative Commons Attribution-NonCommercial-ShareAlike3.0 UnportedLicense.
# model as mesh or convert to mesh
smesh = SimpleMesh(Brep=geo)

merge = Merge(Data1=crv_7, Data2=crv_8)

# ----
# The handles are used to construct planes for orientation
merge_2 = Merge(Data1=crv, Data2=crv_2)

merge_3 = Merge(Data1=crv_5, Data2=crv_6)

smesh_2 = SimpleMesh(Brep=geo_2)

merge_4 = Merge(Data1=crv_3, Data2=crv_4)

merge_5 = Merge(Data1=crv_9, Data2=crv_10)

merge_6 = Merge(Data1=crv_11, Data2=crv_12)

merge_7 = Merge(Data1=crv_14, Data2=crv_21)

# ----
# The handles are used to construct planes for orientation
merge_8 = Merge(Data1=crv_16, Data2=crv_17)

merge_9 = Merge(Data1=crv_20, Data2=crv_13)

merge_10 = Merge(Data1=crv_18, Data2=crv_19)

merge_11 = Merge(Data1=crv_15, Data2=crv_22)

# ---- group: group geometry
group = Group(Objects=smesh)

# groups can take geometry only (not numbers), so we store the type value in a line of a specific length
group_2 = Group(Objects=smesh_2)

# ----
merge_12 = Merge(Data1=group, Data2=merge_2, Data3=merge_4, Data4=merge_3, Data5=merge, Data6=merge_5)
merge_13 = Merge(Data1=group_2, Data2=merge_8, Data3=merge_10, Data4=merge_9, Data5=merge_7, Data6=merge_11, Data7=merge_6)

# ----
# basic orientation operation
# Handles are converted into vectors and form them I build the "sender" plane (normal outwards) and the corresponding "receiver" plane (normal pointing inwards.
# 
# In this case, the handle on face 0 is used both as a sender and receiver (face 0 is compatible with itself for assembly)
vec = Vector(unitize(crv))
vec_2 = Vector(unitize(crv_2))
rev = Reverse(Vector=vec)
end = EndPoints(Curve=crv)  # -> Start, End

# ----
# component 1
group_3 = Group(Objects=merge_13)
# component 0
# Component: Component = geometry + handles
# 
# 
# The first element in the list is the geometry group, followed by all the handles in couples (x first, then y).
# 
# Grouping the component allows to pack together the component geometry and the axis handles in a single object within the loop
group_4 = Group(Objects=merge_12)

# ---- group: "sender" plane
pl = ConstructPlane(Origin=end.Start, XAxis=vec, YAxis=vec_2)

# ---- group: "receiver" plane
pl_2 = ConstructPlane(Origin=end.Start, XAxis=rev, YAxis=vec_2)

# ----
component_type = ValueList({"pyramid": 0, "diamond box": 1}, selected="pyramid")

# ----
# Orient: To make an orientation operation I need the geometry and two compatible planes, a "sender" and a "receiver". Thus, geometry is oriented from the sender to the receiver
orient = Orient(Geometry=group, Source=pl, Target=pl_2)  # -> Geometry, Transform

n_of_iterations = Slider(100, range=1..200)
n_of_iterations_2 = Slider(200, range=1..1000)
n_of_iterations_3 = Slider(100, range=0..1000)
# iterative operation (growth) - with clash detection
restart = Button()
# iterative operation (growth) - with clash detection - random growth point
restart_2 = Button()
# iterative operation (growth) - with clash detection - scalar field growth
restart_3 = Button()
filter = StreamFilter(Gate=component_type, Stream0=group_4, Stream1=group_3)

# ---- group: field center
pt = Point(Point(67.06894249, -0.1281609614, 24.94250101))

# ---- group: field generation points
pt_2 = Point(<point referenced from the Rhino model>)
pt_3 = Point(<point referenced from the Rhino model>)
pt_4 = Point(<point referenced from the Rhino model>)

# ----
# field points generation
# filtered values display
# field values manipulation
field_semi_diagonal_size = Slider(100, range=0..100)
# field
n_of_cells_per_direction = Slider(15, range=1..30)
merge_14 = Merge(Data1=pt_2, Data2=pt_3, Data3=pt_4)
field_threshold = Slider(0.828, range=0..1)

# ----
# single operation (orientation)
# component
grp = Group(group_4)

ungroup = Ungroup(Group=grp)
cull_i = CullIndex(List=ungroup, Indices="0", Wrap=True)
partition = PartitionList(List=cull_i, Size="2")  # -> simplify(Chunks)
item = ListItem(List=partition, Index=0, Wrap=True)  # -> Item, Item1
vec_3 = Vector(unitize(item.Item))
vec_4 = Vector(unitize(item.Item1))
rev_2 = Reverse(Vector=vec_3)
# extract s/r planes
end_2 = EndPoints(Curve=item.Item)  # -> Start, End

X = UnitX(Factor=field_semi_diagonal_size)
Y = UnitY(Factor=field_semi_diagonal_size)
Z = UnitZ(Factor=field_semi_diagonal_size)
addition = Addition(A=X, B=Y, C=Z)
rev_3 = Reverse(Vector=addition)
move = Move(Geometry=pt, Motion=rev_3)  # -> Geometry, Transform
move_2 = Move(Geometry=pt, Motion=addition)  # -> Geometry, Transform
box = Box2Pt(PointA=move.Geometry, PointB=move_2.Geometry, Plane=PlaneXY(0, 0, 0))
one_over_x = OneOverX(Value=n_of_cells_per_direction)
one_over_x_2 = OneOverX(Value=n_of_cells_per_direction)
one_over_x_3 = OneOverX(Value=n_of_cells_per_direction)
scale_nu = ScaleNU(Geometry=box, Plane=pt, ScaleX=one_over_x, ScaleY=one_over_x_2, ScaleZ=one_over_x_3)  # -> Geometry, Transform
arrbox = BoxArray(
    Geometry=move.Geometry,
    Cell=scale_nu.Geometry,
    XCount=n_of_cells_per_direction,
    YCount=n_of_cells_per_direction,
    ZCount=n_of_cells_per_direction)  # -> Geometry, Transform

# ----
# These are all the possible combinations with this geometry. Face 0 is only compatible with itself, 1 with 2 and 3 with 4. Other combinations will yield non-aligned geometry
# combinations are parsed and split into sender/rceiver indexes
sender_receiver_combinations = Panel("""0,0
2,1
1,2
3,4
4,3""")
# choose orientation criteria (s/r sequence)
number_slider = Slider(4, range=0..4)
item_2 = ListItem(List=sender_receiver_combinations, Index=number_slider, Wrap=True)
split = TextSplit(Text=item_2, Separators=",")
int = Integer(split)
item_3 = ListItem(List=int, Index=0, Wrap=True)  # -> Item, Item1

s_r_combinations_box = Panel("""0,0
0,5
1,1
1,2
1,3
1,4
2,2
3,3
4,4
5,0
5,5""")

# ---- group: "sender" plane
pl_3 = ConstructPlane(Origin=end_2.Start, XAxis=vec_3, YAxis=vec_4)

# ---- group: "receiver" plane
pl_4 = ConstructPlane(Origin=end_2.Start, XAxis=rev_2, YAxis=vec_4)

# ----
dist = Distance(PointA=graft(arrbox.Geometry), PointB=merge_14)
expression = Expression(x=dist, y="1", z=Slider(0.01, range=0..3), Expression="1/(pow(x+y,z))")
avr = Average(Input=expression)  # -> flatten(ArithmeticMean)
num = Number(avr)
bnd = Bounds(Numbers=flatten(num))
dom = ConstructDomain(DomainStart=0, DomainEnd=1)
remap = RemapNumbers(Value=num, Source=bnd, Target=dom)  # -> Mapped, Clipped
graph = GraphMapper(
    remap.Mapped,
    x0=0,
    x1=1,
    y0=0,
    y1=1,
    container_name="Bezier",
    cpx=[0, 0, 0.3006992936, 1],
    cpy=[0, 0.5867632627, 0.8529411554, 1])
bar_graph = BarGraph(graph, BarColor=RGB(255, 0, 90))

branch = TreeBranch(Tree=pl_3, Path=item_3.Item, MaintainPaths=False)
branch_2 = TreeBranch(Tree=pl_4, Path=item_3.Item1, MaintainPaths=False)
# orient
# geometry from "sender" to "receiver" planes
orient_2 = Orient(Geometry=grp, Source=branch, Target=branch_2)  # -> Geometry, Transform
previewmat = CustomPreviewMaterials(Geometry=orient_2.Geometry, DiffuseColor=RGB(255, 255, 255))

larger = LargerThan(FirstNumber=graph, SecondNumber=field_threshold)  # -> LargerThan, OrEqualTo
dispatch = Dispatch(List=arrbox.Geometry, DispatchPattern=larger.LargerThan)  # -> ListA, ListB
dispatch_2 = Dispatch(List=graph, DispatchPattern=larger.LargerThan)  # -> ListA, ListB
gradient = Gradient(
    LowerLimit=0,
    UpperLimit=1,
    Parameter=dispatch_2.ListA,
    stops=[0: RGB(0, 128, 0), 0.5: RGB(255, 255, 0), 1: RGB(255, 0, 0)])
preview = CustomPreview(Geometry=dispatch.ListA, Shader=gradient)

# ----
# field points, values and threshold
pt_5 = Point(arrbox.Geometry)
num_2 = Number(graph)
# you can plug any other field values here (for example, a Millipede generated field) - Use a normalized field (0-1 value range)
num_3 = Number(field_threshold)

item_4 = ListItem(List=pt_5, Index=0, Wrap=True)  # -> Item, Item1
# visualization while the loop is active
swatch = ColourSwatch(SwatchColor=RGBA(173, 232, 255, 99))
dist_2 = Distance(PointA=item_4.Item, PointB=item_4.Item1)
# visualization while the loop is active
swatch_2 = ColourSwatch(SwatchColor=RGBA(173, 232, 255, 99))
# visualization when the loop has ended
swatch_3 = ColourSwatch(SwatchColor=RGB(0, 0, 0))
# visualization when the loop has ended
swatch_4 = ColourSwatch(SwatchColor=RGB(0, 0, 0))
# visualization while the loop is active
swatch_5 = ColourSwatch(SwatchColor=RGBA(173, 232, 255, 99))
# visualization when the loop has ended
swatch_6 = ColourSwatch(SwatchColor=RGB(0, 0, 0))

# ----
# enable this to
# see the example
# extract s/r planes
# New components are added to the old ones
# selection: Here, a random component on each iteration is selected. Different selection criteria are possible
# The whole component is oriented so the handles of each one can be used for the next iterations
# choose orientation criteria (s/r sequence)
# clash detection
# checks if a slightly smaller version of the new component clashes with the rest of the aggregation
loop_start = LoopStart(Repeat=n_of_iterations_2, Trigger=restart_2, Data=group_4)  # -> port, Counter, Data; disabled
lng = ListLength(List=loop_start.Data)  # -> expr("x-1", Length)
random = Random(Range=lng, Number=1, Seed=loop_start.Counter, Integers=True)
item_5 = ListItem(List=loop_start.Data, Index=random, Wrap=True)  # -> Item1, Item

iterations_done = Panel(loop_start.Counter)
equals = Equality(FirstNumber=loop_start.Counter, SecondNumber=n_of_iterations_2)  # -> Equality, Inequality

ungroup_2 = Ungroup(Group=item_5.Item)
cull_i_2 = CullIndex(List=ungroup_2, Indices="0", Wrap=True)
partition_2 = PartitionList(List=cull_i_2, Size="2")  # -> simplify(Chunks)
item_6 = ListItem(List=partition_2, Index=0, Wrap=True)  # -> Item, Item1
vec_5 = Vector(unitize(item_6.Item))
vec_6 = Vector(unitize(item_6.Item1))
rev_4 = Reverse(Vector=vec_5)
end_3 = EndPoints(Curve=item_6.Item)  # -> Start, End

s_r_combinations = Panel("""0,0
2,1
1,2
3,4
4,3""")
addition_2 = Addition(A=loop_start.Counter, B="1")
lng_2 = ListLength(List=s_r_combinations)  # -> expr("x-1", Length)
random_2 = Random(Range=lng_2, Number=1, Seed=addition_2, Integers=True)
item_7 = ListItem(List=s_r_combinations, Index=random_2, Wrap=True)
split_2 = TextSplit(Text=item_7, Separators=",")
int_2 = Integer(split_2)
item_8 = ListItem(List=int_2, Index=0, Wrap=True)  # -> Item, Item1

# ---- group: "sender" plane
pl_5 = ConstructPlane(Origin=end_3.Start, XAxis=vec_5, YAxis=vec_6)

# ---- group: "receiver" plane
pl_6 = ConstructPlane(Origin=end_3.Start, XAxis=rev_4, YAxis=vec_6)

# ----
bool = Boolean(equals.Equality)

# ----
# enable this to
# see the example
# extract s/r planes
# New components are added to the old ones
# field-based selection
# clash detection
# selection: Here, a random component on each iteration is selected. Different selection criteria are possible
# The whole component is oriented so the handles of each one can be used for the next iterations
# checks if a slightly smaller version of the new component clashes with the rest of the aggregation
# orientation criteria (s/r sequence)
loop_start_2 = LoopStart(Repeat=n_of_iterations_3, Trigger=restart_3, Data=filter)  # -> port, Counter, Data; disabled

lng_3 = ListLength(List=loop_start_2.Data)  # -> expr("x-1", Length)
iterations_done_2 = Panel(loop_start_2.Counter)
random_3 = Random(Range=lng_3, Number=1, Seed=loop_start_2.Counter, Integers=True)
# this is a distance-based field - any other field can be used (i.e. the one inherited from Millipede), just plug the data in the yellow spot - Use a normalized field (0-1 value range)
equals_2 = Equality(FirstNumber=loop_start_2.Counter, SecondNumber=n_of_iterations_3)  # -> Equality, Inequality
bool_2 = Boolean(equals_2.Equality)

# ----
# enable this to
# see the example
# extract s/r planes
# New components are added to the old ones
# The whole component is oriented so the handles of each one can be used for the next iterations
# selection: Here, only the last component on each iteration is selected. Different selection criteria are possible
# choose orientation criteria (s/r sequence)
# clash detection
# checks if a slightly smaller version of the new component clashes with the rest of the aggregation
loop_start_3 = LoopStart(Repeat=n_of_iterations, Trigger=restart, Data=group_4)  # -> port, Counter, Data; disabled
item_9 = ListItem(List=loop_start_3.Data, Index=0, Wrap=True)  # -> Item1, Item

iterations_done_3 = Panel(loop_start_3.Counter)
equals_3 = Equality(FirstNumber=loop_start_3.Counter, SecondNumber=n_of_iterations)  # -> Equality, Inequality

ungroup_3 = Ungroup(Group=item_9.Item1)
cull_i_3 = CullIndex(List=ungroup_3, Indices="0", Wrap=True)
partition_3 = PartitionList(List=cull_i_3, Size="2")  # -> simplify(Chunks)
item_10 = ListItem(List=partition_3, Index=0, Wrap=True)  # -> Item, Item1
vec_7 = Vector(unitize(item_10.Item))
vec_8 = Vector(unitize(item_10.Item1))
rev_5 = Reverse(Vector=vec_7)
end_4 = EndPoints(Curve=item_10.Item)  # -> Start, End

s_r_combinations_2 = Panel("""0,0
2,1
2,1
2,1
0,0
3,4
3,4""")
int_3 = Integer(loop_start_3.Counter)
item_11 = ListItem(List=s_r_combinations_2, Index=int_3, Wrap=True)
split_3 = TextSplit(Text=item_11, Separators=",")
int_4 = Integer(split_3)
item_12 = ListItem(List=int_4, Index=0, Wrap=True)  # -> Item, Item1

# ---- group: "sender" plane
pl_7 = ConstructPlane(Origin=end_4.Start, XAxis=vec_7, YAxis=vec_8)

# ---- group: "receiver" plane
pl_8 = ConstructPlane(Origin=end_4.Start, XAxis=rev_5, YAxis=vec_8)

# ----
bool_3 = Boolean(equals_3.Equality)

item_13 = ListItem(List=loop_start_2.Data, Index=random_3, Wrap=True)  # -> Item1, Item

ungroup_4 = Ungroup(Group=item_13.Item)
cull_i_4 = CullIndex(List=ungroup_4, Indices="0", Wrap=True)
partition_4 = PartitionList(List=cull_i_4, Size="2")  # -> simplify(Chunks)
item_14 = ListItem(List=partition_4, Index=0, Wrap=True)  # -> Item, Item1
vec_9 = Vector(unitize(item_14.Item))
vec_10 = Vector(unitize(item_14.Item1))
rev_6 = Reverse(Vector=vec_9)
end_5 = EndPoints(Curve=item_14.Item)  # -> Start, End

# ---- group: "sender" plane
pl_9 = ConstructPlane(Origin=end_5.Start, XAxis=vec_9, YAxis=vec_10)

# ---- group: "receiver" plane
pl_10 = ConstructPlane(Origin=end_5.Start, XAxis=rev_6, YAxis=vec_10)

# ----
s_r_combinations_pyramid = Panel("""0,0
1,2
2,1
3,4
4,3""")

filter_2 = StreamFilter(Gate=component_type, Stream0=s_r_combinations_pyramid, Stream1=s_r_combinations_box)

split_4 = TextSplit(Text=filter_2, Separators=",")
int_5 = Integer(split_4)
# . a random component is chosen
# . all possible new component orientation combinations for that component are generated (potential new component)
# . all the potential new components are checked for collision
# . among those who do not collide, the one closer to the field's highest value and within the chosen threshold is chosen
item_15 = ListItem(List=int_5, Index=0, Wrap=True)  # -> Item, Item1

branch_3 = TreeBranch(Tree=pl_9, Path=item_15.Item, MaintainPaths=False)  # -> graft(Branch)
branch_4 = TreeBranch(Tree=pl_10, Path=item_15.Item1, MaintainPaths=False)  # -> graft(Branch)
orient_3 = Orient(Geometry=item_13.Item, Source=branch_3, Target=branch_4)  # -> Geometry, Transform
pshift = ShiftPaths(Data=orient_3.Geometry, Offset=-1)

branch_5 = TreeBranch(Tree=pl_5, Path=item_8.Item, MaintainPaths=False)
branch_6 = TreeBranch(Tree=pl_6, Path=item_8.Item1, MaintainPaths=False)
orient_4 = Orient(Geometry=item_5.Item, Source=branch_5, Target=branch_6)  # -> Geometry, Transform

ungroup_5 = Ungroup(Group=orient_4.Geometry)
ungroup_6 = Ungroup(Group=loop_start.Data)
item_16 = ListItem(List=ungroup_5, Index=0, Wrap=True)  # -> flatten(Item)
item_17 = ListItem(List=ungroup_6, Index=0, Wrap=True)  # -> flatten(Item)
ungroup_7 = Ungroup(Group=item_16)  # -> flatten(Objects)
ungroup_8 = Ungroup(Group=item_17)  # -> flatten(Objects)
demesh = DeconstructMesh(Mesh=ungroup_7)  # -> Vertices, Faces, Colours, Normals
avr_2 = Average(Input=demesh.Vertices)
scale = Scale(Geometry=ungroup_7, Center=avr_2, Factor="0.999")  # -> Geometry, Transform
colom = CollisionOneMany(Collider=scale.Geometry, Obstacles=ungroup_8)  # -> Collision, Index
not = GateNot(A=colom.Collision)

dispatch_3 = Dispatch(List=orient_4.Geometry, DispatchPattern=not)  # -> ListA, ListB
merge_15 = Merge(Data1=flatten(loop_start.Data), Data2=flatten(dispatch_3.ListA))
loop_end = LoopEnd(port=loop_start.port, Exit=False, Data=flatten(merge_15), pausedState=False, state="Constant output", TimeOutVal=0)

ungroup_9 = Ungroup(Group=loop_end)
split_5 = SplitList(List=ungroup_9, Index="1")  # -> ListA, ListB
geo_3 = Geometry(split_5.ListA)
crv_23 = Curve(split_5.ListB)
dispatch_4 = Dispatch(List=geo_3, DispatchPattern=bool)  # -> ListA, ListB
# mesh for baking
ungroup_10 = Ungroup(Group=dispatch_4.ListA)  # -> flatten(Objects)
previewlw = CustomPreviewLineweights(Geometry=dispatch_4.ListB, Shader=swatch_2, Absolute=False)
mjoin = MeshJoin(Meshes=ungroup_10)
mesh = Mesh(mjoin)
medges = MeshEdges(Mesh=mesh)  # -> NakedEdges, InteriorEdges, NonManifoldEdges
previewmat_2 = CustomPreviewMaterials(Geometry=mesh, DiffuseColor=ColourSwatch(SwatchColor=RGB(173, 232, 255)))
previewlw_2 = CustomPreviewLineweights(Geometry=[medges.InteriorEdges, medges.NonManifoldEdges], Shader=swatch_4, Absolute=False)

branch_7 = TreeBranch(Tree=pl_7, Path=item_12.Item, MaintainPaths=False)
branch_8 = TreeBranch(Tree=pl_8, Path=item_12.Item1, MaintainPaths=False)
orient_5 = Orient(Geometry=item_9.Item1, Source=branch_7, Target=branch_8)  # -> Geometry, Transform

ungroup_11 = Ungroup(Group=orient_5.Geometry)
ungroup_12 = Ungroup(Group=loop_start_3.Data)
item_18 = ListItem(List=ungroup_11, Index=0, Wrap=True)  # -> flatten(Item)
item_19 = ListItem(List=ungroup_12, Index=0, Wrap=True)  # -> flatten(Item)
ungroup_13 = Ungroup(Group=item_18)  # -> flatten(Objects)
ungroup_14 = Ungroup(Group=item_19)  # -> flatten(Objects)
demesh_2 = DeconstructMesh(Mesh=ungroup_13)  # -> Vertices, Faces, Colours, Normals
avr_3 = Average(Input=demesh_2.Vertices)
scale_2 = Scale(Geometry=ungroup_13, Center=avr_3, Factor="0.999")  # -> Geometry, Transform
colom_2 = CollisionOneMany(Collider=scale_2.Geometry, Obstacles=ungroup_14)  # -> Collision, Index
not_2 = GateNot(A=colom_2.Collision)

dispatch_5 = Dispatch(List=orient_5.Geometry, DispatchPattern=not_2)  # -> ListA, ListB
merge_16 = Merge(Data1=flatten(loop_start_3.Data), Data2=flatten(dispatch_5.ListA))
loop_end_2 = LoopEnd(port=loop_start_3.port, Exit=False, Data=flatten(merge_16), pausedState=False, state="Constant output", TimeOutVal=0)

ungroup_15 = Ungroup(Group=loop_end_2)
split_6 = SplitList(List=ungroup_15, Index="1")  # -> ListA, ListB
geo_4 = Geometry(split_6.ListA)
crv_24 = Curve(split_6.ListB)
dispatch_6 = Dispatch(List=geo_4, DispatchPattern=bool_3)  # -> ListA, ListB
# mesh for baking
ungroup_16 = Ungroup(Group=dispatch_6.ListA)  # -> flatten(Objects)
previewlw_3 = CustomPreviewLineweights(Geometry=dispatch_6.ListB, Shader=swatch, Absolute=False)
mjoin_2 = MeshJoin(Meshes=ungroup_16)
mesh_2 = Mesh(mjoin_2)
medges_2 = MeshEdges(Mesh=mesh_2)  # -> NakedEdges, InteriorEdges, NonManifoldEdges
previewmat_3 = CustomPreviewMaterials(Geometry=mesh_2, DiffuseColor=ColourSwatch(SwatchColor=RGB(173, 232, 255)))
previewlw_4 = CustomPreviewLineweights(Geometry=[medges_2.InteriorEdges, medges_2.NonManifoldEdges], Shader=swatch_3, Absolute=False)

ungroup_17 = Ungroup(Group=pshift)
ungroup_18 = Ungroup(Group=loop_start_2.Data)
item_20 = ListItem(List=ungroup_17, Index=0, Wrap=True)  # -> flatten(Item)
item_21 = ListItem(List=ungroup_18, Index=0, Wrap=True)  # -> flatten(Item)
ungroup_19 = Ungroup(Group=item_20)  # -> flatten(Objects)
ungroup_20 = Ungroup(Group=item_21)  # -> flatten(Objects)
demesh_3 = DeconstructMesh(Mesh=ungroup_19)  # -> Vertices, Faces, Colours, Normals
avr_4 = Average(Input=demesh_3.Vertices)

pshift_2 = ShiftPaths(Data=avr_4, Offset=-1)

scale_3 = Scale(Geometry=ungroup_19, Center=pshift_2, Factor="0.999")  # -> Geometry, Transform
colom_3 = CollisionOneMany(Collider=scale_3.Geometry, Obstacles=ungroup_20)  # -> Collision, Index
not_3 = GateNot(A=colom_3.Collision)

dispatch_7 = Dispatch(List=pshift, DispatchPattern=not_3)  # -> ListA, ListB

ungroup_21 = Ungroup(Group=dispatch_7.ListA)
item_22 = ListItem(List=ungroup_21, Index=0, Wrap=True)  # -> flatten(Item)
ungroup_22 = Ungroup(Group=item_22)  # -> flatten(Objects)
demesh_4 = DeconstructMesh(Mesh=ungroup_22)  # -> Vertices, Faces, Colours, Normals
avr_5 = Average(Input=demesh_4.Vertices)
pshift_3 = ShiftPaths(Data=avr_5, Offset=-1)
cp = ClosestPoint(Point=pshift_3, Cloud=pt_5)  # -> ClosestPoint, CPIndex, Distance
lng_4 = ListLength(List=pshift_3)
item_23 = ListItem(List=num_2, Index=cp.CPIndex, Wrap=True)
series = Series(Start=0, Step=1, Count=lng_4)
larger_2 = LargerThan(FirstNumber=item_23, SecondNumber=num_3)  # -> LargerThan, OrEqualTo
int_6 = Integer(series)

smaller = SmallerThan(FirstNumber=cp.Distance, SecondNumber=dist_2)  # -> SmallerThan, OrEqualTo
and = GateAnd(A=larger_2.LargerThan, B=smaller.SmallerThan)

dispatch_8 = Dispatch(List=item_23, DispatchPattern=and)  # -> ListA, ListB
dispatch_9 = Dispatch(List=int_6, DispatchPattern=and)  # -> ListA, ListB
sort = SortList(Keys=dispatch_8.ListA, ValuesA=dispatch_9.ListA)  # -> Keys, reverse(ValuesA)
item_24 = ListItem(List=sort.ValuesA, Index=0, Wrap=True)

item_25 = ListItem(List=dispatch_7.ListA, Index=item_24, Wrap=True)
merge_17 = Merge(Data1=flatten(loop_start_2.Data), Data2=flatten(item_25))
loop_end_3 = LoopEnd(port=loop_start_2.port, Exit=False, Data=flatten(merge_17), pausedState=False, state="Constant output", TimeOutVal=0)

ungroup_23 = Ungroup(Group=loop_end_3)
split_7 = SplitList(List=ungroup_23, Index="1")  # -> ListA, ListB
geo_5 = Geometry(split_7.ListA)
crv_25 = Curve(split_7.ListB)
dispatch_10 = Dispatch(List=geo_5, DispatchPattern=bool_2)  # -> ListA, ListB
previewlw_5 = CustomPreviewLineweights(Geometry=dispatch_10.ListB, Shader=swatch_5, Absolute=False)
# mesh for baking
ungroup_24 = Ungroup(Group=dispatch_10.ListA)  # -> flatten(Objects)
mjoin_3 = MeshJoin(Meshes=ungroup_24)
mesh_3 = Mesh(mjoin_3)
medges_3 = MeshEdges(Mesh=mesh_3)  # -> NakedEdges, InteriorEdges, NonManifoldEdges
previewmat_4 = CustomPreviewMaterials(Geometry=mesh_3, DiffuseColor=ColourSwatch(SwatchColor=RGB(173, 232, 255)))
previewlw_6 = CustomPreviewLineweights(Geometry=[medges_3.InteriorEdges, medges_3.NonManifoldEdges], Shader=swatch_6, Absolute=False)
