# Grasshopper definition XX_05-2-2_Anemone aggregation_v2-2 components.gh (Grasshopper 0.9.76)
# plug-ins: Anemone, Human

# component type
geo = Geometry(flatten(<brep referenced from the Rhino model>))

# ---- group: x axis
# handle 0
crv = Curve(<curve referenced from the Rhino model>)

# ---- group: y axis
crv_2 = Curve(<curve referenced from the Rhino model>)

# ---- group: x axis
# handle 1
crv_3 = Curve(<curve referenced from the Rhino model>)

# ---- group: y axis
crv_4 = Curve(<curve referenced from the Rhino model>)

# ---- group: x axis
# handle 2
crv_5 = Curve(<curve referenced from the Rhino model>)

# ---- group: y axis
crv_6 = Curve(<curve referenced from the Rhino model>)

# ---- group: x axis
# handle 3
crv_7 = Curve(<curve referenced from the Rhino model>)

# ---- group: y axis
crv_8 = Curve(<curve referenced from the Rhino model>)

# ---- group: x axis
# handle 4
crv_9 = Curve(<curve referenced from the Rhino model>)

# ---- group: y axis
crv_10 = Curve(<curve referenced from the Rhino model>)

# ----
# component type
geo_2 = Geometry(flatten(<brep referenced from the Rhino model>))
X = UnitX(Factor=1)

# ---- group: x axis
# handle 5
crv_11 = Curve(<curve referenced from the Rhino model>)

# ---- group: y axis
crv_12 = Curve(<curve referenced from the Rhino model>)

crv_13 = Curve(<curve referenced from the Rhino model>)

# ---- group: x axis
# handle 3
crv_14 = Curve(<curve referenced from the Rhino model>)

# handle 4
crv_15 = Curve(<curve referenced from the Rhino model>)

# handle 0
crv_16 = Curve(<curve referenced from the Rhino model>)

# ---- group: y axis
crv_17 = Curve(<curve referenced from the Rhino model>)

# ---- group: x axis
# handle 1
crv_18 = Curve(<curve referenced from the Rhino model>)

# ---- group: y axis
crv_19 = Curve(<curve referenced from the Rhino model>)

# ---- group: x axis
# handle 2
crv_20 = Curve(<curve referenced from the Rhino model>)

# ---- group: y axis
crv_21 = Curve(<curve referenced from the Rhino model>)

crv_22 = Curve(<curve referenced from the Rhino model>)

# ----
# Anemone aggregation - example with 2 different components
# 
# © a3 2017 _ Creative Commons Attribution-NonCommercial-ShareAlike3.0 UnportedLicense.
smesh = SimpleMesh(Brep=geo)
X_2 = UnitX(Factor=1)
smesh_2 = SimpleMesh(Brep=geo_2)

merge = Merge(Data1=crv_7, Data2=crv_8)

# ----
# The handles are used to construct planes for orientation
merge_2 = Merge(Data1=crv, Data2=crv_2)

merge_3 = Merge(Data1=crv_5, Data2=crv_6)

merge_4 = Merge(Data1=crv_3, Data2=crv_4)

merge_5 = Merge(Data1=crv_9, Data2=crv_10)

line = LineSDL(Start="0,0,0", Direction=X, Length="1")

merge_6 = Merge(Data1=crv_11, Data2=crv_12)

merge_7 = Merge(Data1=crv_14, Data2=crv_21)

# ----
# The handles are used to construct planes for orientation
merge_8 = Merge(Data1=crv_16, Data2=crv_17)

merge_9 = Merge(Data1=crv_20, Data2=crv_13)

merge_10 = Merge(Data1=crv_18, Data2=crv_19)

merge_11 = Merge(Data1=crv_15, Data2=crv_22)

# ---- group: group geometry
# groups can take geometry only (not numbers), so we store the type value in a line of a specific length
group = Group(Objects=smesh)

# ----
# groups can take geometry only (not numbers), so we store the type value in a line of a specific length
line_2 = LineSDL(Start="0,0,0", Direction=X_2, Length="2")

# ---- group: group geometry
group_2 = Group(Objects=smesh_2)

# ----
merge_12 = Merge(Data1=group, Data2=line, Data3=merge_2, Data4=merge_4, Data5=merge_3, Data6=merge, Data7=merge_5)
merge_13 = Merge(Data1=group_2, Data2=line_2, Data3=merge_8, Data4=merge_10, Data5=merge_9, Data6=merge_7, Data7=merge_11, Data8=merge_6)

# ----
# basic orientation operation
# Handles are converted into vectors and form them I build the "sender" plane (normal outwards) and the corresponding "receiver" plane (normal pointing inwards.
# 
# In this case, the handle on face 0 is used both as a sender and receiver (face 0 is compatible with itself for assembly)
vec = Vector(unitize(crv))
vec_2 = Vector(unitize(crv_2))
rev = Reverse(Vector=vec)
end = EndPoints(Curve=crv)  # -> Start, End

# ----
# component 1
group_3 = Group(Objects=merge_13)
# component 0
# Component: Component = geometry + handles
# 
# 
# The first element in the list is the geometry group, followed by all the handles in couples (x first, then y).
# 
# Grouping the component allows to pack together the component geometry and the axis handles in a single object within the loop
group_4 = Group(Objects=merge_12)

# ---- group: "sender" plane
pl = ConstructPlane(Origin=end.Start, XAxis=vec, YAxis=vec_2)

# ---- group: "receiver" plane
pl_2 = ConstructPlane(Origin=end.Start, XAxis=rev, YAxis=vec_2)

# ----
# Orient: To make an orientation operation I need the geometry and two compatible planes, a "sender" and a "receiver". Thus, geometry is oriented from the sender to the receiver
orient = Orient(Geometry=group, Source=pl, Target=pl_2)  # -> Geometry, Transform

_0_0_s_r_combinations = Panel("""0,0
2,1
2,1
0,0
3,4
3,4""")
_0_1_s_r_combinations = Panel("""0,0
0,5""")
_1_0_s_r_combinations = Panel("""0,0
5,0""")
_1_1_s_r_combinations = Panel("""0,0
0,5
1,1
1,2
1,3
1,4
2,2
3,3
4,4
5,0
5,5""")
starting_component = Slider(0, range=0..1)
merge_14 = Merge(Data1=group_4, Data2=group_3)
entwine = Entwine(Branch00=_0_0_s_r_combinations, Branch01=_0_1_s_r_combinations, FlattenInputs=True)
entwine_2 = Entwine(Branch00=_1_0_s_r_combinations, Branch01=_1_1_s_r_combinations, FlattenInputs=True)
viewer = ParamViewer(entwine_2)
item = ListItem(List=merge_14, Index=starting_component, Wrap=True)
path_mapper = PathMapper(entwine_2, source="{A;B}", target="{1;B}")
n_of_iterations = Slider(200, range=1..200)
merge_15 = Merge(Data1=entwine, Data2=path_mapper)
viewer_2 = ParamViewer(path_mapper)
# iterative operation (growth) - 2 component types with clash detection
restart = Button()
# single operation (orientation)
# component
grp = Group(group_4)
viewer_3 = ParamViewer(merge_15)

ungroup = Ungroup(Group=grp)
panel = Panel("""0
1""")
cull_i = CullIndex(List=ungroup, Indices=panel, Wrap=True)
partition = PartitionList(List=cull_i, Size="2")  # -> simplify(Chunks)
item_2 = ListItem(List=partition, Index=0, Wrap=True)  # -> Item, Item1
vec_3 = Vector(unitize(item_2.Item))
vec_4 = Vector(unitize(item_2.Item1))
rev_2 = Reverse(Vector=vec_3)
# extract s/r planes
end_2 = EndPoints(Curve=item_2.Item)  # -> Start, End

# ----
# These are all the possible combinations with this geometry. Face 0 is only compatible with itself, 1 with 2 and 3 with 4. Other combinations will yield non-aligned geometry
# combinations are parsed and split into sender/rceiver indexes
sender_receiver_combinations = Panel("""0,0
2,1
1,2
3,4
4,3""")
# choose orientation criteria (s/r sequence)
number_slider = Slider(4, range=0..4)
item_3 = ListItem(List=sender_receiver_combinations, Index=number_slider, Wrap=True)
split = TextSplit(Text=item_3, Separators=",")
int = Integer(split)
item_4 = ListItem(List=int, Index=0, Wrap=True)  # -> Item, Item1

# ---- group: "sender" plane
pl_3 = ConstructPlane(Origin=end_2.Start, XAxis=vec_3, YAxis=vec_4)

# ---- group: "receiver" plane
pl_4 = ConstructPlane(Origin=end_2.Start, XAxis=rev_2, YAxis=vec_4)

# ----
branch = TreeBranch(Tree=pl_3, Path=item_4.Item, MaintainPaths=True)
branch_2 = TreeBranch(Tree=pl_4, Path=item_4.Item1, MaintainPaths=True)
# orient
# geometry from "sender" to "receiver" planes
orient_2 = Orient(Geometry=grp, Source=branch, Target=branch_2)  # -> Geometry, Transform
previewmat = CustomPreviewMaterials(Geometry=orient_2.Geometry, DiffuseColor=RGB(255, 255, 255))
# visualization while the loop is active
swatch = ColourSwatch(SwatchColor=RGBA(173, 232, 255, 99))
# visualization when the loop has ended
swatch_2 = ColourSwatch(SwatchColor=RGB(0, 0, 0))

# ----
# enable this to
# see the example
# New components are added to the old ones
# The whole component is oriented so the handles of each one can be used for the next iterations
# extract receiver planes
# and component type
# clash detection
# selection: Here, a random component on each iteration is selected. Different selection criteria are possible
# checks if a slightly smaller version of the new component clashes with the rest of the aggregation
# choose orientation criteria (s/r sequence)
loop_start = LoopStart(Repeat=n_of_iterations, Trigger=restart, Data=item)  # -> port, Counter, Data

lng = ListLength(List=loop_start.Data)  # -> expr("x-1", Length)
iterations_done = Panel(loop_start.Counter)
random = Random(Range=lng, Number=1, Seed=loop_start.Counter, Integers=True)
equals = Equality(FirstNumber=loop_start.Counter, SecondNumber=n_of_iterations)  # -> Equality, Inequality
bool = Boolean(equals.Equality)

# ---- group: select component
random_2 = Random(Range=Domain(0, 1), Number=1, Seed=loop_start.Counter, Integers=False)

# ----
sqr = Square(Value=random_2)
int_2 = Integer(sqr)

# ---- group: select component (continued)
item_5 = ListItem(List=merge_14, Index=int_2, Wrap=True)

# ----
ungroup_2 = Ungroup(Group=item_5)
panel_2 = Panel("""0
1""")
cull_i_2 = CullIndex(List=ungroup_2, Indices=panel_2, Wrap=True)
item_6 = ListItem(List=ungroup_2, Index="1", Wrap=True)
partition_2 = PartitionList(List=cull_i_2, Size="2")  # -> simplify(Chunks)
item_7 = ListItem(List=partition_2, Index=0, Wrap=True)  # -> Item, Item1
vec_5 = Vector(unitize(item_7.Item))
vec_6 = Vector(unitize(item_7.Item1))
# extract sender planes
end_3 = EndPoints(Curve=item_7.Item)  # -> Start, End

len = Length(Curve=item_6)
expression = Expression(x=len, Expression="(x-1)")

# ---- group: "sender" plane
pl_5 = ConstructPlane(Origin=end_3.Start, XAxis=vec_5, YAxis=vec_6)

# ----
item_8 = ListItem(List=loop_start.Data, Index=random, Wrap=True)

ungroup_3 = Ungroup(Group=item_8)
panel_3 = Panel("""0
1""")
cull_i_3 = CullIndex(List=ungroup_3, Indices=panel_3, Wrap=True)
item_9 = ListItem(List=ungroup_3, Index="1", Wrap=True)
len_2 = Length(Curve=item_9)
partition_3 = PartitionList(List=cull_i_3, Size="2")  # -> simplify(Chunks)
expression_2 = Expression(x=len_2, Expression="(x-1)")
item_10 = ListItem(List=partition_3, Index=0, Wrap=True)  # -> Item, Item1
vec_7 = Vector(unitize(item_10.Item))
end_4 = EndPoints(Curve=item_10.Item)  # -> Start, End
vec_8 = Vector(unitize(item_10.Item1))
rev_3 = Reverse(Vector=vec_7)

int_3 = Integer(expression)
int_4 = Integer(expression_2)
merge_16 = Merge(Data1=int_3, Data2=int_4)
path = ConstructPath(Indices=merge_16)
branch_3 = TreeBranch(Tree=merge_15, Path=path, MaintainPaths=False)
lng_2 = ListLength(List=branch_3)  # -> expr("x-1", Length)
random_3 = Random(Range=lng_2, Number=1, Seed=loop_start.Counter, Integers=True)
item_11 = ListItem(List=branch_3, Index=random_3, Wrap=True)
split_2 = TextSplit(Text=item_11, Separators=",")
int_5 = Integer(split_2)
item_12 = ListItem(List=int_5, Index=0, Wrap=True)  # -> Item, Item1

# ---- group: "receiver" plane
pl_6 = ConstructPlane(Origin=end_4.Start, XAxis=rev_3, YAxis=vec_8)

# ----
branch_4 = TreeBranch(Tree=pl_5, Path=item_12.Item, MaintainPaths=False)
branch_5 = TreeBranch(Tree=pl_6, Path=item_12.Item1, MaintainPaths=False)
orient_3 = Orient(Geometry=item_5, Source=branch_4, Target=branch_5)  # -> Geometry, Transform

ungroup_4 = Ungroup(Group=orient_3.Geometry)
ungroup_5 = Ungroup(Group=loop_start.Data)
item_13 = ListItem(List=ungroup_4, Index=0, Wrap=True)  # -> flatten(Item)
item_14 = ListItem(List=ungroup_5, Index=0, Wrap=True)  # -> flatten(Item)
ungroup_6 = Ungroup(Group=item_13)  # -> flatten(Objects)
ungroup_7 = Ungroup(Group=item_14)  # -> flatten(Objects)
demesh = DeconstructMesh(Mesh=ungroup_6)  # -> Vertices, Faces, Colours, Normals
avr = Average(Input=demesh.Vertices)
scale = Scale(Geometry=ungroup_6, Center=avr, Factor="0.999")  # -> Geometry, Transform
colom = CollisionOneMany(Collider=scale.Geometry, Obstacles=ungroup_7)  # -> Collision, Index
not = GateNot(A=colom.Collision)

dispatch = Dispatch(List=orient_3.Geometry, DispatchPattern=not)  # -> ListA, ListB
merge_17 = Merge(Data1=flatten(loop_start.Data), Data2=flatten(dispatch.ListA))
loop_end = LoopEnd(port=loop_start.port, Exit=False, Data=flatten(merge_17), pausedState=False, state="Constant output", TimeOutVal=0)

ungroup_8 = Ungroup(Group=loop_end)
split_3 = SplitList(List=ungroup_8, Index="1")  # -> ListA, ListB
geo_3 = Geometry(split_3.ListA)
crv_23 = Curve(split_3.ListB)
dispatch_2 = Dispatch(List=geo_3, DispatchPattern=bool)  # -> ListA, ListB
ungroup_9 = Ungroup(Group=dispatch_2.ListA)  # -> flatten(Objects)
previewlw = CustomPreviewLineweights(Geometry=dispatch_2.ListB, Shader=swatch, Absolute=False)
# mesh for baking
mjoin = MeshJoin(Meshes=ungroup_9)
mesh = Mesh(mjoin)
medges = MeshEdges(Mesh=mesh)  # -> NakedEdges, InteriorEdges, NonManifoldEdges
previewmat_2 = CustomPreviewMaterials(Geometry=mesh, DiffuseColor=ColourSwatch(SwatchColor=RGB(173, 232, 255)))
previewlw_2 = CustomPreviewLineweights(Geometry=[medges.InteriorEdges, medges.NonManifoldEdges], Shader=swatch_2, Absolute=False)
