# Grasshopper definition discrete curve field.gh (Grasshopper 0.9.76)
# Copyright: Co-de-iT
# plug-ins: ClosestVector

number_slider = Slider(23, range=10..100)
crv = Curve(<curve referenced from the Rhino model>)
sdivide = DivideSurface(Surface=crv, UCount=number_slider, VCount=number_slider)  # -> Points, Normals, Parameters
# File template
# 
# © a3 2017 _ Creative Commons Attribution-NonCommercial-ShareAlike3.0 UnportedLicense.
pop2d = Populate2D(Region=crv, Count=Slider(379, range=100..1000), Seed=1)
crv_2 = Curve(<curve referenced from the Rhino model>)
number_slider_2 = Slider(2.85, range=0..100)
crv_cp = CurveClosestPoint(Point=sdivide.Points, Curve=crv_2)  # -> Point, Parameter, Distance
eval = EvaluateCurve(Curve=crv_2, Parameter=crv_cp.Parameter)  # -> Point, Tangent, Angle
line = LineSDL(Start=sdivide.Points, Direction=eval.Tangent, Length=number_slider_2)  # -> graft(Line)
range = Range(Domain="0 to 2*Pi", Steps=Slider(4, range=0..10))
X = UnitX(Factor=1)
Y = UnitY(Factor=1)
X_2 = UnitX(Factor=1)
Z = UnitZ(Factor=1)
rev = Reverse(Vector=X)
rev_2 = Reverse(Vector=Y)
cull_i = CullIndex(List=range, Indices="-1", Wrap=True)
merge = Merge(Data1=X, Data2=Y, Data3=rev, Data4=rev_2)
vrot = Rotate(Vector=X_2, Axis=Z, Angle=cull_i)
cv = ClosestVector(Reference=line, Target=vrot)  # -> Vector, Angle
line_2 = LineSDL(Start=graft(sdivide.Points), Direction=cv.Vector, Length=number_slider_2)  # -> graft(Line)
